# Grasshopper definition A-01_complet.gh (Grasshopper 1.0.8)

# ---- group: ZONE_SUJET
# La baie mesure 2 400 mm de haut. Une valeur de hauteur vous est déjà fournie pour l'imposte.
# Ajoutez une seconde valeur réglable pour le châssis, faites-en la somme, et réglez les deux
# hauteurs pour que la baie soit exactement remplie.
reponse = REPONSE()
# A-01 · Premier flux de données
# Débutant  —  durée cible 5 min  —  réf. REF-027, REF-028  —  v0.5-260902
# ▼  CORRIGÉ — à consulter après validation  ▼
# RAPPEL — copie des données fournies dans la zone sujet, afin qu'aucun câble ne relie les deux zones
# ÉTAPE 1 — Poser un second Number Slider de 0 à 100
# ÉTAPE 2 — Additionner les deux valeurs
# ÉTAPE 3 — Afficher le résultat et régler les curseurs sur 42
# RÉSULTAT — tant que l'interrupteur AFFICHER LE CORRIGÉ reste sur faux, la sortie 1 du Stream Gate est
# vide : rien n'apparaît dans Rhino
valeur_a = Slider(17, range=0..100)

# ---- group: ZONE_CORRIGE / DONNÉES FOURNIES (copie)
valeur_a_2 = Slider(17, range=0..100)

# ---- group: ZONE_CORRIGE / ÉTAPE 1
valeur_b = Slider(25, range=0..100)

# ---- group: ZONE_CORRIGE / ÉTAPE 2
addition = Addition(A=valeur_a_2, B=valeur_b)

# ---- group: ZONE_CORRIGE / ÉTAPE 3
panel = Panel(addition)

# ---- group: ZONE_CORRIGE / AFFICHAGE DU CORRIGÉ
afficher_le_corrigé = BooleanToggle(False)
gate = StreamGate(Stream=addition, Gate=afficher_le_corrigé)  # -> Target0, Target1
reponse_corrige = REPONSE_CORRIGE(gate.Target1)
