# Grasshopper definition A-02_complet.gh (Grasshopper 1.0.8)

# ---- group: ZONE_SUJET
# Le repère se trouve à 30 m à l'est, 15 m au sud et 8 m au-dessus de la borne, laquelle est à
# l'origine du modèle. Placez ce repère dans le modèle à partir de trois valeurs réglables
# indépendantes.
reponse = REPONSE()

# ---- group: ZONE_CORRIGE / ÉTAPE 1
# A-02 · Construire un point par coordonnées
# Débutant  —  durée cible 6 min  —  réf. REF-062  —  v0.5-260902
# ▼  CORRIGÉ — à consulter après validation  ▼
# ÉTAPE 1 — Trois curseurs, en veillant aux bornes négatives pour Y
# ÉTAPE 2 — Assembler les trois nombres en un point
# RÉSULTAT — tant que l'interrupteur AFFICHER LE CORRIGÉ reste sur faux, la sortie 1 du Stream Gate est
# vide : rien n'apparaît dans Rhino
X = Slider(30, range=-100..100)
Y = Slider(-15, range=-50..50)
Z = Slider(8, range=-50..50)

# ---- group: ZONE_CORRIGE / ÉTAPE 2
pt = ConstructPoint(XCoordinate=X, YCoordinate=Y, ZCoordinate=Z)

# ---- group: ZONE_CORRIGE / AFFICHAGE DU CORRIGÉ
afficher_le_corrigé = BooleanToggle(False)
gate = StreamGate(Stream=pt, Gate=afficher_le_corrigé)  # -> Target0, Target1
reponse_corrige = REPONSE_CORRIGE(gate.Target1)
