# Grasshopper definition A-03_complet.gh (Grasshopper 1.0.8)

# ---- group: ZONE_SUJET
# Le point vert est produit par un Construct Point. Fige-le dans un paramètre Point autonome puis
# supprime la chaîne amont : le point doit rester affiché.
reponse = REPONSE()
# A-03 · Internaliser une donnée
# Débutant  —  durée cible 6 min  —  réf. REF-027  —  v0.3-260826
# ▼  CORRIGÉ — à consulter après validation  ▼
# ÉTAPE 1 — Poser un paramètre Point autonome et y internaliser la donnée
# ÉTAPE 2 — La chaîne amont peut alors être supprimée : le point subsiste
# RÉSULTAT — tant que l'interrupteur AFFICHER LE CORRIGÉ reste sur faux, la sortie 1 du Stream Gate est
# vide : rien n'apparaît dans Rhino
X = Slider(30, range=-100..100)
Y = Slider(-15, range=-50..50)
Z = Slider(8, range=-50..50)
pt = ConstructPoint(XCoordinate=X, YCoordinate=Y, ZCoordinate=Z)

# ---- group: ZONE_CORRIGE / ÉTAPE 1
point_fige = POINT_FIGE(Point(30, -15, 8))

# ---- group: ZONE_CORRIGE / ÉTAPE 2
viewer = ParamViewer(point_fige)

# ---- group: ZONE_CORRIGE / AFFICHAGE DU CORRIGÉ
afficher_le_corrigé = BooleanToggle(False)
gate = StreamGate(Stream=point_fige, Gate=afficher_le_corrigé)  # -> Target0, Target1
reponse_corrige = REPONSE_CORRIGE(gate.Target1)
