# Grasshopper definition A-03_sujet.gh (Grasshopper 1.0.8)

# ---- group: ZONE_SUJET
# Le point vert est produit par un Construct Point. Fige-le dans un paramètre Point autonome puis
# supprime la chaîne amont : le point doit rester affiché.
reponse = REPONSE()
# A-03 · Internaliser une donnée
# Débutant  —  durée cible 6 min  —  réf. REF-027  —  v0.3-260826
X = Slider(30, range=-100..100)
Y = Slider(-15, range=-50..50)
Z = Slider(8, range=-50..50)
pt = ConstructPoint(XCoordinate=X, YCoordinate=Y, ZCoordinate=Z)
