# Grasshopper definition A-04_complet.gh (Grasshopper 1.0.8)

# ---- group: ZONE_SUJET
# Les cercles d'implantation occupent le calque « CERCLES » du fichier Rhino. Récupérez-les sans
# les désigner un par un — l'implantation peut encore changer — remontez-les de 50 mm, et déposez
# le résultat dans le modèle sur le calque « COPIES ».
reponse = REPONSE()
# A-04 · Référencer et cuire de la géométrie Rhino
# Débutant  —  durée cible 8 min  —  réf. REF-026  —  v0.5-260902
# ▼  CORRIGÉ — à consulter après validation  ▼
# ÉTAPE 1 — Renseigner le calque CERCLES dans le Geometry Pipeline
# ÉTAPE 2 — Construire le vecteur de décalage : 50 mm suivant Z
# ÉTAPE 3 — Déplacer, puis cuire le résultat sur le calque COPIES
# RÉGLAGES À POSER À LA MAIN :
# • Geometry Pipeline : saisir CERCLES dans le champ Layer (sensible à la casse).
# • Bake du composant Move : choisir le calque COPIES.
# RÉSULTAT — tant que l'interrupteur AFFICHER LE CORRIGÉ reste sur faux, la sortie 1 du Stream Gate est
# vide : rien n'apparaît dans Rhino
pipeline = GeometryPipeline(
    GroupByLayer=False,
    GroupByType=False,
    IncludeHidden=True,
    IncludeLocked=True,
    LayerFilter="*",
    NameFilter="*",
    SublayerFiltering=True,
    TypeFilter=0)

# ---- group: ZONE_CORRIGE / ÉTAPE 1
pipeline_2 = GeometryPipeline(
    GroupByLayer=False,
    GroupByType=False,
    IncludeHidden=True,
    IncludeLocked=True,
    LayerFilter="CERCLES",
    NameFilter="*",
    SublayerFiltering=True,
    TypeFilter=0)

# ---- group: ZONE_CORRIGE / ÉTAPE 2
décalage_mm = Slider(50, range=0..200)
Z = UnitZ(Factor=décalage_mm)

# ---- group: ZONE_CORRIGE / ÉTAPE 3
move = Move(Geometry=pipeline_2, Motion=Z)  # -> Geometry, Transform

# ---- group: ZONE_CORRIGE / AFFICHAGE DU CORRIGÉ
afficher_le_corrigé = BooleanToggle(False)
gate = StreamGate(Stream=move.Geometry, Gate=afficher_le_corrigé)  # -> Target0, Target1
reponse_corrige = REPONSE_CORRIGE(gate.Target1)
