# Grasshopper definition A-05_complet.gh (Grasshopper 1.0.8)

# ---- group: ZONE_SUJET
# Un câble transporte une donnée inconnue. Sans modifier le graphe, indique dans un Panel le
# nombre d'éléments qu'il transporte.
flux = FLUX([14, 7, 23, 3, 19, 11, 30, 2, 26, 8, 17, 5])
reponse = REPONSE()

# ---- group: ZONE_CORRIGE / DONNÉES FOURNIES (copie)
flux_2 = FLUX([14, 7, 23, 3, 19, 11, 30, 2, 26, 8, 17, 5])

# ---- group: ZONE_CORRIGE / ÉTAPE 1
# A-05 · Lire ce qui circule dans un câble
# Débutant  —  durée cible 5 min  —  réf. REF-027, REF-028  —  v0.5-260902
# ▼  CORRIGÉ — à consulter après validation  ▼
# RAPPEL — copie des données fournies dans la zone sujet, afin qu'aucun câble ne relie les deux zones
# ÉTAPE 1 — Inspecter la structure du flux sans le modifier
# ÉTAPE 2 — Compter les éléments transportés
# RÉSULTAT — tant que l'interrupteur AFFICHER LE CORRIGÉ reste sur faux, la sortie 1 du Stream Gate est
# vide : rien n'apparaît dans Rhino
viewer = ParamViewer(flux_2)

# ---- group: ZONE_CORRIGE / ÉTAPE 2
lng = ListLength(List=flux_2)
panel = Panel(lng)

# ---- group: ZONE_CORRIGE / AFFICHAGE DU CORRIGÉ
afficher_le_corrigé = BooleanToggle(False)
gate = StreamGate(Stream=lng, Gate=afficher_le_corrigé)  # -> Target0, Target1
reponse_corrige = REPONSE_CORRIGE(gate.Target1)
