# Grasshopper definition A-06_complet.gh (Grasshopper 1.0.8)

# ---- group: ZONE_SUJET
# Le slider vaut 4,6. Il alimente l'entrée Count d'un Series qui attend un entier. Combien
# d'éléments la série contient-elle ? Affiche le nombre dans un Panel et explique la règle
# appliquée.
reponse = REPONSE()
# A-06 · Conversion implicite Number vers Integer
# Débutant  —  durée cible 6 min  —  réf. REF-040  —  v0.5-260902
# ▼  CORRIGÉ — à consulter après validation  ▼
# RAPPEL — copie des données fournies dans la zone sujet, afin qu'aucun câble ne relie les deux zones
# ÉTAPE 1 — Compter les éléments réellement produits par la série
# ÉTAPE 2 — Faire varier le curseur entre 4,4 et 4,6 : Grasshopper arrondit au plus proche
# RÉSULTAT — tant que l'interrupteur AFFICHER LE CORRIGÉ reste sur faux, la sortie 1 du Stream Gate est
# vide : rien n'apparaît dans Rhino
count = Slider(4.6, range=0..10)
series = Series(Start=0, Step=1, Count=count)

# ---- group: ZONE_CORRIGE / DONNÉES FOURNIES (copie)
count_2 = Slider(4.6, range=0..10)
series_2 = Series(Start=0, Step=1, Count=count_2)

# ---- group: ZONE_CORRIGE / ÉTAPE 1
lng = ListLength(List=series_2)
panel = Panel(lng)

# ---- group: ZONE_CORRIGE / ÉTAPE 2
viewer = ParamViewer(series_2)

# ---- group: ZONE_CORRIGE / AFFICHAGE DU CORRIGÉ
afficher_le_corrigé = BooleanToggle(False)
gate = StreamGate(Stream=lng, Gate=afficher_le_corrigé)  # -> Target0, Target1
reponse_corrige = REPONSE_CORRIGE(gate.Target1)
