# Grasshopper definition A-07_complet.gh (Grasshopper 1.0.8)

# ---- group: ZONE_SUJET
# Un Panel contenant le texte « douze » alimente une Addition. Qu'affiche la sortie ? Corrige le
# montage pour que l'addition renvoie 15 sans supprimer le Panel.
reponse = REPONSE()
# A-07 · Quand la conversion échoue
# Débutant  —  durée cible 6 min  —  réf. REF-041  —  v0.3-260826
# ▼  CORRIGÉ — à consulter après validation  ▼
# RAPPEL — copie des données fournies dans la zone sujet, afin qu'aucun câble ne relie les deux zones
# ÉTAPE 1 — Le texte non numérique produit une valeur nulle, pas un zéro
# ÉTAPE 2 — Remplacer le contenu du Panel par une valeur numérique
# ÉTAPE 3 — L'addition redevient valide et renvoie 15
# RÉSULTAT — tant que l'interrupteur AFFICHER LE CORRIGÉ reste sur faux, la sortie 1 du Stream Gate est
# vide : rien n'apparaît dans Rhino
panel = Panel("douze")
valeur_b = Slider(3, range=0..10)
addition = Addition(A=panel, B=valeur_b)

# ---- group: ZONE_CORRIGE / DONNÉES FOURNIES (copie)
valeur_b_2 = Slider(3, range=0..10)
addition_2 = Addition(A="douze", B=valeur_b_2)

# ---- group: ZONE_CORRIGE / ÉTAPE 1
viewer = ParamViewer(addition_2)

# ---- group: ZONE_CORRIGE / ÉTAPE 2
panel_2 = Panel("12")

# ---- group: ZONE_CORRIGE / ÉTAPE 3
addition_3 = Addition(A=panel_2, B=valeur_b_2)
panel_3 = Panel(addition_3)

# ---- group: ZONE_CORRIGE / AFFICHAGE DU CORRIGÉ
afficher_le_corrigé = BooleanToggle(False)
gate = StreamGate(Stream=addition_3, Gate=afficher_le_corrigé)  # -> Target0, Target1
reponse_corrige = REPONSE_CORRIGE(gate.Target1)
