# Grasshopper definition A-07_sujet.gh (Grasshopper 1.0.8)

# ---- group: ZONE_SUJET
# Un Panel contenant le texte « douze » alimente une Addition. Qu'affiche la sortie ? Corrige le
# montage pour que l'addition renvoie 15 sans supprimer le Panel.
reponse = REPONSE()
# A-07 · Quand la conversion échoue
# Débutant  —  durée cible 6 min  —  réf. REF-041  —  v0.3-260826
panel = Panel("douze")
valeur_b = Slider(3, range=0..10)
addition = Addition(A=panel, B=valeur_b)
