# Grasshopper definition A-08_complet.gh (Grasshopper 1.0.8)

# ---- group: ZONE_SUJET
# Les cotes relevées sur les 28 traverses du lot vous sont fournies. Comptez combien de traverses
# sortent de la tolérance, sans écarter aucun élément de la liste.
cotes_relevees = COTES_RELEVEES([1203, 1198, 1207, 1199, 1201, 1194, 1206, 1200, 1211, 1197, 1202, 1188, 1205, 1200, 1196, 1209, 1193, 1204, 1199, 1214, 1201, 1191, 1208, 1200, 1195, 1210, 1198, 1202])
reponse = REPONSE()
# A-08 · Booléen et nombre
# Débutant  —  durée cible 5 min  —  réf. REF-040, REF-059  —  v0.5-260902
# ▼  CORRIGÉ — à consulter après validation  ▼
# RAPPEL — copie des données fournies dans la zone sujet, afin qu'aucun câble ne relie les deux zones
# ÉTAPE 1 — Ramener chaque cote a son ecart par rapport a la nominale
# ÉTAPE 2 — Prendre la valeur absolue : un ecart de -8 est aussi hors tolerance qu'un ecart de +8
# ÉTAPE 3 — Comparer a la tolerance : on obtient une liste de booleens
# ÉTAPE 4 — Sommer les booleens : True vaut 1, False vaut 0
# RÉSULTAT — tant que l'interrupteur AFFICHER LE CORRIGÉ reste sur faux, la sortie 1 du Stream Gate est
# vide : rien n'apparaît dans Rhino
nominale = Slider(1200, range=1000..1400)
tolerance = Slider(5, range=0..20)

# ---- group: ZONE_CORRIGE / DONNÉES FOURNIES (copie)
cotes_relevees_2 = COTES_RELEVEES([1203, 1198, 1207, 1199, 1201, 1194, 1206, 1200, 1211, 1197, 1202, 1188, 1205, 1200, 1196, 1209, 1193, 1204, 1199, 1214, 1201, 1191, 1208, 1200, 1195, 1210, 1198, 1202])
nominale_2 = Slider(1200, range=1000..1400)
tolerance_2 = Slider(5, range=0..20)

# ---- group: ZONE_CORRIGE / ÉTAPE 1
subtraction = Subtraction(A=cotes_relevees_2, B=nominale_2)

# ---- group: ZONE_CORRIGE / ÉTAPE 2
abs = Absolute(Value=subtraction)

# ---- group: ZONE_CORRIGE / ÉTAPE 3
larger = LargerThan(FirstNumber=abs, SecondNumber=tolerance_2)  # -> LargerThan, OrEqualTo

# ---- group: ZONE_CORRIGE / ÉTAPE 4
ma = MassAddition(Input=larger.LargerThan)  # -> Result, PartialResults
panel = Panel(ma.Result)

# ---- group: ZONE_CORRIGE / AFFICHAGE DU CORRIGÉ
afficher_le_corrigé = BooleanToggle(False)
gate = StreamGate(Stream=ma.Result, Gate=afficher_le_corrigé)  # -> Target0, Target1
reponse_corrige = REPONSE_CORRIGE(gate.Target1)
