# Grasshopper definition A-09_complet.gh (Grasshopper 1.0.8)

# ---- group: ZONE_SUJET
# Le relevé porte sur 24 baies, mais certaines lignes n'ont pas été renseignées. Indiquez combien
# de hauteurs sont réellement exploitables.
releve_alleges = RELEVE_ALLEGES([1050, 950, 1120, 1080, 990, 1150, 1020, 1075, 1005, 1130, 960, 1095, 1040, 1110, 985, 1065, 1025, 1085])
reponse = REPONSE()

# ---- group: ZONE_CORRIGE / DONNÉES FOURNIES (copie)
releve_alleges_2 = RELEVE_ALLEGES([1050, 950, 1120, 1080, 990, 1150, 1020, 1075, 1005, 1130, 960, 1095, 1040, 1110, 985, 1065, 1025, 1085])

# ---- group: ZONE_CORRIGE / ÉTAPE 1
# A-09 · Valeur nulle et propagation
# Débutant  —  durée cible 7 min  —  réf. REF-055  —  v0.5-260902
# ▼  CORRIGÉ — à consulter après validation  ▼
# RAPPEL — copie des données fournies dans la zone sujet, afin qu'aucun câble ne relie les deux zones
# ÉTAPE 1 — Localiser les valeurs nulles
# ÉTAPE 2 — Nettoyer la liste en supprimant les nulles
# ÉTAPE 3 — Compter les éléments valides restants
# RÉSULTAT — tant que l'interrupteur AFFICHER LE CORRIGÉ reste sur faux, la sortie 1 du Stream Gate est
# vide : rien n'apparaît dans Rhino
null = NullItem(Item=releve_alleges_2)  # -> NullFlags, InvalidFlags, Description

# ---- group: ZONE_CORRIGE / ÉTAPE 2
clean = CleanTree(RemoveNulls=True, RemoveInvalid=True, RemoveEmpty=False, Tree=releve_alleges_2)

# ---- group: ZONE_CORRIGE / ÉTAPE 3
lng = ListLength(List=clean)
panel = Panel(lng)

# ---- group: ZONE_CORRIGE / AFFICHAGE DU CORRIGÉ
afficher_le_corrigé = BooleanToggle(False)
gate = StreamGate(Stream=lng, Gate=afficher_le_corrigé)  # -> Target0, Target1
reponse_corrige = REPONSE_CORRIGE(gate.Target1)
