# Grasshopper definition A-10_complet.gh (Grasshopper 1.0.8)

# ---- group: ZONE_SUJET
# La halle compte 7 portiques espacés de 5 400 mm, le premier à l'origine de la file. Produisez
# la liste des abscisses des 7 axes.
reponse = REPONSE()

# ---- group: ZONE_CORRIGE / ÉTAPE 1
# A-10 · Series et Range
# Débutant  —  durée cible 7 min  —  réf. REF-043, REF-047  —  v0.3-260826
# ▼  CORRIGÉ — à consulter après validation  ▼
# ÉTAPE 1 — Series raisonne en pas et nombre d'éléments
# ÉTAPE 2 — Range raisonne en domaine et nombre de subdivisions
# RÉSULTAT — tant que l'interrupteur AFFICHER LE CORRIGÉ reste sur faux, la sortie 1 du Stream Gate est
# vide : rien n'apparaît dans Rhino
series = Series(Start=10, Step=5, Count=5)
panel = Panel(series)

# ---- group: ZONE_CORRIGE / ÉTAPE 2
dom = ConstructDomain(DomainStart=10, DomainEnd=30)
range = Range(Domain=dom, Steps=4)
panel_2 = Panel(range)

# ---- group: ZONE_CORRIGE / AFFICHAGE DU CORRIGÉ
afficher_le_corrigé = BooleanToggle(False)
gate = StreamGate(Stream=series, Gate=afficher_le_corrigé)  # -> Target0, Target1
reponse_corrige = REPONSE_CORRIGE(gate.Target1)
