# Grasshopper definition A-11_complet.gh (Grasshopper 1.0.8)

# ---- group: ZONE_SUJET
# Le débit comporte 24 pièces. Relevez la longueur de la quatrième pièce, puis celle de la
# dernière — sachant que le débit s'allongera la semaine prochaine et que votre montage devra
# encore désigner la dernière pièce sans être retouché.
longueurs_debit = LONGUEURS_DEBIT([2450, 1830, 3120, 2075, 1640, 2890, 3450, 1975, 2310, 2660, 1520, 3080, 2185, 2740, 1890, 3260, 2020, 2555, 1735, 2960, 3340, 1680, 2405, 2830])
reponse = REPONSE()

# ---- group: ZONE_CORRIGE / DONNÉES FOURNIES (copie)
longueurs_debit_2 = LONGUEURS_DEBIT([2450, 1830, 3120, 2075, 1640, 2890, 3450, 1975, 2310, 2660, 1520, 3080, 2185, 2740, 1890, 3260, 2020, 2555, 1735, 2960, 3340, 1680, 2405, 2830])

# ---- group: ZONE_CORRIGE / ÉTAPE 1
# A-11 · List Item et indexation
# Débutant  —  durée cible 6 min  —  réf. REF-042  —  v0.3-260826
# ▼  CORRIGÉ — à consulter après validation  ▼
# RAPPEL — copie des données fournies dans la zone sujet, afin qu'aucun câble ne relie les deux zones
# ÉTAPE 1 — Atteindre la piece du quatrieme rang : les rangs commencent a zero, le quatrieme porte donc
# l'indice 3
# ÉTAPE 2 — Atteindre la derniere piece sans coder son rang en dur : mesurer la liste, puis retrancher un
# ÉTAPE 3 — Reunir les deux longueurs en une liste unique : le controle compare une liste, pas deux sorties
# RÉSULTAT — tant que l'interrupteur AFFICHER LE CORRIGÉ reste sur faux, la sortie 1 du Stream Gate est
# vide : rien n'apparaît dans Rhino
item = ListItem(List=longueurs_debit_2, Index=3, Wrap=True)
panel = Panel(item)

# ---- group: ZONE_CORRIGE / ÉTAPE 2
lng = ListLength(List=longueurs_debit_2)
subtraction = Subtraction(A=lng, B=1)
item_2 = ListItem(List=longueurs_debit_2, Index=subtraction, Wrap=True)
panel_2 = Panel(item_2)

# ---- group: ZONE_CORRIGE / ÉTAPE 3
merge = Merge(Data1=item, Data2=item_2)
panel_3 = Panel(merge)

# ---- group: ZONE_CORRIGE / AFFICHAGE DU CORRIGÉ
afficher_le_corrigé = BooleanToggle(False)
gate = StreamGate(Stream=merge, Gate=afficher_le_corrigé)  # -> Target0, Target1
reponse_corrige = REPONSE_CORRIGE(gate.Target1)
