# Grasshopper definition A-12_complet.gh (Grasshopper 1.0.8)

# ---- group: ZONE_SUJET
# Les épaisseurs relevées sur le lot vous sont fournies, en centièmes de millimètre. Produisez,
# dans cet ordre, l'effectif du lot, l'épaisseur la plus faible et l'épaisseur la plus forte.
epaisseurs = EPAISSEURS([62, 58, 71, 55, 67, 60, 74, 53, 69, 57, 64, 76, 51, 68, 59, 72, 56, 65, 61, 78, 54, 70, 63, 66, 52, 75, 58, 73])
reponse = REPONSE()

# ---- group: ZONE_CORRIGE / DONNÉES FOURNIES (copie)
epaisseurs_2 = EPAISSEURS([62, 58, 71, 55, 67, 60, 74, 53, 69, 57, 64, 76, 51, 68, 59, 72, 56, 65, 61, 78, 54, 70, 63, 66, 52, 75, 58, 73])

# ---- group: ZONE_CORRIGE / ÉTAPE 1
# A-12 · Longueur et bornes d'une liste
# Débutant  —  durée cible 5 min  —  réf. REF-043  —  v0.5-260902
# ▼  CORRIGÉ — à consulter après validation  ▼
# RAPPEL — copie des données fournies dans la zone sujet, afin qu'aucun câble ne relie les deux zones
# ÉTAPE 1 — Mesurer l'effectif
# ÉTAPE 2 — Obtenir le domaine des valeurs puis ses deux bornes
# ÉTAPE 3 — Assembler effectif, minimum et maximum dans cet ordre
# RÉSULTAT — tant que l'interrupteur AFFICHER LE CORRIGÉ reste sur faux, la sortie 1 du Stream Gate est
# vide : rien n'apparaît dans Rhino
lng = ListLength(List=epaisseurs_2)

# ---- group: ZONE_CORRIGE / ÉTAPE 2
bnd = Bounds(Numbers=epaisseurs_2)
dedomain = DeconstructDomain(Domain=bnd)  # -> Start, End

# ---- group: ZONE_CORRIGE / ÉTAPE 3
merge = Merge(Data1=lng, Data2=dedomain.Start)
merge_2 = Merge(Data1=merge, Data2=dedomain.End)
panel = Panel(merge_2)

# ---- group: ZONE_CORRIGE / AFFICHAGE DU CORRIGÉ
afficher_le_corrigé = BooleanToggle(False)
gate = StreamGate(Stream=merge_2, Gate=afficher_le_corrigé)  # -> Target0, Target1
reponse_corrige = REPONSE_CORRIGE(gate.Target1)
