# Grasshopper definition A-13_complet.gh (Grasshopper 1.0.8)

# ---- group: ZONE_SUJET
# Six pièces portent chacune un numéro de repère et une longueur. L'atelier débite la plus longue
# en premier. Produisez la liste des numéros de repère dans l'ordre de passage à la scie.
reperes = REPERES(["4207", "4183", "4256", "4171", "4229", "4198"])
longueurs = LONGUEURS([2340, 1875, 2610, 1420, 2185, 1960])
reponse = REPONSE()

# ---- group: ZONE_CORRIGE / DONNÉES FOURNIES (copie)
reperes_2 = REPERES(["4207", "4183", "4256", "4171", "4229", "4198"])
longueurs_2 = LONGUEURS([2340, 1875, 2610, 1420, 2185, 1960])

# ---- group: ZONE_CORRIGE / ÉTAPE 1
# A-13 · Trier une liste avec une clé
# Débutant  —  durée cible 8 min  —  réf. REF-044, REF-047  —  v0.5-260902
# ▼  CORRIGÉ — à consulter après validation  ▼
# RAPPEL — copie des données fournies dans la zone sujet, afin qu'aucun câble ne relie les deux zones
# ÉTAPE 1 — Trier : les longueurs sont les clés, les noms les valeurs
# ÉTAPE 2 — Sort List trie par ordre croissant : inverser pour obtenir le décroissant
# RÉSULTAT — tant que l'interrupteur AFFICHER LE CORRIGÉ reste sur faux, la sortie 1 du Stream Gate est
# vide : rien n'apparaît dans Rhino
sort = SortList(Keys=longueurs_2, ValuesA=reperes_2)  # -> Keys, ValuesA

# ---- group: ZONE_CORRIGE / ÉTAPE 2
rev = ReverseList(List=sort.ValuesA)
panel = Panel(rev)

# ---- group: ZONE_CORRIGE / AFFICHAGE DU CORRIGÉ
afficher_le_corrigé = BooleanToggle(False)
gate = StreamGate(Stream=rev, Gate=afficher_le_corrigé)  # -> Target0, Target1
reponse_corrige = REPONSE_CORRIGE(gate.Target1)
