# Grasshopper definition A-14_complet.gh (Grasshopper 1.0.8)

# ---- group: ZONE_SUJET
# Le calepinage plein comporte 36 lames. Produisez la liste des lames réellement posées, sachant
# qu'on conserve la première puis une sur trois.
calepinage_plein = CALEPINAGE_PLEIN([1840, 1795, 1920, 1755, 1880, 1810, 1965, 1730, 1855, 1900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])
reponse = REPONSE()

# ---- group: ZONE_CORRIGE / DONNÉES FOURNIES (copie)
calepinage_plein_2 = CALEPINAGE_PLEIN([1840, 1795, 1920, 1755, 1880, 1810, 1965, 1730, 1855, 1900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])

# ---- group: ZONE_CORRIGE / ÉTAPE 1
# A-14 · Filtrer avec Cull Pattern
# Débutant  —  durée cible 7 min  —  réf. REF-045  —  v0.5-260902
# ▼  CORRIGÉ — à consulter après validation  ▼
# RAPPEL — copie des données fournies dans la zone sujet, afin qu'aucun câble ne relie les deux zones
# ÉTAPE 1 — Saisir le motif sur trois lignes distinctes du Panel
# ÉTAPE 2 — Le motif se répète cycliquement sur toute la liste
# RÉSULTAT — tant que l'interrupteur AFFICHER LE CORRIGÉ reste sur faux, la sortie 1 du Stream Gate est
# vide : rien n'apparaît dans Rhino
panel = Panel("""True
False
False""")

# ---- group: ZONE_CORRIGE / ÉTAPE 2
cull = CullPattern(List=calepinage_plein_2, CullPattern=panel)
panel_2 = Panel(cull)

# ---- group: ZONE_CORRIGE / AFFICHAGE DU CORRIGÉ
afficher_le_corrigé = BooleanToggle(False)
gate = StreamGate(Stream=cull, Gate=afficher_le_corrigé)  # -> Target0, Target1
reponse_corrige = REPONSE_CORRIGE(gate.Target1)
