# Grasshopper definition A-15_complet.gh (Grasshopper 1.0.8)

# ---- group: ZONE_SUJET
# Les surfaces des 24 panneaux du chantier vous sont fournies. Séparez-les en deux groupes selon
# qu'ils dépassent ou non 2,50 m², et donnez le nombre de panneaux à poser en binôme.
surfaces_m2 = SURFACES_M2([1.84, 3.12, 2.07, 2.95, 1.62, 3.4, 2.21, 1.97, 2.66, 3.28, 1.53, 2.88, 2.14, 3.06, 1.73, 2.49, 2.72, 1.68, 3.34, 2.02, 2.83, 1.91, 3.19, 2.36])
reponse = REPONSE()

# ---- group: ZONE_CORRIGE / DONNÉES FOURNIES (copie)
surfaces_m2_2 = SURFACES_M2([1.84, 3.12, 2.07, 2.95, 1.62, 3.4, 2.21, 1.97, 2.66, 3.28, 1.53, 2.88, 2.14, 3.06, 1.73, 2.49, 2.72, 1.68, 3.34, 2.02, 2.83, 1.91, 3.19, 2.36])

# ---- group: ZONE_CORRIGE / ÉTAPE 1
# A-15 · Répartir avec Dispatch
# Débutant  —  durée cible 7 min  —  réf. REF-045, REF-061  —  v0.3-260826
# ▼  CORRIGÉ — à consulter après validation  ▼
# RAPPEL — copie des données fournies dans la zone sujet, afin qu'aucun câble ne relie les deux zones
# ÉTAPE 1 — Comparer chaque surface au seuil de pose a deux
# ÉTAPE 2 — Separer les panneaux en deux groupes : la competence visee est bien la separation, pas le seul
# comptage
# ÉTAPE 3 — Chiffrer le groupe a poser en binome
# RÉSULTAT — tant que l'interrupteur AFFICHER LE CORRIGÉ reste sur faux, la sortie 1 du Stream Gate est
# vide : rien n'apparaît dans Rhino
seuil = Slider(2.5, range=0..5)
larger = LargerThan(FirstNumber=surfaces_m2_2, SecondNumber=seuil)  # -> LargerThan, OrEqualTo

# ---- group: ZONE_CORRIGE / ÉTAPE 2
dispatch = Dispatch(List=surfaces_m2_2, DispatchPattern=larger.LargerThan)  # -> ListA, ListB
panel = Panel(dispatch.ListA)

# ---- group: ZONE_CORRIGE / ÉTAPE 3
lng = ListLength(List=dispatch.ListA)
panel_3 = Panel(lng)

# ---- group: ZONE_CORRIGE / AFFICHAGE DU CORRIGÉ
afficher_le_corrigé = BooleanToggle(False)
gate = StreamGate(Stream=lng, Gate=afficher_le_corrigé)  # -> Target0, Target1
reponse_corrige = REPONSE_CORRIGE(gate.Target1)
