# Grasshopper definition A-16_complet.gh (Grasshopper 1.0.8)

# ---- group: ZONE_SUJET
# Huit montants sont disposés en octogone. Tracez les huit lisses qui relient chaque montant au
# suivant, la dernière revenant au premier, en n'employant qu'une seule fois le composant de
# tracé.
points_octogone = POINTS_OCTOGONE([Point(100, 0, 0), Point(70.711, 70.711, 0), Point(0, 100, 0), Point(-70.711, 70.711, 0), Point(-100, 0, 0), Point(-70.711, -70.711, 0), Point(0, -100, 0), Point(70.711, -70.711, 0)])
reponse = REPONSE()

# ---- group: ZONE_CORRIGE / DONNÉES FOURNIES (copie)
points_octogone_2 = POINTS_OCTOGONE([Point(100, 0, 0), Point(70.711, 70.711, 0), Point(0, 100, 0), Point(-70.711, 70.711, 0), Point(-100, 0, 0), Point(-70.711, -70.711, 0), Point(0, -100, 0), Point(70.711, -70.711, 0)])

# ---- group: ZONE_CORRIGE / ÉTAPE 1
# A-16 · Décaler et inverser une liste
# Débutant  —  durée cible 6 min  —  réf. REF-046  —  v0.5-260902
# ▼  CORRIGÉ — à consulter après validation  ▼
# RAPPEL — copie des données fournies dans la zone sujet, afin qu'aucun câble ne relie les deux zones
# ÉTAPE 1 — Décaler la liste d'un cran, l'option Wrap ramenant le dernier au début
# ÉTAPE 2 — Un seul composant Line relie chaque point à son suivant
# RÉSULTAT — tant que l'interrupteur AFFICHER LE CORRIGÉ reste sur faux, la sortie 1 du Stream Gate est
# vide : rien n'apparaît dans Rhino
shift = ShiftList(List=points_octogone_2, Shift=1, Wrap=True)

# ---- group: ZONE_CORRIGE / ÉTAPE 2
ln = Line(StartPoint=points_octogone_2, EndPoint=shift)

# ---- group: ZONE_CORRIGE / AFFICHAGE DU CORRIGÉ
afficher_le_corrigé = BooleanToggle(False)
gate = StreamGate(Stream=ln, Gate=afficher_le_corrigé)  # -> Target0, Target1
reponse_corrige = REPONSE_CORRIGE(gate.Target1)
