# Grasshopper definition A-17_complet.gh (Grasshopper 1.0.8)

# ---- group: ZONE_SUJET
# Cinq lames de chêne et cinq lames de noyer vous sont fournies dans deux listes séparées,
# repérées par leur longueur. Produisez l'ordre de pose du plateau, une essence sur deux en
# commençant par le chêne.
chene = CHENE(["1245", "1268", "1231", "1287", "1252"])
noyer = NOYER(["1418", "1463", "1437", "1409", "1481"])
reponse = REPONSE()

# ---- group: ZONE_CORRIGE / DONNÉES FOURNIES (copie)
chene_2 = CHENE(["1245", "1268", "1231", "1287", "1252"])
noyer_2 = NOYER(["1418", "1463", "1437", "1409", "1481"])

# ---- group: ZONE_CORRIGE / ÉTAPE 1
# A-17 · Fusionner et entrelacer
# Débutant  —  durée cible 6 min  —  réf. REF-042  —  v0.3-260826
# ▼  CORRIGÉ — à consulter après validation  ▼
# RAPPEL — copie des données fournies dans la zone sujet, afin qu'aucun câble ne relie les deux zones
# ÉTAPE 1 — Weave alterne les deux flux selon le motif par défaut 0, 1
# ÉTAPE 2 — Merge, lui, concatènerait bout à bout : A B C 1 2 3
# RÉSULTAT — tant que l'interrupteur AFFICHER LE CORRIGÉ reste sur faux, la sortie 1 du Stream Gate est
# vide : rien n'apparaît dans Rhino
weave = Weave(Pattern=[0, 1], Stream0=chene_2, Stream1=noyer_2, NullGaps=False)
panel = Panel(weave)

# ---- group: ZONE_CORRIGE / ÉTAPE 2
merge = Merge(Data1=chene_2, Data2=noyer_2)
panel_2 = Panel(merge)

# ---- group: ZONE_CORRIGE / AFFICHAGE DU CORRIGÉ
afficher_le_corrigé = BooleanToggle(False)
gate = StreamGate(Stream=weave, Gate=afficher_le_corrigé)  # -> Target0, Target1
reponse_corrige = REPONSE_CORRIGE(gate.Target1)
