# Grasshopper definition A-18_complet.gh (Grasshopper 1.0.8)

# ---- group: ZONE_SUJET
# Le profil compte 28 relevés altimétriques. Isolez ceux des rangs 5 à 12 inclus, qui
# correspondent à la section courante.
releves_alti = RELEVES_ALTI([412, 438, 401, 455, 427, 466, 419, 448, 433, 471, 405, 459, 424, 443, 462, 416, 451, 430, 468, 409, 446, 435, 457, 421, 464, 414, 441, 453])
reponse = REPONSE()

# ---- group: ZONE_CORRIGE / DONNÉES FOURNIES (copie)
releves_alti_2 = RELEVES_ALTI([412, 438, 401, 455, 427, 466, 419, 448, 433, 471, 405, 459, 424, 443, 462, 416, 451, 430, 468, 409, 446, 435, 457, 421, 464, 414, 441, 453])

# ---- group: ZONE_CORRIGE / ÉTAPE 1
# A-18 · Extraire une portion de liste
# Débutant  —  durée cible 6 min  —  réf. REF-042, REF-043  —  v0.3-260826
# ▼  CORRIGÉ — à consulter après validation  ▼
# RAPPEL — copie des données fournies dans la zone sujet, afin qu'aucun câble ne relie les deux zones
# ÉTAPE 1 — Construire le domaine d'index : les deux bornes sont incluses
# ÉTAPE 2 — Prélever la portion de liste
# ÉTAPE 3 — Vérifier : huit éléments, et non sept
# RÉSULTAT — tant que l'interrupteur AFFICHER LE CORRIGÉ reste sur faux, la sortie 1 du Stream Gate est
# vide : rien n'apparaît dans Rhino
dom = ConstructDomain(DomainStart=5, DomainEnd=12)

# ---- group: ZONE_CORRIGE / ÉTAPE 2
subset = SubList(List=releves_alti_2, Domain=dom, Wrap=True)  # -> List, Index

# ---- group: ZONE_CORRIGE / ÉTAPE 3
lng = ListLength(List=subset.List)
panel = Panel(subset.List)

# ---- group: ZONE_CORRIGE / AFFICHAGE DU CORRIGÉ
afficher_le_corrigé = BooleanToggle(False)
gate = StreamGate(Stream=subset.List, Gate=afficher_le_corrigé)  # -> Target0, Target1
reponse_corrige = REPONSE_CORRIGE(gate.Target1)
