# Grasshopper definition A-19_complet.gh (Grasshopper 1.0.8)

# ---- group: ZONE_SUJET
# Le flux fourni est structuré en branches. Indiquez combien il en compte.
arbre = ARBRE(Tree({0}: [11, 12, 13], {1}: [21, 22, 23], {2}: [31, 32, 33], {3}: [41, 42, 43]))
reponse = REPONSE()

# ---- group: ZONE_CORRIGE / DONNÉES FOURNIES (copie)
arbre_2 = ARBRE(Tree({0}: [11, 12, 13], {1}: [21, 22, 23], {2}: [31, 32, 33], {3}: [41, 42, 43]))

# ---- group: ZONE_CORRIGE / ÉTAPE 1
# A-19 · Lire un chemin d'arbre
# Débutant  —  durée cible 7 min  —  réf. REF-048, REF-051  —  v0.3-260826
# ▼  CORRIGÉ — à consulter après validation  ▼
# RAPPEL — copie des données fournies dans la zone sujet, afin qu'aucun câble ne relie les deux zones
# ÉTAPE 1 — Tree Statistics : la sortie P donne la liste des chemins
# ÉTAPE 2 — Compter les chemins donne le nombre de branches
# ÉTAPE 3 — Le troisième chemin est à l'index 2
# ÉTAPE 4 — Assembler les deux réponses
# RÉSULTAT — tant que l'interrupteur AFFICHER LE CORRIGÉ reste sur faux, la sortie 1 du Stream Gate est
# vide : rien n'apparaît dans Rhino
tstat = TreeStatistics(Tree=arbre_2)  # -> Paths, Length, Count

# ---- group: ZONE_CORRIGE / ÉTAPE 2
lng = ListLength(List=tstat.Paths)

# ---- group: ZONE_CORRIGE / ÉTAPE 3
item = ListItem(List=tstat.Paths, Index=2, Wrap=True)

# ---- group: ZONE_CORRIGE / ÉTAPE 4
merge = Merge(Data1=lng, Data2=item)
panel = Panel(merge)

# ---- group: ZONE_CORRIGE / AFFICHAGE DU CORRIGÉ
afficher_le_corrigé = BooleanToggle(False)
gate = StreamGate(Stream=merge, Gate=afficher_le_corrigé)  # -> Target0, Target1
reponse_corrige = REPONSE_CORRIGE(gate.Target1)
