# Grasshopper definition A-20_complet.gh (Grasshopper 1.0.8)

# ---- group: ZONE_SUJET
# Trois ancrages de rive et trois ancrages de mât vous sont fournis. Le tracé livre aujourd'hui
# trois haubans, un par paire de même rang. Obtenez les neuf haubans de toutes les combinaisons
# possibles, sans dupliquer le composant de tracé.
points_a = POINTS_A([Point(0, 0, 0), Point(0, 80, 0), Point(0, 160, 0)])
points_b = POINTS_B([Point(200, 0, 0), Point(200, 80, 0), Point(200, 160, 0)])
reponse = REPONSE()
# A-20 · Graft et Flatten
# Débutant  —  durée cible 8 min  —  réf. REF-049, REF-052  —  v0.5-260902
# ▼  CORRIGÉ — à consulter après validation  ▼
# RAPPEL — copie des données fournies dans la zone sujet, afin qu'aucun câble ne relie les deux zones
# ÉTAPE 1 — Grafter l'entrée A : chaque point part dans sa propre branche
# ÉTAPE 2 — Chaque branche de A est croisée avec la liste complète de B
# ÉTAPE 3 — Un Flatten ramènerait les 9 segments dans une seule liste
# RÉSULTAT — tant que l'interrupteur AFFICHER LE CORRIGÉ reste sur faux, la sortie 1 du Stream Gate est
# vide : rien n'apparaît dans Rhino
_3_segments = Line(StartPoint=points_a, EndPoint=points_b)

# ---- group: ZONE_CORRIGE / DONNÉES FOURNIES (copie)
points_a_2 = POINTS_A([Point(0, 0, 0), Point(0, 80, 0), Point(0, 160, 0)])
points_b_2 = POINTS_B([Point(200, 0, 0), Point(200, 80, 0), Point(200, 160, 0)])

# ---- group: ZONE_CORRIGE / ÉTAPE 1
_9_segments = Line(StartPoint=graft(points_a_2), EndPoint=points_b_2)

# ---- group: ZONE_CORRIGE / ÉTAPE 2
viewer = ParamViewer(_9_segments)

# ---- group: ZONE_CORRIGE / ÉTAPE 3
flatten = FlattenTree(Tree=_9_segments, Path="{0}")
lng = ListLength(List=flatten)
panel = Panel(lng)

# ---- group: ZONE_CORRIGE / AFFICHAGE DU CORRIGÉ
afficher_le_corrigé = BooleanToggle(False)
gate = StreamGate(Stream=_9_segments, Gate=afficher_le_corrigé)  # -> Target0, Target1
reponse_corrige = REPONSE_CORRIGE(gate.Target1)
