# Grasshopper definition A-20_sujet.gh (Grasshopper 1.0.8)

# ---- group: ZONE_SUJET
# Trois ancrages de rive et trois ancrages de mât vous sont fournis. Le tracé livre aujourd'hui
# trois haubans, un par paire de même rang. Obtenez les neuf haubans de toutes les combinaisons
# possibles, sans dupliquer le composant de tracé.
points_a = POINTS_A([Point(0, 0, 0), Point(0, 80, 0), Point(0, 160, 0)])
points_b = POINTS_B([Point(200, 0, 0), Point(200, 80, 0), Point(200, 160, 0)])
reponse = REPONSE()
# A-20 · Graft et Flatten
# Débutant  —  durée cible 8 min  —  réf. REF-049, REF-052  —  v0.3-260826
_3_segments = Line(StartPoint=points_a, EndPoint=points_b)
