# Grasshopper definition A-21_complet.gh (Grasshopper 1.0.8)

# ---- group: ZONE_SUJET
# Le flux fourni porte des chemins à quatre niveaux, dont trois ne distinguent plus rien.
# Ramenez-le à un seul niveau, sans fusionner les groupes entre eux. Indiquez le nombre de
# branches obtenu.
arbre_profond = ARBRE_PROFOND(Tree({0;0;0;0}: [1, 2], {0;0;0;1}: [3, 4], {0;0;0;2}: [5, 6], {0;0;0;3}: [7, 8]))
reponse = REPONSE()

# ---- group: ZONE_CORRIGE / DONNÉES FOURNIES (copie)
arbre_profond_2 = ARBRE_PROFOND(Tree({0;0;0;0}: [1, 2], {0;0;0;1}: [3, 4], {0;0;0;2}: [5, 6], {0;0;0;3}: [7, 8]))

# ---- group: ZONE_CORRIGE / ÉTAPE 1
# A-21 · Nettoyer une structure
# Débutant  —  durée cible 7 min  —  réf. REF-050  —  v0.5-260902
# ▼  CORRIGÉ — à consulter après validation  ▼
# RAPPEL — copie des données fournies dans la zone sujet, afin qu'aucun câble ne relie les deux zones
# ÉTAPE 1 — Lire les chemins de départ : {0;0;0;n}
# ÉTAPE 2 — Simplify supprime les niveaux communs à toutes les branches
# ÉTAPE 3 — Trim Tree, lui, supprimerait le dernier niveau et fusionnerait les branches
# RÉSULTAT — tant que l'interrupteur AFFICHER LE CORRIGÉ reste sur faux, la sortie 1 du Stream Gate est
# vide : rien n'apparaît dans Rhino
viewer = ParamViewer(arbre_profond_2)

# ---- group: ZONE_CORRIGE / ÉTAPE 2
simplify = SimplifyTree(Tree=arbre_profond_2, Front=False)
viewer_2 = ParamViewer(simplify)

# ---- group: ZONE_CORRIGE / ÉTAPE 3
trim = TrimTree(Tree=arbre_profond_2, Depth=1)
viewer_3 = ParamViewer(trim)

# ---- group: ZONE_CORRIGE / AFFICHAGE DU CORRIGÉ
afficher_le_corrigé = BooleanToggle(False)
gate = StreamGate(Stream=simplify, Gate=afficher_le_corrigé)  # -> Target0, Target1
reponse_corrige = REPONSE_CORRIGE(gate.Target1)
