# Grasshopper definition A-22_complet.gh (Grasshopper 1.0.8)

# ---- group: ZONE_SUJET
# Trois listes de longueurs différentes vous sont fournies. Faites-les circuler dans un flux
# unique où chacune reste un groupe séparé, puis récupérez les trois listes d'origine à
# l'identique.
liste_1 = LISTE_1([10, 20])
liste_2 = LISTE_2([1, 2, 3, 4, 5])
liste_3 = LISTE_3([100, 200, 300])
reponse = REPONSE()

# ---- group: ZONE_CORRIGE / DONNÉES FOURNIES (copie)
liste_1_2 = LISTE_1([10, 20])
liste_2_2 = LISTE_2([1, 2, 3, 4, 5])
liste_3_2 = LISTE_3([100, 200, 300])

# ---- group: ZONE_CORRIGE / ÉTAPE 1
# A-22 · Construire un arbre
# Débutant  —  durée cible 8 min  —  réf. REF-048, REF-051  —  v0.3-260826
# ▼  CORRIGÉ — à consulter après validation  ▼
# RAPPEL — copie des données fournies dans la zone sujet, afin qu'aucun câble ne relie les deux zones
# ÉTAPE 1 — Entwine assemble les listes en autant de branches
# ÉTAPE 2 — Explode Tree restitue chaque liste séparément (zoomer pour voir les sorties)
# RÉSULTAT — tant que l'interrupteur AFFICHER LE CORRIGÉ reste sur faux, la sortie 1 du Stream Gate est
# vide : rien n'apparaît dans Rhino
entwine = Entwine(Branch00=liste_1_2, Branch01=liste_2_2, Branch02=liste_3_2, FlattenInputs=True)
viewer = ParamViewer(entwine)

# ---- group: ZONE_CORRIGE / ÉTAPE 2
bang = ExplodeTree(Data=entwine)  # -> Branch0, Branch1, Branch2

# ---- group: ZONE_CORRIGE / AFFICHAGE DU CORRIGÉ
afficher_le_corrigé = BooleanToggle(False)
gate = StreamGate(Stream=entwine, Gate=afficher_le_corrigé)  # -> Target0, Target1
reponse_corrige = REPONSE_CORRIGE(gate.Target1)
