# Grasshopper definition A-23_complet.gh (Grasshopper 1.0.8)

# ---- group: ZONE_SUJET
# Le flux fourni est rangé par niveau puis par file. Réorganisez-le par file puis par niveau,
# sans modifier les éléments eux-mêmes. Indiquez le nombre de branches obtenu.
arbre_2_niveaux = ARBRE_2_NIVEAUX(Tree({0;0}: [1], {0;1}: [2], {0;2}: [3], {0;3}: [4], {1;0}: [5], {1;1}: [6], {1;2}: [7], {1;3}: [8], {2;0}: [9], {2;1}: [10], {2;2}: [11], {2;3}: [12]))
reponse = REPONSE()

# ---- group: ZONE_CORRIGE / DONNÉES FOURNIES (copie)
arbre_2_niveaux_2 = ARBRE_2_NIVEAUX(Tree({0;0}: [1], {0;1}: [2], {0;2}: [3], {0;3}: [4], {1;0}: [5], {1;1}: [6], {1;2}: [7], {1;3}: [8], {2;0}: [9], {2;1}: [10], {2;2}: [11], {2;3}: [12]))

# ---- group: ZONE_CORRIGE / ÉTAPE 1
# A-23 · Renommer les chemins avec Path Mapper
# Débutant  —  durée cible 9 min  —  réf. REF-050  —  v0.5-260902
# ▼  CORRIGÉ — à consulter après validation  ▼
# RAPPEL — copie des données fournies dans la zone sujet, afin qu'aucun câble ne relie les deux zones
# ÉTAPE 1 — Path Mapper : masque source {A;B}, masque cible {B;A}
# ÉTAPE 2 — Contrôler la permutation des deux niveaux
# RÉGLAGES À POSER À LA MAIN :
# • Path Mapper : double-cliquer, saisir {A;B} en source et {B;A} en cible.
# • Ne pas oublier les accolades, et réutiliser les mêmes lettres de part et d'autre.
# RÉSULTAT — tant que l'interrupteur AFFICHER LE CORRIGÉ reste sur faux, la sortie 1 du Stream Gate est
# vide : rien n'apparaît dans Rhino
path_mapper = PathMapper(arbre_2_niveaux_2)

# ---- group: ZONE_CORRIGE / ÉTAPE 2
viewer = ParamViewer(path_mapper)

# ---- group: ZONE_CORRIGE / AFFICHAGE DU CORRIGÉ
afficher_le_corrigé = BooleanToggle(False)
gate = StreamGate(Stream=path_mapper, Gate=afficher_le_corrigé)  # -> Target0, Target1
reponse_corrige = REPONSE_CORRIGE(gate.Target1)
