# Grasshopper definition A-24_complet.gh (Grasshopper 1.0.8)

# ---- group: ZONE_SUJET
# Une liste de 10 nombres et une liste de 4 nombres entrent dans une même Addition. Combien de
# résultats sortent ? Affiche le compte dans un Panel, puis explique comment les 6 derniers ont
# été calculés.
dix_valeurs = DIX_VALEURS([12, 68, 34, 91, 7, 55, 80, 23, 46, 99])
quatre_valeurs = QUATRE_VALEURS([1, 2, 3, 4])
reponse = REPONSE()
# A-24 · Correspondance par défaut
# Débutant  —  durée cible 7 min  —  réf. REF-053  —  v0.5-260902
# ▼  CORRIGÉ — à consulter après validation  ▼
# RAPPEL — copie des données fournies dans la zone sujet, afin qu'aucun câble ne relie les deux zones
# ÉTAPE 1 — Compter les résultats réellement produits
# ÉTAPE 2 — Aucun avertissement n'est émis : la troncature est silencieuse (Shortest List)
# RÉSULTAT — tant que l'interrupteur AFFICHER LE CORRIGÉ reste sur faux, la sortie 1 du Stream Gate est
# vide : rien n'apparaît dans Rhino
addition = Addition(A=dix_valeurs, B=quatre_valeurs)

# ---- group: ZONE_CORRIGE / DONNÉES FOURNIES (copie)
dix_valeurs_2 = DIX_VALEURS([12, 68, 34, 91, 7, 55, 80, 23, 46, 99])
quatre_valeurs_2 = QUATRE_VALEURS([1, 2, 3, 4])
addition_2 = Addition(A=dix_valeurs_2, B=quatre_valeurs_2)

# ---- group: ZONE_CORRIGE / ÉTAPE 1
lng = ListLength(List=addition_2)
panel = Panel(lng)

# ---- group: ZONE_CORRIGE / ÉTAPE 2
viewer = ParamViewer(addition_2)

# ---- group: ZONE_CORRIGE / AFFICHAGE DU CORRIGÉ
afficher_le_corrigé = BooleanToggle(False)
gate = StreamGate(Stream=lng, Gate=afficher_le_corrigé)  # -> Target0, Target1
reponse_corrige = REPONSE_CORRIGE(gate.Target1)
