# Grasshopper definition A-24_sujet.gh (Grasshopper 1.0.8)

# ---- group: ZONE_SUJET
# Une liste de 10 nombres et une liste de 4 nombres entrent dans une même Addition. Combien de
# résultats sortent ? Affiche le compte dans un Panel, puis explique comment les 6 derniers ont
# été calculés.
dix_valeurs = DIX_VALEURS([12, 68, 34, 91, 7, 55, 80, 23, 46, 99])
quatre_valeurs = QUATRE_VALEURS([1, 2, 3, 4])
reponse = REPONSE()
# A-24 · Correspondance par défaut
# Débutant  —  durée cible 7 min  —  réf. REF-053  —  v0.5-260902
addition = Addition(A=dix_valeurs, B=quatre_valeurs)
