# Grasshopper definition A-25_complet.gh (Grasshopper 1.0.8)

# ---- group: ZONE_SUJET
# Une liste de 10 valeurs et une liste de 4 valeurs vous sont fournies. Produisez d'abord un
# résultat par file — 10 valeurs — puis un résultat par intersection file × niveau — 40 valeurs.
dix_valeurs = DIX_VALEURS([12, 68, 34, 91, 7, 55, 80, 23, 46, 99])
quatre_valeurs = QUATRE_VALEURS([1, 2, 3, 4])
reponse = REPONSE()

# ---- group: ZONE_CORRIGE / DONNÉES FOURNIES (copie)
dix_valeurs_2 = DIX_VALEURS([12, 68, 34, 91, 7, 55, 80, 23, 46, 99])
quatre_valeurs_2 = QUATRE_VALEURS([1, 2, 3, 4])

# ---- group: ZONE_CORRIGE / ÉTAPE 1
# A-25 · Longest List et Cross Reference
# Débutant  —  durée cible 8 min  —  réf. REF-054  —  v0.5-260902
# ▼  CORRIGÉ — à consulter après validation  ▼
# RAPPEL — copie des données fournies dans la zone sujet, afin qu'aucun câble ne relie les deux zones
# ÉTAPE 1 — Longest List complète la liste courte par répétition de son dernier élément
# ÉTAPE 2 — Cross Reference croise chaque élément de A avec chaque élément de B
# RÉSULTAT — tant que l'interrupteur AFFICHER LE CORRIGÉ reste sur faux, la sortie 1 du Stream Gate est
# vide : rien n'apparaît dans Rhino
long = LongestList(ListA=dix_valeurs_2, ListB=quatre_valeurs_2, PaddingMode=2)  # -> ListA, ListB
addition = Addition(A=long.ListA, B=long.ListB)
lng = ListLength(List=addition)
panel = Panel(lng)

# ---- group: ZONE_CORRIGE / ÉTAPE 2
crossref = CrossReference(ListA=dix_valeurs_2, ListB=quatre_valeurs_2, CrossMode=1)  # -> ListA, ListB
addition_2 = Addition(A=crossref.ListA, B=crossref.ListB)
lng_2 = ListLength(List=addition_2)
panel_2 = Panel(lng_2)

# ---- group: ZONE_CORRIGE / AFFICHAGE DU CORRIGÉ
afficher_le_corrigé = BooleanToggle(False)
gate = StreamGate(Stream=lng, Gate=afficher_le_corrigé)  # -> Target0, Target1
reponse_corrige = REPONSE_CORRIGE(gate.Target1)
