# Grasshopper definition A-26_complet.gh (Grasshopper 1.0.8)

# ---- group: ZONE_SUJET
# Deux branches indépendantes du graphe produisent chacune un résultat. Dans quel ordre
# sont-elles évaluées ? Réponds par QCM et justifie en modifiant un seul slider.
entrée_branche_2 = EntréeBranche2([7, 8, 9])
reponse = REPONSE()
# A-26 · Ordre d'évaluation et recalcul
# Débutant  —  durée cible 6 min  —  réf. REF-056, REF-090  —  v0.5-260902
# ▼  CORRIGÉ — à consulter après validation  ▼
# RAPPEL — copie des données fournies dans la zone sujet, afin qu'aucun câble ne relie les deux zones
# ÉTAPE 1 — Modifier un curseur : seule la branche qui en dépend se recalcule
# ÉTAPE 2 — Déplacer un composant ne change rien : l'ordre suit le graphe de dépendances
# RÉGLAGES À POSER À LA MAIN :
# • Activer le widget Profiler (menu Display) pour lire les temps par composant.
# • Réponse attendue : 1 — l'ordre suit les dépendances de données.
# RÉSULTAT — tant que l'interrupteur AFFICHER LE CORRIGÉ reste sur faux, la sortie 1 du Stream Gate est
# vide : rien n'apparaît dans Rhino
entrée_branche_1 = Slider(20, range=0..100)
multiplication = Multiplication(A=entrée_branche_1, B=2)
panel = Panel(multiplication)
multiplication_2 = Multiplication(A=entrée_branche_2, B=3)
panel_2 = Panel(multiplication_2)
reponse_qcm = ValueList({"0 - de gauche a droite sur le canvas": 0, "1 - selon les dependances de donnees": 1, "2 - dans l'ordre de creation des composants": 2, "3 - de haut en bas sur le canvas": 3}, selected=[])

# ---- group: ZONE_CORRIGE / DONNÉES FOURNIES (copie)
entrée_branche_2_2 = EntréeBranche2([7, 8, 9])
entrée_branche_1_2 = Slider(20, range=0..100)
multiplication_3 = Multiplication(A=entrée_branche_1_2, B=2)
multiplication_4 = Multiplication(A=entrée_branche_2_2, B=3)
reponse_qcm_2 = ValueList({"0 - de gauche a droite sur le canvas": 0, "1 - selon les dependances de donnees": 1, "2 - dans l'ordre de creation des composants": 2, "3 - de haut en bas sur le canvas": 3}, selected=[])

# ---- group: ZONE_CORRIGE / ÉTAPE 1
viewer = ParamViewer(multiplication_3)

# ---- group: ZONE_CORRIGE / ÉTAPE 2
viewer_2 = ParamViewer(multiplication_4)

# ---- group: ZONE_CORRIGE / AFFICHAGE DU CORRIGÉ
afficher_le_corrigé = BooleanToggle(False)
gate = StreamGate(Stream=reponse_qcm_2, Gate=afficher_le_corrigé)  # -> Target0, Target1
reponse_corrige = REPONSE_CORRIGE(gate.Target1)
