# Grasshopper definition A-26_sujet.gh (Grasshopper 1.0.8)

# ---- group: ZONE_SUJET
# Deux branches indépendantes du graphe produisent chacune un résultat. Dans quel ordre
# sont-elles évaluées ? Réponds par QCM et justifie en modifiant un seul slider.
entrée_branche_2 = EntréeBranche2([7, 8, 9])
reponse = REPONSE()
# A-26 · Ordre d'évaluation et recalcul
# Débutant  —  durée cible 6 min  —  réf. REF-056, REF-090  —  v0.5-260902
entrée_branche_1 = Slider(20, range=0..100)
multiplication = Multiplication(A=entrée_branche_1, B=2)
panel = Panel(multiplication)
multiplication_2 = Multiplication(A=entrée_branche_2, B=3)
panel_2 = Panel(multiplication_2)
reponse_qcm = ValueList({"0 - de gauche a droite sur le canvas": 0, "1 - selon les dependances de donnees": 1, "2 - dans l'ordre de creation des composants": 2, "3 - de haut en bas sur le canvas": 3}, selected=[])
