# Grasshopper definition A-27_complet.gh (Grasshopper 1.0.8)

# ---- group: ZONE_SUJET
# Les numéros et les longueurs des 5 pièces vous sont fournis dans deux listes. Produisez les
# cinq étiquettes au format « PIECE-01 : 1250 mm », le numéro étant cadré sur deux chiffres.
numeros = NUMEROS([1, 2, 3, 4, 5])
longueurs = LONGUEURS([1250, 880, 1640, 730, 1100])
reponse = REPONSE()

# ---- group: ZONE_CORRIGE / DONNÉES FOURNIES (copie)
numeros_2 = NUMEROS([1, 2, 3, 4, 5])
longueurs_2 = LONGUEURS([1250, 880, 1640, 730, 1100])

# ---- group: ZONE_CORRIGE / ÉTAPE 1
# A-27 · Construire une chaîne de caractères
# Débutant  —  durée cible 6 min  —  réf. REF-057  —  v0.5-260902
# ▼  CORRIGÉ — à consulter après validation  ▼
# RAPPEL — copie des données fournies dans la zone sujet, afin qu'aucun câble ne relie les deux zones
# ÉTAPE 1 — Formater le numéro sur deux chiffres avec le masque {0:00}
# ÉTAPE 2 — Assembler les cinq fragments, en surveillant les espaces
# RÉSULTAT — tant que l'interrupteur AFFICHER LE CORRIGÉ reste sur faux, la sortie 1 du Stream Gate est
# vide : rien n'apparaît dans Rhino
format = Format(Format="{0:00}", Culture=127, Data0=numeros_2)

# ---- group: ZONE_CORRIGE / ÉTAPE 2
concat = Concatenate(FragmentA="PIECE-", FragmentB=format, FragmentC=" : ", FragmentD=longueurs_2, FragmentE=" mm")
panel = Panel(concat)

# ---- group: ZONE_CORRIGE / AFFICHAGE DU CORRIGÉ
afficher_le_corrigé = BooleanToggle(False)
gate = StreamGate(Stream=concat, Gate=afficher_le_corrigé)  # -> Target0, Target1
reponse_corrige = REPONSE_CORRIGE(gate.Target1)
