# Grasshopper definition A-28_complet.gh (Grasshopper 1.0.8)

# ---- group: ZONE_SUJET
# Les références vous sont fournies au format « MEUB-A12-CHENE ». Extrayez le seul code central
# et livrez-le en minuscules.
references = REFERENCES(["MEUB-A12-CHENE", "MEUB-B07-NOYER", "MEUB-C24-FRENE", "MEUB-D03-ERABLE", "MEUB-E18-HETRE", "MEUB-F31-CHENE"])
reponse = REPONSE()

# ---- group: ZONE_CORRIGE / DONNÉES FOURNIES (copie)
references_2 = REFERENCES(["MEUB-A12-CHENE", "MEUB-B07-NOYER", "MEUB-C24-FRENE", "MEUB-D03-ERABLE", "MEUB-E18-HETRE", "MEUB-F31-CHENE"])

# ---- group: ZONE_CORRIGE / ÉTAPE 1
# A-28 · Découper et remplacer du texte
# Débutant  —  durée cible 7 min  —  réf. REF-058  —  v0.5-260902
# ▼  CORRIGÉ — à consulter après validation  ▼
# RAPPEL — copie des données fournies dans la zone sujet, afin qu'aucun câble ne relie les deux zones
# ÉTAPE 1 — Découper sur le tiret : chaque référence donne une branche de trois fragments
# ÉTAPE 2 — Prendre le fragment central de chaque branche
# ÉTAPE 3 — Convertir en minuscules : la sortie L de Text Case
# RÉSULTAT — tant que l'interrupteur AFFICHER LE CORRIGÉ reste sur faux, la sortie 1 du Stream Gate est
# vide : rien n'apparaît dans Rhino
split = TextSplit(Text=references_2, Separators="-")
viewer = ParamViewer(split)

# ---- group: ZONE_CORRIGE / ÉTAPE 2
item = ListItem(List=split, Index=1, Wrap=True)

# ---- group: ZONE_CORRIGE / ÉTAPE 3
case = TextCase(Text=item, Culture=127)  # -> UpperCase, LowerCase
panel = Panel(case.LowerCase)

# ---- group: ZONE_CORRIGE / AFFICHAGE DU CORRIGÉ
afficher_le_corrigé = BooleanToggle(False)
gate = StreamGate(Stream=case.LowerCase, Gate=afficher_le_corrigé)  # -> Target0, Target1
reponse_corrige = REPONSE_CORRIGE(gate.Target1)
