# Grasshopper definition A-29_complet.gh (Grasshopper 1.0.8)

# ---- group: ZONE_SUJET
# Compare les valeurs 0,1 + 0,2 et 0,3 avec Equality. Le résultat est-il True ? Corrige le
# montage pour qu'il le devienne.
reponse = REPONSE()
# A-29 · Comparer deux valeurs
# Débutant  —  durée cible 5 min  —  réf. REF-059  —  v0.5-260902
# ▼  CORRIGÉ — à consulter après validation  ▼
# RAPPEL — copie des données fournies dans la zone sujet, afin qu'aucun câble ne relie les deux zones
# ÉTAPE 1 — Equality renvoie False : deux flottants ne sont jamais strictement égaux
# ÉTAPE 2 — Similarity compare avec une tolérance explicite
# RÉSULTAT — tant que l'interrupteur AFFICHER LE CORRIGÉ reste sur faux, la sortie 1 du Stream Gate est
# vide : rien n'apparaît dans Rhino
A = Slider(0.1, range=0..1)
B = Slider(0.2, range=0..1)
addition = Addition(A=A, B=B)
C = Slider(0.3, range=0..1)
equals = Equality(FirstNumber=addition, SecondNumber=C)  # -> Equality, Inequality

# ---- group: ZONE_CORRIGE / DONNÉES FOURNIES (copie)
A_2 = Slider(0.1, range=0..1)
B_2 = Slider(0.2, range=0..1)
addition_2 = Addition(A=A_2, B=B_2)
C_2 = Slider(0.3, range=0..1)
equals_2 = Equality(FirstNumber=addition_2, SecondNumber=C_2)  # -> Equality, Inequality

# ---- group: ZONE_CORRIGE / ÉTAPE 1
panel = Panel(equals_2.Equality)

# ---- group: ZONE_CORRIGE / ÉTAPE 2
similar = Similarity(FirstNumber=addition_2, SecondNumber=C_2, Threshold=0.001)  # -> Similarity, AbsoluteDifference
panel_2 = Panel(similar.Similarity)

# ---- group: ZONE_CORRIGE / AFFICHAGE DU CORRIGÉ
afficher_le_corrigé = BooleanToggle(False)
gate = StreamGate(Stream=similar.Similarity, Gate=afficher_le_corrigé)  # -> Target0, Target1
reponse_corrige = REPONSE_CORRIGE(gate.Target1)
