# Grasshopper definition A-29_sujet.gh (Grasshopper 1.0.8)

# ---- group: ZONE_SUJET
# Compare les valeurs 0,1 + 0,2 et 0,3 avec Equality. Le résultat est-il True ? Corrige le
# montage pour qu'il le devienne.
reponse = REPONSE()
# A-29 · Comparer deux valeurs
# Débutant  —  durée cible 5 min  —  réf. REF-059  —  v0.5-260902
A = Slider(0.1, range=0..1)
B = Slider(0.2, range=0..1)
addition = Addition(A=A, B=B)
C = Slider(0.3, range=0..1)
equals = Equality(FirstNumber=addition, SecondNumber=C)  # -> Equality, Inequality
