# Grasshopper definition A-30_complet.gh (Grasshopper 1.0.8)

# ---- group: ZONE_SUJET
# Les longueurs des 24 chutes du jour vous sont fournies. Comptez celles qui repartent en stock,
# bornes incluses.
longueurs_chutes = LONGUEURS_CHUTES([1240, 480, 890, 1620, 1075, 500, 1500, 340, 1180, 760, 1550, 620, 1420, 295, 985, 1330, 545, 1710, 830, 1150, 465, 1275, 705, 1505])
reponse = REPONSE()

# ---- group: ZONE_CORRIGE / DONNÉES FOURNIES (copie)
longueurs_chutes_2 = LONGUEURS_CHUTES([1240, 480, 890, 1620, 1075, 500, 1500, 340, 1180, 760, 1550, 620, 1420, 295, 985, 1330, 545, 1710, 830, 1150, 465, 1275, 705, 1505])

# ---- group: ZONE_CORRIGE / ÉTAPE 1
# A-30 · Combiner plusieurs conditions
# Débutant  —  durée cible 7 min  —  réf. REF-060  —  v0.5-260902
# ▼  CORRIGÉ — à consulter après validation  ▼
# RAPPEL — copie des données fournies dans la zone sujet, afin qu'aucun câble ne relie les deux zones
# ÉTAPE 1 — Premier test : la chute atteint-elle la borne basse ? Bornes incluses, il faut un test large
# ÉTAPE 2 — Second test : la chute reste-t-elle sous la borne haute ?
# ÉTAPE 3 — Les deux conditions doivent etre vraies ensemble
# ÉTAPE 4 — Sommer les booleens pour obtenir le nombre de chutes remises en stock
# RÉSULTAT — tant que l'interrupteur AFFICHER LE CORRIGÉ reste sur faux, la sortie 1 du Stream Gate est
# vide : rien n'apparaît dans Rhino
mini = Slider(500, range=0..2000)
larger = LargerThan(FirstNumber=longueurs_chutes_2, SecondNumber=mini)  # -> LargerThan, OrEqualTo

# ---- group: ZONE_CORRIGE / ÉTAPE 2
maxi = Slider(1500, range=0..2000)
smaller = SmallerThan(FirstNumber=longueurs_chutes_2, SecondNumber=maxi)  # -> SmallerThan, OrEqualTo

# ---- group: ZONE_CORRIGE / ÉTAPE 3
and = GateAnd(A=larger.OrEqualTo, B=smaller.OrEqualTo)
panel = Panel(and)

# ---- group: ZONE_CORRIGE / ÉTAPE 4
ma = MassAddition(Input=and)  # -> Result, PartialResults
panel_2 = Panel(ma.Result)

# ---- group: ZONE_CORRIGE / AFFICHAGE DU CORRIGÉ
afficher_le_corrigé = BooleanToggle(False)
gate = StreamGate(Stream=ma.Result, Gate=afficher_le_corrigé)  # -> Target0, Target1
reponse_corrige = REPONSE_CORRIGE(gate.Target1)
