# Grasshopper definition A-31_complet.gh (Grasshopper 1.0.8)

# ---- group: ZONE_SUJET
# Les deux variantes de remplissage sont montées et fonctionnent. Faites en sorte qu'un seul
# interrupteur bascule l'affichage de l'une à l'autre, sans supprimer ni débrancher aucun
# composant.
cercle = CERCLE(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)
carre = CARRE(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)
reponse = REPONSE()
# A-31 · Orienter un flux avec une condition
# Débutant  —  durée cible 7 min  —  réf. REF-061  —  v0.5-260902
# ▼  CORRIGÉ — à consulter après validation  ▼
# RAPPEL — copie des données fournies dans la zone sujet, afin qu'aucun câble ne relie les deux zones
# ÉTAPE 1 — Stream Filter choisit une entrée : le booléen est converti en 0 ou 1
# ÉTAPE 2 — Basculer le toggle et vérifier l'alternance dans la vue
# RÉSULTAT — tant que l'interrupteur AFFICHER LE CORRIGÉ reste sur faux, la sortie 1 du Stream Gate est
# vide : rien n'apparaît dans Rhino
cercle_carré = BooleanToggle(False)

# ---- group: ZONE_CORRIGE / DONNÉES FOURNIES (copie)
cercle_2 = CERCLE(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)
carre_2 = CARRE(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)
cercle_carré_2 = BooleanToggle(False)

# ---- group: ZONE_CORRIGE / ÉTAPE 1
filter = StreamFilter(Gate=cercle_carré_2, Stream0=cercle_2, Stream1=carre_2)

# ---- group: ZONE_CORRIGE / ÉTAPE 2
viewer = ParamViewer(filter)

# ---- group: ZONE_CORRIGE / AFFICHAGE DU CORRIGÉ
afficher_le_corrigé = BooleanToggle(False)
gate = StreamGate(Stream=filter, Gate=afficher_le_corrigé)  # -> Target0, Target1
reponse_corrige = REPONSE_CORRIGE(gate.Target1)
