# Grasshopper definition A-32_complet.gh (Grasshopper 1.0.8)

# ---- group: ZONE_SUJET
# Le tirant part de l'origine et rejoint le point situé à 30 en X et 40 en Y. Construisez sa
# direction, puis produisez un second tirant de même direction mais de 100 unités de long.
origine = ORIGINE(Point(0, 0, 0))
extremite = EXTREMITE(Point(30, 40, 0))
reponse = REPONSE()

# ---- group: ZONE_CORRIGE / DONNÉES FOURNIES (copie)
origine_2 = ORIGINE(Point(0, 0, 0))
extremite_2 = EXTREMITE(Point(30, 40, 0))

# ---- group: ZONE_CORRIGE / ÉTAPE 1
# A-32 · Vecteur, amplitude et direction
# Débutant  —  durée cible 7 min  —  réf. REF-062  —  v0.5-260902
# ▼  CORRIGÉ — à consulter après validation  ▼
# RAPPEL — copie des données fournies dans la zone sujet, afin qu'aucun câble ne relie les deux zones
# ÉTAPE 1 — Le vecteur entre les deux points mesure 50
# ÉTAPE 2 — Amplitude impose une longueur sans changer la direction
# ÉTAPE 3 — Afficher les deux vecteurs pour comparer
# RÉSULTAT — tant que l'interrupteur AFFICHER LE CORRIGÉ reste sur faux, la sortie 1 du Stream Gate est
# vide : rien n'apparaît dans Rhino
vec2pt = Vector2Pt(PointA=origine_2, PointB=extremite_2, Unitize=False)  # -> Vector, Length
vlen = VectorLength(Vector=vec2pt.Vector)
panel = Panel(vlen)

# ---- group: ZONE_CORRIGE / ÉTAPE 2
amp = Amplitude(Vector=vec2pt.Vector, Amplitude=100)

# ---- group: ZONE_CORRIGE / ÉTAPE 3
vdis = VectorDisplay(Anchor=origine_2, Vector=amp)

# ---- group: ZONE_CORRIGE / AFFICHAGE DU CORRIGÉ
afficher_le_corrigé = BooleanToggle(False)
gate = StreamGate(Stream=amp, Gate=afficher_le_corrigé)  # -> Target0, Target1
reponse_corrige = REPONSE_CORRIGE(gate.Target1)
