# Grasshopper definition A-33_complet.gh (Grasshopper 1.0.8)

# ---- group: ZONE_SUJET
# Le percement est circulaire, de 20 de rayon, centré à 50 au-dessus de l'origine, et son plan
# est incliné de 30° autour de l'axe X. Construisez ce tracé.
reponse = REPONSE()

# ---- group: ZONE_CORRIGE / ÉTAPE 1
# A-33 · Plans de construction
# Débutant  —  durée cible 7 min  —  réf. REF-062  —  v0.3-260826
# ▼  CORRIGÉ — à consulter après validation  ▼
# ÉTAPE 1 — Poser l'origine du plan à (0 ; 0 ; 50)
# ÉTAPE 2 — Grasshopper travaille en radians : convertir les 30°
# ÉTAPE 3 — Incliner le plan puis y poser le cercle de rayon 20
# RÉSULTAT — tant que l'interrupteur AFFICHER LE CORRIGÉ reste sur faux, la sortie 1 du Stream Gate est
# vide : rien n'apparaît dans Rhino
pt = ConstructPoint(XCoordinate=0, YCoordinate=0, ZCoordinate=50)
xy = XYPlane(Origin=pt)

# ---- group: ZONE_CORRIGE / ÉTAPE 2
angle = Slider(30, range=0..90)
rad = Radians(Degrees=angle)

# ---- group: ZONE_CORRIGE / ÉTAPE 3
prot = RotatePlane(Plane=xy, Angle=rad)
cir = Circle(Plane=prot, Radius=20)

# ---- group: ZONE_CORRIGE / AFFICHAGE DU CORRIGÉ
afficher_le_corrigé = BooleanToggle(False)
gate = StreamGate(Stream=cir, Gate=afficher_le_corrigé)  # -> Target0, Target1
reponse_corrige = REPONSE_CORRIGE(gate.Target1)
