# Grasshopper definition A-34_complet.gh (Grasshopper 1.0.8)

# ---- group: ZONE_SUJET
# Le fourreau a 40 de rayon. Construisez la section hexagonale inscrite dans ce fourreau, ainsi
# que le carré de coffrage circonscrit au même fourreau.
reponse = REPONSE()

# ---- group: ZONE_CORRIGE / ÉTAPE 1
# A-34 · Primitives filaires
# Débutant  —  durée cible 8 min  —  réf. REF-063  —  v0.3-260826
# ▼  CORRIGÉ — à consulter après validation  ▼
# ÉTAPE 1 — Polygon attend un nombre de côtés, ici 6, et un rayon de 40
# ÉTAPE 2 — Rectangle attend deux domaines centrés, et non une largeur
# ÉTAPE 3 — Le rectangle est tangent au cercle circonscrit à l'hexagone
# RÉSULTAT — tant que l'interrupteur AFFICHER LE CORRIGÉ reste sur faux, la sortie 1 du Stream Gate est
# vide : rien n'apparaît dans Rhino
polygon = Polygon(Plane=PlaneXY(0, 0, 0), Radius=40, Segments=6, FilletRadius=0)  # -> Polygon, Length

# ---- group: ZONE_CORRIGE / ÉTAPE 2
dom = ConstructDomain(DomainStart=-40, DomainEnd=40)
rectangle = Rectangle(Plane=PlaneXY(0, 0, 0), XSize=dom, YSize=dom, Radius=0)  # -> Rectangle, Length

# ---- group: ZONE_CORRIGE / ÉTAPE 3
merge = Merge(Data1=polygon.Polygon, Data2=rectangle.Rectangle)

# ---- group: ZONE_CORRIGE / AFFICHAGE DU CORRIGÉ
afficher_le_corrigé = BooleanToggle(False)
gate = StreamGate(Stream=merge, Gate=afficher_le_corrigé)  # -> Target0, Target1
reponse_corrige = REPONSE_CORRIGE(gate.Target1)
