# Grasshopper definition A-35_complet.gh (Grasshopper 1.0.8)

# ---- group: ZONE_SUJET
# Le tracé du conduit vous est fourni. Placez 12 colliers de 5 de rayon, régulièrement espacés le
# long du tracé et perpendiculaires à celui-ci en chaque point.
courbe = COURBE(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)
reponse = REPONSE()

# ---- group: ZONE_CORRIGE / DONNÉES FOURNIES (copie)
courbe_2 = COURBE(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)

# ---- group: ZONE_CORRIGE / ÉTAPE 1
# A-35 · Diviser et évaluer une courbe
# Débutant  —  durée cible 8 min  —  réf. REF-064  —  v0.5-260902
# ▼  CORRIGÉ — à consulter après validation  ▼
# RAPPEL — copie des données fournies dans la zone sujet, afin qu'aucun câble ne relie les deux zones
# ÉTAPE 1 — Sur une courbe ouverte, 11 divisions donnent 12 points
# ÉTAPE 2 — Perp Frames fournit directement les plans perpendiculaires
# ÉTAPE 3 — Poser un cercle de rayon 5 dans chacun de ces plans
# RÉSULTAT — tant que l'interrupteur AFFICHER LE CORRIGÉ reste sur faux, la sortie 1 du Stream Gate est
# vide : rien n'apparaît dans Rhino
divide = DivideCurve(Curve=courbe_2, Count=11, Kinks=False)  # -> Points, Tangents, Parameters

# ---- group: ZONE_CORRIGE / ÉTAPE 2
pframes = PerpFrames(Curve=courbe_2, Count=11, Align=True)  # -> Frames, Parameters

# ---- group: ZONE_CORRIGE / ÉTAPE 3
cir = Circle(Plane=pframes.Frames, Radius=5)

# ---- group: ZONE_CORRIGE / AFFICHAGE DU CORRIGÉ
afficher_le_corrigé = BooleanToggle(False)
gate = StreamGate(Stream=cir, Gate=afficher_le_corrigé)  # -> Target0, Target1
reponse_corrige = REPONSE_CORRIGE(gate.Target1)
