# Grasshopper definition A-36_complet.gh (Grasshopper 1.0.8)

# ---- group: ZONE_SUJET
# Six points vous sont fournis. Tracez la courbe qui passe exactement par chacun d'eux, puis
# celle qui ne fait que s'en approcher en les prenant pour points de commande. Superposez les
# deux.
points = POINTS([Point(0, 0, 0), Point(120, 90, 0), Point(260, -50, 0), Point(390, 70, 0), Point(520, -20, 0), Point(640, 40, 0)])
reponse = REPONSE()

# ---- group: ZONE_CORRIGE / DONNÉES FOURNIES (copie)
points_2 = POINTS([Point(0, 0, 0), Point(120, 90, 0), Point(260, -50, 0), Point(390, 70, 0), Point(520, -20, 0), Point(640, 40, 0)])

# ---- group: ZONE_CORRIGE / ÉTAPE 1
# A-36 · Courbes passant par des points
# Débutant  —  durée cible 7 min  —  réf. REF-063  —  v0.5-260902
# ▼  CORRIGÉ — à consulter après validation  ▼
# RAPPEL — copie des données fournies dans la zone sujet, afin qu'aucun câble ne relie les deux zones
# ÉTAPE 1 — Interpolate : la courbe passe exactement par les points
# ÉTAPE 2 — Nurbs Curve : les points deviennent des points de contrôle
# ÉTAPE 3 — Superposer les deux tracés pour comparer
# RÉSULTAT — tant que l'interrupteur AFFICHER LE CORRIGÉ reste sur faux, la sortie 1 du Stream Gate est
# vide : rien n'apparaît dans Rhino
intcrv = Interpolate(Vertices=points_2, Degree=3, Periodic=False, KnotStyle=1)  # -> Curve, Length, Domain

# ---- group: ZONE_CORRIGE / ÉTAPE 2
nurbs = NurbsCurve(Vertices=points_2, Degree=3, Periodic=False)  # -> Curve, Length, Domain

# ---- group: ZONE_CORRIGE / ÉTAPE 3
merge = Merge(Data1=intcrv.Curve, Data2=nurbs.Curve)

# ---- group: ZONE_CORRIGE / AFFICHAGE DU CORRIGÉ
afficher_le_corrigé = BooleanToggle(False)
gate = StreamGate(Stream=intcrv.Curve, Gate=afficher_le_corrigé)  # -> Target0, Target1
reponse_corrige = REPONSE_CORRIGE(gate.Target1)
