# Grasshopper definition A-37_complet.gh (Grasshopper 1.0.8)

# ---- group: ZONE_SUJET
# L'entretoise de base vous est fournie. Remontez-la de 120 mm, puis produisez cinq entretoises
# supplémentaires échelonnées tous les 24 mm au-dessus d'elle, sans employer de composant de
# réseau.
cercle = CERCLE(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)
reponse = REPONSE()

# ---- group: ZONE_CORRIGE / DONNÉES FOURNIES (copie)
cercle_2 = CERCLE(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)

# ---- group: ZONE_CORRIGE / ÉTAPE 1
# A-37 · Déplacer par un vecteur
# Débutant  —  durée cible 5 min  —  réf. REF-067  —  v0.5-260902
# ▼  CORRIGÉ — à consulter après validation  ▼
# RAPPEL — copie des données fournies dans la zone sujet, afin qu'aucun câble ne relie les deux zones
# ÉTAPE 1 — Une série de six hauteurs, de 0 à 120 par pas de 24
# ÉTAPE 2 — Unit Z multiplié par chaque hauteur donne une liste de vecteurs
# ÉTAPE 3 — Une liste de vecteurs sur l'entrée T produit une liste de résultats
# RÉSULTAT — tant que l'interrupteur AFFICHER LE CORRIGÉ reste sur faux, la sortie 1 du Stream Gate est
# vide : rien n'apparaît dans Rhino
series = Series(Start=0, Step=24, Count=6)

# ---- group: ZONE_CORRIGE / ÉTAPE 2
Z = UnitZ(Factor=series)

# ---- group: ZONE_CORRIGE / ÉTAPE 3
move = Move(Geometry=cercle_2, Motion=Z)  # -> Geometry, Transform

# ---- group: ZONE_CORRIGE / AFFICHAGE DU CORRIGÉ
afficher_le_corrigé = BooleanToggle(False)
gate = StreamGate(Stream=move.Geometry, Gate=afficher_le_corrigé)  # -> Target0, Target1
reponse_corrige = REPONSE_CORRIGE(gate.Target1)
