# Grasshopper definition A-38_complet.gh (Grasshopper 1.0.8)

# ---- group: ZONE_SUJET
# Le profil vous est fourni. Faites-le tourner de 45° autour de l'axe vertical passant par
# l'origine, puis produisez sa version symétrique par rapport au plan vertical contenant l'axe X.
profil = PROFIL(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)
reponse = REPONSE()

# ---- group: ZONE_CORRIGE / DONNÉES FOURNIES (copie)
profil_2 = PROFIL(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)

# ---- group: ZONE_CORRIGE / ÉTAPE 1
# A-38 · Rotation et symétrie
# Débutant  —  durée cible 7 min  —  réf. REF-067  —  v0.3-260826
# ▼  CORRIGÉ — à consulter après validation  ▼
# RAPPEL — copie des données fournies dans la zone sujet, afin qu'aucun câble ne relie les deux zones
# ÉTAPE 1 — Convertir 45° en radians avant de tourner
# ÉTAPE 2 — Rotation autour de l'axe Z passant par l'origine
# ÉTAPE 3 — Le plan de symétrie de Mirror est un plan, pas un axe
# RÉSULTAT — tant que l'interrupteur AFFICHER LE CORRIGÉ reste sur faux, la sortie 1 du Stream Gate est
# vide : rien n'apparaît dans Rhino
angle = Slider(45, range=0..180)
rad = Radians(Degrees=angle)

# ---- group: ZONE_CORRIGE / ÉTAPE 2
rotate = Rotate(Geometry=profil_2, Angle=rad, Plane=PlaneXY(0, 0, 0))  # -> Geometry, Transform

# ---- group: ZONE_CORRIGE / ÉTAPE 3
xz = XZPlane(Origin=Point(0, 0, 0))
mirror = Mirror(Geometry=rotate.Geometry, Plane=xz)  # -> Geometry, Transform

# ---- group: ZONE_CORRIGE / AFFICHAGE DU CORRIGÉ
afficher_le_corrigé = BooleanToggle(False)
gate = StreamGate(Stream=mirror.Geometry, Gate=afficher_le_corrigé)  # -> Target0, Target1
reponse_corrige = REPONSE_CORRIGE(gate.Target1)
