# Grasshopper definition A-39_complet.gh (Grasshopper 1.0.8)

# ---- group: ZONE_SUJET
# Le module vous est fourni. Produisez la trame de 5 modules en largeur et 4 en hauteur, espacés
# de 600 mm et 400 mm, puis la couronne de 12 modules répartis sur un tour complet.
module = MODULE(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)
reponse = REPONSE()

# ---- group: ZONE_CORRIGE / DONNÉES FOURNIES (copie)
module_2 = MODULE(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)

# ---- group: ZONE_CORRIGE / ÉTAPE 1
# A-39 · Réseaux rectangulaire et polaire
# Débutant  —  durée cible 8 min  —  réf. REF-068  —  v0.5-260902
# ▼  CORRIGÉ — à consulter après validation  ▼
# RAPPEL — copie des données fournies dans la zone sujet, afin qu'aucun câble ne relie les deux zones
# ÉTAPE 1 — La cellule du réseau est une boîte : 600 x 400 correspond à des demi-cotes de 300 et 200
# ÉTAPE 2 — Réseau rectangulaire 5 x 4 : la sortie est un arbre, pas une liste plate
# ÉTAPE 3 — Réseau polaire : 12 copies sur 2 pi radians
# RÉSULTAT — tant que l'interrupteur AFFICHER LE CORRIGÉ reste sur faux, la sortie 1 du Stream Gate est
# vide : rien n'apparaît dans Rhino
box = CenterBox(Base=PlaneXY(0, 0, 0), X=300, Y=200, Z=0.5)

# ---- group: ZONE_CORRIGE / ÉTAPE 2
arrrec = RectangularArray(Geometry=module_2, Cell=box, XCount=5, YCount=4)  # -> Geometry, Transform
viewer = ParamViewer(arrrec.Geometry)

# ---- group: ZONE_CORRIGE / ÉTAPE 3
arrpolar = PolarArray(Geometry=module_2, Plane=PlaneXY(0, 0, 0), Count=12, Angle=6.283185307)  # -> Geometry, Transform

# ---- group: ZONE_CORRIGE / AFFICHAGE DU CORRIGÉ
afficher_le_corrigé = BooleanToggle(False)
gate = StreamGate(Stream=arrrec.Geometry, Gate=afficher_le_corrigé)  # -> Target0, Target1
reponse_corrige = REPONSE_CORRIGE(gate.Target1)
