# Grasshopper definition A-40_complet.gh (Grasshopper 1.0.8)

# ---- group: ZONE_SUJET
# Le profil vous est fourni. Produisez d'abord une version réduite à 60 % autour de son propre
# centre de gravité, puis une version deux fois plus haute dont la largeur reste inchangée.
profil = PROFIL(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)
reponse = REPONSE()

# ---- group: ZONE_CORRIGE / DONNÉES FOURNIES (copie)
profil_2 = PROFIL(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)

# ---- group: ZONE_CORRIGE / ÉTAPE 1
# A-40 · Mise à l'échelle
# Débutant  —  durée cible 6 min  —  réf. REF-067  —  v0.5-260902
# ▼  CORRIGÉ — à consulter après validation  ▼
# RAPPEL — copie des données fournies dans la zone sujet, afin qu'aucun câble ne relie les deux zones
# ÉTAPE 1 — Area fournit le centroïde : Scale utiliserait sinon l'origine du repère
# ÉTAPE 2 — Échelle uniforme à 60 %, centrée sur le centre de gravité
# ÉTAPE 3 — Échelle non uniforme : deux fois plus haut, largeur inchangée
# RÉSULTAT — tant que l'interrupteur AFFICHER LE CORRIGÉ reste sur faux, la sortie 1 du Stream Gate est
# vide : rien n'apparaît dans Rhino
area = Area(Geometry=profil_2)  # -> Area, Centroid

# ---- group: ZONE_CORRIGE / ÉTAPE 2
scale = Scale(Geometry=profil_2, Center=area.Centroid, Factor=0.6)

# ---- group: ZONE_CORRIGE / ÉTAPE 3
xy = XYPlane(Origin=Point(0, 0, 0))
scale_nu = ScaleNU(Geometry=profil_2, Plane=xy, ScaleX=1, ScaleY=2, ScaleZ=1)  # -> Geometry, Transform

# ---- group: ZONE_CORRIGE / AFFICHAGE DU CORRIGÉ
afficher_le_corrigé = BooleanToggle(False)
gate = StreamGate(Stream=scale, Gate=afficher_le_corrigé)  # -> Target0, Target1
reponse_corrige = REPONSE_CORRIGE(gate.Target1)
