# Grasshopper definition A-41_complet.gh (Grasshopper 1.0.8)

# ---- group: ZONE_SUJET
# Deux profils fermés superposés vous sont fournis. Produisez la surface de transition qui les
# relie, puis, séparément, la surface obtenue en poussant le profil du bas de 200 mm vers le
# haut. Comparez les deux.
profils = PROFILS([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])
reponse = REPONSE()

# ---- group: ZONE_CORRIGE / DONNÉES FOURNIES (copie)
profils_2 = PROFILS([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])

# ---- group: ZONE_CORRIGE / ÉTAPE 1
# A-41 · Extrusion et surface réglée
# Débutant  —  durée cible 8 min  —  réf. REF-069  —  v0.5-260902
# ▼  CORRIGÉ — à consulter après validation  ▼
# RAPPEL — copie des données fournies dans la zone sujet, afin qu'aucun câble ne relie les deux zones
# ÉTAPE 1 — Loft relie les deux profils : l'ordre de branchement compte
# ÉTAPE 2 — Extrude attend un vecteur, pas une distance
# ÉTAPE 3 — Loft suit les deux profils, Extrude conserve la section constante
# RÉSULTAT — tant que l'interrupteur AFFICHER LE CORRIGÉ reste sur faux, la sortie 1 du Stream Gate est
# vide : rien n'apparaît dans Rhino
loft = Loft(Curves=profils_2, Options={Adjust=False, Closed=False, LoftEnds=0, LoftSimp=0, LoftType=0, Rebuild=10, Refit=0.01})

# ---- group: ZONE_CORRIGE / ÉTAPE 2
item = ListItem(List=profils_2, Index=0, Wrap=True)
hauteur_mm = Slider(200, range=0..500)
Z = UnitZ(Factor=hauteur_mm)

# ---- group: ZONE_CORRIGE / ÉTAPE 3
extr = Extrude(Base=item, Direction=Z)

# ---- group: ZONE_CORRIGE / AFFICHAGE DU CORRIGÉ
afficher_le_corrigé = BooleanToggle(False)
gate = StreamGate(Stream=loft, Gate=afficher_le_corrigé)  # -> Target0, Target1
reponse_corrige = REPONSE_CORRIGE(gate.Target1)
