# Grasshopper definition A-42_complet.gh (Grasshopper 1.0.8)

# ---- group: ZONE_SUJET
# Le profil circulaire et son guide vous sont fournis, ainsi qu'un profil plan. Engendrez le tube
# en promenant le profil circulaire le long du guide, puis le fût en faisant tourner le profil
# plan autour de l'axe vertical.
courbe_guide = COURBE_GUIDE(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)
profil_circulaire = PROFIL_CIRCULAIRE(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)
profil_vase = PROFIL_VASE(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)
reponse = REPONSE()

# ---- group: ZONE_CORRIGE / DONNÉES FOURNIES (copie)
courbe_guide_2 = COURBE_GUIDE(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)
profil_circulaire_2 = PROFIL_CIRCULAIRE(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)
profil_vase_2 = PROFIL_VASE(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)

# ---- group: ZONE_CORRIGE / ÉTAPE 3
axe_z = AXE_Z(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)
# A-42 · Balayage et révolution
# Débutant  —  durée cible 8 min  —  réf. REF-069  —  v0.5-260902
# ▼  CORRIGÉ — à consulter après validation  ▼
# RAPPEL — copie des données fournies dans la zone sujet, afin qu'aucun câble ne relie les deux zones
# ÉTAPE 1 — Balayage : le profil doit être perpendiculaire au rail
# ÉTAPE 2 — Sweep1 le long de la courbe guide
# ÉTAPE 3 — Révolution du profil plan : le domaine complet ferme le vase
# RÉSULTAT — tant que l'interrupteur AFFICHER LE CORRIGÉ reste sur faux, la sortie 1 du Stream Gate est
# vide : rien n'apparaît dans Rhino
dom = ConstructDomain(DomainStart=0, DomainEnd=6.283185307)
revsrf = Revolution(Curve=profil_vase_2, Axis=axe_z, Domain=dom)

# ---- group: ZONE_CORRIGE / ÉTAPE 1
pframes = PerpFrames(Curve=courbe_guide_2, Count=1, Align=True)  # -> Frames, Parameters
xy = XYPlane(Origin=Point(0, 0, 0))
orient = Orient(Geometry=profil_circulaire_2, Initial=xy, Final=pframes.Frames)

# ---- group: ZONE_CORRIGE / ÉTAPE 2
swp1 = Sweep1(Rail=courbe_guide_2, Sections=orient, Miter=1)

# ---- group: ZONE_CORRIGE / AFFICHAGE DU CORRIGÉ
afficher_le_corrigé = BooleanToggle(False)
gate = StreamGate(Stream=swp1, Gate=afficher_le_corrigé)  # -> Target0, Target1
reponse_corrige = REPONSE_CORRIGE(gate.Target1)
