# Grasshopper definition A-43_complet.gh (Grasshopper 1.0.8)

# ---- group: ZONE_SUJET
# L'enveloppe fournie présente deux ouvertures. Refermez-la, puis établissez par une valeur
# numérique qu'elle est désormais un solide.
polysurface_ouverte = POLYSURFACE_OUVERTE(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)
reponse = REPONSE()

# ---- group: ZONE_CORRIGE / DONNÉES FOURNIES (copie)
polysurface_ouverte_2 = POLYSURFACE_OUVERTE(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)

# ---- group: ZONE_CORRIGE / ÉTAPE 1
# A-43 · Fermer une polysurface en solide
# Débutant  —  durée cible 7 min  —  réf. REF-070  —  v0.5-260902
# ▼  CORRIGÉ — à consulter après validation  ▼
# RAPPEL — copie des données fournies dans la zone sujet, afin qu'aucun câble ne relie les deux zones
# ÉTAPE 1 — Refermer les ouvertures planes
# ÉTAPE 2 — Le volume EST la preuve : une enveloppe ouverte n'en a pas. Inutile de le traduire en booleen —
# le controle compare des nombres, et un booleen brancherait dans le vide.
# RÉSULTAT — tant que l'interrupteur AFFICHER LE CORRIGÉ reste sur faux, la sortie 1 du Stream Gate est
# vide : rien n'apparaît dans Rhino
cap = CapHoles(Brep=polysurface_ouverte_2)

# ---- group: ZONE_CORRIGE / ÉTAPE 2
volume = Volume(Geometry=cap)  # -> Volume, Centroid
panel = Panel(volume.Volume)

# ---- group: ZONE_CORRIGE / AFFICHAGE DU CORRIGÉ
afficher_le_corrigé = BooleanToggle(False)
gate = StreamGate(Stream=volume.Volume, Gate=afficher_le_corrigé)  # -> Target0, Target1
reponse_corrige = REPONSE_CORRIGE(gate.Target1)
