# Grasshopper definition A-44_complet.gh (Grasshopper 1.0.8)

# ---- group: ZONE_SUJET
# La platine vous est fournie. Percez-la de quatre trous traversants de 20 mm de diamètre, puis
# donnez le volume de matière retirée.
bloc = BLOC(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)
cylindres = CYLINDRES([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])
reponse = REPONSE()

# ---- group: ZONE_CORRIGE / DONNÉES FOURNIES (copie)
bloc_2 = BLOC(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)
cylindres_2 = CYLINDRES([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])

# ---- group: ZONE_CORRIGE / ÉTAPE 1
# A-44 · Opérations booléennes
# Débutant  —  durée cible 8 min  —  réf. REF-071  —  v0.3-260826
# ▼  CORRIGÉ — à consulter après validation  ▼
# RAPPEL — copie des données fournies dans la zone sujet, afin qu'aucun câble ne relie les deux zones
# ÉTAPE 1 — Solid Difference : le bloc sur A, les cylindres sur B
# ÉTAPE 2 — Mesurer le volume avant et après perçage
# ÉTAPE 3 — La différence donne le volume de matière retirée
# RÉSULTAT — tant que l'interrupteur AFFICHER LE CORRIGÉ reste sur faux, la sortie 1 du Stream Gate est
# vide : rien n'apparaît dans Rhino
sdiff = SolidDifference(BrepsA=bloc_2, BrepsB=cylindres_2)

# ---- group: ZONE_CORRIGE / ÉTAPE 2
volume = Volume(Geometry=bloc_2)  # -> Volume, Centroid
volume_2 = Volume(Geometry=sdiff)  # -> Volume, Centroid

# ---- group: ZONE_CORRIGE / ÉTAPE 3
subtraction = Subtraction(A=volume.Volume, B=volume_2.Volume)
panel = Panel(subtraction)

# ---- group: ZONE_CORRIGE / AFFICHAGE DU CORRIGÉ
afficher_le_corrigé = BooleanToggle(False)
gate = StreamGate(Stream=subtraction, Gate=afficher_le_corrigé)  # -> Target0, Target1
reponse_corrige = REPONSE_CORRIGE(gate.Target1)
