# Grasshopper definition A-45_complet.gh (Grasshopper 1.0.8)

# ---- group: ZONE_SUJET
# Le solide vous est fourni. Établissez son contour de coupe à mi-hauteur et donnez le linéaire
# total de ce contour.
solide = SOLIDE(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)
reponse = REPONSE()

# ---- group: ZONE_CORRIGE / DONNÉES FOURNIES (copie)
solide_2 = SOLIDE(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)

# ---- group: ZONE_CORRIGE / ÉTAPE 1
# A-45 · Intersections entre géométries
# Débutant  —  durée cible 7 min  —  réf. REF-071  —  v0.5-260902
# ▼  CORRIGÉ — à consulter après validation  ▼
# RAPPEL — copie des données fournies dans la zone sujet, afin qu'aucun câble ne relie les deux zones
# ÉTAPE 1 — Le centroïde donne directement la mi-hauteur
# ÉTAPE 2 — Couper le solide par ce plan et récupérer les courbes de coupe
# ÉTAPE 3 — Additionner les longueurs de tous les contours obtenus
# RÉSULTAT — tant que l'interrupteur AFFICHER LE CORRIGÉ reste sur faux, la sortie 1 du Stream Gate est
# vide : rien n'apparaît dans Rhino
volume = Volume(Geometry=solide_2)  # -> Volume, Centroid
xy = XYPlane(Origin=volume.Centroid)

# ---- group: ZONE_CORRIGE / ÉTAPE 2
sec = BrepPlane(Brep=solide_2, Plane=xy)  # -> Curves, Points

# ---- group: ZONE_CORRIGE / ÉTAPE 3
len = Length(Curve=sec.Curves)
ma = MassAddition(Input=len)  # -> Result, PartialResults
panel = Panel(ma.Result)

# ---- group: ZONE_CORRIGE / AFFICHAGE DU CORRIGÉ
afficher_le_corrigé = BooleanToggle(False)
gate = StreamGate(Stream=ma.Result, Gate=afficher_le_corrigé)  # -> Target0, Target1
reponse_corrige = REPONSE_CORRIGE(gate.Target1)
