# Grasshopper definition A-46_complet.gh (Grasshopper 1.0.8)

# ---- group: ZONE_SUJET
# Quinze blocs sont disposés autour du gabarit de passage fourni. Indiquez combien d'entre eux
# empiètent sur ce gabarit.
blocs = BLOCS([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])
gabarit = GABARIT(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)
reponse = REPONSE()

# ---- group: ZONE_CORRIGE / DONNÉES FOURNIES (copie)
blocs_2 = BLOCS([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])
gabarit_2 = GABARIT(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)

# ---- group: ZONE_CORRIGE / ÉTAPE 1
# A-46 · Détecter une collision
# Débutant  —  durée cible 7 min  —  réf. REF-072  —  v0.5-260902
# ▼  CORRIGÉ — à consulter après validation  ▼
# RAPPEL — copie des données fournies dans la zone sujet, afin qu'aucun câble ne relie les deux zones
# ÉTAPE 1 — Inverser les rôles : les blocs sur Collider, le gabarit sur Obstacles
# ÉTAPE 2 — Grafter l'entrée Collider : chaque bloc, seul dans sa branche, obtient son propre booléen. Sans
# graft on n'aurait qu'un booléen global.
# ÉTAPE 3 — Afficher les blocs en collision dans une couleur distincte
# RÉGLAGES À POSER À LA MAIN :
# • Colour Swatch : régler la couleur sur rouge par double-clic.
# RÉSULTAT — tant que l'interrupteur AFFICHER LE CORRIGÉ reste sur faux, la sortie 1 du Stream Gate est
# vide : rien n'apparaît dans Rhino
colom = CollisionOneMany(Collider=graft(blocs_2), Obstacles=gabarit_2)  # -> Collision, Index

# ---- group: ZONE_CORRIGE / ÉTAPE 2
flatten = FlattenTree(Tree=colom.Collision, Path="{0}")
dispatch = Dispatch(List=blocs_2, DispatchPattern=flatten)  # -> ListA, ListB

# ---- group: ZONE_CORRIGE / ÉTAPE 3
preview = CustomPreview(Geometry=dispatch.ListA, Material=ColourSwatch(SwatchColor=RGB(255, 255, 255)))

# ---- group: ZONE_CORRIGE / AFFICHAGE DU CORRIGÉ
afficher_le_corrigé = BooleanToggle(False)
gate = StreamGate(Stream=dispatch.ListA, Gate=afficher_le_corrigé)  # -> Target0, Target1
reponse_corrige = REPONSE_CORRIGE(gate.Target1)
