# Grasshopper definition A-47_complet.gh (Grasshopper 1.0.8)

# ---- group: ZONE_SUJET
# L'assemblage vous est fourni. Donnez, dans cet ordre, le linéaire total des arêtes, la surface
# développée et le volume.
assemblage = ASSEMBLAGE(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)
reponse = REPONSE()

# ---- group: ZONE_CORRIGE / DONNÉES FOURNIES (copie)
assemblage_2 = ASSEMBLAGE(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)

# ---- group: ZONE_CORRIGE / ÉTAPE 1
# A-47 · Longueur, aire et volume
# Débutant  —  durée cible 6 min  —  réf. REF-079  —  v0.3-260826
# ▼  CORRIGÉ — à consulter après validation  ▼
# RAPPEL — copie des données fournies dans la zone sujet, afin qu'aucun câble ne relie les deux zones
# ÉTAPE 1 — Deconstruct Brep sépare faces, arêtes et sommets
# ÉTAPE 2 — Développé des arêtes : mesurer puis sommer
# ÉTAPE 3 — Sur un Brep fermé, Area renvoie déjà la surface totale
# ÉTAPE 4 — Assembler les trois valeurs dans l'ordre demandé
# RÉSULTAT — tant que l'interrupteur AFFICHER LE CORRIGÉ reste sur faux, la sortie 1 du Stream Gate est
# vide : rien n'apparaît dans Rhino
debrep = DeconstructBrep(Brep=assemblage_2)  # -> Faces, Edges, Vertices

# ---- group: ZONE_CORRIGE / ÉTAPE 2
len = Length(Curve=debrep.Edges)
ma = MassAddition(Input=len)  # -> Result, PartialResults

# ---- group: ZONE_CORRIGE / ÉTAPE 3
area = Area(Geometry=assemblage_2)  # -> Area, Centroid
volume = Volume(Geometry=assemblage_2)  # -> Volume, Centroid

# ---- group: ZONE_CORRIGE / ÉTAPE 4
merge = Merge(Data1=ma.Result, Data2=area.Area)
merge_2 = Merge(Data1=merge, Data2=volume.Volume)
panel = Panel(merge_2)

# ---- group: ZONE_CORRIGE / AFFICHAGE DU CORRIGÉ
afficher_le_corrigé = BooleanToggle(False)
gate = StreamGate(Stream=merge_2, Gate=afficher_le_corrigé)  # -> Target0, Target1
reponse_corrige = REPONSE_CORRIGE(gate.Target1)
