# Grasshopper definition A-48_complet.gh (Grasshopper 1.0.8)

# ---- group: ZONE_SUJET
# Le tracé vous est fourni. Localisez son point le plus serré et donnez le rayon de cintrage à
# cet endroit.
courbe = COURBE(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)
reponse = REPONSE()

# ---- group: ZONE_CORRIGE / DONNÉES FOURNIES (copie)
courbe_2 = COURBE(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)

# ---- group: ZONE_CORRIGE / ÉTAPE 1
# A-48 · Courbure et point le plus proche
# Débutant  —  durée cible 7 min  —  réf. REF-080  —  v0.5-260902
# ▼  CORRIGÉ — à consulter après validation  ▼
# RAPPEL — copie des données fournies dans la zone sujet, afin qu'aucun câble ne relie les deux zones
# ÉTAPE 1 — Échantillonner finement : 200 divisions
# ÉTAPE 2 — Curvature renvoie le vecteur de courbure en chaque paramètre
# ÉTAPE 3 — Prendre la courbure maximale, puis son inverse : le rayon
# RÉGLAGES À POSER À LA MAIN :
# • Remplacer le second Bounds par un Deconstruct Domain si le nom diffère : on cherche la borne haute du
# domaine des courbures.
# RÉSULTAT — tant que l'interrupteur AFFICHER LE CORRIGÉ reste sur faux, la sortie 1 du Stream Gate est
# vide : rien n'apparaît dans Rhino
divide = DivideCurve(Curve=courbe_2, Count=200, Kinks=False)  # -> Points, Tangents, Parameters

# ---- group: ZONE_CORRIGE / ÉTAPE 2
curvature = Curvature(Curve=courbe_2, Parameter=divide.Parameters)  # -> P, K, C
vlen = VectorLength(Vector=curvature.K)

# ---- group: ZONE_CORRIGE / ÉTAPE 3
bnd = Bounds(Numbers=vlen)
bnd_2 = Bounds(Numbers=bnd)
division = Division(A=1, B=bnd_2)
panel = Panel(division)

# ---- group: ZONE_CORRIGE / AFFICHAGE DU CORRIGÉ
afficher_le_corrigé = BooleanToggle(False)
gate = StreamGate(Stream=division, Gate=afficher_le_corrigé)  # -> Target0, Target1
reponse_corrige = REPONSE_CORRIGE(gate.Target1)
