# Grasshopper definition A-49_complet.gh (Grasshopper 1.0.8)

# ---- group: ZONE_SUJET
# Six pièces vous sont fournies. Placez au centre de gravité de chacune une étiquette portant son
# numéro.
pieces = PIECES([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])
reponse = REPONSE()

# ---- group: ZONE_CORRIGE / DONNÉES FOURNIES (copie)
pieces_2 = PIECES([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])

# ---- group: ZONE_CORRIGE / ÉTAPE 1
# A-49 · Centre de gravité
# Débutant  —  durée cible 6 min  —  réf. REF-081  —  v0.3-260826
# ▼  CORRIGÉ — à consulter après validation  ▼
# RAPPEL — copie des données fournies dans la zone sujet, afin qu'aucun câble ne relie les deux zones
# ÉTAPE 1 — La sortie C de Volume donne le centroïde volumique de chaque pièce
# ÉTAPE 2 — Générer les numéros de 1 à 6 et les formater sur deux chiffres
# ÉTAPE 3 — Poser l'étiquette au centre de gravité de chaque pièce
# RÉSULTAT — tant que l'interrupteur AFFICHER LE CORRIGÉ reste sur faux, la sortie 1 du Stream Gate est
# vide : rien n'apparaît dans Rhino
volume = Volume(Geometry=pieces_2)  # -> Volume, Centroid

# ---- group: ZONE_CORRIGE / ÉTAPE 2
series = Series(Start=1, Step=1, Count=6)
format = Format(Format="{0:00}", Culture=127, Data0=series)

# ---- group: ZONE_CORRIGE / ÉTAPE 3
tag = TextTag3D(Location=volume.Centroid, Text=format, Size=12, Justification=7)

# ---- group: ZONE_CORRIGE / AFFICHAGE DU CORRIGÉ
afficher_le_corrigé = BooleanToggle(False)
gate = StreamGate(Stream=volume.Centroid, Gate=afficher_le_corrigé)  # -> Target0, Target1
reponse_corrige = REPONSE_CORRIGE(gate.Target1)
