# Grasshopper definition A-50_complet.gh (Grasshopper 1.0.8)

# ---- group: ZONE_SUJET
# Les vingt libellés vous sont fournis tels qu'ils ont été saisis. Donnez le nombre de références
# réellement distinctes.
libelles_saisis = LIBELLES_SAISIS([" MEL-19 ", "mel-19", "MEL-19", "CP-18", " cp-18", "CP-18 ", "MDF-22", "mdf-22 ", " MDF-22", "MAS-27", "mas-27", "MAS-27 ", "CP-12", " cp-12 ", "MEL-19", "mdf-16", "MDF-16 ", "CP-18", "mas-27", "MEL-19 "])
reponse = REPONSE()

# ---- group: ZONE_CORRIGE / DONNÉES FOURNIES (copie)
libelles_saisis_2 = LIBELLES_SAISIS([" MEL-19 ", "mel-19", "MEL-19", "CP-18", " cp-18", "CP-18 ", "MDF-22", "mdf-22 ", " MDF-22", "MAS-27", "mas-27", "MAS-27 ", "CP-12", " cp-12 ", "MEL-19", "mdf-16", "MDF-16 ", "CP-18", "mas-27", "MEL-19 "])

# ---- group: ZONE_CORRIGE / ÉTAPE 1
# A-50 · Nettoyer avant de regrouper
# Intermédiaire  —  durée cible 25 min  —  réf. REF-144  —  v0.5-260902
# ▼  CORRIGÉ — à consulter après validation  ▼
# RAPPEL — copie des données fournies dans la zone sujet, afin qu'aucun câble ne relie les deux zones
# ÉTAPE 1 — Retirer les espaces de bord — et EUX SEULS. Retirer tous les espaces ferait perdre son sens à
# un libellé composé
# ÉTAPE 2 — Uniformiser la casse : « MEL-19 » et « mel-19 » désignent la même référence, et ne se
# regroupent pas tant qu'elles ne s'écrivent pas pareil
# ÉTAPE 3 — Six références distinctes. Regrouper sans nettoyer en donnerait dix-sept : le fournisseur
# recevrait dix-sept lignes pour six produits, et le rapprochement de facture échouerait sans que rien ne
# soit signalé
# RÉSULTAT — tant que l'interrupteur AFFICHER LE CORRIGÉ reste sur faux, la sortie 1 du Stream Gate est
# vide : rien n'apparaît dans Rhino
trim = TextTrim(Text=libelles_saisis_2, Start=True, End=True)

# ---- group: ZONE_CORRIGE / ÉTAPE 2
case = TextCase(Text=trim, Culture=127)  # -> UpperCase, LowerCase

# ---- group: ZONE_CORRIGE / ÉTAPE 3
cset = CreateSet(List=case.UpperCase)  # -> Set, Map
lng = ListLength(List=cset.Set)
panel = Panel(lng)

# ---- group: ZONE_CORRIGE / AFFICHAGE DU CORRIGÉ
afficher_le_corrigé = BooleanToggle(False)
gate = StreamGate(Stream=lng, Gate=afficher_le_corrigé)  # -> Target0, Target1
reponse_corrige = REPONSE_CORRIGE(gate.Target1)
