# Grasshopper definition A-51_complet.gh (Grasshopper 1.0.8)

# ---- group: ZONE_SUJET
# Les douze repères vous sont fournis tels qu'ils arrivent du tableur : ce sont des chaînes de
# caractères. Triés en l'état, donnez le repère qui arrive en tête.
reperes_en_texte = REPERES_EN_TEXTE(["2", "10", "7", "21", "3", "15", "9", "100", "12", "5", "30", "8"])
reponse = REPONSE()

# ---- group: ZONE_CORRIGE / DONNÉES FOURNIES (copie)
reperes_en_texte_2 = REPERES_EN_TEXTE(["2", "10", "7", "21", "3", "15", "9", "100", "12", "5", "30", "8"])

# ---- group: ZONE_CORRIGE / ÉTAPE 1
# A-51 · Le repère qui arrive en tête
# Débutant  —  durée cible 20 min  —  réf. REF-145  —  v0.4-260901
# ▼  CORRIGÉ — à consulter après validation  ▼
# RAPPEL — copie des données fournies dans la zone sujet, afin qu'aucun câble ne relie les deux zones
# ÉTAPE 1 — Trier les repères TELS QU'ILS SONT : du texte. La comparaison se fait caractère par caractère,
# et « 1 » vient avant « 2 »
# ÉTAPE 2 — Le premier de ce tri est 10 — pas 2. Sur un bon de débit, les pièces sortent alors dans un
# ordre qui n'est celui de personne. Le remède se pose en amont, à la lecture du tableur : convertir avant
# de trier
# ÉTAPE 3 — À titre de comparaison, le tri des mêmes valeurs converties en nombres commence par 2 et finit
# par 100 ; le tri de texte commence par 10 et finit par 9
# RÉSULTAT — tant que l'interrupteur AFFICHER LE CORRIGÉ reste sur faux, la sortie 1 du Stream Gate est
# vide : rien n'apparaît dans Rhino
tsort = SortText(Keys=reperes_en_texte_2, Values=reperes_en_texte_2, Culture=127)  # -> Keys, Values

# ---- group: ZONE_CORRIGE / ÉTAPE 2
item = ListItem(List=tsort.Keys, Index=0, Wrap=True)
panel = Panel(item)

# ---- group: ZONE_CORRIGE / ÉTAPE 3
panel_2 = Panel("""texte  : 10 100 12 15 2 21 3 30 5 7 8 9
nombre :  2 3 5 7 8 9 10 12 15 21 30 100""")

# ---- group: ZONE_CORRIGE / AFFICHAGE DU CORRIGÉ
afficher_le_corrigé = BooleanToggle(False)
gate = StreamGate(Stream=item, Gate=afficher_le_corrigé)  # -> Target0, Target1
reponse_corrige = REPONSE_CORRIGE(gate.Target1)
