# Grasshopper definition AV-01_complet.gh (Grasshopper 1.0.8)

# ---- group: ZONE_SUJET
# La flèche admissible est atteinte pour une portée comprise entre 1 000 et 4 000 mm. Approchez
# cette portée par bissection jusqu'à ce que l'intervalle passe sous 1 mm, et donnez le nombre
# d'itérations nécessaires.
reponse = REPONSE()
# AV-01 · Converger vers une portée
# Perfectionnement  —  durée cible 35 min  —  réf. REF-093  —  v0.5-260902
# ▼  CORRIGÉ — à consulter après validation  ▼
# RAPPEL — copie des données fournies dans la zone sujet, afin qu'aucun câble ne relie les deux zones
# ÉTAPE 1 — L'étalon ne reproduit pas la boucle : il calcule directement ce qu'elle doit trouver.
# L'intervalle de départ mesure 3 000 mm
# ÉTAPE 2 — Chaque bissection le divise par deux. Le nombre de passages nécessaires pour descendre sous le
# critère est donc le logarithme en base 2 du rapport : log₂(3 000 ÷ 1) vaut 11,55
# ÉTAPE 3 — Arrondi au SUPÉRIEUR : onze bissections laissent encore 1,46 mm, douze descendent à 0,73. Il en
# faut donc 12 — et c'est le CRITÈRE qui doit commander la sortie de boucle, jamais un compte fixé d'avance
# ÉTAPE 4 — Ce que l'étalon enseigne en passant : quand un calcul direct existe, faire tourner une boucle
# pour l'obtenir est un détour. Savoir le reconnaître fait partie de la compétence
# RÉSULTAT — tant que l'interrupteur AFFICHER LE CORRIGÉ reste sur faux, la sortie 1 du Stream Gate est
# vide : rien n'apparaît dans Rhino
# 11 bissections -> 1.46 mm
# 12 bissections -> 0.73 mm
# 
# Sortir sur le CRITERE, non sur un compte.
borne_basse = Slider(1000, range=0..3000)
borne_haute = Slider(4000, range=1000..8000)
critere_d_arret = Slider(1, range=0.1..10)

# ---- group: ZONE_CORRIGE / DONNÉES FOURNIES (copie)
borne_basse_2 = Slider(1000, range=0..3000)
borne_haute_2 = Slider(4000, range=1000..8000)
critere_d_arret_2 = Slider(1, range=0.1..10)

# ---- group: ZONE_CORRIGE / ÉTAPE 1
subtraction = Subtraction(A=borne_haute_2, B=borne_basse_2)

# ---- group: ZONE_CORRIGE / ÉTAPE 2
division = Division(A=subtraction, B=critere_d_arret_2)
logn = LogN(Number=division, Base=2)

# ---- group: ZONE_CORRIGE / ÉTAPE 3
round = Round(Number=logn)  # -> Nearest, Floor, Ceiling
panel = Panel(round.Ceiling)

# ---- group: ZONE_CORRIGE / AFFICHAGE DU CORRIGÉ
afficher_le_corrigé = BooleanToggle(False)
gate = StreamGate(Stream=round.Ceiling, Gate=afficher_le_corrigé)  # -> Target0, Target1
reponse_corrige = REPONSE_CORRIGE(gate.Target1)
