# Grasshopper definition AV-02_complet.gh (Grasshopper 1.0.8)

# ---- group: ZONE_SUJET
# Le câble mesure 6 000 mm et ses deux ancrages sont distants de 4 800 mm. Laissez la forme
# s'établir sous son poids propre, et donnez la flèche au point bas, en millimètres.
reponse = REPONSE()
# AV-02 · Une chaînette qui se stabilise
# Perfectionnement  —  durée cible 35 min  —  réf. REF-094  —  v0.5-260902
# ▼  CORRIGÉ — à consulter après validation  ▼
# ÉTAPE 1 — Les deux ancrages, à 4 800 mm l'un de l'autre et à la même altitude
# ÉTAPE 2 — 6 000 mm de câble pour 4 800 mm de portée : un quart de mou. La pesanteur descend, et c'est
# elle qui donne la forme — un câble sans poids resterait tendu en ligne droite
# ÉTAPE 3 — Échantillonner la courbe, puis n'en garder que les altitudes
# ÉTAPE 4 — La flèche est l'écart entre les ancrages et le point bas : l'altitude la plus basse, prise au
# signe près. Mesurer la corde du câble au lieu de sa flèche donnerait 4 800 mm — la portée, que l'on
# connaissait déjà
# RÉSULTAT — tant que l'interrupteur AFFICHER LE CORRIGÉ reste sur faux, la sortie 1 du Stream Gate est
# vide : rien n'apparaît dans Rhino
longueur_du_cable = Slider(6000, range=4000..8000)
portee_entre_ancrages = Slider(4800, range=2000..6000)

# ---- group: ZONE_CORRIGE / ÉTAPE 1
ancrage_a = ANCRAGE_A(Point(0, 0, 0))
ancrage_b = ANCRAGE_B(Point(4800, 0, 0))

# ---- group: ZONE_CORRIGE / ÉTAPE 2
longueur_du_cable_2 = LONGUEUR_DU_CABLE(6000)
Z = UnitZ(Factor=-1)
cat = Catenary(PointA=ancrage_a, PointB=ancrage_b, Length=longueur_du_cable_2, Gravity=Z)

# ---- group: ZONE_CORRIGE / ÉTAPE 3
nombre_de_points = NOMBRE_DE_POINTS(2000)
divide = DivideCurve(Curve=cat, Count=nombre_de_points, Kinks=False)  # -> Points, Tangents, Parameters
pdecon = Deconstruct(Point=divide.Points)  # -> XComponent, YComponent, ZComponent

# ---- group: ZONE_CORRIGE / ÉTAPE 4
bnd = Bounds(Numbers=pdecon.ZComponent)
dedomain = DeconstructDomain(Domain=bnd)  # -> Start, End
abs = Absolute(Value=dedomain.Start)
panel = Panel(abs)

# ---- group: ZONE_CORRIGE / AFFICHAGE DU CORRIGÉ
afficher_le_corrigé = BooleanToggle(False)
gate = StreamGate(Stream=abs, Gate=afficher_le_corrigé)  # -> Target0, Target1
reponse_corrige = REPONSE_CORRIGE(gate.Target1)
