# Grasshopper definition AV-03_complet.gh (Grasshopper 1.0.8)

# ---- group: ZONE_SUJET
# La façade mesure 18 600 mm de long. Cherchez le calepinage qui minimise le nombre de panneaux
# sans qu'aucun dépasse 2 400 mm, et donnez ce nombre.
reponse = REPONSE()
# AV-03 · Chercher la meilleure trame
# Perfectionnement  —  durée cible 40 min  —  réf. REF-095  —  v0.5-260902
# ▼  CORRIGÉ — à consulter après validation  ▼
# RAPPEL — copie des données fournies dans la zone sujet, afin qu'aucun câble ne relie les deux zones
# ÉTAPE 1 — 18 600 ÷ 2 400 vaut 7,75 panneaux
# ÉTAPE 2 — La largeur maximale est un plafond : il faut donc au moins autant de panneaux, arrondi au
# SUPÉRIEUR. Sept panneaux feraient 2 657 mm chacun et dépasseraient la prescription
# ÉTAPE 3 — Et voici la leçon de l'exercice : un moteur de recherche laissé sans contrainte proposerait UN
# panneau de 18 600 mm — optimum parfait, calepinage absurde. Une recherche de forme ne vaut que ce que
# vaut ce qu'on lui demande d'optimiser. Ici, une division suffisait
# RÉSULTAT — tant que l'interrupteur AFFICHER LE CORRIGÉ reste sur faux, la sortie 1 du Stream Gate est
# vide : rien n'apparaît dans Rhino
# Contrainte HORS de la fonction evaluee
# -> optimum : 1 panneau de 18 600 mm.
# 
# Savoir qu'un calcul direct suffit fait
# partie de la competence.
longueur_de_facade = Slider(18600, range=5000..30000)
largeur_maxi_de_panneau = Slider(2400, range=1000..3000)

# ---- group: ZONE_CORRIGE / DONNÉES FOURNIES (copie)
longueur_de_facade_2 = Slider(18600, range=5000..30000)
largeur_maxi_de_panneau_2 = Slider(2400, range=1000..3000)

# ---- group: ZONE_CORRIGE / ÉTAPE 1
division = Division(A=longueur_de_facade_2, B=largeur_maxi_de_panneau_2)

# ---- group: ZONE_CORRIGE / ÉTAPE 2
round = Round(Number=division)  # -> Nearest, Floor, Ceiling
panel = Panel(round.Ceiling)

# ---- group: ZONE_CORRIGE / AFFICHAGE DU CORRIGÉ
afficher_le_corrigé = BooleanToggle(False)
gate = StreamGate(Stream=round.Ceiling, Gate=afficher_le_corrigé)  # -> Target0, Target1
reponse_corrige = REPONSE_CORRIGE(gate.Target1)
