# Grasshopper definition AV-04_complet.gh (Grasshopper 1.0.8)

# ---- group: ZONE_SUJET
# Le tassement initial vaut 48 mm et chaque passe le réduit de 15 %. Donnez le nombre de passes
# nécessaires pour descendre sous 5 mm.
reponse = REPONSE()
# AV-04 · Ce qui met fin à la boucle
# Perfectionnement  —  durée cible 25 min  —  réf. REF-151  —  v0.5-260902
# ▼  CORRIGÉ — à consulter après validation  ▼
# RAPPEL — copie des données fournies dans la zone sujet, afin qu'aucun câble ne relie les deux zones
# ÉTAPE 1 — Après n passes, le tassement vaut le tassement initial multiplié par le facteur élevé à la
# puissance n. On cherche le n qui le ramène sous le seuil
# ÉTAPE 2 — C'est un logarithme, dans la base du facteur : log₀,₈₅(5 ÷ 48) vaut 13,92
# ÉTAPE 3 — Arrondi au SUPÉRIEUR : 14 passes. La treizième laisse encore 5,80 mm. Fixer dix passes d'avance
# en laisserait 9,45 — près du double du toléré, et la boucle se serait arrêtée sur un compte, pas sur un
# état
# RÉSULTAT — tant que l'interrupteur AFFICHER LE CORRIGÉ reste sur faux, la sortie 1 du Stream Gate est
# vide : rien n'apparaît dans Rhino
tassement_initial = Slider(48, range=10..200)
facteur_par_passe = Slider(0.85, range=0.5..0.99)
seuil = Slider(5, range=1..40)

# ---- group: ZONE_CORRIGE / DONNÉES FOURNIES (copie)
tassement_initial_2 = Slider(48, range=10..200)
facteur_par_passe_2 = Slider(0.85, range=0.5..0.99)
seuil_2 = Slider(5, range=1..40)

# ---- group: ZONE_CORRIGE / ÉTAPE 1
division = Division(A=seuil_2, B=tassement_initial_2)

# ---- group: ZONE_CORRIGE / ÉTAPE 2
logn = LogN(Number=division, Base=facteur_par_passe_2)

# ---- group: ZONE_CORRIGE / ÉTAPE 3
round = Round(Number=logn)  # -> Nearest, Floor, Ceiling
panel = Panel(round.Ceiling)

# ---- group: ZONE_CORRIGE / AFFICHAGE DU CORRIGÉ
afficher_le_corrigé = BooleanToggle(False)
gate = StreamGate(Stream=round.Ceiling, Gate=afficher_le_corrigé)  # -> Target0, Target1
reponse_corrige = REPONSE_CORRIGE(gate.Target1)
