# Grasshopper definition AV-05_complet.gh (Grasshopper 1.0.8)

# ---- group: ZONE_SUJET
# Les vingt longueurs vous sont fournies dans l'ordre de chargement. La capacité est de 4 000 mm
# cumulés. Donnez le rang de la première pièce qui fait dépasser la capacité.
longueurs_dans_l_ordre = LONGUEURS_DANS_L_ORDRE([340, 512, 198, 760, 425, 630, 285, 918, 372, 540, 205, 688, 455, 310, 795, 240, 610, 380, 725, 165])
capacite = CAPACITE(4000)
reponse = REPONSE()

# ---- group: ZONE_CORRIGE / DONNÉES FOURNIES (copie)
longueurs_dans_l_ordre_2 = LONGUEURS_DANS_L_ORDRE([340, 512, 198, 760, 425, 630, 285, 918, 372, 540, 205, 688, 455, 310, 795, 240, 610, 380, 725, 165])
capacite_2 = CAPACITE(4000)

# ---- group: ZONE_CORRIGE / ÉTAPE 1
# AV-05 · Charger jusqu'à la limite
# Perfectionnement  —  durée cible 25 min  —  réf. REF-152  —  v0.5-260902
# ▼  CORRIGÉ — à consulter après validation  ▼
# RAPPEL — copie des données fournies dans la zone sujet, afin qu'aucun câble ne relie les deux zones
# ÉTAPE 1 — Le cumul PARTIEL, pièce après pièce — c'est lui qui porte l'information, pas le total. C'est
# aussi ce qu'une boucle transporterait d'un passage au suivant
# ÉTAPE 2 — Comparer chaque cumul à la capacité, et repérer les rangs qui la dépassent
# ÉTAPE 3 — Le premier d'entre eux : la huitième pièce, qui porte le cumul à 4 068 mm. La septième laissait
# 3 150 : c'est elle qu'on charge, et la huitième qu'on repose
# RÉSULTAT — tant que l'interrupteur AFFICHER LE CORRIGÉ reste sur faux, la sortie 1 du Stream Gate est
# vide : rien n'apparaît dans Rhino
ma = MassAddition(Input=longueurs_dans_l_ordre_2)  # -> Result, PartialResults

# ---- group: ZONE_CORRIGE / ÉTAPE 2
larger = LargerThan(FirstNumber=ma.PartialResults, SecondNumber=capacite_2)  # -> LargerThan, OrEqualTo
series = Series(Start=1, Step=1, Count=20)
cull = CullPattern(List=series, CullPattern=larger.LargerThan)

# ---- group: ZONE_CORRIGE / ÉTAPE 3
item = ListItem(List=cull, Index=0, Wrap=True)
panel = Panel(item)

# ---- group: ZONE_CORRIGE / AFFICHAGE DU CORRIGÉ
afficher_le_corrigé = BooleanToggle(False)
gate = StreamGate(Stream=item, Gate=afficher_le_corrigé)  # -> Target0, Target1
reponse_corrige = REPONSE_CORRIGE(gate.Target1)
