# Grasshopper definition AV-06_complet.gh (Grasshopper 1.0.8)

# ---- group: ZONE_SUJET
reponse = REPONSE()
# AV-06 · Ce qu'on demande à l'optimisation
# Perfectionnement  —  durée cible 8 min  —  réf. REF-153  —  v0.4-260901
# ▼  CORRIGÉ — à consulter après validation  ▼
# ÉTAPE 1 — La bonne réponse est la proposition 0. Le corrigé porte cet indice en clair : le menu du sujet,
# lui, part sur la première proposition, quelle qu'elle soit.
# ÉTAPE 2 — À retenir
# RÉSULTAT — tant que l'interrupteur AFFICHER LE CORRIGÉ reste sur faux, la sortie 1 du Stream Gate est
# vide : rien n'apparaît dans Rhino
# Objectif SANS contraintes : une solution
# absurde mais optimale.
# 
# Contraintes SANS objectif : un ensemble
# admissible, dont aucune n'est meilleure.
reponse_qcm = ValueList({"0 - La grandeur à optimiser, ET les contraintes qui bornent…": 0, "1 - Les contraintes : ce que la façade ne doit en aucun cas…": 1, "2 - Les paramètres à faire varier : c'est eux qui définissent…": 2, "3 - Le nombre de générations, pour cadrer le temps de calcul.": 3}, selected=[])

# ---- group: ZONE_CORRIGE / ÉTAPE 1
bonne_reponse = BONNE_REPONSE(0)

# ---- group: ZONE_CORRIGE / AFFICHAGE DU CORRIGÉ
afficher_le_corrigé = BooleanToggle(False)
gate = StreamGate(Stream=bonne_reponse, Gate=afficher_le_corrigé)  # -> Target0, Target1
reponse_corrige = REPONSE_CORRIGE(gate.Target1)
