# Grasshopper definition AV-07_complet.gh (Grasshopper 1.0.8)

# ---- group: ZONE_SUJET
# Les huit solutions vous sont fournies avec leur coût, à minimiser, et leur performance, à
# maximiser. Donnez le nombre de solutions qu'aucune autre ne surpasse sur les deux critères à la
# fois.
reponse = REPONSE()

# ---- group: ZONE_CORRIGE / ÉTAPE 1
solutions_non_surpassees = SOLUTIONS_NON_SURPASSEES(["S2 (980 € / 74)", "S3 (1450 € / 91)", "S5 (1320 € / 86)", "S6 (890 € / 68)", "S8 (1050 € / 83)"])

# ---- group: ZONE_CORRIGE / ÉTAPE 2
# AV-07 · Les solutions qu'on ne peut pas départager
# Perfectionnement  —  durée cible 30 min  —  réf. REF-154  —  v0.5-260902
# ▼  CORRIGÉ — à consulter après validation  ▼
# ÉTAPE 1 — L'étalon nomme les solutions qu'aucune autre ne surpasse sur les DEUX critères à la fois —
# moins chère ET plus performante. Trois des huit le sont ; les cinq autres restent défendables
# ÉTAPE 2 — Cinq sur huit. Ne garder que la moins chère, ou que la plus performante, réduirait un arbitrage
# à un classement — et déciderait à la place du projeteur sans le lui dire
# RÉSULTAT — tant que l'interrupteur AFFICHER LE CORRIGÉ reste sur faux, la sortie 1 du Stream Gate est
# vide : rien n'apparaît dans Rhino
lng = ListLength(List=solutions_non_surpassees)
panel = Panel(lng)

# ---- group: ZONE_CORRIGE / AFFICHAGE DU CORRIGÉ
afficher_le_corrigé = BooleanToggle(False)
gate = StreamGate(Stream=lng, Gate=afficher_le_corrigé)  # -> Target0, Target1
reponse_corrige = REPONSE_CORRIGE(gate.Target1)
