# Grasshopper definition AV-08_complet.gh (Grasshopper 1.0.8)

# ---- group: ZONE_SUJET
# Le résidu de chacune des dix passes vous est fourni. La tolérance vaut 0,1. Donnez le numéro de
# la première passe à partir de laquelle le résidu RESTE sous la tolérance.
residu_par_passe = RESIDU_PAR_PASSE([42, 18.5, 6.2, 1.8, 0.42, 0.09, 0.13, 0.06, 0.04, 0.03])
tolerance = TOLERANCE(0.1)
reponse = REPONSE()

# ---- group: ZONE_CORRIGE / ÉTAPE 1
passes_definitivement_sous_le_seuil = PASSES_DEFINITIVEMENT_SOUS_LE_SEUIL([8, 9, 10])

# ---- group: ZONE_CORRIGE / ÉTAPE 2
# AV-08 · Quand la relaxation a-t-elle convergé
# Perfectionnement  —  durée cible 25 min  —  réf. REF-155  —  v0.5-260902
# ▼  CORRIGÉ — à consulter après validation  ▼
# ÉTAPE 1 — L'étalon porte les passes à partir desquelles le résidu ne remonte PLUS. La sixième descend à
# 0,09 — sous la tolérance — puis la septième remonte à 0,13 : la simulation passait, elle n'était pas
# stabilisée
# ÉTAPE 2 — La première d'entre elles est la huitième. Répondre 6, le premier passage sous la tolérance,
# fige une forme qui bougeait encore — et rien à l'écran ne l'en distingue
# RÉSULTAT — tant que l'interrupteur AFFICHER LE CORRIGÉ reste sur faux, la sortie 1 du Stream Gate est
# vide : rien n'apparaît dans Rhino
item = ListItem(List=passes_definitivement_sous_le_seuil, Index=0, Wrap=True)
panel = Panel(item)

# ---- group: ZONE_CORRIGE / AFFICHAGE DU CORRIGÉ
afficher_le_corrigé = BooleanToggle(False)
gate = StreamGate(Stream=item, Gate=afficher_le_corrigé)  # -> Target0, Target1
reponse_corrige = REPONSE_CORRIGE(gate.Target1)
