# Grasshopper definition AV-09_complet.gh (Grasshopper 1.0.8)

# ---- group: ZONE_SUJET
reponse = REPONSE()
# AV-09 · Ce qu'une simulation ne dit pas
# Perfectionnement  —  durée cible 8 min  —  réf. REF-156  —  v0.5-260902
# ▼  CORRIGÉ — à consulter après validation  ▼
# ÉTAPE 1 — La bonne réponse est la proposition 2. Le corrigé porte cet indice en clair : le menu du sujet,
# lui, part sur la première proposition, quelle qu'elle soit.
# ÉTAPE 2 — À retenir
# RÉSULTAT — tant que l'interrupteur AFFICHER LE CORRIGÉ reste sur faux, la sortie 1 du Stream Gate est
# vide : rien n'apparaît dans Rhino
# Une forme d'equilibre dit OU VA l'effort.
# Elle ne dit pas s'il passe.
# 
# C'est ce qu'un logiciel de calcul
# demandera en entree.
reponse_qcm = ValueList({"0 - Que la structure tient : la forme est en équilibre.": 0, "1 - Rien d'utilisable : il faut un logiciel de calcul.": 1, "2 - Une géométrie d'équilibre sous les hypothèses posées — ni…": 2, "3 - Que la forme est optimale.": 3}, selected=[])

# ---- group: ZONE_CORRIGE / ÉTAPE 1
bonne_reponse = BONNE_REPONSE(2)

# ---- group: ZONE_CORRIGE / AFFICHAGE DU CORRIGÉ
afficher_le_corrigé = BooleanToggle(False)
gate = StreamGate(Stream=bonne_reponse, Gate=afficher_le_corrigé)  # -> Target0, Target1
reponse_corrige = REPONSE_CORRIGE(gate.Target1)
