# Grasshopper definition B-01_complet.gh (Grasshopper 1.0.8)

# ---- group: ZONE_SUJET
# Produis un escalier droit reliant deux niveaux distants de H = 2 850 mm. Le giron est fixé à
# 280 mm et la hauteur de marche doit rester comprise entre 165 et 180 mm. Détermine
# automatiquement le nombre de marches et vérifie la règle de Blondel (2h + g compris entre 600
# et 650 mm).
reponse = REPONSE()
# B-01 · Escalier droit paramétrique
# Intermédiaire  —  durée cible 25 min  —  réf. REF-067, REF-068, REF-047, REF-043  —  v0.5-260902
# ▼  CORRIGÉ — à consulter après validation  ▼
# RAPPEL — copie des données fournies dans la zone sujet, afin qu'aucun câble ne relie les deux zones
# ÉTAPE 1 — Le nombre de contremarches est un ENTIER : 2 850 ÷ 172,5 vaut 16,52, donc 17
# ÉTAPE 2 — La hauteur réelle se recale sur cet entier : 2 850 ÷ 17 vaut 167,65 mm, et non les 172,5 visés.
# Garder la valeur visée donnerait un escalier de 2 932 mm — qui dépasse l'étage de 82 mm
# ÉTAPE 3 — Blondel : deux fois la hauteur, plus le giron. 615,29 mm, dans la plage 600-650. La valeur
# fausse, 625, y est AUSSI — le contrôle réglementaire ne rattrape donc pas l'erreur
# RÉSULTAT — tant que l'interrupteur AFFICHER LE CORRIGÉ reste sur faux, la sortie 1 du Stream Gate est
# vide : rien n'apparaît dans Rhino
hauteur_d_etage = Slider(2850, range=2000..4000)
giron = Slider(280, range=200..350)
hauteur_de_marche_visee = Slider(172.5, range=150..200)

# ---- group: ZONE_CORRIGE / DONNÉES FOURNIES (copie)
hauteur_d_etage_2 = Slider(2850, range=2000..4000)
giron_2 = Slider(280, range=200..350)
hauteur_de_marche_visee_2 = Slider(172.5, range=150..200)

# ---- group: ZONE_CORRIGE / ÉTAPE 1
division = Division(A=hauteur_d_etage_2, B=hauteur_de_marche_visee_2)
round = Round(Number=division)  # -> Nearest, Floor, Ceiling

# ---- group: ZONE_CORRIGE / ÉTAPE 2
division_2 = Division(A=hauteur_d_etage_2, B=round.Nearest)

# ---- group: ZONE_CORRIGE / ÉTAPE 3
multiplication = Multiplication(A=division_2, B=2)
addition = Addition(A=multiplication, B=giron_2)
panel = Panel(addition)

# ---- group: ZONE_CORRIGE / AFFICHAGE DU CORRIGÉ
afficher_le_corrigé = BooleanToggle(False)
gate = StreamGate(Stream=addition, Gate=afficher_le_corrigé)  # -> Target0, Target1
reponse_corrige = REPONSE_CORRIGE(gate.Target1)
