# Grasshopper definition B-02_complet.gh (Grasshopper 1.0.8)

# ---- group: ZONE_SUJET
# Sur la main courante fournie, place des barreaux verticaux de 16 mm de diamètre. L'espacement
# libre entre barreaux ne doit jamais dépasser 110 mm. Détermine le nombre de barreaux et affiche
# l'entraxe réel.
reponse = REPONSE()
# B-02 · Garde-corps à barreaudage régulier
# Intermédiaire  —  durée cible 20 min  —  réf. REF-064, REF-047, REF-043  —  v0.4-260901
# ▼  CORRIGÉ — à consulter après validation  ▼
# RAPPEL — copie des données fournies dans la zone sujet, afin qu'aucun câble ne relie les deux zones
# ÉTAPE 1 — Le pas d'un barreau au suivant n'est pas l'espace libre : c'est l'espace libre PLUS le diamètre
# du barreau
# ÉTAPE 2 — La longueur à répartir se compte entre nus de montants, d'où le diamètre retranché une fois
# ÉTAPE 3 — Arrondi au SUPÉRIEUR — un espace de trop violerait la règle — puis un barreau de moins que
# d'espaces : 25 barreaux, pour 108 mm de libre. Diviser par le seul espace libre en donnerait 30, soit 20
# % de matière en trop
# RÉSULTAT — tant que l'interrupteur AFFICHER LE CORRIGÉ reste sur faux, la sortie 1 du Stream Gate est
# vide : rien n'apparaît dans Rhino
main_courante = Slider(3240, range=1000..6000)
diametre_du_barreau = Slider(16, range=8..30)
espace_libre_maximal = Slider(110, range=50..200)

# ---- group: ZONE_CORRIGE / DONNÉES FOURNIES (copie)
main_courante_2 = Slider(3240, range=1000..6000)
diametre_du_barreau_2 = Slider(16, range=8..30)
espace_libre_maximal_2 = Slider(110, range=50..200)

# ---- group: ZONE_CORRIGE / ÉTAPE 1
addition = Addition(A=espace_libre_maximal_2, B=diametre_du_barreau_2)

# ---- group: ZONE_CORRIGE / ÉTAPE 2
subtraction = Subtraction(A=main_courante_2, B=diametre_du_barreau_2)
division = Division(A=subtraction, B=addition)

# ---- group: ZONE_CORRIGE / ÉTAPE 3
round = Round(Number=division)  # -> Nearest, Floor, Ceiling
subtraction_2 = Subtraction(A=round.Ceiling, B=1)
panel = Panel(subtraction_2)

# ---- group: ZONE_CORRIGE / AFFICHAGE DU CORRIGÉ
afficher_le_corrigé = BooleanToggle(False)
gate = StreamGate(Stream=subtraction_2, Gate=afficher_le_corrigé)  # -> Target0, Target1
reponse_corrige = REPONSE_CORRIGE(gate.Target1)
