# Grasshopper definition B-03_complet.gh (Grasshopper 1.0.8)

# ---- group: ZONE_SUJET
# Sur la trame de façade 12 × 8, perce chaque panneau d'une ouverture circulaire dont le rayon
# varie de 50 mm (loin de l'attracteur) à 350 mm (au plus près). Le point attracteur est
# déplaçable dans Rhino.
reponse = REPONSE()
# B-03 · Façade à trame variable pilotée par un attracteur
# Intermédiaire  —  durée cible 30 min  —  réf. REF-068, REF-053, REF-054  —  v0.5-260902
# ▼  CORRIGÉ — à consulter après validation  ▼
# ÉTAPE 1 — L'étalon porte les 96 rayons, tels que la distance à l'attracteur les donne : de 350 mm au plus
# près à 50 mm au plus loin
# ÉTAPE 2 — L'aire d'un disque va comme le CARRÉ du rayon. C'est ce qui rend la moyenne trompeuse : la
# moyenne des carrés n'est pas le carré de la moyenne, et l'écart est toujours dans le même sens
# ÉTAPE 3 — 13,30 m² au total. Le calcul par le rayon moyen en donnerait 12,06 — 1,24 m² de vitrage qui
# manquent à la commande
# RÉSULTAT — tant que l'interrupteur AFFICHER LE CORRIGÉ reste sur faux, la sortie 1 du Stream Gate est
# vide : rien n'apparaît dans Rhino
mailles_en_largeur = Slider(12, range=4..20)
mailles_en_hauteur = Slider(8, range=4..20)

# ---- group: ZONE_CORRIGE / ÉTAPE 1
rayons = RAYONS([66.61388124, 100.3849117, 133.0278288, 163.9478981, 192.1295565, 215.8359214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])

# ---- group: ZONE_CORRIGE / ÉTAPE 2
multiplication = Multiplication(A=rayons, B=rayons)
pi = Pi(Factor=1)
multiplication_2 = Multiplication(A=multiplication, B=pi)

# ---- group: ZONE_CORRIGE / ÉTAPE 3
ma = MassAddition(Input=multiplication_2)  # -> Result, PartialResults
division = Division(A=ma.Result, B=1000000)
panel = Panel(division)

# ---- group: ZONE_CORRIGE / AFFICHAGE DU CORRIGÉ
afficher_le_corrigé = BooleanToggle(False)
gate = StreamGate(Stream=division, Gate=afficher_le_corrigé)  # -> Target0, Target1
reponse_corrige = REPONSE_CORRIGE(gate.Target1)
