# Grasshopper definition B-04_complet.gh (Grasshopper 1.0.8)

# ---- group: ZONE_SUJET
# Applique un pavage hexagonal de 400 mm de côté sur la surface libre fournie, puis extrude
# chaque hexagone de 60 mm suivant la normale locale de la surface.
reponse = REPONSE()
# B-04 · Pavage hexagonal sur surface
# Intermédiaire  —  durée cible 28 min  —  réf. REF-068, REF-069, REF-049  —  v0.5-260902
# ▼  CORRIGÉ — à consulter après validation  ▼
# RAPPEL — copie des données fournies dans la zone sujet, afin qu'aucun câble ne relie les deux zones
# ÉTAPE 1 — Le pas HORIZONTAL d'une trame hexagonale vaut √3 fois le côté — 692,8 mm ici, et non 400
# ÉTAPE 2 — Le pas VERTICAL vaut une fois et demie le côté : 600 mm. Les deux pas diffèrent, c'est ce qui
# distingue une trame hexagonale d'une trame carrée
# ÉTAPE 3 — 13 colonnes et 10 rangées : 130 hexagones. Diviser par le CÔTÉ au lieu du pas en donnerait 384,
# soit trois fois trop
# RÉSULTAT — tant que l'interrupteur AFFICHER LE CORRIGÉ reste sur faux, la sortie 1 du Stream Gate est
# vide : rien n'apparaît dans Rhino
cote_de_l_hexagone = Slider(400, range=100..800)
largeur = Slider(9600, range=2000..20000)
profondeur = Slider(6400, range=2000..20000)

# ---- group: ZONE_CORRIGE / DONNÉES FOURNIES (copie)
cote_de_l_hexagone_2 = Slider(400, range=100..800)
largeur_2 = Slider(9600, range=2000..20000)
profondeur_2 = Slider(6400, range=2000..20000)

# ---- group: ZONE_CORRIGE / ÉTAPE 1
sqrt = SquareRoot(Value=3)
multiplication = Multiplication(A=cote_de_l_hexagone_2, B=sqrt)

# ---- group: ZONE_CORRIGE / ÉTAPE 2
multiplication_2 = Multiplication(A=cote_de_l_hexagone_2, B=1.5)

# ---- group: ZONE_CORRIGE / ÉTAPE 3
division = Division(A=largeur_2, B=multiplication)
division_2 = Division(A=profondeur_2, B=multiplication_2)
round = Round(Number=division)  # -> Nearest, Floor, Ceiling
round_2 = Round(Number=division_2)  # -> Nearest, Floor, Ceiling
multiplication_3 = Multiplication(A=round.Floor, B=round_2.Floor)
panel = Panel(multiplication_3)

# ---- group: ZONE_CORRIGE / AFFICHAGE DU CORRIGÉ
afficher_le_corrigé = BooleanToggle(False)
gate = StreamGate(Stream=multiplication_3, Gate=afficher_le_corrigé)  # -> Target0, Target1
reponse_corrige = REPONSE_CORRIGE(gate.Target1)
