# Grasshopper definition B-05_complet.gh (Grasshopper 1.0.8)

# ---- group: ZONE_SUJET
# Produis une poutre treillis Warren de 12 000 mm de portée et 900 mm de hauteur, avec 8
# panneaux. Affiche le linéaire total de tube nécessaire, membrures et diagonales séparées.
reponse = REPONSE()
# B-05 · Poutre treillis paramétrique
# Intermédiaire  —  durée cible 25 min  —  réf. REF-046, REF-063, REF-079  —  v0.5-260902
# ▼  CORRIGÉ — à consulter après validation  ▼
# RAPPEL — copie des données fournies dans la zone sujet, afin qu'aucun câble ne relie les deux zones
# ÉTAPE 1 — Les deux membrures courent sur toute la portée : 24 000 mm
# ÉTAPE 2 — Le pas d'un panneau : 1 500 mm. La DIAGONALE, elle, traverse le panneau en biais — c'est
# l'hypoténuse du pas et de la hauteur, 1 749 mm, soit 17 % de plus
# ÉTAPE 3 — Huit diagonales : 13 994 mm. Total 37,99 m. Compter la diagonale comme un panneau donnerait
# 36,00 m — deux mètres de tube qui manquent
# RÉSULTAT — tant que l'interrupteur AFFICHER LE CORRIGÉ reste sur faux, la sortie 1 du Stream Gate est
# vide : rien n'apparaît dans Rhino
portee = Slider(12000, range=4000..30000)
hauteur = Slider(900, range=300..2000)
panneaux = Slider(8, range=2..20)

# ---- group: ZONE_CORRIGE / DONNÉES FOURNIES (copie)
portee_2 = Slider(12000, range=4000..30000)
hauteur_2 = Slider(900, range=300..2000)
panneaux_2 = Slider(8, range=2..20)

# ---- group: ZONE_CORRIGE / ÉTAPE 1
multiplication = Multiplication(A=portee_2, B=2)

# ---- group: ZONE_CORRIGE / ÉTAPE 2
division = Division(A=portee_2, B=panneaux_2)
multiplication_2 = Multiplication(A=division, B=division)
multiplication_3 = Multiplication(A=hauteur_2, B=hauteur_2)
addition = Addition(A=multiplication_2, B=multiplication_3)
sqrt = SquareRoot(Value=addition)

# ---- group: ZONE_CORRIGE / ÉTAPE 3
multiplication_4 = Multiplication(A=sqrt, B=panneaux_2)
addition_2 = Addition(A=multiplication, B=multiplication_4)
division_2 = Division(A=addition_2, B=1000)
panel = Panel(division_2)

# ---- group: ZONE_CORRIGE / AFFICHAGE DU CORRIGÉ
afficher_le_corrigé = BooleanToggle(False)
gate = StreamGate(Stream=division_2, Gate=afficher_le_corrigé)  # -> Target0, Target1
reponse_corrige = REPONSE_CORRIGE(gate.Target1)
