# Grasshopper definition B-06_complet.gh (Grasshopper 1.0.8)

# ---- group: ZONE_SUJET
# Modélise un caisson de largeur L, hauteur H et profondeur P, en panneaux de 19 mm. Les joues
# reçoivent une rainure de 6 mm de profondeur pour le fond de 8 mm. Le dessus et le dessous
# s'insèrent entre les joues.
reponse = REPONSE()
# B-06 · Caisson de meuble avec épaisseur et rainures
# Intermédiaire  —  durée cible 30 min  —  réf. REF-070, REF-071, REF-068  —  v0.5-260902
# ▼  CORRIGÉ — à consulter après validation  ▼
# RAPPEL — copie des données fournies dans la zone sujet, afin qu'aucun câble ne relie les deux zones
# ÉTAPE 1 — Les deux joues, pleine hauteur et pleine profondeur
# ÉTAPE 2 — Les deux traverses, entre les joues : la largeur diminue de deux épaisseurs
# ÉTAPE 3 — Le fond entre DANS les rainures : il se débite plus grand que le vide intérieur, de deux fois
# la profondeur de rainure dans chaque dimension. Le couper aux cotes nettes le rendrait inutilisable
# ÉTAPE 4 — 32,73 dm³ de panneau. Sans les rainures : 32,40 — 1 % d'écart, invisible au devis et fatal au
# montage
# RÉSULTAT — tant que l'interrupteur AFFICHER LE CORRIGÉ reste sur faux, la sortie 1 du Stream Gate est
# vide : rien n'apparaît dans Rhino
largeur = Slider(800, range=300..1600)
hauteur = Slider(720, range=300..2200)
profondeur = Slider(400, range=200..700)
epaisseur = Slider(19, range=10..30)
profondeur_de_rainure = Slider(6, range=0..15)

# ---- group: ZONE_CORRIGE / DONNÉES FOURNIES (copie)
largeur_2 = Slider(800, range=300..1600)
hauteur_2 = Slider(720, range=300..2200)
profondeur_2 = Slider(400, range=200..700)
epaisseur_2 = Slider(19, range=10..30)
profondeur_de_rainure_2 = Slider(6, range=0..15)

# ---- group: ZONE_CORRIGE / ÉTAPE 1
multiplication = Multiplication(A=hauteur_2, B=profondeur_2)
multiplication_2 = Multiplication(A=multiplication, B=epaisseur_2)
multiplication_3 = Multiplication(A=multiplication_2, B=2)

# ---- group: ZONE_CORRIGE / ÉTAPE 2
multiplication_4 = Multiplication(A=epaisseur_2, B=2)
subtraction = Subtraction(A=largeur_2, B=multiplication_4)
multiplication_5 = Multiplication(A=subtraction, B=profondeur_2)
multiplication_6 = Multiplication(A=multiplication_5, B=epaisseur_2)
multiplication_7 = Multiplication(A=multiplication_6, B=2)

# ---- group: ZONE_CORRIGE / ÉTAPE 3
multiplication_8 = Multiplication(A=profondeur_de_rainure_2, B=2)
addition = Addition(A=subtraction, B=multiplication_8)
subtraction_2 = Subtraction(A=hauteur_2, B=multiplication_4)
addition_2 = Addition(A=subtraction_2, B=multiplication_8)
multiplication_9 = Multiplication(A=addition, B=addition_2)
multiplication_10 = Multiplication(A=multiplication_9, B=epaisseur_2)

# ---- group: ZONE_CORRIGE / ÉTAPE 4
addition_3 = Addition(A=multiplication_3, B=multiplication_7)
addition_4 = Addition(A=addition_3, B=multiplication_10)
division = Division(A=addition_4, B=1000000)
panel = Panel(division)

# ---- group: ZONE_CORRIGE / AFFICHAGE DU CORRIGÉ
afficher_le_corrigé = BooleanToggle(False)
gate = StreamGate(Stream=division, Gate=afficher_le_corrigé)  # -> Target0, Target1
reponse_corrige = REPONSE_CORRIGE(gate.Target1)
