# Grasshopper definition B-07_complet.gh (Grasshopper 1.0.8)

# ---- group: ZONE_SUJET
# Insère dans le caisson un tiroir sur coulisses de 13 mm de jeu latéral par côté et 2 mm en
# hauteur. Le tiroir doit pouvoir coulisser de toute sa profondeur sans collision : prouve-le.
reponse = REPONSE()
# B-07 · Tiroir paramétrique avec jeux fonctionnels
# Intermédiaire  —  durée cible 25 min  —  réf. REF-070, REF-072  —  v0.5-260902
# ▼  CORRIGÉ — à consulter après validation  ▼
# RAPPEL — copie des données fournies dans la zone sujet, afin qu'aucun câble ne relie les deux zones
# ÉTAPE 1 — L'intérieur du caisson : la largeur moins DEUX épaisseurs de joue, soit 762 mm
# ÉTAPE 2 — La coulisse se pose des DEUX côtés : le jeu se retranche deux fois. 736 mm. Ne le retrancher
# qu'une fois donnerait 749 — 13 mm de trop, et le tiroir n'entre pas
# RÉSULTAT — tant que l'interrupteur AFFICHER LE CORRIGÉ reste sur faux, la sortie 1 du Stream Gate est
# vide : rien n'apparaît dans Rhino
largeur_du_caisson = Slider(800, range=300..1600)
epaisseur_du_panneau = Slider(19, range=10..30)
jeu_par_cote = Slider(13, range=5..25)

# ---- group: ZONE_CORRIGE / DONNÉES FOURNIES (copie)
largeur_du_caisson_2 = Slider(800, range=300..1600)
epaisseur_du_panneau_2 = Slider(19, range=10..30)
jeu_par_cote_2 = Slider(13, range=5..25)

# ---- group: ZONE_CORRIGE / ÉTAPE 1
multiplication = Multiplication(A=epaisseur_du_panneau_2, B=2)
subtraction = Subtraction(A=largeur_du_caisson_2, B=multiplication)

# ---- group: ZONE_CORRIGE / ÉTAPE 2
multiplication_2 = Multiplication(A=jeu_par_cote_2, B=2)
subtraction_2 = Subtraction(A=subtraction, B=multiplication_2)
panel = Panel(subtraction_2)

# ---- group: ZONE_CORRIGE / AFFICHAGE DU CORRIGÉ
afficher_le_corrigé = BooleanToggle(False)
gate = StreamGate(Stream=subtraction_2, Gate=afficher_le_corrigé)  # -> Target0, Target1
reponse_corrige = REPONSE_CORRIGE(gate.Target1)
