# Grasshopper definition B-08_complet.gh (Grasshopper 1.0.8)

# ---- group: ZONE_SUJET
# Répartis 6 tablettes sur une hauteur de 2 000 mm de sorte que les entre-deux augmentent
# progressivement du bas vers le haut, la plus petite hauteur libre valant au moins 220 mm.
reponse = REPONSE()
# B-08 · Étagère modulaire à pas variable
# Intermédiaire  —  durée cible 22 min  —  réf. REF-043, REF-044, REF-047  —  v0.4-260901
# ▼  CORRIGÉ — à consulter après validation  ▼
# RAPPEL — copie des données fournies dans la zone sujet, afin qu'aucun câble ne relie les deux zones
# ÉTAPE 1 — La hauteur réellement LIBRE : le total moins l'épaisseur des six tablettes, soit 1 868 mm et
# non 2 000
# ÉTAPE 2 — Sept entre-deux pour six tablettes — un de plus, comme toujours entre des intervalles et ce qui
# les sépare
# ÉTAPE 3 — En progression arithmétique, la somme vaut n fois le premier terme plus la raison multipliée
# par la somme des rangs — n(n−1)/2. On inverse pour trouver la raison : 28,95 mm
# ÉTAPE 4 — Le plus grand entre-deux est le premier plus six fois la raison : 353,71 mm. Répartir 2 000 mm
# au lieu de 1 868 le porterait à 378,3, et la dernière tablette dépasserait du meuble
# RÉSULTAT — tant que l'interrupteur AFFICHER LE CORRIGÉ reste sur faux, la sortie 1 du Stream Gate est
# vide : rien n'apparaît dans Rhino
hauteur_totale = Slider(2000, range=1000..3000)
tablettes = Slider(6, range=2..12)
epaisseur = Slider(22, range=10..40)
plus_petit_entre_deux = Slider(180, range=100..300)

# ---- group: ZONE_CORRIGE / DONNÉES FOURNIES (copie)
hauteur_totale_2 = Slider(2000, range=1000..3000)
tablettes_2 = Slider(6, range=2..12)
epaisseur_2 = Slider(22, range=10..40)
plus_petit_entre_deux_2 = Slider(180, range=100..300)

# ---- group: ZONE_CORRIGE / ÉTAPE 1
multiplication = Multiplication(A=tablettes_2, B=epaisseur_2)
subtraction = Subtraction(A=hauteur_totale_2, B=multiplication)

# ---- group: ZONE_CORRIGE / ÉTAPE 2
addition = Addition(A=tablettes_2, B=1)

# ---- group: ZONE_CORRIGE / ÉTAPE 3
multiplication_2 = Multiplication(A=addition, B=plus_petit_entre_deux_2)
subtraction_2 = Subtraction(A=subtraction, B=multiplication_2)
subtraction_3 = Subtraction(A=addition, B=1)
multiplication_3 = Multiplication(A=addition, B=subtraction_3)
division = Division(A=multiplication_3, B=2)
division_2 = Division(A=subtraction_2, B=division)

# ---- group: ZONE_CORRIGE / ÉTAPE 4
multiplication_4 = Multiplication(A=subtraction_3, B=division_2)
addition_2 = Addition(A=plus_petit_entre_deux_2, B=multiplication_4)
panel = Panel(addition_2)

# ---- group: ZONE_CORRIGE / AFFICHAGE DU CORRIGÉ
afficher_le_corrigé = BooleanToggle(False)
gate = StreamGate(Stream=addition_2, Gate=afficher_le_corrigé)  # -> Target0, Target1
reponse_corrige = REPONSE_CORRIGE(gate.Target1)
