# Grasshopper definition B-09_complet.gh (Grasshopper 1.0.8)

# ---- group: ZONE_SUJET
# Modélise 4 griffes réparties à 90° autour d'une pierre ronde de 5 mm de diamètre. Chaque griffe
# est un fil de 0,9 mm de diamètre, incliné de 12° vers l'intérieur, avec une tête arrondie
# recouvrant la ceinture de la pierre.
reponse = REPONSE()
# B-09 · Griffe de sertissage paramétrique
# Intermédiaire  —  durée cible 28 min  —  réf. REF-068, REF-069, REF-067  —  v0.4-260901
# ▼  CORRIGÉ — à consulter après validation  ▼
# RAPPEL — copie des données fournies dans la zone sujet, afin qu'aucun câble ne relie les deux zones
# ÉTAPE 1 — Une griffe inclinée est plus longue que la hauteur qu'elle couvre : sa longueur est la hauteur
# DIVISÉE par le cosinus de l'inclinaison
# ÉTAPE 2 — Quatre griffes : 14,72 mm de fil. La hauteur droite en donnerait 14,40 — sur une série, c'est
# de l'or qui manque à chaque montage
# RÉSULTAT — tant que l'interrupteur AFFICHER LE CORRIGÉ reste sur faux, la sortie 1 du Stream Gate est
# vide : rien n'apparaît dans Rhino
griffes = Slider(4, range=2..8)
hauteur_de_griffe = Slider(3.6, range=1..10)
inclinaison = Slider(12, range=0..45)

# ---- group: ZONE_CORRIGE / DONNÉES FOURNIES (copie)
griffes_2 = Slider(4, range=2..8)
hauteur_de_griffe_2 = Slider(3.6, range=1..10)
inclinaison_2 = Slider(12, range=0..45)

# ---- group: ZONE_CORRIGE / ÉTAPE 1
rad = Radians(Degrees=inclinaison_2)
cos = Cosine(Value=rad)
division = Division(A=hauteur_de_griffe_2, B=cos)

# ---- group: ZONE_CORRIGE / ÉTAPE 2
multiplication = Multiplication(A=division, B=griffes_2)
panel = Panel(multiplication)

# ---- group: ZONE_CORRIGE / AFFICHAGE DU CORRIGÉ
afficher_le_corrigé = BooleanToggle(False)
gate = StreamGate(Stream=multiplication, Gate=afficher_le_corrigé)  # -> Target0, Target1
reponse_corrige = REPONSE_CORRIGE(gate.Target1)
