# Grasshopper definition B-10_complet.gh (Grasshopper 1.0.8)

# ---- group: ZONE_SUJET
# Dessine à plat un motif géométrique répétitif de 12 modules, puis applique-le sur la face
# extérieure d'un anneau de taille 54 et de 4 mm de large. Le motif doit boucler sans rupture.
reponse = REPONSE()
# B-10 · Motif gravé développé sur un anneau
# Intermédiaire  —  durée cible 30 min  —  réf. REF-115, REF-069, REF-049  —  v0.5-260902
# ▼  CORRIGÉ — à consulter après validation  ▼
# RAPPEL — copie des données fournies dans la zone sujet, afin qu'aucun câble ne relie les deux zones
# ÉTAPE 1 — La taille d'un anneau est une CIRCONFÉRENCE, pas un diamètre. Le motif se développe sur elle,
# et douze modules la partagent exactement
# ÉTAPE 2 — 4,50 mm par module — un compte rond, qui rend le raccord vérifiable à la règle. Prendre la
# circonférence pour un diamètre donnerait 1,43 mm, et les douze modules ne couvriraient qu'un tiers du
# tour
# RÉSULTAT — tant que l'interrupteur AFFICHER LE CORRIGÉ reste sur faux, la sortie 1 du Stream Gate est
# vide : rien n'apparaît dans Rhino
# Taille d'anneau = CIRCONFERENCE.
# 
# 54 / 12 = 4,50 mm
# 54 / pi / 12 = 1,43 mm  (faux)
circonference = Slider(54, range=40..80)
modules = Slider(12, range=4..24)

# ---- group: ZONE_CORRIGE / DONNÉES FOURNIES (copie)
circonference_2 = Slider(54, range=40..80)
modules_2 = Slider(12, range=4..24)

# ---- group: ZONE_CORRIGE / ÉTAPE 1
division = Division(A=circonference_2, B=modules_2)
panel = Panel(division)

# ---- group: ZONE_CORRIGE / AFFICHAGE DU CORRIGÉ
afficher_le_corrigé = BooleanToggle(False)
gate = StreamGate(Stream=division, Gate=afficher_le_corrigé)  # -> Target0, Target1
reponse_corrige = REPONSE_CORRIGE(gate.Target1)
