# Grasshopper definition B-11_complet.gh (Grasshopper 1.0.8)

# ---- group: ZONE_SUJET
# Répartis des maillons ovales de 4 mm le long de la courbe fournie, chaque maillon tourné de 90°
# par rapport au précédent, sans jeu ni recouvrement excessif.
reponse = REPONSE()
# B-11 · Chaîne de maillons le long d'une courbe
# Intermédiaire  —  durée cible 25 min  —  réf. REF-064, REF-067, REF-046  —  v0.5-260902
# ▼  CORRIGÉ — à consulter après validation  ▼
# RAPPEL — copie des données fournies dans la zone sujet, afin qu'aucun câble ne relie les deux zones
# ÉTAPE 1 — Le pas d'un maillon au suivant n'est pas sa taille : les maillons s'enfilent, d'où le
# recouvrement retranché. 4 − 1,2 = 2,8 mm
# ÉTAPE 2 — La longueur à couvrir après le premier maillon, divisée par le pas, arrondie à l'entier
# INFÉRIEUR — un maillon qui dépasse ne tient pas — puis le premier maillon rajouté
# ÉTAPE 3 — 66 maillons. Diviser la courbe par la taille du maillon en donnerait 46 — la chaîne arriverait
# vingt maillons trop courte
# RÉSULTAT — tant que l'interrupteur AFFICHER LE CORRIGÉ reste sur faux, la sortie 1 du Stream Gate est
# vide : rien n'apparaît dans Rhino
longueur_de_courbe = Slider(187.5, range=50..500)
maillon = Slider(4, range=1..20)
recouvrement = Slider(1.2, range=0..10)

# ---- group: ZONE_CORRIGE / DONNÉES FOURNIES (copie)
longueur_de_courbe_2 = Slider(187.5, range=50..500)
maillon_2 = Slider(4, range=1..20)
recouvrement_2 = Slider(1.2, range=0..10)

# ---- group: ZONE_CORRIGE / ÉTAPE 1
subtraction = Subtraction(A=maillon_2, B=recouvrement_2)

# ---- group: ZONE_CORRIGE / ÉTAPE 2
subtraction_2 = Subtraction(A=longueur_de_courbe_2, B=maillon_2)
division = Division(A=subtraction_2, B=subtraction)
round = Round(Number=division)  # -> Nearest, Floor, Ceiling
addition = Addition(A=round.Floor, B=1)

# ---- group: ZONE_CORRIGE / ÉTAPE 3
panel = Panel(addition)

# ---- group: ZONE_CORRIGE / AFFICHAGE DU CORRIGÉ
afficher_le_corrigé = BooleanToggle(False)
gate = StreamGate(Stream=addition, Gate=afficher_le_corrigé)  # -> Target0, Target1
reponse_corrige = REPONSE_CORRIGE(gate.Target1)
