# Grasshopper definition B-12_complet.gh (Grasshopper 1.0.8)

# ---- group: ZONE_SUJET
# À partir du modèle fourni, produis une nomenclature triée par volume décroissant comportant,
# pour chaque pièce, le repère, le volume en dm³, la surface en dm² et la masse en kg pour une
# densité de 700 kg/m³. Exporte le tableau au format CSV.
reponse = REPONSE()
# B-12 · Nomenclature automatique et export CSV
# Intermédiaire  —  durée cible 25 min  —  réf. REF-082, REF-083, REF-085, REF-087  —  v0.5-260902
# ▼  CORRIGÉ — à consulter après validation  ▼
# RAPPEL — copie des données fournies dans la zone sujet, afin qu'aucun câble ne relie les deux zones
# ÉTAPE 1 — Une ligne par pièce, plus la ligne d'en-tête qui nomme les colonnes. Quinze lignes
# ÉTAPE 2 — L'oublier fait lire la première pièce comme un nom de colonne : elle disparaît de la
# nomenclature, sans erreur ni message. C'est le même contrôle que QT-05, sur un assemblage plutôt qu'un
# débit
# RÉSULTAT — tant que l'interrupteur AFFICHER LE CORRIGÉ reste sur faux, la sortie 1 du Stream Gate est
# vide : rien n'apparaît dans Rhino
# 14 pieces + 1 en-tete = 15 lignes.
pieces_de_l_assemblage = Slider(14, range=1..60)

# ---- group: ZONE_CORRIGE / DONNÉES FOURNIES (copie)
pieces_de_l_assemblage_2 = Slider(14, range=1..60)

# ---- group: ZONE_CORRIGE / ÉTAPE 1
addition = Addition(A=pieces_de_l_assemblage_2, B=1)
panel = Panel(addition)

# ---- group: ZONE_CORRIGE / AFFICHAGE DU CORRIGÉ
afficher_le_corrigé = BooleanToggle(False)
gate = StreamGate(Stream=addition, Gate=afficher_le_corrigé)  # -> Target0, Target1
reponse_corrige = REPONSE_CORRIGE(gate.Target1)
