# Grasshopper definition B-13_complet.gh (Grasshopper 1.0.8)

# ---- group: ZONE_SUJET
# Les 22 pièces rectangulaires fournies doivent être débitées dans des plaques de 2 800 × 2 070
# mm. Calcule le nombre de plaques nécessaires et le taux de chute en pourcentage.
aires_des_pieces = AIRES_DES_PIECES([720000, 405000, 720000, 562500, 330000, 360000, 750000, 160000, 700000, 552500, 585000, 490000, 480000, 522500, 250000, 700000, 640000, 367500, 840000, 292500, 570000, 1000000])
aire_d_une_plaque = AIRE_D_UNE_PLAQUE(5796000)
reponse = REPONSE()

# ---- group: ZONE_CORRIGE / DONNÉES FOURNIES (copie)
aires_des_pieces_2 = AIRES_DES_PIECES([720000, 405000, 720000, 562500, 330000, 360000, 750000, 160000, 700000, 552500, 585000, 490000, 480000, 522500, 250000, 700000, 640000, 367500, 840000, 292500, 570000, 1000000])
aire_d_une_plaque_2 = AIRE_D_UNE_PLAQUE(5796000)

# ---- group: ZONE_CORRIGE / ÉTAPE 1
# B-13 · Calepinage de plaques et calcul de chute
# Intermédiaire  —  durée cible 28 min  —  réf. REF-113, REF-082, REF-045  —  v0.5-260902
# ▼  CORRIGÉ — à consulter après validation  ▼
# RAPPEL — copie des données fournies dans la zone sujet, afin qu'aucun câble ne relie les deux zones
# ÉTAPE 1 — La surface à débiter : 12,00 m²
# ÉTAPE 2 — Rapportée à la plaque, elle en demande 2,07 — donc TROIS, arrondi au supérieur : on ne commande
# pas 7 % de plaque
# ÉTAPE 3 — La chute est ce qui reste des trois plaques : 31,00 %. C'est un MINORANT — le placement réel
# ajoute sa propre chute, et le taux d'atelier est toujours supérieur
# RÉSULTAT — tant que l'interrupteur AFFICHER LE CORRIGÉ reste sur faux, la sortie 1 du Stream Gate est
# vide : rien n'apparaît dans Rhino
ma = MassAddition(Input=aires_des_pieces_2)  # -> Result, PartialResults

# ---- group: ZONE_CORRIGE / ÉTAPE 2
division = Division(A=ma.Result, B=aire_d_une_plaque_2)
round = Round(Number=division)  # -> Nearest, Floor, Ceiling

# ---- group: ZONE_CORRIGE / ÉTAPE 3
multiplication = Multiplication(A=round.Ceiling, B=aire_d_une_plaque_2)
division_2 = Division(A=ma.Result, B=multiplication)
subtraction = Subtraction(A=1, B=division_2)
multiplication_2 = Multiplication(A=subtraction, B=100)
panel = Panel(multiplication_2)

# ---- group: ZONE_CORRIGE / AFFICHAGE DU CORRIGÉ
afficher_le_corrigé = BooleanToggle(False)
gate = StreamGate(Stream=multiplication_2, Gate=afficher_le_corrigé)  # -> Target0, Target1
reponse_corrige = REPONSE_CORRIGE(gate.Target1)
