# Grasshopper definition B-14_complet.gh (Grasshopper 1.0.8)

# ---- group: ZONE_SUJET
# Numérote les 14 pièces de l'assemblage de gauche à droite puis de bas en haut, au format R-A01
# à R-A14, et place l'étiquette au centre de gravité de chaque pièce, orientée face à la vue de
# face.
abscisses = ABSCISSES([1200, 400, 2000, 800, 1600, 400, 2000, 1200, 800, 1600, 400, 1200, 2000, 1600])
ordonnees = ORDONNEES([300, 300, 300, 900, 300, 900, 900, 900, 300, 900, 1500, 1500, 1500, 1500])
reponse = REPONSE()

# ---- group: ZONE_CORRIGE / ÉTAPE 1
rang_de_la_piece_visee = RANG_DE_LA_PIECE_VISEE(7)

# ---- group: ZONE_CORRIGE / ÉTAPE 2
# B-14 · Numérotation et étiquetage automatiques
# Intermédiaire  —  durée cible 22 min  —  réf. REF-066, REF-081, REF-057  —  v0.5-260902
# ▼  CORRIGÉ — à consulter après validation  ▼
# ÉTAPE 1 — L'étalon porte le rang cherché, obtenu en triant par ORDONNÉE d'abord, puis par abscisse —
# l'ordre de pose, rangée du bas en premier
# ÉTAPE 2 — Rang 7. Trier par colonne d'abord donnerait 5, et l'ordre de saisie 4 : l'ordre des critères
# n'est pas commutatif, et le poseur ne s'y retrouve que dans un seul des trois
# RÉSULTAT — tant que l'interrupteur AFFICHER LE CORRIGÉ reste sur faux, la sortie 1 du Stream Gate est
# vide : rien n'apparaît dans Rhino
item = ListItem(List=rang_de_la_piece_visee, Index=0, Wrap=True)
panel = Panel(item)

# ---- group: ZONE_CORRIGE / AFFICHAGE DU CORRIGÉ
afficher_le_corrigé = BooleanToggle(False)
gate = StreamGate(Stream=item, Gate=afficher_le_corrigé)  # -> Target0, Target1
reponse_corrige = REPONSE_CORRIGE(gate.Target1)
