# Grasshopper definition B-15_complet.gh (Grasshopper 1.0.8)

# ---- group: ZONE_SUJET
# Débite 30 pièces de longueurs variées dans des barres de 6 000 mm. Applique la règle du plus
# grand d'abord et affiche le nombre de barres consommées ainsi que la chute totale.
longueurs_a_debiter = LONGUEURS_A_DEBITER([2250, 1370, 2620, 3930, 840, 970, 3340, 1080, 2470, 3580, 890, 3190, 1690, 790, 1040, 2820, 2740, 950, 1830, 1060, 3420, 2770, 900, 3490, 1230, 1740, 3820, 3810, 3580, 910])
longueur_d_une_barre = LONGUEUR_D_UNE_BARRE(6000)
reponse = REPONSE()

# ---- group: ZONE_CORRIGE / ÉTAPE 1
charge_de_chaque_barre = CHARGE_DE_CHAQUE_BARRE([5760, 5560, 5500, 5830, 5990, 5960, 5730, 5960, 5960, 5560, 5680, 1630])

# ---- group: ZONE_CORRIGE / ÉTAPE 2
# B-15 · Optimisation d'une découpe linéaire
# Intermédiaire  —  durée cible 30 min  —  réf. REF-044, REF-045, REF-082  —  v0.5-260902
# ▼  CORRIGÉ — à consulter après validation  ▼
# ÉTAPE 1 — L'étalon porte le CHARGEMENT de chaque barre tel que la règle du plus grand d'abord le produit
# : on place la plus longue pièce restante dans la première barre qui peut encore la recevoir, et l'on
# n'ouvre une barre neuve que si aucune n'y suffit
# ÉTAPE 2 — Douze barres. La borne théorique — 65 120 ÷ 6 000, arrondi au supérieur — en annonce onze, et
# AUCUNE découpe ne l'atteint : les longueurs ne se combinent pas pour remplir onze barres
# ÉTAPE 3 — Ce que l'exercice enseigne : une borne n'est pas un objectif. Annoncer onze barres promet un
# rendement qu'aucun débit ne donnera
# RÉSULTAT — tant que l'interrupteur AFFICHER LE CORRIGÉ reste sur faux, la sortie 1 du Stream Gate est
# vide : rien n'apparaît dans Rhino
# borne theorique : 11 barres
# plus grand d'abord : 12 barres
# 
# L'ecart d'une barre se paie.
lng = ListLength(List=charge_de_chaque_barre)
panel = Panel(lng)

# ---- group: ZONE_CORRIGE / AFFICHAGE DU CORRIGÉ
afficher_le_corrigé = BooleanToggle(False)
gate = StreamGate(Stream=lng, Gate=afficher_le_corrigé)  # -> Target0, Target1
reponse_corrige = REPONSE_CORRIGE(gate.Target1)
