# Grasshopper definition B-16_complet.gh (Grasshopper 1.0.8)

# ---- group: ZONE_SUJET
# Produis un abat-jour composé de 24 lamelles réparties autour d'un axe. Chaque lamelle suit un
# profil dont la largeur varie de 15 mm aux extrémités à 45 mm au milieu, selon une courbe douce.
reponse = REPONSE()
# B-16 · Lampe à lamelles de section variable
# Intermédiaire  —  durée cible 28 min  —  réf. REF-064, REF-069, REF-067  —  v0.5-260902
# ▼  CORRIGÉ — à consulter après validation  ▼
# RAPPEL — copie des données fournies dans la zone sujet, afin qu'aucun câble ne relie les deux zones
# ÉTAPE 1 — La largeur varie LINÉAIREMENT : sa moyenne est la demi-somme des extrêmes, 30 mm — jamais le
# maximum
# ÉTAPE 2 — Une lamelle développée : hauteur par largeur moyenne
# ÉTAPE 3 — Vingt-quatre lamelles : 0,3024 m². Prendre la largeur maximale partout donnerait 0,4536 m²,
# soit 50 % de tôle en trop
# RÉSULTAT — tant que l'interrupteur AFFICHER LE CORRIGÉ reste sur faux, la sortie 1 du Stream Gate est
# vide : rien n'apparaît dans Rhino
lamelles = Slider(24, range=6..48)
largeur_aux_extremites = Slider(15, range=5..60)
largeur_au_milieu = Slider(45, range=5..100)
hauteur = Slider(420, range=100..900)

# ---- group: ZONE_CORRIGE / DONNÉES FOURNIES (copie)
lamelles_2 = Slider(24, range=6..48)
largeur_aux_extremites_2 = Slider(15, range=5..60)
largeur_au_milieu_2 = Slider(45, range=5..100)
hauteur_2 = Slider(420, range=100..900)

# ---- group: ZONE_CORRIGE / ÉTAPE 1
addition = Addition(A=largeur_aux_extremites_2, B=largeur_au_milieu_2)
division = Division(A=addition, B=2)

# ---- group: ZONE_CORRIGE / ÉTAPE 2
multiplication = Multiplication(A=hauteur_2, B=division)

# ---- group: ZONE_CORRIGE / ÉTAPE 3
multiplication_2 = Multiplication(A=multiplication, B=lamelles_2)
division_2 = Division(A=multiplication_2, B=1000000)
panel = Panel(division_2)

# ---- group: ZONE_CORRIGE / AFFICHAGE DU CORRIGÉ
afficher_le_corrigé = BooleanToggle(False)
gate = StreamGate(Stream=division_2, Gate=afficher_le_corrigé)  # -> Target0, Target1
reponse_corrige = REPONSE_CORRIGE(gate.Target1)
