# Grasshopper definition B-17_complet.gh (Grasshopper 1.0.8)

# ---- group: ZONE_SUJET
# Sur la coque libre fournie, extrais 9 nervures transversales espacées régulièrement, donne-leur
# 12 mm d'épaisseur et 60 mm de hauteur vers l'intérieur, puis prépare leur mise à plat.
reponse = REPONSE()
# B-17 · Coque à nervures depuis une surface libre
# Intermédiaire  —  durée cible 30 min  —  réf. REF-069, REF-101, REF-049  —  v0.5-260902
# ▼  CORRIGÉ — à consulter après validation  ▼
# RAPPEL — copie des données fournies dans la zone sujet, afin qu'aucun câble ne relie les deux zones
# ÉTAPE 1 — Le rayon d'un arc se retrouve de sa corde et de sa flèche : (c²/4 + f²) ÷ 2f, soit 2 179 mm
# ÉTAPE 2 — Le demi-angle au centre est l'arcsinus de la demi-corde sur le rayon ; l'arc vaut deux fois cet
# angle multiplié par le rayon — 3 594 mm, contre 3 200 de corde
# ÉTAPE 3 — Neuf nervures : 32,34 m. La corde en donnerait 28,80 — trois mètres et demi qui manquent,
# répartis sur les neuf pièces, donc vus tard
# RÉSULTAT — tant que l'interrupteur AFFICHER LE CORRIGÉ reste sur faux, la sortie 1 du Stream Gate est
# vide : rien n'apparaît dans Rhino
corde = Slider(3200, range=500..8000)
fleche = Slider(700, range=50..2000)
nervures = Slider(9, range=2..30)

# ---- group: ZONE_CORRIGE / DONNÉES FOURNIES (copie)
corde_2 = Slider(3200, range=500..8000)
fleche_2 = Slider(700, range=50..2000)
nervures_2 = Slider(9, range=2..30)

# ---- group: ZONE_CORRIGE / ÉTAPE 1
multiplication = Multiplication(A=corde_2, B=corde_2)
division = Division(A=multiplication, B=4)
multiplication_2 = Multiplication(A=fleche_2, B=fleche_2)
addition = Addition(A=division, B=multiplication_2)
multiplication_3 = Multiplication(A=fleche_2, B=2)
division_2 = Division(A=addition, B=multiplication_3)

# ---- group: ZONE_CORRIGE / ÉTAPE 2
division_3 = Division(A=corde_2, B=2)
division_4 = Division(A=division_3, B=division_2)
asin = ArcSine(Value=division_4)
multiplication_4 = Multiplication(A=asin, B=2)
multiplication_5 = Multiplication(A=multiplication_4, B=division_2)

# ---- group: ZONE_CORRIGE / ÉTAPE 3
multiplication_6 = Multiplication(A=multiplication_5, B=nervures_2)
division_5 = Division(A=multiplication_6, B=1000)
panel = Panel(division_5)

# ---- group: ZONE_CORRIGE / AFFICHAGE DU CORRIGÉ
afficher_le_corrigé = BooleanToggle(False)
gate = StreamGate(Stream=division_5, Gate=afficher_le_corrigé)  # -> Target0, Target1
reponse_corrige = REPONSE_CORRIGE(gate.Target1)
