# Grasshopper definition B-18_complet.gh (Grasshopper 1.0.8)

# ---- group: ZONE_SUJET
# Modélise une vis M10 au pas de 1,5 mm sur 30 mm de longueur filetée, profil triangulaire à 60°,
# et vérifie que le diamètre à fond de filet correspond bien à la valeur normalisée de 8,376 mm.
reponse = REPONSE()
# B-18 · Filetage hélicoïdal paramétrique
# Intermédiaire  —  durée cible 28 min  —  réf. REF-069, REF-103  —  v0.4-260901
# ▼  CORRIGÉ — à consulter après validation  ▼
# RAPPEL — copie des données fournies dans la zone sujet, afin qu'aucun câble ne relie les deux zones
# ÉTAPE 1 — Le profil ISO retire 1,2269 fois le pas au diamètre nominal — le filet est triangulaire à 60°
# et tronqué en fond comme en crête
# ÉTAPE 2 — 8,16 mm. Retrancher le pas une seule fois donnerait 8,50 — la section résistante paraîtrait 8 %
# plus grande qu'elle n'est, et la vis plus solide qu'elle n'est
# RÉSULTAT — tant que l'interrupteur AFFICHER LE CORRIGÉ reste sur faux, la sortie 1 du Stream Gate est
# vide : rien n'apparaît dans Rhino
diametre_nominal = Slider(10, range=3..30)
pas = Slider(1.5, range=0.5..4)

# ---- group: ZONE_CORRIGE / DONNÉES FOURNIES (copie)
diametre_nominal_2 = Slider(10, range=3..30)
pas_2 = Slider(1.5, range=0.5..4)

# ---- group: ZONE_CORRIGE / ÉTAPE 1
multiplication = Multiplication(A=pas_2, B=1.226869)
subtraction = Subtraction(A=diametre_nominal_2, B=multiplication)

# ---- group: ZONE_CORRIGE / ÉTAPE 2
panel = Panel(subtraction)

# ---- group: ZONE_CORRIGE / AFFICHAGE DU CORRIGÉ
afficher_le_corrigé = BooleanToggle(False)
gate = StreamGate(Stream=subtraction, Gate=afficher_le_corrigé)  # -> Target0, Target1
reponse_corrige = REPONSE_CORRIGE(gate.Target1)
