# Grasshopper definition C-01_complet.gh (Grasshopper 1.0.8)

# ---- group: ZONE_SUJET
# La façade sud du bâtiment reçoit 180 lames brise-soleil. Oriente chaque lame
# perpendiculairement à la direction du soleil au 21 juin à 15 h, puis optimise l'angle moyen
# pour limiter la surface exposée à 40 % de la surface vitrée tout en préservant au moins 25 % de
# vue directe.
reponse = REPONSE()
# C-01 · Enveloppe à brise-soleil orientés selon l'ensoleillement
# Perfectionnement  —  durée cible 90 min  —  réf. REF-027, REF-068, REF-095, REF-079  —  v0.5-260902
# ▼  CORRIGÉ — à consulter après validation  ▼
# RAPPEL — copie des données fournies dans la zone sujet, afin qu'aucun câble ne relie les deux zones
# ÉTAPE 1 — L'ombre d'une lame descend de sa profondeur multipliée par la tangente de la hauteur solaire.
# Pour qu'elle atteigne la lame suivante, il faut donc DIVISER l'entraxe par cette tangente
# ÉTAPE 2 — 249,95 mm. Multiplier au lieu de diviser donnerait 640 mm — une lame qui se recouvre elle-même
# sur un entraxe de 400, et une façade devenue mur
# RÉSULTAT — tant que l'interrupteur AFFICHER LE CORRIGÉ reste sur faux, la sortie 1 du Stream Gate est
# vide : rien n'apparaît dans Rhino
entraxe_des_lames = Slider(400, range=100..1200)
hauteur_solaire = Slider(58, range=10..85)

# ---- group: ZONE_CORRIGE / DONNÉES FOURNIES (copie)
entraxe_des_lames_2 = Slider(400, range=100..1200)
hauteur_solaire_2 = Slider(58, range=10..85)

# ---- group: ZONE_CORRIGE / ÉTAPE 1
rad = Radians(Degrees=hauteur_solaire_2)
tan = Tangent(Value=rad)
division = Division(A=entraxe_des_lames_2, B=tan)

# ---- group: ZONE_CORRIGE / ÉTAPE 2
panel = Panel(division)

# ---- group: ZONE_CORRIGE / AFFICHAGE DU CORRIGÉ
afficher_le_corrigé = BooleanToggle(False)
gate = StreamGate(Stream=division, Gate=afficher_le_corrigé)  # -> Target0, Target1
reponse_corrige = REPONSE_CORRIGE(gate.Target1)
