# Grasshopper definition C-02_complet.gh (Grasshopper 1.0.8)

# ---- group: ZONE_SUJET
# Sur le contour libre fourni, génère une toiture en résille triangulée, relaxe-la par Kangaroo
# pour obtenir une forme en équilibre de traction, puis produis la nomenclature des barres
# regroupées par longueur à 5 mm près et la liste des nœuds avec leur nombre de branches.
reponse = REPONSE()
# C-02 · Résille structurelle sur plan libre
# Perfectionnement  —  durée cible 90 min  —  réf. REF-069, REF-094, REF-074, REF-049  —  v0.5-260902
# ▼  CORRIGÉ — à consulter après validation  ▼
# RAPPEL — copie des données fournies dans la zone sujet, afin qu'aucun câble ne relie les deux zones
# ÉTAPE 1 — Le nombre de panneaux dans chaque sens : 12 par 8
# ÉTAPE 2 — Les horizontales courent sur chaque rangée de nœuds — il y en a une de plus que de panneaux ;
# de même pour les verticales
# ÉTAPE 3 — Une diagonale par panneau, longue de √2 fois la maille. Ce sont elles qui TRIANGULENT : sans
# elles, la résille est une grille articulée, et le chiffrage tombe à 424 m au lieu de 695
# ÉTAPE 4 — 695,53 m de barres
# RÉSULTAT — tant que l'interrupteur AFFICHER LE CORRIGÉ reste sur faux, la sortie 1 du Stream Gate est
# vide : rien n'apparaît dans Rhino
largeur = Slider(24000, range=6000..40000)
profondeur = Slider(16000, range=6000..40000)
maille = Slider(2000, range=500..4000)

# ---- group: ZONE_CORRIGE / DONNÉES FOURNIES (copie)
largeur_2 = Slider(24000, range=6000..40000)
profondeur_2 = Slider(16000, range=6000..40000)
maille_2 = Slider(2000, range=500..4000)

# ---- group: ZONE_CORRIGE / ÉTAPE 1
division = Division(A=largeur_2, B=maille_2)
division_2 = Division(A=profondeur_2, B=maille_2)

# ---- group: ZONE_CORRIGE / ÉTAPE 2
addition = Addition(A=division_2, B=1)
addition_2 = Addition(A=division, B=1)
multiplication = Multiplication(A=addition, B=division)
multiplication_2 = Multiplication(A=multiplication, B=maille_2)
multiplication_3 = Multiplication(A=addition_2, B=division_2)
multiplication_4 = Multiplication(A=multiplication_3, B=maille_2)

# ---- group: ZONE_CORRIGE / ÉTAPE 3
multiplication_5 = Multiplication(A=division, B=division_2)
sqrt = SquareRoot(Value=2)
multiplication_6 = Multiplication(A=maille_2, B=sqrt)
multiplication_7 = Multiplication(A=multiplication_5, B=multiplication_6)

# ---- group: ZONE_CORRIGE / ÉTAPE 4
addition_3 = Addition(A=multiplication_2, B=multiplication_4)
addition_4 = Addition(A=addition_3, B=multiplication_7)
division_3 = Division(A=addition_4, B=1000)
panel = Panel(division_3)

# ---- group: ZONE_CORRIGE / AFFICHAGE DU CORRIGÉ
afficher_le_corrigé = BooleanToggle(False)
gate = StreamGate(Stream=division_3, Gate=afficher_le_corrigé)  # -> Target0, Target1
reponse_corrige = REPONSE_CORRIGE(gate.Target1)
