# Grasshopper definition C-03_complet.gh (Grasshopper 1.0.8)

# ---- group: ZONE_SUJET
# Modélise 18 rangs de gradins de 850 mm de profondeur. La ligne de visée de chaque spectateur
# vers le point focal doit passer au moins 90 mm au-dessus de la tête du spectateur du rang
# précédent. Détermine automatiquement la hauteur de chaque marche et signale tout rang non
# conforme.
reponse = REPONSE()
# C-03 · Gradins avec contrôle de visibilité
# Perfectionnement  —  durée cible 80 min  —  réf. REF-047, REF-079, REF-046, REF-060  —  v0.4-260901
# ▼  CORRIGÉ — à consulter après validation  ▼
# ÉTAPE 1 — L'étalon porte les dix-huit hauteurs. La progression est RÉCURSIVE : chaque rang se déduit du
# précédent, multiplié par le rapport des distances au foyer — elle ne s'écrit pas sans boucle, et c'est
# pourquoi le corrigé la donne relevée
# ÉTAPE 2 — 3 105 mm au dernier rang. Ajouter 90 mm par rang en donnerait 1 530 — la moitié. Le dégagement
# ne s'ajoute pas, il se propage, et d'autant plus qu'on s'éloigne du foyer
# RÉSULTAT — tant que l'interrupteur AFFICHER LE CORRIGÉ reste sur faux, la sortie 1 du Stream Gate est
# vide : rien n'apparaît dans Rhino
rangs = Slider(18, range=4..40)
profondeur_de_rang = Slider(850, range=600..1400)
degagement = Slider(90, range=60..150)

# ---- group: ZONE_CORRIGE / ÉTAPE 1
hauteur_de_chaque_rang = HAUTEUR_DE_CHAQUE_RANG([0, 108.2142857, 231.5770863, 367.9059885, 515.5682241, 673.2962492, 840.0775287, 1015.084615, 1197.628646, 1387.127224, 1583.081497, 1785.059393, 1992.683044, 2205.619196, 2423.571742, 2646.27584, 2873.493212, 3105.008338])

# ---- group: ZONE_CORRIGE / ÉTAPE 2
bnd = Bounds(Numbers=hauteur_de_chaque_rang)
dedomain = DeconstructDomain(Domain=bnd)  # -> Start, End
panel = Panel(dedomain.End)

# ---- group: ZONE_CORRIGE / AFFICHAGE DU CORRIGÉ
afficher_le_corrigé = BooleanToggle(False)
gate = StreamGate(Stream=dedomain.End, Gate=afficher_le_corrigé)  # -> Target0, Target1
reponse_corrige = REPONSE_CORRIGE(gate.Target1)
