# Grasshopper definition C-04_complet.gh (Grasshopper 1.0.8)

# ---- group: ZONE_SUJET
# À partir du module constructif fourni, produis un devis quantitatif estimatif par lot (gros
# œuvre, menuiserie, second œuvre) avec quantités, unités, prix unitaires et totaux, ainsi qu'un
# récapitulatif par lot et un total général. Le calcul doit rester juste si l'on modifie les
# dimensions du module.
quantites = QUANTITES([18.4, 1.35, 96, 12, 7, 145, 210, 168, 320])
prix_unitaires = PRIX_UNITAIRES([185, 1420, 42, 680, 410, 88, 34, 52, 19])
reponse = REPONSE()

# ---- group: ZONE_CORRIGE / DONNÉES FOURNIES (copie)
quantites_2 = QUANTITES([18.4, 1.35, 96, 12, 7, 145, 210, 168, 320])
prix_unitaires_2 = PRIX_UNITAIRES([185, 1420, 42, 680, 410, 88, 34, 52, 19])

# ---- group: ZONE_CORRIGE / ÉTAPE 1
# C-04 · Métré et chiffrage complet d'un module
# Perfectionnement  —  durée cible 75 min  —  réf. REF-082, REF-083, REF-084, REF-086  —  v0.5-260902
# ▼  CORRIGÉ — à consulter après validation  ▼
# RAPPEL — copie des données fournies dans la zone sujet, afin qu'aucun câble ne relie les deux zones
# ÉTAPE 1 — Chaque ligne : sa quantité par son prix unitaire. Les unités diffèrent — m³, tonne, unité, m² —
# de sorte que sommer les quantités n'aurait aucun sens
# ÉTAPE 2 — 55 099,00 €. Un devis à trois lots et neuf lignes se vérifie de deux façons — par les lots et
# par les lignes — et les deux doivent tomber sur le même chiffre
# RÉSULTAT — tant que l'interrupteur AFFICHER LE CORRIGÉ reste sur faux, la sortie 1 du Stream Gate est
# vide : rien n'apparaît dans Rhino
multiplication = Multiplication(A=quantites_2, B=prix_unitaires_2)

# ---- group: ZONE_CORRIGE / ÉTAPE 2
ma = MassAddition(Input=multiplication)  # -> Result, PartialResults
panel = Panel(ma.Result)

# ---- group: ZONE_CORRIGE / AFFICHAGE DU CORRIGÉ
afficher_le_corrigé = BooleanToggle(False)
gate = StreamGate(Stream=ma.Result, Gate=afficher_le_corrigé)  # -> Target0, Target1
reponse_corrige = REPONSE_CORRIGE(gate.Target1)
