# Grasshopper definition C-05_complet.gh (Grasshopper 1.0.8)

# ---- group: ZONE_SUJET
# Modélise une bibliothèque de largeur, hauteur et profondeur paramétrables, à montants verticaux
# tous les 800 mm maximum et tablettes réglables. Produis la nomenclature de débit et la mise à
# plat repérée de tous les panneaux, prête pour la CNC.
reponse = REPONSE()
# C-05 · Bibliothèque paramétrique avec débit et mise à plat CNC
# Perfectionnement  —  durée cible 90 min  —  réf. REF-070, REF-082, REF-115, REF-087  —  v0.4-260901
# ▼  CORRIGÉ — à consulter après validation  ▼
# RAPPEL — copie des données fournies dans la zone sujet, afin qu'aucun câble ne relie les deux zones
# ÉTAPE 1 — Le nombre de travées est imposé par la portée maximale d'une tablette : 3 200 ÷ 800 fait
# exactement 4, arrondi au supérieur
# ÉTAPE 2 — Les montants sont un de plus que les travées — cinq, pas quatre. Le meuble monté sur le compte
# faux n'a pas de joue à une extrémité
# ÉTAPE 3 — Plus les tablettes, deux traverses et un fond : 28 panneaux
# RÉSULTAT — tant que l'interrupteur AFFICHER LE CORRIGÉ reste sur faux, la sortie 1 du Stream Gate est
# vide : rien n'apparaît dans Rhino
largeur = Slider(3200, range=800..6000)
entraxe_maximal = Slider(800, range=400..1200)
tablettes_par_travee = Slider(5, range=1..10)

# ---- group: ZONE_CORRIGE / DONNÉES FOURNIES (copie)
largeur_2 = Slider(3200, range=800..6000)
entraxe_maximal_2 = Slider(800, range=400..1200)
tablettes_par_travee_2 = Slider(5, range=1..10)

# ---- group: ZONE_CORRIGE / ÉTAPE 1
division = Division(A=largeur_2, B=entraxe_maximal_2)
round = Round(Number=division)  # -> Nearest, Floor, Ceiling

# ---- group: ZONE_CORRIGE / ÉTAPE 2
addition = Addition(A=round.Ceiling, B=1)

# ---- group: ZONE_CORRIGE / ÉTAPE 3
multiplication = Multiplication(A=round.Ceiling, B=tablettes_par_travee_2)
addition_2 = Addition(A=addition, B=multiplication)
addition_3 = Addition(A=addition_2, B=3)
panel = Panel(addition_3)

# ---- group: ZONE_CORRIGE / AFFICHAGE DU CORRIGÉ
afficher_le_corrigé = BooleanToggle(False)
gate = StreamGate(Stream=addition_3, Gate=afficher_le_corrigé)  # -> Target0, Target1
reponse_corrige = REPONSE_CORRIGE(gate.Target1)
