# Grasshopper definition C-06_complet.gh (Grasshopper 1.0.8)

# ---- group: ZONE_SUJET
# Modélise l'assise et le dossier d'une chaise en 22 lamelles de 40 mm de large et 8 mm
# d'épaisseur suivant deux courbes directrices. Le rayon de courbure de chaque lamelle ne doit
# jamais descendre sous 350 mm, limite de cintrage du matériau : signale toute lamelle non
# conforme.
reponse = REPONSE()
# C-06 · Chaise à assise en lamelles courbes
# Perfectionnement  —  durée cible 85 min  —  réf. REF-069, REF-064, REF-074  —  v0.4-260901
# ▼  CORRIGÉ — à consulter après validation  ▼
# RAPPEL — copie des données fournies dans la zone sujet, afin qu'aucun câble ne relie les deux zones
# ÉTAPE 1 — Le rayon d'un arc se retrouve de sa corde ET de sa flèche : (c² / 4 + f²) ÷ 2f. Ni la flèche ni
# la demi-corde ne sont le rayon
# ÉTAPE 2 — 371,73 mm, contre 200 admissibles pour une lamelle de 8 mm au rapport 25 : conforme, avec 86 %
# de marge
# RÉSULTAT — tant que l'interrupteur AFFICHER LE CORRIGÉ reste sur faux, la sortie 1 du Stream Gate est
# vide : rien n'apparaît dans Rhino
corde_de_la_directrice = Slider(420, range=100..1200)
fleche = Slider(65, range=10..300)
epaisseur_de_lamelle = Slider(8, range=2..20)

# ---- group: ZONE_CORRIGE / DONNÉES FOURNIES (copie)
corde_de_la_directrice_2 = Slider(420, range=100..1200)
fleche_2 = Slider(65, range=10..300)
epaisseur_de_lamelle_2 = Slider(8, range=2..20)

# ---- group: ZONE_CORRIGE / ÉTAPE 1
multiplication = Multiplication(A=corde_de_la_directrice_2, B=corde_de_la_directrice_2)
division = Division(A=multiplication, B=4)
multiplication_2 = Multiplication(A=fleche_2, B=fleche_2)
addition = Addition(A=division, B=multiplication_2)
multiplication_3 = Multiplication(A=fleche_2, B=2)
division_2 = Division(A=addition, B=multiplication_3)

# ---- group: ZONE_CORRIGE / ÉTAPE 2
multiplication_4 = Multiplication(A=epaisseur_de_lamelle_2, B=25)
panel = Panel(division_2)

# ---- group: ZONE_CORRIGE / AFFICHAGE DU CORRIGÉ
afficher_le_corrigé = BooleanToggle(False)
gate = StreamGate(Stream=division_2, Gate=afficher_le_corrigé)  # -> Target0, Target1
reponse_corrige = REPONSE_CORRIGE(gate.Target1)
