# Grasshopper definition C-07_complet.gh (Grasshopper 1.0.8)

# ---- group: ZONE_SUJET
# Réalise un configurateur de table de nuit : 4 types de pieds au choix, de 1 à 3 tiroirs, deux
# matériaux avec des épaisseurs différentes. Le modèle doit rester valide dans toutes les
# combinaisons et produire son prix estimatif.
reponse = REPONSE()
# C-07 · Table de nuit configurable
# Perfectionnement  —  durée cible 80 min  —  réf. REF-070, REF-072, REF-082, REF-106  —  v0.5-260902
# ▼  CORRIGÉ — à consulter après validation  ▼
# RAPPEL — copie des données fournies dans la zone sujet, afin qu'aucun câble ne relie les deux zones
# ÉTAPE 1 — Le meuble hors matière : base, pied, et les tiroirs
# ÉTAPE 2 — Le coefficient de matière s'applique à TOUT le meuble — pieds et tiroirs compris. Ne majorer
# que la base donnerait 858,20 € au lieu de 1 033,76 : un sixième du prix, toujours à la perte
# RÉSULTAT — tant que l'interrupteur AFFICHER LE CORRIGÉ reste sur faux, la sortie 1 du Stream Gate est
# vide : rien n'apparaît dans Rhino
prix_de_base = Slider(310, range=100..800)
prix_du_pied_choisi = Slider(154, range=50..250)
tiroirs = Slider(3, range=0..5)
prix_par_tiroir = Slider(88, range=20..200)
coefficient_matiere = Slider(1.42, range=1..2)

# ---- group: ZONE_CORRIGE / DONNÉES FOURNIES (copie)
prix_de_base_2 = Slider(310, range=100..800)
prix_du_pied_choisi_2 = Slider(154, range=50..250)
tiroirs_2 = Slider(3, range=0..5)
prix_par_tiroir_2 = Slider(88, range=20..200)
coefficient_matiere_2 = Slider(1.42, range=1..2)

# ---- group: ZONE_CORRIGE / ÉTAPE 1
multiplication = Multiplication(A=tiroirs_2, B=prix_par_tiroir_2)
addition = Addition(A=prix_de_base_2, B=prix_du_pied_choisi_2)
addition_2 = Addition(A=addition, B=multiplication)

# ---- group: ZONE_CORRIGE / ÉTAPE 2
multiplication_2 = Multiplication(A=addition_2, B=coefficient_matiere_2)
panel = Panel(multiplication_2)

# ---- group: ZONE_CORRIGE / AFFICHAGE DU CORRIGÉ
afficher_le_corrigé = BooleanToggle(False)
gate = StreamGate(Stream=multiplication_2, Gate=afficher_le_corrigé)  # -> Target0, Target1
reponse_corrige = REPONSE_CORRIGE(gate.Target1)
