# Grasshopper definition C-08_complet.gh (Grasshopper 1.0.8)

# ---- group: ZONE_SUJET
# Modélise une bague solitaire pour une pierre ronde de 6,5 mm : anneau de taille paramétrable,
# chaton, panier et 4 griffes. Contrôle que la masse en or 750 reste inférieure à 3,2 g et que la
# hauteur totale ne dépasse pas 8 mm.
reponse = REPONSE()
# C-08 · Bague solitaire complète
# Perfectionnement  —  durée cible 85 min  —  réf. REF-069, REF-068, REF-081, REF-079  —  v0.5-260902
# ▼  CORRIGÉ — à consulter après validation  ▼
# RAPPEL — copie des données fournies dans la zone sujet, afin qu'aucun câble ne relie les deux zones
# ÉTAPE 1 — La matière ne court pas sur la circonférence du DOIGT mais sur la fibre moyenne de l'anneau, à
# mi-épaisseur : la taille plus π fois l'épaisseur
# ÉTAPE 2 — Le volume de l'anneau, puis celui du chaton et des griffes
# ÉTAPE 3 — L'or 750 pèse 15,6 g par centimètre cube : 3,011 g, sous la limite de 3,2. Le calcul sur la
# circonférence nominale donnerait 2,845 — 0,17 g de moins, soit plus de trois fois la tolérance, et
# toujours en dessous de la vérité
# RÉSULTAT — tant que l'interrupteur AFFICHER LE CORRIGÉ reste sur faux, la sortie 1 du Stream Gate est
# vide : rien n'apparaît dans Rhino
taille_circonference = Slider(54, range=40..70)
largeur_de_l_anneau = Slider(2, range=1..6)
epaisseur = Slider(1.3, range=0.8..3)
volume_du_chaton = Slider(42, range=0..120)

# ---- group: ZONE_CORRIGE / DONNÉES FOURNIES (copie)
taille_circonference_2 = Slider(54, range=40..70)
largeur_de_l_anneau_2 = Slider(2, range=1..6)
epaisseur_2 = Slider(1.3, range=0.8..3)
volume_du_chaton_2 = Slider(42, range=0..120)

# ---- group: ZONE_CORRIGE / ÉTAPE 1
pi = Pi(Factor=1)
multiplication = Multiplication(A=epaisseur_2, B=pi)
addition = Addition(A=taille_circonference_2, B=multiplication)

# ---- group: ZONE_CORRIGE / ÉTAPE 2
multiplication_2 = Multiplication(A=addition, B=largeur_de_l_anneau_2)
multiplication_3 = Multiplication(A=multiplication_2, B=epaisseur_2)
addition_2 = Addition(A=multiplication_3, B=volume_du_chaton_2)

# ---- group: ZONE_CORRIGE / ÉTAPE 3
multiplication_4 = Multiplication(A=addition_2, B=15.6)
division = Division(A=multiplication_4, B=1000)
panel = Panel(division)

# ---- group: ZONE_CORRIGE / AFFICHAGE DU CORRIGÉ
afficher_le_corrigé = BooleanToggle(False)
gate = StreamGate(Stream=division, Gate=afficher_le_corrigé)  # -> Target0, Target1
reponse_corrige = REPONSE_CORRIGE(gate.Target1)
