# Grasshopper definition C-09_complet.gh (Grasshopper 1.0.8)

# ---- group: ZONE_SUJET
# Pave la surface libre fournie de pierres rondes de 1,2 à 2,5 mm réparties de manière quasi
# aléatoire mais sans jamais laisser moins de 0,3 mm de métal entre deux pierres voisines. Perce
# ensuite les logements coniques correspondants.
reponse = REPONSE()
# C-09 · Pavage de pierres sur surface libre
# Perfectionnement  —  durée cible 85 min  —  réf. REF-068, REF-101, REF-080, REF-045  —  v0.5-260902
# ▼  CORRIGÉ — à consulter après validation  ▼
# RAPPEL — copie des données fournies dans la zone sujet, afin qu'aucun câble ne relie les deux zones
# ÉTAPE 1 — Le pas d'une pierre à la suivante n'est pas son diamètre : c'est le diamètre PLUS le métal qui
# les sépare
# ÉTAPE 2 — Dans une maille hexagonale — la plus dense — chaque pierre occupe √3/2 fois le carré du pas,
# soit 4,00 mm² ici. Des disques ne pavent pas un plan : même sans écart, 9 % de vide subsiste
# ÉTAPE 3 — 64 pierres. Diviser par l'aire d'une pierre seule en donnerait 96 — une commande fausse de
# moitié
# RÉSULTAT — tant que l'interrupteur AFFICHER LE CORRIGÉ reste sur faux, la sortie 1 du Stream Gate est
# vide : rien n'apparaît dans Rhino
surface_a_paver = Slider(260, range=50..800)
diametre_de_pierre = Slider(1.85, range=0.5..5)
metal_entre_pierres = Slider(0.3, range=0.1..1)

# ---- group: ZONE_CORRIGE / DONNÉES FOURNIES (copie)
surface_a_paver_2 = Slider(260, range=50..800)
diametre_de_pierre_2 = Slider(1.85, range=0.5..5)
metal_entre_pierres_2 = Slider(0.3, range=0.1..1)

# ---- group: ZONE_CORRIGE / ÉTAPE 1
addition = Addition(A=diametre_de_pierre_2, B=metal_entre_pierres_2)

# ---- group: ZONE_CORRIGE / ÉTAPE 2
multiplication = Multiplication(A=addition, B=addition)
sqrt = SquareRoot(Value=3)
division = Division(A=sqrt, B=2)
multiplication_2 = Multiplication(A=multiplication, B=division)

# ---- group: ZONE_CORRIGE / ÉTAPE 3
division_2 = Division(A=surface_a_paver_2, B=multiplication_2)
round = Round(Number=division_2)  # -> Nearest, Floor, Ceiling
panel = Panel(round.Floor)

# ---- group: ZONE_CORRIGE / AFFICHAGE DU CORRIGÉ
afficher_le_corrigé = BooleanToggle(False)
gate = StreamGate(Stream=round.Floor, Gate=afficher_le_corrigé)  # -> Target0, Target1
reponse_corrige = REPONSE_CORRIGE(gate.Target1)
