# Grasshopper definition C-10_complet.gh (Grasshopper 1.0.8)

# ---- group: ZONE_SUJET
# Génère sur le corps de bague un motif de type Voronoï dont les cellules mesurent entre 0,8 et
# 2,2 mm², sépare les cellules par un filet de 0,25 mm, grave à 0,3 mm de profondeur, et fais en
# sorte que le motif boucle sans rupture visible.
reponse = REPONSE()
# C-10 · Motif gravé génératif sur bijou
# Perfectionnement  —  durée cible 80 min  —  réf. REF-115, REF-095, REF-069  —  v0.5-260902
# ▼  CORRIGÉ — à consulter après validation  ▼
# RAPPEL — copie des données fournies dans la zone sujet, afin qu'aucun câble ne relie les deux zones
# ÉTAPE 1 — Le côté d'une cellule d'aire donnée : sa racine carrée, 1,22 mm
# ÉTAPE 2 — Le filet court AUTOUR de chaque cellule : le pas réel est le côté plus le filet, 1,47 mm — soit
# 2,17 mm² par cellule au lieu de 1,5, 45 % de plus
# ÉTAPE 3 — 77 cellules. Ignorer le filet en donnerait 112 : le motif arrive trop dense, et le filet
# disparaît au polissage
# RÉSULTAT — tant que l'interrupteur AFFICHER LE CORRIGÉ reste sur faux, la sortie 1 du Stream Gate est
# vide : rien n'apparaît dans Rhino
surface_du_corps = Slider(168, range=50..500)
aire_de_cellule_visee = Slider(1.5, range=0.5..4)
filet = Slider(0.25, range=0.05..1)

# ---- group: ZONE_CORRIGE / DONNÉES FOURNIES (copie)
surface_du_corps_2 = Slider(168, range=50..500)
aire_de_cellule_visee_2 = Slider(1.5, range=0.5..4)
filet_2 = Slider(0.25, range=0.05..1)

# ---- group: ZONE_CORRIGE / ÉTAPE 1
sqrt = SquareRoot(Value=aire_de_cellule_visee_2)

# ---- group: ZONE_CORRIGE / ÉTAPE 2
addition = Addition(A=sqrt, B=filet_2)
multiplication = Multiplication(A=addition, B=addition)

# ---- group: ZONE_CORRIGE / ÉTAPE 3
division = Division(A=surface_du_corps_2, B=multiplication)
round = Round(Number=division)  # -> Nearest, Floor, Ceiling
panel = Panel(round.Floor)

# ---- group: ZONE_CORRIGE / AFFICHAGE DU CORRIGÉ
afficher_le_corrigé = BooleanToggle(False)
gate = StreamGate(Stream=round.Floor, Gate=afficher_le_corrigé)  # -> Target0, Target1
reponse_corrige = REPONSE_CORRIGE(gate.Target1)
