# Grasshopper definition C-11_complet.gh (Grasshopper 1.0.8)

# ---- group: ZONE_SUJET
# La pièce en tôle de 2 mm comporte 5 plis à 90° de rayon intérieur 3 mm. Produis son développé
# en tenant compte du facteur K de 0,44, cote les lignes de pli et vérifie que la longueur
# développée calculée correspond à la longueur mesurée sur le développé.
cotes_exterieures = COTES_EXTERIEURES([70, 120, 95, 120, 70, 45])
reponse = REPONSE()
# C-11 · Déroulé de tôle pliée avec compensation
# Perfectionnement  —  durée cible 80 min  —  réf. REF-116, REF-115, REF-082  —  v0.5-260902
# ▼  CORRIGÉ — à consulter après validation  ▼
# RAPPEL — copie des données fournies dans la zone sujet, afin qu'aucun câble ne relie les deux zones
# ÉTAPE 1 — L'étalon porte les parties réellement PLATES. Le décompte se fait segment par segment : les
# quatre segments intérieurs portent DEUX plis, les deux extrémités un seul. C'est une condition, pas un
# calcul — d'où le relevé
# ÉTAPE 2 — L'allongement d'un pli à 90° : un quart de cercle sur la fibre neutre, à r + K·e du centre de
# courbure
# ÉTAPE 3 — Cinq plis : 500,47 mm de développé. La somme des cotes extérieures donnerait 520 — près de 20
# mm de bande en trop
# RÉSULTAT — tant que l'interrupteur AFFICHER LE CORRIGÉ reste sur faux, la sortie 1 du Stream Gate est
# vide : rien n'apparaît dans Rhino
epaisseur = Slider(2, range=0.5..6)
rayon_interieur = Slider(3, range=0.5..10)
facteur_k = Slider(0.44, range=0.3..0.5)

# ---- group: ZONE_CORRIGE / ÉTAPE 1
parties_plates = PARTIES_PLATES([65, 110, 85, 110, 60, 40])
ma = MassAddition(Input=parties_plates)  # -> Result, PartialResults

# ---- group: ZONE_CORRIGE / DONNÉES FOURNIES (copie)
epaisseur_2 = Slider(2, range=0.5..6)
rayon_interieur_2 = Slider(3, range=0.5..10)
facteur_k_2 = Slider(0.44, range=0.3..0.5)

# ---- group: ZONE_CORRIGE / ÉTAPE 2
multiplication = Multiplication(A=facteur_k_2, B=epaisseur_2)
addition = Addition(A=rayon_interieur_2, B=multiplication)
pi = Pi(Factor=0.5)
multiplication_2 = Multiplication(A=addition, B=pi)

# ---- group: ZONE_CORRIGE / ÉTAPE 3
multiplication_3 = Multiplication(A=multiplication_2, B=5)
addition_2 = Addition(A=ma.Result, B=multiplication_3)
panel = Panel(addition_2)

# ---- group: ZONE_CORRIGE / AFFICHAGE DU CORRIGÉ
afficher_le_corrigé = BooleanToggle(False)
gate = StreamGate(Stream=addition_2, Gate=afficher_le_corrigé)  # -> Target0, Target1
reponse_corrige = REPONSE_CORRIGE(gate.Target1)
