# Grasshopper definition C-12_complet.gh (Grasshopper 1.0.8)

# ---- group: ZONE_SUJET
# Imbrique les 46 pièces découpées fournies dans des plaques de 3 000 × 1 500 mm avec un
# espacement de 8 mm entre pièces et 15 mm de bord de plaque. Produis le plan de découpe repéré,
# le nombre de plaques et le taux de matière utile, puis exporte en DXF par plaque.
aires_nues = AIRES_NUES([416000, 364900, 637200, 124200, 415950, 97900, 246875, 427500, 64000, 590175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])
aires_avec_espacement = AIRES_AVEC_ESPACEMENT([426624, 375084, 650104, 130104, 426854, 103284, 255099, 438124, 68224, 602719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])
surface_utile_d_une_plaque = SURFACE_UTILE_D_UNE_PLAQUE(4365900)
surface_d_une_plaque = SURFACE_D_UNE_PLAQUE(4500000)
reponse = REPONSE()

# ---- group: ZONE_CORRIGE / DONNÉES FOURNIES (copie)
aires_nues_2 = AIRES_NUES([416000, 364900, 637200, 124200, 415950, 97900, 246875, 427500, 64000, 590175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])
aires_avec_espacement_2 = AIRES_AVEC_ESPACEMENT([426624, 375084, 650104, 130104, 426854, 103284, 255099, 438124, 68224, 602719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])
surface_utile_d_une_plaque_2 = SURFACE_UTILE_D_UNE_PLAQUE(4365900)
surface_d_une_plaque_2 = SURFACE_D_UNE_PLAQUE(4500000)

# ---- group: ZONE_CORRIGE / ÉTAPE 1
# C-12 · Imbrication et export de fabrication
# Perfectionnement  —  durée cible 75 min  —  réf. REF-113, REF-114, REF-087  —  v0.4-260901
# ▼  CORRIGÉ — à consulter après validation  ▼
# RAPPEL — copie des données fournies dans la zone sujet, afin qu'aucun câble ne relie les deux zones
# ÉTAPE 1 — C'est la surface AVEC espacement qui décide du nombre de plaques, et la surface utile — bords
# perdus déduits — qui sert de référence : 13,45 m² ne tiennent pas dans les 13,10 m² utiles de trois
# plaques
# ÉTAPE 2 — Quatre plaques. Le calcul sur les surfaces nues en annoncerait trois — et la découpe
# s'arrêterait en fin de série, une plaque manquante au bon de commande
# ÉTAPE 3 — 27,36 % de chute. C'est un MINORANT, comme en B-13 : le placement réel ajoute la sienne
# RÉSULTAT — tant que l'interrupteur AFFICHER LE CORRIGÉ reste sur faux, la sortie 1 du Stream Gate est
# vide : rien n'apparaît dans Rhino
ma = MassAddition(Input=aires_avec_espacement_2)  # -> Result, PartialResults
division = Division(A=ma.Result, B=surface_utile_d_une_plaque_2)
round = Round(Number=division)  # -> Nearest, Floor, Ceiling

# ---- group: ZONE_CORRIGE / ÉTAPE 2
ma_2 = MassAddition(Input=aires_nues_2)  # -> Result, PartialResults
multiplication = Multiplication(A=round.Ceiling, B=surface_d_une_plaque_2)

# ---- group: ZONE_CORRIGE / ÉTAPE 3
division_2 = Division(A=ma_2.Result, B=multiplication)
subtraction = Subtraction(A=1, B=division_2)
multiplication_2 = Multiplication(A=subtraction, B=100)
panel = Panel(multiplication_2)

# ---- group: ZONE_CORRIGE / AFFICHAGE DU CORRIGÉ
afficher_le_corrigé = BooleanToggle(False)
gate = StreamGate(Stream=multiplication_2, Gate=afficher_le_corrigé)  # -> Target0, Target1
reponse_corrige = REPONSE_CORRIGE(gate.Target1)
