# Grasshopper definition DV-01_complet.gh (Grasshopper 1.0.8)

# ---- group: ZONE_SUJET
reponse = REPONSE()
# DV-01 · Quand écrire du script plutôt que câbler
# Expert  —  durée cible 8 min  —  réf. REF-100  —  v0.5-260902
# ▼  CORRIGÉ — à consulter après validation  ▼
# ÉTAPE 1 — La bonne réponse est la proposition 1. Le corrigé porte cet indice en clair : le menu du sujet,
# lui, part sur la première proposition, quelle qu'elle soit.
# ÉTAPE 2 — À retenir
# RÉSULTAT — tant que l'interrupteur AFFICHER LE CORRIGÉ reste sur faux, la sortie 1 du Stream Gate est
# vide : rien n'apparaît dans Rhino
# Le critere n'est pas la preference de
# celui qui ecrit, mais la lisibilite du
# resultat.
# 
# Scripter quand la logique est iterative
# ou conditionnelle et que le cablage la
# rendrait illisible.
reponse_qcm = ValueList({"0 - Dès qu'on sait programmer : c'est toujours plus rapide.": 0, "1 - Quand la logique est itérative ou conditionnelle, et que…": 1, "2 - Jamais : une définition doit rester lisible par des…": 2, "3 - Uniquement pour les performances.": 3}, selected=[])

# ---- group: ZONE_CORRIGE / ÉTAPE 1
bonne_reponse = BONNE_REPONSE(1)

# ---- group: ZONE_CORRIGE / AFFICHAGE DU CORRIGÉ
afficher_le_corrigé = BooleanToggle(False)
gate = StreamGate(Stream=bonne_reponse, Gate=afficher_le_corrigé)  # -> Target0, Target1
reponse_corrige = REPONSE_CORRIGE(gate.Target1)
