# Grasshopper definition DV-02_complet.gh (Grasshopper 1.0.8)

# ---- group: ZONE_SUJET
# Le rayon de cintrage minimal de la machine est de 250 mm. Sur la courbe fournie, donnez la
# longueur cumulée des portions où le rayon de courbure descend sous cette valeur, en
# millimètres.
trace_a_cintrer = TRACE_A_CINTRER()
reponse = REPONSE()
# DV-02 · Un composant scripté qui parle à RhinoCommon
# Expert  —  durée cible 35 min  —  réf. REF-101, REF-102, REF-103  —  v0.5-260902
# ▼  CORRIGÉ — à consulter après validation  ▼
# ÉTAPE 1 — L'étalon : le tracé livré par le bureau d'études
# ÉTAPE 2 — Le pas d'échantillonnage EST la réponse à l'exercice : 3 000 pas sur 5 988 mm font un point
# tous les 2 mm. À 200 mm, la zone entière passe entre deux échantillons et la pièce est déclarée
# fabricable. Le découpage se fait à LONGUEUR d'arc constante : un pas de paramètre constant resserrerait
# les points dans les courbes et compterait la zone quatre fois
# ÉTAPE 3 — Le rayon de courbure est l'INVERSE de la courbure. Comparer directement les courbures
# reviendrait à inverser le sens du critère : la zone dangereuse est celle où la courbure est GRANDE
# ÉTAPE 4 — Retenir les échantillons dont le rayon descend sous 250 mm, puis les compter
# ÉTAPE 5 — La longueur cumulée est le nombre d'échantillons retenus multiplié par le pas. 106 mm, sur un
# développé de 5 988 mm
# RÉSULTAT — tant que l'interrupteur AFFICHER LE CORRIGÉ reste sur faux, la sortie 1 du Stream Gate est
# vide : rien n'apparaît dans Rhino
rayon_de_cintrage_mini = Slider(250, range=100..500)

# ---- group: ZONE_CORRIGE / ÉTAPE 1
trace_de_reference = TRACE_DE_REFERENCE(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)

# ---- group: ZONE_CORRIGE / ÉTAPE 2
nombre_de_pas = NOMBRE_DE_PAS(3000)
divide = DivideCurve(Curve=trace_de_reference, Count=nombre_de_pas, Kinks=False)  # -> Points, Tangents, Parameters
curvature = Curvature(Curve=trace_de_reference, Parameter=divide.Parameters)  # -> P, K, C

# ---- group: ZONE_CORRIGE / ÉTAPE 3
vlen = VectorLength(Vector=curvature.K)
division = Division(A=1, B=vlen)

# ---- group: ZONE_CORRIGE / ÉTAPE 4
smaller = SmallerThan(FirstNumber=division, SecondNumber=250)  # -> SmallerThan, OrEqualTo
cull = CullPattern(List=division, CullPattern=smaller.SmallerThan)
lng = ListLength(List=cull)

# ---- group: ZONE_CORRIGE / ÉTAPE 5
len = Length(Curve=trace_de_reference)
division_2 = Division(A=len, B=nombre_de_pas)
multiplication = Multiplication(A=lng, B=division_2)
panel = Panel(multiplication)

# ---- group: ZONE_CORRIGE / AFFICHAGE DU CORRIGÉ
afficher_le_corrigé = BooleanToggle(False)
gate = StreamGate(Stream=multiplication, Gate=afficher_le_corrigé)  # -> Target0, Target1
reponse_corrige = REPONSE_CORRIGE(gate.Target1)
