# Grasshopper definition DV-03_complet.gh (Grasshopper 1.0.8)

# ---- group: ZONE_SUJET
reponse = REPONSE()
# DV-03 · Ce que les librairies évitent d'écrire
# Expert  —  durée cible 8 min  —  réf. REF-104, REF-105  —  v0.3-260826
# ▼  CORRIGÉ — à consulter après validation  ▼
# ÉTAPE 1 — La bonne réponse est la proposition 3. Le corrigé porte cet indice en clair : le menu du sujet,
# lui, part sur la première proposition, quelle qu'elle soit.
# ÉTAPE 2 — À retenir
# RÉSULTAT — tant que l'interrupteur AFFICHER LE CORRIGÉ reste sur faux, la sortie 1 du Stream Gate est
# vide : rien n'apparaît dans Rhino
# La question n'est pas la difficulte
# d'ECRIRE, mais le cout de VALIDER.
# 
# Une librairie eprouvee a deja rencontre
# les cas degeneres qu'un code neuf
# decouvrira en production.
reponse_qcm = ValueList({"0 - L'écrire : c'est un bon exercice.": 0, "1 - La demander à un assistant, qui l'écrira vite.": 1, "2 - Changer d'approche pour éviter d'en avoir besoin.": 2, "3 - Chercher si RhinoCommon la fournit déjà, puis une…": 3}, selected=[])

# ---- group: ZONE_CORRIGE / ÉTAPE 1
bonne_reponse = BONNE_REPONSE(3)

# ---- group: ZONE_CORRIGE / AFFICHAGE DU CORRIGÉ
afficher_le_corrigé = BooleanToggle(False)
gate = StreamGate(Stream=bonne_reponse, Gate=afficher_le_corrigé)  # -> Target0, Target1
reponse_corrige = REPONSE_CORRIGE(gate.Target1)
