# Grasshopper definition DV-05_complet.gh (Grasshopper 1.0.8)

# ---- group: ZONE_SUJET
reponse = REPONSE()
# DV-05 · Ce que la compilation change vraiment
# Expert  —  durée cible 8 min  —  réf. REF-096  —  v0.5-260902
# ▼  CORRIGÉ — à consulter après validation  ▼
# ÉTAPE 1 — La bonne réponse est la proposition 2. Le corrigé porte cet indice en clair : le menu du sujet,
# lui, part sur la première proposition, quelle qu'elle soit.
# ÉTAPE 2 — À retenir
# RÉSULTAT — tant que l'interrupteur AFFICHER LE CORRIGÉ reste sur faux, la sortie 1 du Stream Gate est
# vide : rien n'apparaît dans Rhino
# Composant scripte : une copie par definition.
# Plugin compile  : une version, N definitions.
# 
# Le gain est de DISTRIBUTION,
# pas de vitesse.
reponse_qcm = ValueList({"0 - Il ira plus vite : le code n'est plus interprété.": 0, "1 - Le code source devient illisible pour l'utilisateur.": 1, "2 - Il se distribue et se corrige en un seul endroit, sans…": 2, "3 - Il pourra enfin appeler RhinoCommon.": 3}, selected=[])

# ---- group: ZONE_CORRIGE / ÉTAPE 1
bonne_reponse = BONNE_REPONSE(2)

# ---- group: ZONE_CORRIGE / AFFICHAGE DU CORRIGÉ
afficher_le_corrigé = BooleanToggle(False)
gate = StreamGate(Stream=bonne_reponse, Gate=afficher_le_corrigé)  # -> Target0, Target1
reponse_corrige = REPONSE_CORRIGE(gate.Target1)
