# Grasshopper definition DV-06_complet.gh (Grasshopper 1.0.8)

# ---- group: ZONE_SUJET
reponse = REPONSE()
# DV-06 · Le plugin qui parle aussi à Rhino
# Expert  —  durée cible 8 min  —  réf. REF-097, REF-099  —  v0.5-260902
# ▼  CORRIGÉ — à consulter après validation  ▼
# ÉTAPE 1 — La bonne réponse est la proposition 2. Le corrigé porte cet indice en clair : le menu du sujet,
# lui, part sur la première proposition, quelle qu'elle soit.
# ÉTAPE 2 — À retenir
# RÉSULTAT — tant que l'interrupteur AFFICHER LE CORRIGÉ reste sur faux, la sortie 1 du Stream Gate est
# vide : rien n'apparaît dans Rhino
# .gha -> vit dans Grasshopper.
# .rhp -> declare des commandes Rhino.
# 
# Le calcul va dans une bibliotheque
# que les deux referencent. Sinon ils
# divergent des la premiere correction.
reponse_qcm = ValueList({"0 - Rien : un .gha est déjà chargé par Rhino, la commande…": 0, "1 - Réécrire le calcul en RhinoScript.": 1, "2 - Un plugin .rhp qui déclare la commande, les deux…": 2, "3 - Publier le .gha sur le gestionnaire de paquets.": 3}, selected=[])

# ---- group: ZONE_CORRIGE / ÉTAPE 1
bonne_reponse = BONNE_REPONSE(2)

# ---- group: ZONE_CORRIGE / AFFICHAGE DU CORRIGÉ
afficher_le_corrigé = BooleanToggle(False)
gate = StreamGate(Stream=bonne_reponse, Gate=afficher_le_corrigé)  # -> Target0, Target1
reponse_corrige = REPONSE_CORRIGE(gate.Target1)
