# Grasshopper definition DV-08_complet.gh (Grasshopper 1.0.8)

# ---- group: ZONE_SUJET
# L'arbre porte trois valeurs au premier niveau de chemin et quatre au second, soit une branche
# par combinaison. Le remappage ne conserve que le second niveau. Donnez le nombre de branches
# obtenues.
reponse = REPONSE()
# DV-08 · Ce que le remappage fait aux branches
# Expert  —  durée cible 25 min  —  réf. REF-105  —  v0.5-260902
# ▼  CORRIGÉ — à consulter après validation  ▼
# RAPPEL — copie des données fournies dans la zone sujet, afin qu'aucun câble ne relie les deux zones
# ÉTAPE 1 — L'arbre de départ porte une branche par combinaison : 3 × 4 = 12 chemins {A;B}
# ÉTAPE 2 — Le remappage laisse tomber le premier maillon. Les branches qui ne différaient QUE par lui
# fusionnent : il reste autant de chemins que le second niveau a de valeurs, soit 4 — et chacune porte
# désormais trois fois plus de données
# RÉSULTAT — tant que l'interrupteur AFFICHER LE CORRIGÉ reste sur faux, la sortie 1 du Stream Gate est
# vide : rien n'apparaît dans Rhino
valeurs_du_niveau_a = Slider(3, range=1..10)
valeurs_du_niveau_b = Slider(4, range=1..10)

# ---- group: ZONE_CORRIGE / DONNÉES FOURNIES (copie)
valeurs_du_niveau_a_2 = Slider(3, range=1..10)
valeurs_du_niveau_b_2 = Slider(4, range=1..10)

# ---- group: ZONE_CORRIGE / ÉTAPE 1
multiplication = Multiplication(A=valeurs_du_niveau_a_2, B=valeurs_du_niveau_b_2)
panel = Panel(multiplication)

# ---- group: ZONE_CORRIGE / ÉTAPE 2
addition = Addition(A=valeurs_du_niveau_b_2, B=0)
panel_2 = Panel(addition)

# ---- group: ZONE_CORRIGE / AFFICHAGE DU CORRIGÉ
afficher_le_corrigé = BooleanToggle(False)
gate = StreamGate(Stream=addition, Gate=afficher_le_corrigé)  # -> Target0, Target1
reponse_corrige = REPONSE_CORRIGE(gate.Target1)
