# Grasshopper definition DV-09_complet.gh (Grasshopper 1.0.8)

# ---- group: ZONE_SUJET
# Le script divise chacune des dix quantités par 4 et somme les résultats. Les quantités et le
# diviseur sont déclarés comme des ENTIERS. Donnez la somme rendue par le script.
quantites = QUANTITES([7, 13, 22, 5, 18, 31, 9, 26, 14, 3])
diviseur = DIVISEUR(4)
reponse = REPONSE()

# ---- group: ZONE_CORRIGE / DONNÉES FOURNIES (copie)
quantites_2 = QUANTITES([7, 13, 22, 5, 18, 31, 9, 26, 14, 3])
diviseur_2 = DIVISEUR(4)

# ---- group: ZONE_CORRIGE / ÉTAPE 1
# DV-09 · La division qui n'est pas celle qu'on croit
# Expert  —  durée cible 25 min  —  réf. REF-100, REF-102  —  v0.5-260902
# ▼  CORRIGÉ — à consulter après validation  ▼
# RAPPEL — copie des données fournies dans la zone sujet, afin qu'aucun câble ne relie les deux zones
# ÉTAPE 1 — La division réelle donne 1,75 pour 7 ÷ 4. Ce n'est pas ce que fait le langage sur deux ENTIERS
# ÉTAPE 2 — Sur des entiers, la division TRONQUE : elle prend la partie entière inférieure, elle n'arrondit
# pas. La sortie retenue est donc le plancher, pas le plus proche
# ÉTAPE 3 — 32, contre 37 en réel. Aucune des dix quantités n'est multiple de 4 : la troncature agit à
# chaque terme et l'écart s'accumule. Les deux valeurs sont assez proches pour paraître toutes deux
# crédibles — c'est exactement le danger
# RÉSULTAT — tant que l'interrupteur AFFICHER LE CORRIGÉ reste sur faux, la sortie 1 du Stream Gate est
# vide : rien n'apparaît dans Rhino
division = Division(A=quantites_2, B=diviseur_2)

# ---- group: ZONE_CORRIGE / ÉTAPE 2
round = Round(Number=division)  # -> Nearest, Floor, Ceiling

# ---- group: ZONE_CORRIGE / ÉTAPE 3
ma = MassAddition(Input=round.Floor)  # -> Result, PartialResults
panel = Panel(ma.Result)

# ---- group: ZONE_CORRIGE / AFFICHAGE DU CORRIGÉ
afficher_le_corrigé = BooleanToggle(False)
gate = StreamGate(Stream=ma.Result, Gate=afficher_le_corrigé)  # -> Target0, Target1
reponse_corrige = REPONSE_CORRIGE(gate.Target1)
