# Grasshopper definition FA-01_complet.gh (Grasshopper 1.0.8)

# ---- group: ZONE_SUJET
# Les 20 pièces à débiter vous sont fournies avec leurs dimensions. Donnez le nombre minimal
# théorique de panneaux, c'est-à-dire celui qu'imposerait déjà la seule surface, avant toute
# contrainte de placement.
longueurs_mm = LONGUEURS_MM([1180, 860, 1420, 640, 980, 1560, 720, 1120, 890, 1340, 600, 1480, 760, 1050, 920, 1260, 680, 1390, 840, 1150])
hauteurs_mm = HAUTEURS_MM([450, 640, 410, 570, 490, 350, 610, 430, 550, 380, 660, 320, 590, 470, 520, 400, 630, 360, 540, 460])
reponse = REPONSE()
# FA-01 · Combien de panneaux pour ce débit
# Perfectionnement  —  durée cible 35 min  —  réf. REF-113, REF-114  —  v0.3-260826
# ▼  CORRIGÉ — à consulter après validation  ▼
# RAPPEL — copie des données fournies dans la zone sujet, afin qu'aucun câble ne relie les deux zones
# ÉTAPE 1 — Surface de chaque pièce, puis surface totale du débit
# ÉTAPE 2 — Surface d'un panneau brut
# ÉTAPE 3 — Le rapport vaut 3,10 panneaux. Un panneau se commande entier : c'est un approvisionnement, donc
# un arrondi au SUPÉRIEUR. L'arrondi au plus proche donnerait 3, et il manquerait de quoi débiter un
# dixième du lot
# ÉTAPE 4 — Ce nombre est un MINORANT : aucune imbrication ne peut faire mieux, et toutes feront moins bien
# — la chute de placement s'ajoute à la chute de surface
# RÉSULTAT — tant que l'interrupteur AFFICHER LE CORRIGÉ reste sur faux, la sortie 1 du Stream Gate est
# vide : rien n'apparaît dans Rhino
# 3,10 panneaux exiges -> 4 commandes.
# Le nombre reel sera superieur.
panneau_longueur = Slider(2500, range=1000..3000)
panneau_largeur = Slider(1250, range=600..2000)

# ---- group: ZONE_CORRIGE / DONNÉES FOURNIES (copie)
longueurs_mm_2 = LONGUEURS_MM([1180, 860, 1420, 640, 980, 1560, 720, 1120, 890, 1340, 600, 1480, 760, 1050, 920, 1260, 680, 1390, 840, 1150])
hauteurs_mm_2 = HAUTEURS_MM([450, 640, 410, 570, 490, 350, 610, 430, 550, 380, 660, 320, 590, 470, 520, 400, 630, 360, 540, 460])
panneau_longueur_2 = Slider(2500, range=1000..3000)
panneau_largeur_2 = Slider(1250, range=600..2000)

# ---- group: ZONE_CORRIGE / ÉTAPE 1
multiplication = Multiplication(A=longueurs_mm_2, B=hauteurs_mm_2)
ma = MassAddition(Input=multiplication)  # -> Result, PartialResults

# ---- group: ZONE_CORRIGE / ÉTAPE 2
multiplication_2 = Multiplication(A=panneau_longueur_2, B=panneau_largeur_2)

# ---- group: ZONE_CORRIGE / ÉTAPE 3
division = Division(A=ma.Result, B=multiplication_2)
round = Round(Number=division)  # -> Nearest, Floor, Ceiling
panel = Panel(round.Ceiling)

# ---- group: ZONE_CORRIGE / AFFICHAGE DU CORRIGÉ
afficher_le_corrigé = BooleanToggle(False)
gate = StreamGate(Stream=round.Ceiling, Gate=afficher_le_corrigé)  # -> Target0, Target1
reponse_corrige = REPONSE_CORRIGE(gate.Target1)
