# Grasshopper definition FA-02_complet.gh (Grasshopper 1.0.8)

# ---- group: ZONE_SUJET
# La virole relie un diamètre de 360 mm à un diamètre de 190 mm sur une hauteur de 340 mm.
# Produisez son développé à plat et donnez la surface développée, en mètres carrés.
reponse = REPONSE()
# FA-02 · Le développé d'une virole
# Perfectionnement  —  durée cible 30 min  —  réf. REF-115, REF-116  —  v0.5-260902
# ▼  CORRIGÉ — à consulter après validation  ▼
# RAPPEL — copie des données fournies dans la zone sujet, afin qu'aucun câble ne relie les deux zones
# ÉTAPE 1 — Contrôle par le calcul, indépendant du déroulé. La génératrice n'est PAS la hauteur : elle vaut
# la racine de la hauteur au carré plus l'écart des rayons au carré — 350,46 mm ici, contre 340 de hauteur.
# Deux pour cent d'écart, et la virole ne se referme pas
# ÉTAPE 2 — Surface développée : π multiplié par la somme des rayons, multiplié par la génératrice
# ÉTAPE 3 — En mètres carrés : 0,3028. Prendre la hauteur pour la génératrice donnerait 0,2938 — moins de
# trois pour cent d'écart, invisible sur un devis, fatal à l'atelier
# RÉSULTAT — tant que l'interrupteur AFFICHER LE CORRIGÉ reste sur faux, la sortie 1 du Stream Gate est
# vide : rien n'apparaît dans Rhino
grand_rayon = Slider(180, range=50..400)
petit_rayon = Slider(95, range=20..300)
hauteur = Slider(340, range=100..800)

# ---- group: ZONE_CORRIGE / DONNÉES FOURNIES (copie)
grand_rayon_2 = Slider(180, range=50..400)
petit_rayon_2 = Slider(95, range=20..300)
hauteur_2 = Slider(340, range=100..800)

# ---- group: ZONE_CORRIGE / ÉTAPE 1
subtraction = Subtraction(A=grand_rayon_2, B=petit_rayon_2)
multiplication = Multiplication(A=subtraction, B=subtraction)
multiplication_2 = Multiplication(A=hauteur_2, B=hauteur_2)
addition = Addition(A=multiplication_2, B=multiplication)
sqrt = SquareRoot(Value=addition)

# ---- group: ZONE_CORRIGE / ÉTAPE 2
addition_2 = Addition(A=grand_rayon_2, B=petit_rayon_2)
pi = Pi(Factor=1)
multiplication_3 = Multiplication(A=addition_2, B=pi)
multiplication_4 = Multiplication(A=multiplication_3, B=sqrt)

# ---- group: ZONE_CORRIGE / ÉTAPE 3
division = Division(A=multiplication_4, B=1000000)
panel = Panel(division)

# ---- group: ZONE_CORRIGE / AFFICHAGE DU CORRIGÉ
afficher_le_corrigé = BooleanToggle(False)
gate = StreamGate(Stream=division, Gate=afficher_le_corrigé)  # -> Target0, Target1
reponse_corrige = REPONSE_CORRIGE(gate.Target1)
