# Grasshopper definition FA-03_complet.gh (Grasshopper 1.0.8)

# ---- group: ZONE_SUJET
# Le profil en U mesure 120 mm d'aile, 300 mm d'âme, cotes extérieures, dans une tôle de 3 mm.
# Les deux plis à 90° se font sur un rayon intérieur de 5 mm, avec un facteur K de 0,42. Donnez
# la longueur de la bande à débiter, en millimètres.
reponse = REPONSE()
# FA-03 · Le développé d'un profil plié
# Perfectionnement  —  durée cible 35 min  —  réf. REF-116  —  v0.3-260826
# ▼  CORRIGÉ — à consulter après validation  ▼
# RAPPEL — copie des données fournies dans la zone sujet, afin qu'aucun câble ne relie les deux zones
# ÉTAPE 1 — La partie réellement PLATE d'une paroi n'est pas sa cote extérieure : le pli lui prend le rayon
# et l'épaisseur. Une aile, qui ne porte qu'un pli, en perd une fois ; l'âme, qui en porte deux, en perd
# deux fois
# ÉTAPE 2 — L'allongement d'un pli à 90° : un quart de cercle décrit par la FIBRE NEUTRE, la seule fibre
# qui garde sa longueur au pliage. Elle se situe à r + K·e du centre de courbure — le facteur K dit où
# exactement, et il ne vaut pas 0,5
# ÉTAPE 3 — Le développé est la somme des parties plates et des deux allongements : 527,67 mm. Additionner
# les cotes extérieures donnerait 540 mm — 12,3 mm de trop, invisibles au plan, et répétés sur chaque pièce
# de la série
# RÉSULTAT — tant que l'interrupteur AFFICHER LE CORRIGÉ reste sur faux, la sortie 1 du Stream Gate est
# vide : rien n'apparaît dans Rhino
aile_exterieure = Slider(120, range=50..300)
ame_exterieure = Slider(300, range=100..600)
epaisseur = Slider(3, range=1..10)
rayon_interieur = Slider(5, range=1..20)
facteur_k = Slider(0.42, range=0.3..0.5)

# ---- group: ZONE_CORRIGE / DONNÉES FOURNIES (copie)
aile_exterieure_2 = Slider(120, range=50..300)
ame_exterieure_2 = Slider(300, range=100..600)
epaisseur_2 = Slider(3, range=1..10)
rayon_interieur_2 = Slider(5, range=1..20)
facteur_k_2 = Slider(0.42, range=0.3..0.5)

# ---- group: ZONE_CORRIGE / ÉTAPE 1
addition = Addition(A=rayon_interieur_2, B=epaisseur_2)
subtraction = Subtraction(A=aile_exterieure_2, B=addition)
multiplication = Multiplication(A=addition, B=2)
subtraction_2 = Subtraction(A=ame_exterieure_2, B=multiplication)

# ---- group: ZONE_CORRIGE / ÉTAPE 2
multiplication_2 = Multiplication(A=facteur_k_2, B=epaisseur_2)
addition_2 = Addition(A=rayon_interieur_2, B=multiplication_2)
pi = Pi(Factor=0.5)
multiplication_3 = Multiplication(A=addition_2, B=pi)

# ---- group: ZONE_CORRIGE / ÉTAPE 3
multiplication_4 = Multiplication(A=subtraction, B=2)
addition_3 = Addition(A=multiplication_4, B=subtraction_2)
multiplication_5 = Multiplication(A=multiplication_3, B=2)
addition_4 = Addition(A=addition_3, B=multiplication_5)
panel = Panel(addition_4)

# ---- group: ZONE_CORRIGE / AFFICHAGE DU CORRIGÉ
afficher_le_corrigé = BooleanToggle(False)
gate = StreamGate(Stream=addition_4, Gate=afficher_le_corrigé)  # -> Target0, Target1
reponse_corrige = REPONSE_CORRIGE(gate.Target1)
