# Grasshopper definition FA-04_complet.gh (Grasshopper 1.0.8)

# ---- group: ZONE_SUJET
# Le volume de construction mesure 250 × 210 × 210 mm. La pièce tient dans un encombrement de 62
# × 38 × 95 mm et ne peut pas être réorientée. Il faut 4 mm entre deux pièces et 4 mm entre une
# pièce et chaque paroi. Donnez le nombre de pièces par fournée.
reponse = REPONSE()
# FA-04 · Combien de pièces par fournée
# Perfectionnement  —  durée cible 30 min  —  réf. REF-114  —  v0.3-260826
# ▼  CORRIGÉ — à consulter après validation  ▼
# ÉTAPE 1 — Sur chaque axe : retrancher les deux écarts de paroi, puis chercher combien de pièces séparées
# d'un écart tiennent dans ce qui reste. Entre n pièces il y a n − 1 intervalles, d'où le + écart au
# numérateur
# ÉTAPE 2 — L'arrondi se fait à l'entier INFÉRIEUR : une pièce qui dépasse ne se produit pas. Les trois
# divisions tombent sur 3,72, 4,90 et 2,08 — au plus proche, elles donneraient 4, 5 et 2, soit quarante
# pièces qui ne rentrent pas
# ÉTAPE 3 — Le même compte sur la hauteur
# ÉTAPE 4 — 3 × 4 × 2 font 24 pièces. Le rapport des volumes en annonçait 49 — le double. Les pièces ne se
# déforment pas pour combler les creux, et c'est ce que le rapport des volumes oublie
# RÉSULTAT — tant que l'interrupteur AFFICHER LE CORRIGÉ reste sur faux, la sortie 1 du Stream Gate est
# vide : rien n'apparaît dans Rhino
plateau_x = Slider(250, range=100..400)
plateau_y = Slider(210, range=100..400)
plateau_z = Slider(210, range=100..400)
ecart = Slider(4, range=0..20)

# ---- group: ZONE_CORRIGE / ÉTAPE 1
subtraction = Subtraction(A=250, B=8)
addition = Addition(A=subtraction, B=4)
addition_2 = Addition(A=62, B=4)
division = Division(A=addition, B=addition_2)
round = Round(Number=division)  # -> Nearest, Floor, Ceiling

# ---- group: ZONE_CORRIGE / ÉTAPE 2
subtraction_2 = Subtraction(A=210, B=8)
addition_3 = Addition(A=subtraction_2, B=4)
addition_4 = Addition(A=38, B=4)
division_2 = Division(A=addition_3, B=addition_4)
round_2 = Round(Number=division_2)  # -> Nearest, Floor, Ceiling

# ---- group: ZONE_CORRIGE / ÉTAPE 3
subtraction_3 = Subtraction(A=210, B=8)
addition_5 = Addition(A=subtraction_3, B=4)
addition_6 = Addition(A=95, B=4)
division_3 = Division(A=addition_5, B=addition_6)
round_3 = Round(Number=division_3)  # -> Nearest, Floor, Ceiling

# ---- group: ZONE_CORRIGE / ÉTAPE 4
multiplication = Multiplication(A=round.Floor, B=round_2.Floor)
multiplication_2 = Multiplication(A=multiplication, B=round_3.Floor)
panel = Panel(multiplication_2)

# ---- group: ZONE_CORRIGE / AFFICHAGE DU CORRIGÉ
afficher_le_corrigé = BooleanToggle(False)
gate = StreamGate(Stream=multiplication_2, Gate=afficher_le_corrigé)  # -> Target0, Target1
reponse_corrige = REPONSE_CORRIGE(gate.Target1)
