# Grasshopper definition FA-05_complet.gh (Grasshopper 1.0.8)

# ---- group: ZONE_SUJET
reponse = REPONSE()
# FA-05 · Ce qui se met à plat, et ce qui ne s'y met pas
# Perfectionnement  —  durée cible 8 min  —  réf. REF-159  —  v0.5-260902
# ▼  CORRIGÉ — à consulter après validation  ▼
# ÉTAPE 1 — La bonne réponse est la proposition 3. Le corrigé porte cet indice en clair : le menu du sujet,
# lui, part sur la première proposition, quelle qu'elle soit.
# ÉTAPE 2 — À retenir
# RÉSULTAT — tant que l'interrupteur AFFICHER LE CORRIGÉ reste sur faux, la sortie 1 du Stream Gate est
# vide : rien n'apparaît dans Rhino
# Aucun outil ne refuse de derouler.
# Ils deforment.
# 
# L'ecart se chiffre — et il se chiffre
# AVANT de decouper en bandes.
reponse_qcm = ValueList({"0 - Que la surface est développable, sinon il aurait refusé.": 0, "1 - Que le déroulé est juste aux tolérances près du logiciel.": 1, "2 - Qu'il faut découper la surface en bandes pour être…": 2, "3 - Qu'il a produit une APPROXIMATION, dont l'écart se…": 3}, selected=[])

# ---- group: ZONE_CORRIGE / ÉTAPE 1
bonne_reponse = BONNE_REPONSE(3)

# ---- group: ZONE_CORRIGE / AFFICHAGE DU CORRIGÉ
afficher_le_corrigé = BooleanToggle(False)
gate = StreamGate(Stream=bonne_reponse, Gate=afficher_le_corrigé)  # -> Target0, Target1
reponse_corrige = REPONSE_CORRIGE(gate.Target1)
