# Grasshopper definition FA-06_complet.gh (Grasshopper 1.0.8)

# ---- group: ZONE_SUJET
# Le panneau mesure 2 500 mm. Chaque pièce fait 352 mm, le trait de scie 4 mm, et 12 mm de rive
# sont à écarter de chaque côté. Donnez le nombre de pièces par panneau.
reponse = REPONSE()
# FA-06 · Le trait de scie mange une pièce
# Perfectionnement  —  durée cible 25 min  —  réf. REF-160  —  v0.5-260902
# ▼  CORRIGÉ — à consulter après validation  ▼
# RAPPEL — copie des données fournies dans la zone sujet, afin qu'aucun câble ne relie les deux zones
# ÉTAPE 1 — Retirer les DEUX rives : 2 476 mm utilisables sur 2 500
# ÉTAPE 2 — Entre n pièces il y a n − 1 traits de scie, d'où le trait ajouté au numérateur et à la longueur
# de pièce
# ÉTAPE 3 — Arrondi à l'entier INFÉRIEUR : 6 pièces. Diviser 2 500 par 352 en donnerait 7 — il en manque
# une. Rives et traits mangent 44 mm à eux tous, moins de 2 % du panneau, et une pièce sur sept
# RÉSULTAT — tant que l'interrupteur AFFICHER LE CORRIGÉ reste sur faux, la sortie 1 du Stream Gate est
# vide : rien n'apparaît dans Rhino
longueur_du_panneau = Slider(2500, range=500..5000)
longueur_d_une_piece = Slider(352, range=50..1000)
trait_de_scie = Slider(4, range=0..10)
rive_a_ecarter = Slider(12, range=0..50)

# ---- group: ZONE_CORRIGE / DONNÉES FOURNIES (copie)
longueur_du_panneau_2 = Slider(2500, range=500..5000)
longueur_d_une_piece_2 = Slider(352, range=50..1000)
trait_de_scie_2 = Slider(4, range=0..10)
rive_a_ecarter_2 = Slider(12, range=0..50)

# ---- group: ZONE_CORRIGE / ÉTAPE 1
multiplication = Multiplication(A=rive_a_ecarter_2, B=2)
subtraction = Subtraction(A=longueur_du_panneau_2, B=multiplication)

# ---- group: ZONE_CORRIGE / ÉTAPE 2
addition = Addition(A=subtraction, B=trait_de_scie_2)
addition_2 = Addition(A=longueur_d_une_piece_2, B=trait_de_scie_2)
division = Division(A=addition, B=addition_2)

# ---- group: ZONE_CORRIGE / ÉTAPE 3
round = Round(Number=division)  # -> Nearest, Floor, Ceiling
panel = Panel(round.Floor)

# ---- group: ZONE_CORRIGE / AFFICHAGE DU CORRIGÉ
afficher_le_corrigé = BooleanToggle(False)
gate = StreamGate(Stream=round.Floor, Gate=afficher_le_corrigé)  # -> Target0, Target1
reponse_corrige = REPONSE_CORRIGE(gate.Target1)
