# Grasshopper definition G-01_complet.gh (Grasshopper 1.0.8)

# ---- group: ZONE_SUJET
# Trie les 12 valeurs par ordre croissant. Chaque valeur correctement placée rapporte 10 points,
# chaque valeur mal placée en coûte 5. Le score s'affiche en direct dans le panneau SCORE.
valeurs_melangees = VALEURS_MELANGEES([847, 132, 596, 274, 913, 458, 61, 725, 389, 168, 502, 941])
reponse = REPONSE()

# ---- group: ZONE_CORRIGE / DONNÉES FOURNIES (copie)
valeurs_melangees_2 = VALEURS_MELANGEES([847, 132, 596, 274, 913, 458, 61, 725, 389, 168, 502, 941])

# ---- group: ZONE_CORRIGE / ÉTAPE 1
# G-01 · Le tableau des scores
# Débutant  —  durée cible 10 min  —  réf. REF-047, REF-043  —  v0.5-260902
# ▼  CORRIGÉ — à consulter après validation  ▼
# RAPPEL — copie des données fournies dans la zone sujet, afin qu'aucun câble ne relie les deux zones
# ÉTAPE 1 — `Sort List` trie ses CLÉS et rend la liste triée. Le score en découle : dix points par valeur
# bien placée, douze fois, cent vingt
# RÉSULTAT — tant que l'interrupteur AFFICHER LE CORRIGÉ reste sur faux, la sortie 1 du Stream Gate est
# vide : rien n'apparaît dans Rhino
sort = SortList(Keys=valeurs_melangees_2)  # -> Keys, ValuesA
panel = Panel(sort.Keys)

# ---- group: ZONE_CORRIGE / AFFICHAGE DU CORRIGÉ
afficher_le_corrigé = BooleanToggle(False)
gate = StreamGate(Stream=sort.Keys, Gate=afficher_le_corrigé)  # -> Target0, Target1
reponse_corrige = REPONSE_CORRIGE(gate.Target1)
