# Grasshopper definition G-02_complet.gh (Grasshopper 1.0.8)

# ---- group: ZONE_SUJET
# Reconstitue le logo en 5 étapes. Chaque forme correctement placée fait progresser la barre de
# 20 %. La barre passe au vert à 100 %.
reponse = REPONSE()
# G-02 · La barre de progression
# Débutant  —  durée cible 12 min  —  réf. REF-062, REF-063  —  v0.4-260901
# ▼  CORRIGÉ — à consulter après validation  ▼
# RAPPEL — copie des données fournies dans la zone sujet, afin qu'aucun câble ne relie les deux zones
# ÉTAPE 1 — Le cercle : 2πr. Le rectangle : deux fois la somme de ses côtés
# ÉTAPE 2 — Le triangle et l'hexagone : n fois leur côté. C'est ici que se perd le premier jalon — prendre
# le côté pour le périmètre donne 936,74 au lieu de 1 372,74
# ÉTAPE 3 — 1 372,74 mm : la barre passe au vert
# RÉSULTAT — tant que l'interrupteur AFFICHER LE CORRIGÉ reste sur faux, la sortie 1 du Stream Gate est
# vide : rien n'apparaît dans Rhino
rayon_du_cercle = Slider(45, range=10..200)
rectangle_cote_a = Slider(120, range=10..300)
rectangle_cote_b = Slider(70, range=10..300)
cote_du_triangle = Slider(88, range=10..200)
cote_de_l_hexagone = Slider(52, range=10..200)
longueur_du_segment = Slider(134, range=10..300)

# ---- group: ZONE_CORRIGE / DONNÉES FOURNIES (copie)
rayon_du_cercle_2 = Slider(45, range=10..200)
rectangle_cote_a_2 = Slider(120, range=10..300)
rectangle_cote_b_2 = Slider(70, range=10..300)
cote_du_triangle_2 = Slider(88, range=10..200)
cote_de_l_hexagone_2 = Slider(52, range=10..200)
longueur_du_segment_2 = Slider(134, range=10..300)

# ---- group: ZONE_CORRIGE / ÉTAPE 1
pi = Pi(Factor=2)
multiplication = Multiplication(A=rayon_du_cercle_2, B=pi)
addition = Addition(A=rectangle_cote_a_2, B=rectangle_cote_b_2)
multiplication_2 = Multiplication(A=addition, B=2)

# ---- group: ZONE_CORRIGE / ÉTAPE 2
multiplication_3 = Multiplication(A=cote_du_triangle_2, B=3)
multiplication_4 = Multiplication(A=cote_de_l_hexagone_2, B=6)

# ---- group: ZONE_CORRIGE / ÉTAPE 3
addition_2 = Addition(A=multiplication, B=multiplication_2)
addition_3 = Addition(A=addition_2, B=multiplication_3)
addition_4 = Addition(A=addition_3, B=multiplication_4)
addition_5 = Addition(A=addition_4, B=longueur_du_segment_2)
panel = Panel(addition_5)

# ---- group: ZONE_CORRIGE / AFFICHAGE DU CORRIGÉ
afficher_le_corrigé = BooleanToggle(False)
gate = StreamGate(Stream=addition_5, Gate=afficher_le_corrigé)  # -> Target0, Target1
reponse_corrige = REPONSE_CORRIGE(gate.Target1)
