# Grasshopper definition G-03_complet.gh (Grasshopper 1.0.8)

# ---- group: ZONE_SUJET
# Cinq extractions de listes à réaliser en moins de 180 secondes. Le chronomètre démarre à
# l'ouverture de l'exercice et s'affiche en haut du canvas.
liste_1 = LISTE_1([318, 745, 129, 806, 452, 973, 264, 587])
liste_2 = LISTE_2([61, 903, 447, 218, 675, 334, 891, 156, 729])
liste_3 = LISTE_3([512, 87, 640, 293, 758, 421, 965, 176])
liste_4 = LISTE_4([234, 819, 405, 672, 148, 583, 927, 361, 796])
liste_5 = LISTE_5([703, 259, 846, 132, 578, 964, 315, 487])
reponse = REPONSE()

# ---- group: ZONE_CORRIGE / DONNÉES FOURNIES (copie)
liste_1_2 = LISTE_1([318, 745, 129, 806, 452, 973, 264, 587])
liste_2_2 = LISTE_2([61, 903, 447, 218, 675, 334, 891, 156, 729])
liste_3_2 = LISTE_3([512, 87, 640, 293, 758, 421, 965, 176])
liste_4_2 = LISTE_4([234, 819, 405, 672, 148, 583, 927, 361, 796])
liste_5_2 = LISTE_5([703, 259, 846, 132, 578, 964, 315, 487])

# ---- group: ZONE_CORRIGE / ÉTAPE 1
# G-03 · Contre la montre
# Intermédiaire  —  durée cible 6 min  —  réf. REF-042, REF-043  —  v0.4-260901
# ▼  CORRIGÉ — à consulter après validation  ▼
# RAPPEL — copie des données fournies dans la zone sujet, afin qu'aucun câble ne relie les deux zones
# ÉTAPE 1 — Cinq extractions de cinq natures : l'élément d'index 3, le dernier, le maximum, le minimum, le
# médian. Aucun composant ne les fait toutes
# ÉTAPE 2 — Les cinq réponses dans l'ordre. Rendre 3 au lieu de 806 pour « l'élément d'index 3 » est
# l'erreur du chronomètre : le rang n'est pas la valeur
# RÉSULTAT — tant que l'interrupteur AFFICHER LE CORRIGÉ reste sur faux, la sortie 1 du Stream Gate est
# vide : rien n'apparaît dans Rhino
item = ListItem(List=liste_1_2, Index=3, Wrap=True)
rev = ReverseList(List=liste_2_2)
item_2 = ListItem(List=rev, Index=0, Wrap=True)
bnd = Bounds(Numbers=liste_3_2)
dedomain = DeconstructDomain(Domain=bnd)  # -> Start, End
bnd_2 = Bounds(Numbers=liste_4_2)
dedomain_2 = DeconstructDomain(Domain=bnd_2)  # -> Start, End
sort = SortList(Keys=liste_5_2)  # -> Keys, ValuesA
item_3 = ListItem(List=sort.Keys, Index=4, Wrap=True)

# ---- group: ZONE_CORRIGE / ÉTAPE 2
merge = Merge(Data1=item, Data2=item_2)
merge_2 = Merge(Data1=merge, Data2=dedomain.End)
merge_3 = Merge(Data1=merge_2, Data2=dedomain_2.Start)
merge_4 = Merge(Data1=merge_3, Data2=item_3)
panel = Panel(merge_4)

# ---- group: ZONE_CORRIGE / AFFICHAGE DU CORRIGÉ
afficher_le_corrigé = BooleanToggle(False)
gate = StreamGate(Stream=merge_4, Gate=afficher_le_corrigé)  # -> Target0, Target1
reponse_corrige = REPONSE_CORRIGE(gate.Target1)
