# Grasshopper definition G-04_complet.gh (Grasshopper 1.0.8)

# ---- group: ZONE_SUJET
# Trois questions sur les modes de correspondance de données. Tu disposes de trois vies : chaque
# mauvaise soumission en coûte une. À zéro vie, l'exercice se recharge depuis le début.
reponse = REPONSE()
# G-04 · Trois vies
# Intermédiaire  —  durée cible 15 min  —  réf. REF-053, REF-054  —  v0.5-260902
# ▼  CORRIGÉ — à consulter après validation  ▼
# RAPPEL — copie des données fournies dans la zone sujet, afin qu'aucun câble ne relie les deux zones
# ÉTAPE 1 — Le plus court rend 7 résultats, le plus long 11. La référence croisée, elle, est un PRODUIT :
# 77, et non 18
# ÉTAPE 2 — 95. Croire que la référence croisée additionne donne 36, et fait perdre les trois vies d'un
# coup
# RÉSULTAT — tant que l'interrupteur AFFICHER LE CORRIGÉ reste sur faux, la sortie 1 du Stream Gate est
# vide : rien n'apparaît dans Rhino
taille_de_la_liste_a = Slider(11, range=1..30)
taille_de_la_liste_b = Slider(7, range=1..30)

# ---- group: ZONE_CORRIGE / DONNÉES FOURNIES (copie)
taille_de_la_liste_a_2 = Slider(11, range=1..30)
taille_de_la_liste_b_2 = Slider(7, range=1..30)

# ---- group: ZONE_CORRIGE / ÉTAPE 1
min = Minimum(A=taille_de_la_liste_a_2, B=taille_de_la_liste_b_2)
max = Maximum(A=taille_de_la_liste_a_2, B=taille_de_la_liste_b_2)
multiplication = Multiplication(A=taille_de_la_liste_a_2, B=taille_de_la_liste_b_2)

# ---- group: ZONE_CORRIGE / ÉTAPE 2
addition = Addition(A=min, B=max)
addition_2 = Addition(A=addition, B=multiplication)
panel = Panel(addition_2)

# ---- group: ZONE_CORRIGE / AFFICHAGE DU CORRIGÉ
afficher_le_corrigé = BooleanToggle(False)
gate = StreamGate(Stream=addition_2, Gate=afficher_le_corrigé)  # -> Target0, Target1
reponse_corrige = REPONSE_CORRIGE(gate.Target1)
