# Grasshopper definition G-05_complet.gh (Grasshopper 1.0.8)

# ---- group: ZONE_SUJET
# Six mesures à produire sur le même assemblage. Chaque mesure exacte débloque un badge. La
# collection complète débloque le badge doré ARPENTEUR.
reponse = REPONSE()
# G-05 · La collection de badges
# Intermédiaire  —  durée cible 20 min  —  réf. REF-079, REF-081, REF-098  —  v0.5-260902
# ▼  CORRIGÉ — à consulter après validation  ▼
# RAPPEL — copie des données fournies dans la zone sujet, afin qu'aucun câble ne relie les deux zones
# ÉTAPE 1 — Badge 1 — le développé : deux poteaux et une traverse
# ÉTAPE 2 — Badge 2 — l'aire de la section. Le profil est CREUX : on déduit l'intérieur. Le calculer plein
# donne 61 200 au lieu de 11 904, et fait rater trois badges d'un coup
# ÉTAPE 3 — Badges 3 et 4 — le volume, puis la masse à 7,85 g/cm³
# ÉTAPE 4 — Badges 5 et 6 — la hauteur hors tout et la portée libre. Six badges : le badge doré ARPENTEUR
# RÉSULTAT — tant que l'interrupteur AFFICHER LE CORRIGÉ reste sur faux, la sortie 1 du Stream Gate est
# vide : rien n'apparaît dans Rhino
hauteur_de_poteau = Slider(4200, range=1000..8000)
entraxe = Slider(6800, range=2000..12000)
hauteur_de_section = Slider(340, range=100..600)
largeur_de_section = Slider(180, range=50..400)
epaisseur = Slider(12, range=4..30)

# ---- group: ZONE_CORRIGE / DONNÉES FOURNIES (copie)
hauteur_de_poteau_2 = Slider(4200, range=1000..8000)
entraxe_2 = Slider(6800, range=2000..12000)
hauteur_de_section_2 = Slider(340, range=100..600)
largeur_de_section_2 = Slider(180, range=50..400)
epaisseur_2 = Slider(12, range=4..30)

# ---- group: ZONE_CORRIGE / ÉTAPE 1
multiplication = Multiplication(A=hauteur_de_poteau_2, B=2)
addition = Addition(A=multiplication, B=entraxe_2)

# ---- group: ZONE_CORRIGE / ÉTAPE 2
multiplication_2 = Multiplication(A=epaisseur_2, B=2)
subtraction = Subtraction(A=largeur_de_section_2, B=multiplication_2)
subtraction_2 = Subtraction(A=hauteur_de_section_2, B=multiplication_2)
multiplication_3 = Multiplication(A=largeur_de_section_2, B=hauteur_de_section_2)
multiplication_4 = Multiplication(A=subtraction, B=subtraction_2)
subtraction_3 = Subtraction(A=multiplication_3, B=multiplication_4)

# ---- group: ZONE_CORRIGE / ÉTAPE 3
multiplication_5 = Multiplication(A=subtraction_3, B=addition)
division = Division(A=multiplication_5, B=1000)
multiplication_6 = Multiplication(A=multiplication_5, B=7.85e-06)

# ---- group: ZONE_CORRIGE / ÉTAPE 4
division_2 = Division(A=hauteur_de_section_2, B=2)
addition_2 = Addition(A=hauteur_de_poteau_2, B=division_2)
subtraction_4 = Subtraction(A=entraxe_2, B=largeur_de_section_2)
merge = Merge(Data1=addition, Data2=subtraction_3)
merge_2 = Merge(Data1=division, Data2=multiplication_6)
merge_3 = Merge(Data1=addition_2, Data2=subtraction_4)
merge_4 = Merge(Data1=merge, Data2=merge_2)
merge_5 = Merge(Data1=merge_4, Data2=merge_3)
panel = Panel(merge_5)

# ---- group: ZONE_CORRIGE / AFFICHAGE DU CORRIGÉ
afficher_le_corrigé = BooleanToggle(False)
gate = StreamGate(Stream=merge_5, Gate=afficher_le_corrigé)  # -> Target0, Target1
reponse_corrige = REPONSE_CORRIGE(gate.Target1)
