# Grasshopper definition G-06_complet.gh (Grasshopper 1.0.8)

# ---- group: ZONE_SUJET
# Trois niveaux de logique. Le niveau 2 ne devient actif qu'une fois le niveau 1 validé, et ainsi
# de suite. Les groupes verrouillés apparaissent grisés.
soixante_valeurs = SOIXANTE_VALEURS([822, 228, 933, 775, 738, 260, 667, 515, 862, 583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])
reponse = REPONSE()

# ---- group: ZONE_CORRIGE / DONNÉES FOURNIES (copie)
soixante_valeurs_2 = SOIXANTE_VALEURS([822, 228, 933, 775, 738, 260, 667, 515, 862, 583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])

# ---- group: ZONE_CORRIGE / ÉTAPE 1
# G-06 · Le déblocage progressif
# Intermédiaire  —  durée cible 18 min  —  réf. REF-059, REF-060, REF-061  —  v0.5-260902
# ▼  CORRIGÉ — à consulter après validation  ▼
# RAPPEL — copie des données fournies dans la zone sujet, afin qu'aucun câble ne relie les deux zones
# ÉTAPE 1 — Niveau 1 — les valeurs paires : le reste modulo 2 vaut zéro. Il en reste 32
# ÉTAPE 2 — Niveau 2 — parmi CELLES-LÀ, celles qui dépassent 500. Il en reste 16
# ÉTAPE 3 — Niveau 3 — celles qui dépassent la moyenne DES SEIZE SURVIVANTES, 771,50. Prendre la moyenne
# des soixante valeurs de départ, 518,93, en garderait quinze au lieu de huit : un filtre s'applique à ce
# qui reste
# RÉSULTAT — tant que l'interrupteur AFFICHER LE CORRIGÉ reste sur faux, la sortie 1 du Stream Gate est
# vide : rien n'apparaît dans Rhino
series = Series(Start=0, Step=1, Count=60)
mod = Modulus(A=soixante_valeurs_2, B=2)
equals = Equality(FirstNumber=mod, SecondNumber=0)  # -> Equality, Inequality

# ---- group: ZONE_CORRIGE / ÉTAPE 2
cull = CullPattern(List=soixante_valeurs_2, CullPattern=equals.Equality)
cull_2 = CullPattern(List=series, CullPattern=equals.Equality)
larger = LargerThan(FirstNumber=cull, SecondNumber=500)  # -> LargerThan, OrEqualTo
cull_3 = CullPattern(List=cull, CullPattern=larger.LargerThan)
cull_4 = CullPattern(List=cull_2, CullPattern=larger.LargerThan)

# ---- group: ZONE_CORRIGE / ÉTAPE 3
avr = Average(Input=cull_3)
larger_2 = LargerThan(FirstNumber=cull_3, SecondNumber=avr)  # -> LargerThan, OrEqualTo
cull_5 = CullPattern(List=cull_4, CullPattern=larger_2.LargerThan)
panel = Panel(cull_5)

# ---- group: ZONE_CORRIGE / AFFICHAGE DU CORRIGÉ
afficher_le_corrigé = BooleanToggle(False)
gate = StreamGate(Stream=cull_5, Gate=afficher_le_corrigé)  # -> Target0, Target1
reponse_corrige = REPONSE_CORRIGE(gate.Target1)
