# Grasshopper definition G-07_complet.gh (Grasshopper 1.0.8)

# ---- group: ZONE_SUJET
# Produis la trame demandée. Une étoile pour un résultat juste, deux étoiles si la solution tient
# en moins de 12 composants, trois étoiles si elle reste juste après changement des paramètres de
# trame.
reponse = REPONSE()
# G-07 · Une, deux ou trois étoiles
# Intermédiaire  —  durée cible 15 min  —  réf. REF-067, REF-068  —  v0.5-260902
# ▼  CORRIGÉ — à consulter après validation  ▼
# RAPPEL — copie des données fournies dans la zone sujet, afin qu'aucun câble ne relie les deux zones
# ÉTAPE 1 — 13,08 et 11,35 : le nombre de modules s'arrondit vers le BAS. Arrondir au plus proche donnerait
# 13 et 11 ici, mais 14 et 12 sur une trame à peine plus grande — et vingt-cinq modules hors cadre
# ÉTAPE 2 — 143 modules
# RÉSULTAT — tant que l'interrupteur AFFICHER LE CORRIGÉ reste sur faux, la sortie 1 du Stream Gate est
# vide : rien n'apparaît dans Rhino
longueur_de_trame = Slider(3400, range=500..8000)
largeur_de_trame = Slider(2100, range=500..8000)
pas_en_x = Slider(260, range=50..600)
pas_en_y = Slider(185, range=50..600)

# ---- group: ZONE_CORRIGE / DONNÉES FOURNIES (copie)
longueur_de_trame_2 = Slider(3400, range=500..8000)
largeur_de_trame_2 = Slider(2100, range=500..8000)
pas_en_x_2 = Slider(260, range=50..600)
pas_en_y_2 = Slider(185, range=50..600)

# ---- group: ZONE_CORRIGE / ÉTAPE 1
division = Division(A=longueur_de_trame_2, B=pas_en_x_2)
division_2 = Division(A=largeur_de_trame_2, B=pas_en_y_2)
round = Round(Number=division)  # -> Nearest, Floor, Ceiling
round_2 = Round(Number=division_2)  # -> Nearest, Floor, Ceiling

# ---- group: ZONE_CORRIGE / ÉTAPE 2
multiplication = Multiplication(A=round.Nearest, B=round_2.Nearest)
panel = Panel(multiplication)

# ---- group: ZONE_CORRIGE / AFFICHAGE DU CORRIGÉ
afficher_le_corrigé = BooleanToggle(False)
gate = StreamGate(Stream=multiplication, Gate=afficher_le_corrigé)  # -> Target0, Target1
reponse_corrige = REPONSE_CORRIGE(gate.Target1)
