# Grasshopper definition G-08_complet.gh (Grasshopper 1.0.8)

# ---- group: ZONE_SUJET
# Huit manipulations de listes s'enchaînent. Chaque bonne réponse consécutive augmente le
# multiplicateur : ×1, ×1,5, ×2, ×3. Une erreur remet le multiplicateur à ×1.
seize_valeurs = SEIZE_VALEURS([464, 69, 411, 404, 579, 216, 862, 294, 857, 962, 204, 356, 140, 370, 290, 655])
reponse = REPONSE()

# ---- group: ZONE_CORRIGE / DONNÉES FOURNIES (copie)
seize_valeurs_2 = SEIZE_VALEURS([464, 69, 411, 404, 579, 216, 862, 294, 857, 962, 204, 356, 140, 370, 290, 655])

# ---- group: ZONE_CORRIGE / ÉTAPE 1
# G-08 · La série de bonnes réponses
# Intermédiaire  —  durée cible 16 min  —  réf. REF-044, REF-045, REF-046  —  v0.5-260902
# ▼  CORRIGÉ — à consulter après validation  ▼
# RAPPEL — copie des données fournies dans la zone sujet, afin qu'aucun câble ne relie les deux zones
# ÉTAPE 1 — Réponses 1 à 4 — les pairs, le maximum, le minimum, la somme
# ÉTAPE 2 — Réponse 5 — le médian, qui exige un TRI préalable. L'élément de rang 8 de la liste brute vaut
# 857, le médian 404 : c'est là que la série se casse
# ÉTAPE 3 — Réponses 6 à 8 — premier plus dernier, le compte au-dessus de 500, la somme des quatre
# premières
# ÉTAPE 4 — Les huit réponses dans l'ordre, multiplicateur maximal
# RÉSULTAT — tant que l'interrupteur AFFICHER LE CORRIGÉ reste sur faux, la sortie 1 du Stream Gate est
# vide : rien n'apparaît dans Rhino
mod = Modulus(A=seize_valeurs_2, B=2)
equals = Equality(FirstNumber=mod, SecondNumber=0)  # -> Equality, Inequality
cull = CullPattern(List=seize_valeurs_2, CullPattern=equals.Equality)
lng = ListLength(List=cull)
bnd = Bounds(Numbers=seize_valeurs_2)
dedomain = DeconstructDomain(Domain=bnd)  # -> Start, End
ma = MassAddition(Input=seize_valeurs_2)  # -> Result, PartialResults

# ---- group: ZONE_CORRIGE / ÉTAPE 2
sort = SortList(Keys=seize_valeurs_2)  # -> Keys, ValuesA
item = ListItem(List=sort.Keys, Index=8, Wrap=True)

# ---- group: ZONE_CORRIGE / ÉTAPE 3
item_2 = ListItem(List=seize_valeurs_2, Index=0, Wrap=True)
rev = ReverseList(List=seize_valeurs_2)
item_3 = ListItem(List=rev, Index=0, Wrap=True)
addition = Addition(A=item_2, B=item_3)
larger = LargerThan(FirstNumber=seize_valeurs_2, SecondNumber=500)  # -> LargerThan, OrEqualTo
cull_2 = CullPattern(List=seize_valeurs_2, CullPattern=larger.LargerThan)
lng_2 = ListLength(List=cull_2)
dom = ConstructDomain(DomainStart=0, DomainEnd=3)
subset = SubList(List=seize_valeurs_2, Domain=dom, Wrap=True)  # -> List, Index
ma_2 = MassAddition(Input=subset.List)  # -> Result, PartialResults

# ---- group: ZONE_CORRIGE / ÉTAPE 4
merge = Merge(Data1=lng, Data2=dedomain.End)
merge_2 = Merge(Data1=dedomain.Start, Data2=ma.Result)
merge_3 = Merge(Data1=item, Data2=addition)
merge_4 = Merge(Data1=lng_2, Data2=ma_2.Result)
merge_5 = Merge(Data1=merge, Data2=merge_2)
merge_6 = Merge(Data1=merge_3, Data2=merge_4)
merge_7 = Merge(Data1=merge_5, Data2=merge_6)
panel = Panel(merge_7)

# ---- group: ZONE_CORRIGE / AFFICHAGE DU CORRIGÉ
afficher_le_corrigé = BooleanToggle(False)
gate = StreamGate(Stream=merge_7, Gate=afficher_le_corrigé)  # -> Target0, Target1
reponse_corrige = REPONSE_CORRIGE(gate.Target1)
