# Grasshopper definition G-09_complet.gh (Grasshopper 1.0.8)

# ---- group: ZONE_SUJET
# Un composant a été rendu invisible sur ce canvas. Trouve-le, révèle-le et recopie dans le Panel
# le mot de passe qu'il contient.
composant_masque = COMPOSANT_MASQUE([562, 807, 522, 578, 718, 330, 618, 728, 876, 696, 372, 939, 464, 328])
reponse = REPONSE()

# ---- group: ZONE_CORRIGE / DONNÉES FOURNIES (copie)
composant_masque_2 = COMPOSANT_MASQUE([562, 807, 522, 578, 718, 330, 618, 728, 876, 696, 372, 939, 464, 328])

# ---- group: ZONE_CORRIGE / ÉTAPE 1
# G-09 · Le composant caché
# Débutant  —  durée cible 10 min  —  réf. REF-028, REF-056  —  v0.5-260902
# ▼  CORRIGÉ — à consulter après validation  ▼
# RAPPEL — copie des données fournies dans la zone sujet, afin qu'aucun câble ne relie les deux zones
# ÉTAPE 1 — Le composant est masqué, pas supprimé : Ctrl+A le sélectionne comme les autres, et Edit >
# Arrange le fait ressortir. Sa somme vaut 8 538
# RÉSULTAT — tant que l'interrupteur AFFICHER LE CORRIGÉ reste sur faux, la sortie 1 du Stream Gate est
# vide : rien n'apparaît dans Rhino
ma = MassAddition(Input=composant_masque_2)  # -> Result, PartialResults
panel = Panel(ma.Result)

# ---- group: ZONE_CORRIGE / AFFICHAGE DU CORRIGÉ
afficher_le_corrigé = BooleanToggle(False)
gate = StreamGate(Stream=ma.Result, Gate=afficher_le_corrigé)  # -> Target0, Target1
reponse_corrige = REPONSE_CORRIGE(gate.Target1)
