# Grasshopper definition G-10_complet.gh (Grasshopper 1.0.8)

# ---- group: ZONE_SUJET
# Vingt coffres sont disposés en trame. Trois contiennent une récompense, désignés par le tirage
# aléatoire de graine 7. Identifie-les et affiche leurs index.
contenu_des_vingt_coffres = CONTENU_DES_VINGT_COFFRES([14, 70, 16, 56, 72, 24, 57, 87, 80, 14, 75, 54, 86, 95, 66, 73, 93, 68, 34, 21])
reponse = REPONSE()

# ---- group: ZONE_CORRIGE / DONNÉES FOURNIES (copie)
contenu_des_vingt_coffres_2 = CONTENU_DES_VINGT_COFFRES([14, 70, 16, 56, 72, 24, 57, 87, 80, 14, 75, 54, 86, 95, 66, 73, 93, 68, 34, 21])

# ---- group: ZONE_CORRIGE / ÉTAPE 1
# G-10 · Le coffre à butin
# Intermédiaire  —  durée cible 14 min  —  réf. REF-068, REF-045  —  v0.5-260902
# ▼  CORRIGÉ — à consulter après validation  ▼
# RAPPEL — copie des données fournies dans la zone sujet, afin qu'aucun câble ne relie les deux zones
# ÉTAPE 1 — Le seuil : la troisième valeur en partant du haut, 87. Trier puis lire l'avant-avant-dernière
# ÉTAPE 2 — Les coffres qui l'atteignent, et surtout leurs INDEX. Rendre les contenus — 87, 95, 93 — au
# lieu des index est l'erreur : c'est l'index qui désigne le coffre dans la trame
# RÉSULTAT — tant que l'interrupteur AFFICHER LE CORRIGÉ reste sur faux, la sortie 1 du Stream Gate est
# vide : rien n'apparaît dans Rhino
sort = SortList(Keys=contenu_des_vingt_coffres_2)  # -> Keys, ValuesA
item = ListItem(List=sort.Keys, Index=17, Wrap=True)

# ---- group: ZONE_CORRIGE / ÉTAPE 2
series = Series(Start=0, Step=1, Count=20)
larger = LargerThan(FirstNumber=contenu_des_vingt_coffres_2, SecondNumber=item)  # -> LargerThan, OrEqualTo
cull = CullPattern(List=series, CullPattern=larger.OrEqualTo)
sort_2 = SortList(Keys=cull)  # -> Keys, ValuesA
panel = Panel(sort_2.Keys)

# ---- group: ZONE_CORRIGE / AFFICHAGE DU CORRIGÉ
afficher_le_corrigé = BooleanToggle(False)
gate = StreamGate(Stream=sort_2.Keys, Gate=afficher_le_corrigé)  # -> Target0, Target1
reponse_corrige = REPONSE_CORRIGE(gate.Target1)
