# Grasshopper definition G-11_complet.gh (Grasshopper 1.0.8)

# ---- group: ZONE_SUJET
# Complète la grille de mots croisés dessinée sur le canvas. Chaque définition renvoie au nom
# anglais d'un composant natif. Assemble ensuite les lettres des cases grisées pour former le mot
# final.
reponse = REPONSE()
# G-11 · Les mots croisés des composants
# Débutant  —  durée cible 15 min  —  réf. REF-057, REF-058  —  v0.5-260902
# ▼  CORRIGÉ — à consulter après validation  ▼
# ÉTAPE 1 — L'étalon porte la longueur de chacun des sept mots : SERIES (6), CULL (4), GRAFT (5), DISPATCH
# (8), WEAVE (5), JITTER (6), PARTITION (9). Un nom de composant ne se calcule pas — il se sait, et c'est
# le sujet de l'exercice
# ÉTAPE 2 — 43. Écrire SORT (4) pour « produire une suite régulière » au lieu de SERIES (6) décale la somme
# de deux, et la grille ne ferme plus
# RÉSULTAT — tant que l'interrupteur AFFICHER LE CORRIGÉ reste sur faux, la sortie 1 du Stream Gate est
# vide : rien n'apparaît dans Rhino
definitions_de_la_grille = Slider(7, range=1..15)

# ---- group: ZONE_CORRIGE / ÉTAPE 1
longueur_de_chaque_mot = LONGUEUR_DE_CHAQUE_MOT([6, 4, 5, 8, 5, 6, 9])

# ---- group: ZONE_CORRIGE / ÉTAPE 2
ma = MassAddition(Input=longueur_de_chaque_mot)  # -> Result, PartialResults
panel = Panel(ma.Result)

# ---- group: ZONE_CORRIGE / AFFICHAGE DU CORRIGÉ
afficher_le_corrigé = BooleanToggle(False)
gate = StreamGate(Stream=ma.Result, Gate=afficher_le_corrigé)  # -> Target0, Target1
reponse_corrige = REPONSE_CORRIGE(gate.Target1)
