# Grasshopper definition G-12_complet.gh (Grasshopper 1.0.8)

# ---- group: ZONE_SUJET
# Douze cartes affichent d'un côté un nom de composant, de l'autre une structure de données
# avant/après. Reconstitue les six paires en indiquant les couples d'index.
reponse = REPONSE()
# G-12 · Le memory des composants
# Débutant  —  durée cible 12 min  —  réf. REF-047, REF-051, REF-049  —  v0.5-260902
# ▼  CORRIGÉ — à consulter après validation  ▼
# ÉTAPE 1 — L'étalon donne le partenaire de chaque carte, dans l'ordre des cartes. Cette forme est UNIQUE,
# là où six couples rendus dans un ordre libre ne le seraient pas — deux apprenants justes rendraient deux
# listes différentes
# RÉSULTAT — tant que l'interrupteur AFFICHER LE CORRIGÉ reste sur faux, la sortie 1 du Stream Gate est
# vide : rien n'apparaît dans Rhino
cartes_du_memory = Slider(12, range=2..24)

# ---- group: ZONE_CORRIGE / ÉTAPE 1
partenaire_de_chaque_carte = PARTENAIRE_DE_CHAQUE_CARTE([8, 11, 6, 12, 9, 3, 10, 1, 5, 7, 2, 4])
panel = Panel(partenaire_de_chaque_carte)

# ---- group: ZONE_CORRIGE / AFFICHAGE DU CORRIGÉ
afficher_le_corrigé = BooleanToggle(False)
gate = StreamGate(Stream=partenaire_de_chaque_carte, Gate=afficher_le_corrigé)  # -> Target0, Target1
reponse_corrige = REPONSE_CORRIGE(gate.Target1)
