# Grasshopper definition G-13_complet.gh (Grasshopper 1.0.8)

# ---- group: ZONE_SUJET
# Trois rouleaux affichent chacun une séquence de 8 motifs. Trouve les trois valeurs de décalage
# qui alignent trois motifs identiques sur la ligne centrale.
rouleau_1 = ROULEAU_1([1, 2, 4, 1, 3, 2, 3, 1])
rouleau_2 = ROULEAU_2([5, 4, 6, 5, 6, 5, 6, 6])
rouleau_3 = ROULEAU_3([7, 4, 8, 7, 8, 9, 9, 7])
reponse = REPONSE()

# ---- group: ZONE_CORRIGE / ÉTAPE 1
decalage_de_chaque_rouleau = DECALAGE_DE_CHAQUE_ROULEAU([7, 6, 6])
# G-13 · La machine à sous des motifs
# Intermédiaire  —  durée cible 15 min  —  réf. REF-045, REF-068  —  v0.5-260902
# ▼  CORRIGÉ — à consulter après validation  ▼
# ÉTAPE 1 — Le motif 4 est le SEUL présent dans les trois rouleaux, et une seule fois dans chacun : la
# solution est unique. Il occupe les positions 2, 1 et 1 ; la ligne centrale est en position 3, d'où des
# décalages de 7, 6 et 6
# RÉSULTAT — tant que l'interrupteur AFFICHER LE CORRIGÉ reste sur faux, la sortie 1 du Stream Gate est
# vide : rien n'apparaît dans Rhino
panel = Panel(decalage_de_chaque_rouleau)

# ---- group: ZONE_CORRIGE / AFFICHAGE DU CORRIGÉ
afficher_le_corrigé = BooleanToggle(False)
gate = StreamGate(Stream=decalage_de_chaque_rouleau, Gate=afficher_le_corrigé)  # -> Target0, Target1
reponse_corrige = REPONSE_CORRIGE(gate.Target1)
