# Grasshopper definition G-14_complet.gh (Grasshopper 1.0.8)

# ---- group: ZONE_SUJET
# Six composants sont posés sur le canvas, tous les câbles ont été supprimés. Rétablis le câblage
# pour reproduire la géométrie affichée en filigrane, sans ajouter ni supprimer aucun composant.
sommets_x = SOMMETS_X([0, 340, 340, 620, 620, 180])
sommets_y = SOMMETS_Y([0, 0, 190, 190, 470, 470])
reponse = REPONSE()

# ---- group: ZONE_CORRIGE / DONNÉES FOURNIES (copie)
sommets_x_2 = SOMMETS_X([0, 340, 340, 620, 620, 180])
sommets_y_2 = SOMMETS_Y([0, 0, 190, 190, 470, 470])

# ---- group: ZONE_CORRIGE / ÉTAPE 1
# G-14 · Le puzzle de câblage
# Débutant  —  durée cible 12 min  —  réf. REF-027, REF-048  —  v0.5-260902
# ▼  CORRIGÉ — à consulter après validation  ▼
# RAPPEL — copie des données fournies dans la zone sujet, afin qu'aucun câble ne relie les deux zones
# ÉTAPE 1 — Six sommets, un point par couple de coordonnées
# ÉTAPE 2 — La polyligne FERMÉE. Laisser le contour ouvert donne 1 530,00 mm au lieu de 2 033,29 : il
# manque le segment de retour, 503,29 mm — un quart de la réponse, invisible à l'aperçu
# RÉSULTAT — tant que l'interrupteur AFFICHER LE CORRIGÉ reste sur faux, la sortie 1 du Stream Gate est
# vide : rien n'apparaît dans Rhino
pt = ConstructPoint(XCoordinate=sommets_x_2, YCoordinate=sommets_y_2, ZCoordinate=0)

# ---- group: ZONE_CORRIGE / ÉTAPE 2
pline = PolyLine(Vertices=pt, Closed=True)
len = Length(Curve=pline)
panel = Panel(len)

# ---- group: ZONE_CORRIGE / AFFICHAGE DU CORRIGÉ
afficher_le_corrigé = BooleanToggle(False)
gate = StreamGate(Stream=len, Gate=afficher_le_corrigé)  # -> Target0, Target1
reponse_corrige = REPONSE_CORRIGE(gate.Target1)
