# Grasshopper definition G-15_complet.gh (Grasshopper 1.0.8)

# ---- group: ZONE_SUJET
# La moitié gauche du motif est dessinée. Complète la moitié droite pour obtenir une figure
# parfaitement symétrique, puis referme le contour.
demi_figure_x = DEMI_FIGURE_X([0, -120, -185, -150, -60, 0])
demi_figure_y = DEMI_FIGURE_Y([0, 40, 145, 260, 330, 355])
reponse = REPONSE()

# ---- group: ZONE_CORRIGE / ÉTAPE 1
figure_complete_x = FIGURE_COMPLETE_X([0, -120, -185, -150, -60, 0, 60, 150, 185, 120])
figure_complete_y = FIGURE_COMPLETE_Y([0, 40, 145, 260, 330, 355, 330, 260, 145, 40])
# G-15 · Le dessin à compléter
# Débutant  —  durée cible 14 min  —  réf. REF-063, REF-067  —  v0.5-260902
# ▼  CORRIGÉ — à consulter après validation  ▼
# ÉTAPE 1 — La figure complétée : dix sommets et non douze. Les deux points posés SUR l'axe ne se recopient
# pas — les redoubler laisse l'aire inchangée mais allonge le périmètre, ce que le contrôle croisé attrape
# ÉTAPE 2 — 91 550 mm² et 1 098,42 mm. Les deux mesures ensemble : le périmètre seul ne distingue pas une
# symétrie d'une translation
# RÉSULTAT — tant que l'interrupteur AFFICHER LE CORRIGÉ reste sur faux, la sortie 1 du Stream Gate est
# vide : rien n'apparaît dans Rhino
pt = ConstructPoint(XCoordinate=figure_complete_x, YCoordinate=figure_complete_y, ZCoordinate=0)
pline = PolyLine(Vertices=pt, Closed=True)

# ---- group: ZONE_CORRIGE / ÉTAPE 2
area = Area(Geometry=pline)  # -> Area, Centroid
len = Length(Curve=pline)
merge = Merge(Data1=area.Area, Data2=len)
panel = Panel(merge)

# ---- group: ZONE_CORRIGE / AFFICHAGE DU CORRIGÉ
afficher_le_corrigé = BooleanToggle(False)
gate = StreamGate(Stream=merge, Gate=afficher_le_corrigé)  # -> Target0, Target1
reponse_corrige = REPONSE_CORRIGE(gate.Target1)
