# Grasshopper definition G-16_complet.gh (Grasshopper 1.0.8)

# ---- group: ZONE_SUJET
# Parmi 500 points, un seul est aberrant : il est hors du volume de référence. Trouve son index.
# Trois indices sont disponibles, chacun coûte 2 points.
points_x = POINTS_X([1003, 631, 813, 1290, 1914, 480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])
points_y = POINTS_Y([973, 718, 290, 112, 449, 565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])
points_z = POINTS_Z([160, 255, 527, 530, 733, 620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])
reponse = REPONSE()

# ---- group: ZONE_CORRIGE / DONNÉES FOURNIES (copie)
points_x_2 = POINTS_X([1003, 631, 813, 1290, 1914, 480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])
points_y_2 = POINTS_Y([973, 718, 290, 112, 449, 565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])
points_z_2 = POINTS_Z([160, 255, 527, 530, 733, 620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])

# ---- group: ZONE_CORRIGE / ÉTAPE 1
# G-16 · La chasse au trésor
# Intermédiaire  —  durée cible 18 min  —  réf. REF-055, REF-101  —  v0.5-260902
# ▼  CORRIGÉ — à consulter après validation  ▼
# RAPPEL — copie des données fournies dans la zone sujet, afin qu'aucun câble ne relie les deux zones
# ÉTAPE 1 — Un test par axe : le point sort-il du volume 2 000 × 1 200 × 800 ? Chercher le plus ÉLOIGNÉ DU
# CENTRE désignerait un coin parfaitement légitime — la méthode paraît raisonnable et donne un index faux
# ÉTAPE 2 — Un OU entre les trois : il suffit de sortir sur un axe
# ÉTAPE 3 — L'index 337. `Cull Pattern` sur la série des index garde celui des points retenus
# RÉSULTAT — tant que l'interrupteur AFFICHER LE CORRIGÉ reste sur faux, la sortie 1 du Stream Gate est
# vide : rien n'apparaît dans Rhino
larger = LargerThan(FirstNumber=points_x_2, SecondNumber=2000)  # -> LargerThan, OrEqualTo
larger_2 = LargerThan(FirstNumber=points_y_2, SecondNumber=1200)  # -> LargerThan, OrEqualTo
larger_3 = LargerThan(FirstNumber=points_z_2, SecondNumber=800)  # -> LargerThan, OrEqualTo

# ---- group: ZONE_CORRIGE / ÉTAPE 2
or = GateOr(A=larger.LargerThan, B=larger_2.LargerThan)
or_2 = GateOr(A=or, B=larger_3.LargerThan)

# ---- group: ZONE_CORRIGE / ÉTAPE 3
series = Series(Start=0, Step=1, Count=500)
cull = CullPattern(List=series, CullPattern=or_2)
panel = Panel(cull)

# ---- group: ZONE_CORRIGE / AFFICHAGE DU CORRIGÉ
afficher_le_corrigé = BooleanToggle(False)
gate = StreamGate(Stream=cull, Gate=afficher_le_corrigé)  # -> Target0, Target1
reponse_corrige = REPONSE_CORRIGE(gate.Target1)
