# Grasshopper definition G-17_complet.gh (Grasshopper 1.0.8)

# ---- group: ZONE_SUJET
# Dix questions à choix multiple sur les comportements implicites de Grasshopper. Trente secondes
# par question, une seule réponse possible.
reponse = REPONSE()
# G-17 · Le quiz éclair
# Débutant  —  durée cible 8 min  —  réf. REF-040, REF-053, REF-056  —  v0.5-260902
# ▼  CORRIGÉ — à consulter après validation  ▼
# ÉTAPE 1 — Les dix rangs. Ils se répartissent sur les quatre propositions — trois fois le rang 3, deux
# fois le 1, deux fois le 2, une fois le 4 — de sorte qu'aucune stratégie de rang constant ne dépasse trois
# points sur dix
# RÉSULTAT — tant que l'interrupteur AFFICHER LE CORRIGÉ reste sur faux, la sortie 1 du Stream Gate est
# vide : rien n'apparaît dans Rhino
questions_du_quiz = Slider(10, range=1..20)

# ---- group: ZONE_CORRIGE / ÉTAPE 1
rang_de_la_bonne_reponse = RANG_DE_LA_BONNE_REPONSE([3, 2, 3, 1, 3, 4, 1, 3, 2, 3])
panel = Panel(rang_de_la_bonne_reponse)

# ---- group: ZONE_CORRIGE / AFFICHAGE DU CORRIGÉ
afficher_le_corrigé = BooleanToggle(False)
gate = StreamGate(Stream=rang_de_la_bonne_reponse, Gate=afficher_le_corrigé)  # -> Target0, Target1
reponse_corrige = REPONSE_CORRIGE(gate.Target1)
