# Grasshopper definition G-18_complet.gh (Grasshopper 1.0.8)

# ---- group: ZONE_SUJET
# Quinze affirmations sur les types et les conversions. Réponds par vrai ou faux. Une erreur
# élimine l'affirmation et ses deux suivantes du décompte : mieux vaut réfléchir que deviner.
reponse = REPONSE()
# G-18 · Vrai ou faux à élimination
# Débutant  —  durée cible 10 min  —  réf. REF-040, REF-041, REF-059  —  v0.4-260901
# ▼  CORRIGÉ — à consulter après validation  ▼
# ÉTAPE 1 — Les huit affirmations vraies, par leur rang. Huit sur quinze : ni la majorité ni la moitié, de
# sorte que répondre uniformément ne rapporte rien
# RÉSULTAT — tant que l'interrupteur AFFICHER LE CORRIGÉ reste sur faux, la sortie 1 du Stream Gate est
# vide : rien n'apparaît dans Rhino
affirmations = Slider(15, range=1..30)

# ---- group: ZONE_CORRIGE / ÉTAPE 1
affirmations_vraies = AFFIRMATIONS_VRAIES([1, 3, 5, 7, 9, 11, 13, 14])
panel = Panel(affirmations_vraies)

# ---- group: ZONE_CORRIGE / AFFICHAGE DU CORRIGÉ
afficher_le_corrigé = BooleanToggle(False)
gate = StreamGate(Stream=affirmations_vraies, Gate=afficher_le_corrigé)  # -> Target0, Target1
reponse_corrige = REPONSE_CORRIGE(gate.Target1)
