# Grasshopper definition G-19_complet.gh (Grasshopper 1.0.8)

# ---- group: ZONE_SUJET
# Quatre clusters anonymes transforment les données. Observe leurs entrées et sorties, puis
# identifie le composant natif que chacun reproduit.
jeu_de_preuve = JEU_DE_PREUVE([58, 91, 23, 77, 46, 88, 12, 65, 39, 94, 51, 30])
reponse = REPONSE()

# ---- group: ZONE_CORRIGE / ÉTAPE 1
resultat_de_chaque_cluster = RESULTAT_DE_CHAQUE_CLUSTER([7, 273, 9, 5])
# G-19 · Le composant mystère
# Intermédiaire  —  durée cible 12 min  —  réf. REF-028, REF-042  —  v0.4-260901
# ▼  CORRIGÉ — à consulter après validation  ▼
# ÉTAPE 1 — Les quatre clusters reproduisent : un comptage au-dessus de 50, la somme des trois plus
# grandes, l'index du maximum, le nombre de restes distincts modulo 7. Nommer le composant sans le vérifier
# sur ce second jeu est l'erreur : trois composants différents se comportent à l'identique sur les données
# de test
# RÉSULTAT — tant que l'interrupteur AFFICHER LE CORRIGÉ reste sur faux, la sortie 1 du Stream Gate est
# vide : rien n'apparaît dans Rhino
panel = Panel(resultat_de_chaque_cluster)

# ---- group: ZONE_CORRIGE / AFFICHAGE DU CORRIGÉ
afficher_le_corrigé = BooleanToggle(False)
gate = StreamGate(Stream=resultat_de_chaque_cluster, Gate=afficher_le_corrigé)  # -> Target0, Target1
reponse_corrige = REPONSE_CORRIGE(gate.Target1)
