# Grasshopper definition G-20_complet.gh (Grasshopper 1.0.8)

# ---- group: ZONE_SUJET
# Cette définition devrait produire 24 modules, elle n'en produit que 6. Trois défauts se cachent
# dans le graphe. Identifie-les et corrige la définition sans en changer la structure générale.
reponse = REPONSE()
# G-20 · La chasse aux bugs
# Intermédiaire  —  durée cible 20 min  —  réf. REF-041, REF-053, REF-055  —  v0.4-260901
# ▼  CORRIGÉ — à consulter après validation  ▼
# RAPPEL — copie des données fournies dans la zone sujet, afin qu'aucun câble ne relie les deux zones
# ÉTAPE 1 — Vingt-quatre modules retrouvés — le compte est annoncé dans l'énoncé et ne prouve donc rien
# ÉTAPE 2 — C'est l'AIRE qui est l'indicateur : 2 306 400 mm². Empiler quatre fois la même rangée au même
# endroit donnerait vingt-quatre objets et la bonne aire — mais la définition resterait fausse, et le
# canvas le dirait
# RÉSULTAT — tant que l'interrupteur AFFICHER LE CORRIGÉ reste sur faux, la sortie 1 du Stream Gate est
# vide : rien n'apparaît dans Rhino
modules_en_x = Slider(6, range=1..20)
modules_en_y = Slider(4, range=1..20)
cote_du_module = Slider(310, range=50..800)

# ---- group: ZONE_CORRIGE / DONNÉES FOURNIES (copie)
modules_en_x_2 = Slider(6, range=1..20)
modules_en_y_2 = Slider(4, range=1..20)
cote_du_module_2 = Slider(310, range=50..800)

# ---- group: ZONE_CORRIGE / ÉTAPE 1
multiplication = Multiplication(A=modules_en_x_2, B=modules_en_y_2)

# ---- group: ZONE_CORRIGE / ÉTAPE 2
multiplication_2 = Multiplication(A=cote_du_module_2, B=cote_du_module_2)
multiplication_3 = Multiplication(A=multiplication, B=multiplication_2)
panel = Panel(multiplication_3)

# ---- group: ZONE_CORRIGE / AFFICHAGE DU CORRIGÉ
afficher_le_corrigé = BooleanToggle(False)
gate = StreamGate(Stream=multiplication_3, Gate=afficher_le_corrigé)  # -> Target0, Target1
reponse_corrige = REPONSE_CORRIGE(gate.Target1)
