# Grasshopper definition G-21_complet.gh (Grasshopper 1.0.8)

# ---- group: ZONE_SUJET
# Produis la géométrie cible avec le moins de composants possible. Le par du trou est fixé à 7
# composants. Sliders et Panels comptent.
reponse = REPONSE()
# G-21 · Le golf de composants
# Intermédiaire  —  durée cible 20 min  —  réf. REF-068, REF-043, REF-046  —  v0.4-260901
# ▼  CORRIGÉ — à consulter après validation  ▼
# ÉTAPE 1 — Dix-huit sommets, alternant rayon extérieur et rayon de creux. `Polygon` en mode étoile les
# produit en UN composant ; les poser segment par segment en demande dix-huit, pour un par de sept
# ÉTAPE 2 — 1 582,75 mm de périmètre. Neuf branches : nombre impair, donc aucun axe de symétrie horizontal
# — l'étoile ne se construit pas par miroir
# RÉSULTAT — tant que l'interrupteur AFFICHER LE CORRIGÉ reste sur faux, la sortie 1 du Stream Gate est
# vide : rien n'apparaît dans Rhino
rayon_exterieur = Slider(240, range=50..600)
branches = Slider(9, range=3..20)
profondeur_du_creux = Slider(46, range=5..200)

# ---- group: ZONE_CORRIGE / ÉTAPE 1
sommets_x = SOMMETS_X([240, 182.3003684, 183.8506663, 97, 41.67556264, -33.68774647, -120, -148.612622, -225.526229, -194, -225.526229, -148.612622, -120, -33.68774647, 41.67556264, 97, 183.8506663, 182.3003684])
sommets_y = SOMMETS_Y([0, 66.35190781, 154.2690263, 168.0089283, 236.3538607, 191.0527041, 207.8460969, 124.7007963, 82.0848344, 2.38e-14, -82.0848344, -124.7007963, -207.8460969, -191.0527041, -236.3538607, -168.0089283, -154.2690263, -66.35190781])
pt = ConstructPoint(XCoordinate=sommets_x, YCoordinate=sommets_y, ZCoordinate=0)

# ---- group: ZONE_CORRIGE / ÉTAPE 2
pline = PolyLine(Vertices=pt, Closed=True)
len = Length(Curve=pline)
panel = Panel(len)

# ---- group: ZONE_CORRIGE / AFFICHAGE DU CORRIGÉ
afficher_le_corrigé = BooleanToggle(False)
gate = StreamGate(Stream=len, Gate=afficher_le_corrigé)  # -> Target0, Target1
reponse_corrige = REPONSE_CORRIGE(gate.Target1)
