# Grasshopper definition G-22_complet.gh (Grasshopper 1.0.8)

# ---- group: ZONE_SUJET
# Trois phases s'enchaînent sans validation intermédiaire. Phase 1 : structurer les données en
# arbre. Phase 2 : filtrer selon deux conditions combinées. Phase 3 : produire le tableau de
# synthèse. Toute erreur en phase 3 impose de reprendre depuis la phase 1.
deux_cent_quarante_valeurs = DEUX_CENT_QUARANTE_VALEURS([832, 487, 671, 934, 350, 205, 622, 329, 434, 149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])
reponse = REPONSE()

# ---- group: ZONE_CORRIGE / DONNÉES FOURNIES (copie)
deux_cent_quarante_valeurs_2 = DEUX_CENT_QUARANTE_VALEURS([832, 487, 671, 934, 350, 205, 622, 329, 434, 149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])

# ---- group: ZONE_CORRIGE / ÉTAPE 1
# G-22 · Le boss de fin de chapitre
# Perfectionnement  —  durée cible 45 min  —  réf. REF-047, REF-051, REF-068, REF-079  —  v0.4-260901
# ▼  CORRIGÉ — à consulter après validation  ▼
# RAPPEL — copie des données fournies dans la zone sujet, afin qu'aucun câble ne relie les deux zones
# ÉTAPE 1 — Phase 1 — huit branches PAR PAS DE HUIT, et non huit tranches consécutives. `Partition List`
# par 8 puis `Flip Matrix` : la première branche prend les valeurs 0, 8, 16… Les deux découpages donnent
# bien huit branches de trente, et les comptes filtrés n'ont plus rien à voir
# ÉTAPE 2 — Phase 2 — deux conditions combinées : au-dessus de 400 ET multiple de 3
# ÉTAPE 3 — Phase 3 — le tableau : huit comptes, puis huit sommes. Les comptes vont de 4 à 10, les sommes
# de 3 150 à 7 818 : aucune colonne ne peut se confondre avec une autre
# RÉSULTAT — tant que l'interrupteur AFFICHER LE CORRIGÉ reste sur faux, la sortie 1 du Stream Gate est
# vide : rien n'apparaît dans Rhino
partition = PartitionList(List=deux_cent_quarante_valeurs_2, Size=8)
flip = FlipMatrix(Data=partition)

# ---- group: ZONE_CORRIGE / ÉTAPE 2
larger = LargerThan(FirstNumber=flip, SecondNumber=400)  # -> LargerThan, OrEqualTo
mod = Modulus(A=flip, B=3)
equals = Equality(FirstNumber=mod, SecondNumber=0)  # -> Equality, Inequality
and = GateAnd(A=larger.LargerThan, B=equals.Equality)
cull = CullPattern(List=flip, CullPattern=and)

# ---- group: ZONE_CORRIGE / ÉTAPE 3
lng = ListLength(List=cull)
ma = MassAddition(Input=cull)  # -> Result, PartialResults
flatten = FlattenTree(Tree=lng, Path="{0}")
flatten_2 = FlattenTree(Tree=ma.Result, Path="{0}")
merge = Merge(Data1=flatten, Data2=flatten_2)
panel = Panel(merge)

# ---- group: ZONE_CORRIGE / AFFICHAGE DU CORRIGÉ
afficher_le_corrigé = BooleanToggle(False)
gate = StreamGate(Stream=merge, Gate=afficher_le_corrigé)  # -> Target0, Target1
reponse_corrige = REPONSE_CORRIGE(gate.Target1)
