# Grasshopper definition G-23_complet.gh (Grasshopper 1.0.8)

# ---- group: ZONE_SUJET
# Même énoncé pour tous : produire la nomenclature triée de l'assemblage. Trois critères
# départagent les participants : justesse, nombre de composants, temps d'exécution de la
# définition.
quantites = QUANTITES([14, 22, 9, 31, 6, 44, 18, 27])
reponse = REPONSE()

# ---- group: ZONE_CORRIGE / DONNÉES FOURNIES (copie)
quantites_2 = QUANTITES([14, 22, 9, 31, 6, 44, 18, 27])

# ---- group: ZONE_CORRIGE / ÉTAPE 1
# G-23 · Le duel
# Intermédiaire  —  durée cible 20 min  —  réf. REF-082, REF-044  —  v0.5-260902
# ▼  CORRIGÉ — à consulter après validation  ▼
# RAPPEL — copie des données fournies dans la zone sujet, afin qu'aucun câble ne relie les deux zones
# ÉTAPE 1 — Trier par QUANTITÉ, puis inverser. Trier par désignation — ce que `Sort List` fait sur des
# textes — donne 6, 18, 9, 14, 31, 44, 27, 22 : huit lignes parfaitement présentables, et un classement
# faux
# RÉSULTAT — tant que l'interrupteur AFFICHER LE CORRIGÉ reste sur faux, la sortie 1 du Stream Gate est
# vide : rien n'apparaît dans Rhino
sort = SortList(Keys=quantites_2)  # -> Keys, ValuesA
rev = ReverseList(List=sort.Keys)
panel = Panel(rev)

# ---- group: ZONE_CORRIGE / AFFICHAGE DU CORRIGÉ
afficher_le_corrigé = BooleanToggle(False)
gate = StreamGate(Stream=rev, Gate=afficher_le_corrigé)  # -> Target0, Target1
reponse_corrige = REPONSE_CORRIGE(gate.Target1)
