# Grasshopper definition G-24_complet.gh (Grasshopper 1.0.8)

# ---- group: ZONE_SUJET
# Câble la définition de sorte qu'un son de validation retentisse quand la condition est vraie et
# un son d'erreur quand elle est fausse. Puis résous l'énigme logique qui déclenche le son de
# victoire.
quatre_vingts_valeurs = QUATRE_VINGTS_VALEURS([281, 334, 138, 341, 284, 339, 280, 376, 146, 365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])
reponse = REPONSE()

# ---- group: ZONE_CORRIGE / DONNÉES FOURNIES (copie)
quatre_vingts_valeurs_2 = QUATRE_VINGTS_VALEURS([281, 334, 138, 341, 284, 339, 280, 376, 146, 365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])

# ---- group: ZONE_CORRIGE / ÉTAPE 1
# G-24 · Le retour sonore
# Débutant  —  durée cible 10 min  —  réf. REF-027, REF-061  —  v0.5-260902
# ▼  CORRIGÉ — à consulter après validation  ▼
# RAPPEL — copie des données fournies dans la zone sujet, afin qu'aucun câble ne relie les deux zones
# ÉTAPE 1 — Condition 1 — multiple de 4. Condition 2 — au-dessus de 120
# ÉTAPE 2 — Condition 3 — le dernier chiffre vaut 0, 4 ou 8 : le reste modulo 10. Tout multiple de 4 finit
# par 0, 2, 4, 6 ou 8 — cette condition écarte les deux derniers cas
# ÉTAPE 3 — Les trois par un ET, jamais par un OU. Un OU retiendrait 71 valeurs sur 80 : le son de victoire
# retentirait presque toujours, et deviendrait inaudible
# RÉSULTAT — tant que l'interrupteur AFFICHER LE CORRIGÉ reste sur faux, la sortie 1 du Stream Gate est
# vide : rien n'apparaît dans Rhino
mod = Modulus(A=quatre_vingts_valeurs_2, B=4)
equals = Equality(FirstNumber=mod, SecondNumber=0)  # -> Equality, Inequality
larger = LargerThan(FirstNumber=quatre_vingts_valeurs_2, SecondNumber=120)  # -> LargerThan, OrEqualTo

# ---- group: ZONE_CORRIGE / ÉTAPE 2
mod_2 = Modulus(A=quatre_vingts_valeurs_2, B=10)
equals_2 = Equality(FirstNumber=mod_2, SecondNumber=0)  # -> Equality, Inequality
equals_3 = Equality(FirstNumber=mod_2, SecondNumber=4)  # -> Equality, Inequality
equals_4 = Equality(FirstNumber=mod_2, SecondNumber=8)  # -> Equality, Inequality
or = GateOr(A=equals_2.Equality, B=equals_3.Equality)
or_2 = GateOr(A=or, B=equals_4.Equality)

# ---- group: ZONE_CORRIGE / ÉTAPE 3
and = GateAnd(A=equals.Equality, B=larger.LargerThan)
and_2 = GateAnd(A=and, B=or_2)
cull = CullPattern(List=quatre_vingts_valeurs_2, CullPattern=and_2)
lng = ListLength(List=cull)
panel = Panel(lng)

# ---- group: ZONE_CORRIGE / AFFICHAGE DU CORRIGÉ
afficher_le_corrigé = BooleanToggle(False)
gate = StreamGate(Stream=lng, Gate=afficher_le_corrigé)  # -> Target0, Target1
reponse_corrige = REPONSE_CORRIGE(gate.Target1)
