# Grasshopper definition G-25_complet.gh (Grasshopper 1.0.8)

# ---- group: ZONE_SUJET
# Anime la construction de la structure : les 40 barres doivent apparaître une par une en trois
# secondes, puis la structure entière change de couleur. Le pilotage se fait par un unique slider
# de 0 à 1.
longueur_des_quarante_barres = LONGUEUR_DES_QUARANTE_BARRES([700, 1052, 429, 1021, 1806, 1775, 1409, 362, 1583, 1591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])
reponse = REPONSE()
# G-25 · L'animation de la solution
# Perfectionnement  —  durée cible 25 min  —  réf. REF-090, REF-093, REF-067  —  v0.5-260902
# ▼  CORRIGÉ — à consulter après validation  ▼
# RAPPEL — copie des données fournies dans la zone sujet, afin qu'aucun câble ne relie les deux zones
# ÉTAPE 1 — Les barres apparaissent de la plus courte à la plus longue : on trie d'abord
# ÉTAPE 2 — Le nombre visible à t : quinze barres sur quarante
# ÉTAPE 3 — 8 508 mm cumulés, soit 19 % de la longueur pour 37,5 % des barres. Un cumul proportionnel au
# temps — 16 510 mm — signalerait une révélation dans le désordre. C'est l'état INTERMÉDIAIRE qui prouve le
# pilotage : à t = 1, toute animation affiche les quarante
# RÉSULTAT — tant que l'interrupteur AFFICHER LE CORRIGÉ reste sur faux, la sortie 1 du Stream Gate est
# vide : rien n'apparaît dans Rhino
avancement_de_l_animation = Slider(0.375, range=0..1)

# ---- group: ZONE_CORRIGE / DONNÉES FOURNIES (copie)
longueur_des_quarante_barres_2 = LONGUEUR_DES_QUARANTE_BARRES([700, 1052, 429, 1021, 1806, 1775, 1409, 362, 1583, 1591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])
avancement_de_l_animation_2 = Slider(0.375, range=0..1)

# ---- group: ZONE_CORRIGE / ÉTAPE 1
sort = SortList(Keys=longueur_des_quarante_barres_2)  # -> Keys, ValuesA

# ---- group: ZONE_CORRIGE / ÉTAPE 2
multiplication = Multiplication(A=avancement_de_l_animation_2, B=40)
round = Round(Number=multiplication)  # -> Nearest, Floor, Ceiling
subtraction = Subtraction(A=round.Ceiling, B=1)
dom = ConstructDomain(DomainStart=0, DomainEnd=subtraction)

# ---- group: ZONE_CORRIGE / ÉTAPE 3
subset = SubList(List=sort.Keys, Domain=dom, Wrap=True)  # -> List, Index
ma = MassAddition(Input=subset.List)  # -> Result, PartialResults
panel = Panel(ma.Result)

# ---- group: ZONE_CORRIGE / AFFICHAGE DU CORRIGÉ
afficher_le_corrigé = BooleanToggle(False)
gate = StreamGate(Stream=ma.Result, Gate=afficher_le_corrigé)  # -> Target0, Target1
reponse_corrige = REPONSE_CORRIGE(gate.Target1)
