# Grasshopper definition G-26_complet.gh (Grasshopper 1.0.8)

# ---- group: ZONE_SUJET
# Vingt pièces doivent mesurer entre 400 et 900 mm. Colore en vert celles qui sont conformes, en
# rouge les autres, et affiche le nombre de non-conformes.
longueur_des_vingt_pieces = LONGUEUR_DES_VINGT_PIECES([740, 540, 500, 700, 330, 680, 350, 390, 760, 670, 840, 1010, 380, 640, 850, 660, 880, 390, 1130, 1110])
reponse = REPONSE()

# ---- group: ZONE_CORRIGE / DONNÉES FOURNIES (copie)
longueur_des_vingt_pieces_2 = LONGUEUR_DES_VINGT_PIECES([740, 540, 500, 700, 330, 680, 350, 390, 760, 670, 840, 1010, 380, 640, 850, 660, 880, 390, 1130, 1110])

# ---- group: ZONE_CORRIGE / ÉTAPE 1
# G-26 · Le retour visuel immédiat
# Débutant  —  durée cible 12 min  —  réf. REF-026, REF-059  —  v0.5-260902
# ▼  CORRIGÉ — à consulter après validation  ▼
# RAPPEL — copie des données fournies dans la zone sujet, afin qu'aucun câble ne relie les deux zones
# ÉTAPE 1 — Une tolérance a DEUX bornes. Ne tester que les pièces trop courtes en compte 5 au lieu de 8 :
# trois pièces dépassent 900 mm et passeraient en vert
# ÉTAPE 2 — 8 pièces non conformes
# RÉSULTAT — tant que l'interrupteur AFFICHER LE CORRIGÉ reste sur faux, la sortie 1 du Stream Gate est
# vide : rien n'apparaît dans Rhino
smaller = SmallerThan(FirstNumber=longueur_des_vingt_pieces_2, SecondNumber=400)  # -> SmallerThan, OrEqualTo
larger = LargerThan(FirstNumber=longueur_des_vingt_pieces_2, SecondNumber=900)  # -> LargerThan, OrEqualTo

# ---- group: ZONE_CORRIGE / ÉTAPE 2
or = GateOr(A=smaller.SmallerThan, B=larger.LargerThan)
cull = CullPattern(List=longueur_des_vingt_pieces_2, CullPattern=or)
lng = ListLength(List=cull)
panel = Panel(lng)

# ---- group: ZONE_CORRIGE / AFFICHAGE DU CORRIGÉ
afficher_le_corrigé = BooleanToggle(False)
gate = StreamGate(Stream=lng, Gate=afficher_le_corrigé)  # -> Target0, Target1
reponse_corrige = REPONSE_CORRIGE(gate.Target1)
