# Grasshopper definition G-27_complet.gh (Grasshopper 1.0.8)

# ---- group: ZONE_SUJET
# Chapitre 1 de la savane : construis l'abreuvoir circulaire, puis dispose la harde de 12 animaux
# en trame autour du point d'eau, chacun orienté vers le centre.
reponse = REPONSE()
# G-27 · La savane paramétrique
# Débutant  —  durée cible 20 min  —  réf. REF-063, REF-067, REF-068  —  v0.4-260901
# ▼  CORRIGÉ — à consulter après validation  ▼
# RAPPEL — copie des données fournies dans la zone sujet, afin qu'aucun câble ne relie les deux zones
# ÉTAPE 1 — Les animaux se tiennent à 950 mm DU BORD, pas du centre : leur cercle a pour rayon 1 800 + 950
# = 2 750. Les poser sur le cercle de l'abreuvoir donnerait 11 180,98 mm — et douze animaux les pieds dans
# l'eau
# ÉTAPE 2 — Le côté d'un polygone régulier à n sommets : 2R·sin(π/n)
# ÉTAPE 3 — 17 082,06 mm — le périmètre de la harde
# RÉSULTAT — tant que l'interrupteur AFFICHER LE CORRIGÉ reste sur faux, la sortie 1 du Stream Gate est
# vide : rien n'apparaît dans Rhino
rayon_de_l_abreuvoir = Slider(1800, range=200..4000)
ecart_au_bord = Slider(950, range=100..3000)
animaux_de_la_harde = Slider(12, range=3..24)

# ---- group: ZONE_CORRIGE / DONNÉES FOURNIES (copie)
rayon_de_l_abreuvoir_2 = Slider(1800, range=200..4000)
ecart_au_bord_2 = Slider(950, range=100..3000)
animaux_de_la_harde_2 = Slider(12, range=3..24)

# ---- group: ZONE_CORRIGE / ÉTAPE 1
addition = Addition(A=rayon_de_l_abreuvoir_2, B=ecart_au_bord_2)

# ---- group: ZONE_CORRIGE / ÉTAPE 2
pi = Pi(Factor=1)
division = Division(A=pi, B=animaux_de_la_harde_2)
sin = Sine(Value=division)
multiplication = Multiplication(A=addition, B=2)
multiplication_2 = Multiplication(A=multiplication, B=sin)

# ---- group: ZONE_CORRIGE / ÉTAPE 3
multiplication_3 = Multiplication(A=multiplication_2, B=animaux_de_la_harde_2)
panel = Panel(multiplication_3)

# ---- group: ZONE_CORRIGE / AFFICHAGE DU CORRIGÉ
afficher_le_corrigé = BooleanToggle(False)
gate = StreamGate(Stream=multiplication_3, Gate=afficher_le_corrigé)  # -> Target0, Target1
reponse_corrige = REPONSE_CORRIGE(gate.Target1)
