# Grasshopper definition G-28_complet.gh (Grasshopper 1.0.8)

# ---- group: ZONE_SUJET
# Compose ton avatar : 3 formes de corps, 4 motifs, 6 couleurs. Ton avatar doit rester valide
# dans les 72 combinaisons possibles et son code de configuration doit s'afficher dans le Panel.
reponse = REPONSE()
# G-28 · L'avatar paramétrique
# Intermédiaire  —  durée cible 22 min  —  réf. REF-067, REF-106, REF-061  —  v0.5-260902
# ▼  CORRIGÉ — à consulter après validation  ▼
# RAPPEL — copie des données fournies dans la zone sujet, afin qu'aucun câble ne relie les deux zones
# ÉTAPE 1 — Le code vaut forme×100 + motif×10 + couleur. Sur les 72 combinaisons, chaque forme revient 4 ×
# 6 = 24 fois, chaque motif 3 × 6 = 18 fois, chaque couleur 3 × 4 = 12 fois
# ÉTAPE 2 — La somme des rangs de 1 à n vaut n(n+1)/2 : 6 pour les formes, 10 pour les motifs, 21 pour les
# couleurs
# ÉTAPE 3 — 16 452. Vérifier son avatar sur la seule combinaison choisie ne prouve rien : un codage qui
# casse sur 3-4-6 passe tous les contrôles visuels
# RÉSULTAT — tant que l'interrupteur AFFICHER LE CORRIGÉ reste sur faux, la sortie 1 du Stream Gate est
# vide : rien n'apparaît dans Rhino
formes_de_corps = Slider(3, range=1..10)
motifs = Slider(4, range=1..10)
couleurs = Slider(6, range=1..12)

# ---- group: ZONE_CORRIGE / DONNÉES FOURNIES (copie)
formes_de_corps_2 = Slider(3, range=1..10)
motifs_2 = Slider(4, range=1..10)
couleurs_2 = Slider(6, range=1..12)

# ---- group: ZONE_CORRIGE / ÉTAPE 1
multiplication = Multiplication(A=motifs_2, B=couleurs_2)
multiplication_2 = Multiplication(A=formes_de_corps_2, B=couleurs_2)
multiplication_3 = Multiplication(A=formes_de_corps_2, B=motifs_2)

# ---- group: ZONE_CORRIGE / ÉTAPE 2
addition = Addition(A=formes_de_corps_2, B=1)
multiplication_4 = Multiplication(A=formes_de_corps_2, B=addition)
division = Division(A=multiplication_4, B=2)
addition_2 = Addition(A=motifs_2, B=1)
multiplication_5 = Multiplication(A=motifs_2, B=addition_2)
division_2 = Division(A=multiplication_5, B=2)
addition_3 = Addition(A=couleurs_2, B=1)
multiplication_6 = Multiplication(A=couleurs_2, B=addition_3)
division_3 = Division(A=multiplication_6, B=2)

# ---- group: ZONE_CORRIGE / ÉTAPE 3
multiplication_7 = Multiplication(A=division, B=multiplication)
multiplication_8 = Multiplication(A=multiplication_7, B=100)
multiplication_9 = Multiplication(A=division_2, B=multiplication_2)
multiplication_10 = Multiplication(A=multiplication_9, B=10)
multiplication_11 = Multiplication(A=division_3, B=multiplication_3)
addition_4 = Addition(A=multiplication_8, B=multiplication_10)
addition_5 = Addition(A=addition_4, B=multiplication_11)
panel = Panel(addition_5)

# ---- group: ZONE_CORRIGE / AFFICHAGE DU CORRIGÉ
afficher_le_corrigé = BooleanToggle(False)
gate = StreamGate(Stream=addition_5, Gate=afficher_le_corrigé)  # -> Target0, Target1
reponse_corrige = REPONSE_CORRIGE(gate.Target1)
