# Grasshopper definition G-29_complet.gh (Grasshopper 1.0.8)

# ---- group: ZONE_SUJET
# Un défi court, différent chaque jour, tiré d'une banque de 30 micro-tâches. Celui du jour :
# trie les pièces par longueur et donne la longueur médiane.
pieces_du_jour = PIECES_DU_JOUR([1755, 1340, 1899, 2202, 379, 1403, 396, 197, 2236, 807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])
reponse = REPONSE()

# ---- group: ZONE_CORRIGE / DONNÉES FOURNIES (copie)
pieces_du_jour_2 = PIECES_DU_JOUR([1755, 1340, 1899, 2202, 379, 1403, 396, 197, 2236, 807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])

# ---- group: ZONE_CORRIGE / ÉTAPE 1
# G-29 · Le défi du jour
# Intermédiaire  —  durée cible 10 min  —  réf. REF-047, REF-079  —  v0.5-260902
# ▼  CORRIGÉ — à consulter après validation  ▼
# RAPPEL — copie des données fournies dans la zone sujet, afin qu'aucun câble ne relie les deux zones
# ÉTAPE 1 — Quarante-et-une pièces : un nombre IMPAIR, donc la médiane est une valeur réellement présente
# dans la liste — celle de rang 20 après tri
# ÉTAPE 2 — 1 119 mm. La moyenne, 1 203 mm, répond à la même question et diffère de 84 mm : assez pour
# fausser un débit, pas assez pour alerter
# RÉSULTAT — tant que l'interrupteur AFFICHER LE CORRIGÉ reste sur faux, la sortie 1 du Stream Gate est
# vide : rien n'apparaît dans Rhino
sort = SortList(Keys=pieces_du_jour_2)  # -> Keys, ValuesA
item = ListItem(List=sort.Keys, Index=20, Wrap=True)

# ---- group: ZONE_CORRIGE / ÉTAPE 2
panel = Panel(item)

# ---- group: ZONE_CORRIGE / AFFICHAGE DU CORRIGÉ
afficher_le_corrigé = BooleanToggle(False)
gate = StreamGate(Stream=item, Gate=afficher_le_corrigé)  # -> Target0, Target1
reponse_corrige = REPONSE_CORRIGE(gate.Target1)
