# Grasshopper definition G-30_complet.gh (Grasshopper 1.0.8)

# ---- group: ZONE_SUJET
# Première moitié : construis la structure de données jusqu'au point de passage marqué, en la
# rendant compréhensible par un tiers. Ton binôme reprendra le fichier pour la seconde moitié
# sans explication orale.
quatre_vingt_seize_valeurs = QUATRE_VINGT_SEIZE_VALEURS([462, 341, 216, 221, 529, 133, 594, 404, 913, 120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])
reponse = REPONSE()

# ---- group: ZONE_CORRIGE / DONNÉES FOURNIES (copie)
quatre_vingt_seize_valeurs_2 = QUATRE_VINGT_SEIZE_VALEURS([462, 341, 216, 221, 529, 133, 594, 404, 913, 120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])

# ---- group: ZONE_CORRIGE / ÉTAPE 1
# G-30 · Le relais à deux
# Perfectionnement  —  durée cible 30 min  —  réf. REF-088, REF-048  —  v0.4-260901
# ▼  CORRIGÉ — à consulter après validation  ▼
# RAPPEL — copie des données fournies dans la zone sujet, afin qu'aucun câble ne relie les deux zones
# ÉTAPE 1 — Première moitié — six branches de seize. C'est le point de passage : ce que le binôme reprend
# ÉTAPE 2 — Seconde moitié — dans CHAQUE branche, on trie puis on écarte deux valeurs hautes et deux
# basses. Les écarter sur l'ensemble des 96 avant de répartir est l'autre lecture, défendable à l'oral et
# fausse ici : c'est exactement l'ambiguïté qu'un relais révèle
# ÉTAPE 3 — 2 904,3333 — la somme des six moyennes. Sans `Flatten Tree`, `Mass Addition` rendrait SIX
# sommes, une par branche : il somme ce que chaque branche contient, et chacune n'en contient qu'une
# RÉSULTAT — tant que l'interrupteur AFFICHER LE CORRIGÉ reste sur faux, la sortie 1 du Stream Gate est
# vide : rien n'apparaît dans Rhino
partition = PartitionList(List=quatre_vingt_seize_valeurs_2, Size=16)

# ---- group: ZONE_CORRIGE / ÉTAPE 2
sort = SortList(Keys=partition)  # -> Keys, ValuesA
dom = ConstructDomain(DomainStart=2, DomainEnd=13)
subset = SubList(List=sort.Keys, Domain=dom, Wrap=True)  # -> List, Index
avr = Average(Input=subset.List)

# ---- group: ZONE_CORRIGE / ÉTAPE 3
flatten = FlattenTree(Tree=avr, Path="{0}")
ma = MassAddition(Input=flatten)  # -> Result, PartialResults
panel = Panel(ma.Result)

# ---- group: ZONE_CORRIGE / AFFICHAGE DU CORRIGÉ
afficher_le_corrigé = BooleanToggle(False)
gate = StreamGate(Stream=ma.Result, Gate=afficher_le_corrigé)  # -> Target0, Target1
reponse_corrige = REPONSE_CORRIGE(gate.Target1)
