# Grasshopper definition G-31_complet.gh (Grasshopper 1.0.8)

# ---- group: ZONE_SUJET
# Construis la représentation graphique de ton propre arbre de compétences à partir de la liste
# des exercices validés : un nœud par notion, une branche par domaine, un code couleur par niveau
# atteint.
exercices_portes = EXERCICES_PORTES([1, 3, 1, 1, 2, 4, 3, 3, 2, 4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])
exercices_valides = EXERCICES_VALIDES([2, 2, 2, 3, 1, 3, 2, 2, 0, 4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])
reponse = REPONSE()

# ---- group: ZONE_CORRIGE / DONNÉES FOURNIES (copie)
exercices_portes_2 = EXERCICES_PORTES([1, 3, 1, 1, 2, 4, 3, 3, 2, 4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])
exercices_valides_2 = EXERCICES_VALIDES([2, 2, 2, 3, 1, 3, 2, 2, 0, 4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])

# ---- group: ZONE_CORRIGE / ÉTAPE 1
# G-31 · L'arbre de compétences
# Intermédiaire  —  durée cible 15 min  —  réf. REF-048, REF-051  —  v0.4-260901
# ▼  CORRIGÉ — à consulter après validation  ▼
# RAPPEL — copie des données fournies dans la zone sujet, afin qu'aucun câble ne relie les deux zones
# ÉTAPE 1 — Une notion est COMPLÈTE quand les validés atteignent les portés — « au moins », et non «
# exactement » : une notion peut avoir plus de validés que d'exercices portés, cas réel d'un exercice
# retiré du référentiel
# ÉTAPE 2 — 21 notions sur 48, soit 44 %. Compter les notions ENTAMÉES — au moins un exercice validé — en
# donnerait 37, et l'arbre paraîtrait aux trois quarts vert
# RÉSULTAT — tant que l'interrupteur AFFICHER LE CORRIGÉ reste sur faux, la sortie 1 du Stream Gate est
# vide : rien n'apparaît dans Rhino
larger = LargerThan(FirstNumber=exercices_valides_2, SecondNumber=exercices_portes_2)  # -> LargerThan, OrEqualTo

# ---- group: ZONE_CORRIGE / ÉTAPE 2
cull = CullPattern(List=exercices_valides_2, CullPattern=larger.OrEqualTo)
lng = ListLength(List=cull)
panel = Panel(lng)

# ---- group: ZONE_CORRIGE / AFFICHAGE DU CORRIGÉ
afficher_le_corrigé = BooleanToggle(False)
gate = StreamGate(Stream=lng, Gate=afficher_le_corrigé)  # -> Target0, Target1
reponse_corrige = REPONSE_CORRIGE(gate.Target1)
