# Grasshopper definition G-32_complet.gh (Grasshopper 1.0.8)

# ---- group: ZONE_SUJET
# Restructure l'arbre fourni pour atteindre la structure cible. Quatre indices sont disponibles,
# du plus général au plus précis, coûtant respectivement 1, 2, 3 et 4 points sur un total de 12.
arbre_source = ARBRE_SOURCE([440, 694, 282, 480, 682, 150, 542, 355, 727, 657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])
reponse = REPONSE()

# ---- group: ZONE_CORRIGE / DONNÉES FOURNIES (copie)
arbre_source_2 = ARBRE_SOURCE([440, 694, 282, 480, 682, 150, 542, 355, 727, 657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])

# ---- group: ZONE_CORRIGE / ÉTAPE 1
# G-32 · Les indices payants
# Intermédiaire  —  durée cible 20 min  —  réf. REF-052, REF-049, REF-050  —  v0.4-260901
# ▼  CORRIGÉ — à consulter après validation  ▼
# RAPPEL — copie des données fournies dans la zone sujet, afin qu'aucun câble ne relie les deux zones
# ÉTAPE 1 — Neuf branches de huit, puis les multiples de 5 de chacune
# ÉTAPE 2 — La structure se décrit par les EFFECTIFS de ses branches, pas par les valeurs retenues : 4, 1,
# 0, 3, 2, 2, 3, 2, 2. Une branche est vide — c'est elle qui vérifie qu'on ne supprime pas les branches
# sans contenu
# RÉSULTAT — tant que l'interrupteur AFFICHER LE CORRIGÉ reste sur faux, la sortie 1 du Stream Gate est
# vide : rien n'apparaît dans Rhino
partition = PartitionList(List=arbre_source_2, Size=8)
mod = Modulus(A=partition, B=5)
equals = Equality(FirstNumber=mod, SecondNumber=0)  # -> Equality, Inequality
cull = CullPattern(List=partition, CullPattern=equals.Equality)

# ---- group: ZONE_CORRIGE / ÉTAPE 2
lng = ListLength(List=cull)
panel = Panel(lng)

# ---- group: ZONE_CORRIGE / AFFICHAGE DU CORRIGÉ
afficher_le_corrigé = BooleanToggle(False)
gate = StreamGate(Stream=lng, Gate=afficher_le_corrigé)  # -> Target0, Target1
reponse_corrige = REPONSE_CORRIGE(gate.Target1)
