# Grasshopper definition GP-01_complet.gh (Grasshopper 1.0.8)

# ---- group: ZONE_SUJET
# La réservation est rectangulaire, avec un congé de 60 mm à chaque angle. Produisez son tracé
# pour une réservation de 1 400 × 850 mm, et donnez le périmètre développé du contour.
reponse = REPONSE()
# GP-01 · Un plan coté qui suit ses paramètres
# Débutant  —  durée cible 25 min  —  réf. REF-065, REF-066  —  v0.3-260826
# ▼  CORRIGÉ — à consulter après validation  ▼
# RAPPEL — copie des données fournies dans la zone sujet, afin qu'aucun câble ne relie les deux zones
# ÉTAPE 1 — Le rectangle se construit dans le plan de base, à partir des deux dimensions réglables
# ÉTAPE 2 — Le congé est un paramètre du tracé, non un raccord posé après coup : le contour reste ainsi une
# courbe unique, et sa mesure a un sens
# ÉTAPE 3 — Mesurer le contour. Le retranchement des côtés droits est déjà fait : y ajouter les quarts de
# cercle donnerait 4 × (2r − πr/2) de trop
# RÉSULTAT — tant que l'interrupteur AFFICHER LE CORRIGÉ reste sur faux, la sortie 1 du Stream Gate est
# vide : rien n'apparaît dans Rhino
# Le conge est l'entree R
# du composant de trace.
largeur = Slider(1400, range=200..3000)
hauteur = Slider(850, range=200..3000)
rayon_de_conge = Slider(60, range=0..200)

# ---- group: ZONE_CORRIGE / DONNÉES FOURNIES (copie)
largeur_2 = Slider(1400, range=200..3000)
hauteur_2 = Slider(850, range=200..3000)
rayon_de_conge_2 = Slider(60, range=0..200)

# ---- group: ZONE_CORRIGE / ÉTAPE 1
rectangle = Rectangle(Plane=PlaneXY(0, 0, 0), XSize=largeur_2, YSize=hauteur_2, Radius=rayon_de_conge_2)  # -> Rectangle, Length

# ---- group: ZONE_CORRIGE / ÉTAPE 3
len = Length(Curve=rectangle.Rectangle)
panel = Panel(len)

# ---- group: ZONE_CORRIGE / AFFICHAGE DU CORRIGÉ
afficher_le_corrigé = BooleanToggle(False)
gate = StreamGate(Stream=len, Gate=afficher_le_corrigé)  # -> Target0, Target1
reponse_corrige = REPONSE_CORRIGE(gate.Target1)
