# Grasshopper definition GP-02_complet.gh (Grasshopper 1.0.8)

# ---- group: ZONE_SUJET
# L'escalier est massif, 1 100 mm de large, giron de 280 mm. Pour une hauteur d'étage de 2 700 mm
# et une hauteur de marche visée de 175 mm, produisez le volume de béton, en mètres cubes.
reponse = REPONSE()
# GP-02 · Un modèle paramétrique de bout en bout
# Intermédiaire  —  durée cible 45 min  —  réf. REF-073  —  v0.5-260902
# ▼  CORRIGÉ — à consulter après validation  ▼
# RAPPEL — copie des données fournies dans la zone sujet, afin qu'aucun câble ne relie les deux zones
# ÉTAPE 1 — Le nombre de contremarches est un ENTIER : c'est lui qu'on arrondit, au plus proche. 2 700 ÷
# 175 vaut 15,43, donc 15
# ÉTAPE 2 — La hauteur réelle se recale alors sur ce nombre : 2 700 ÷ 15 vaut 180 mm, et non les 175 visés.
# Garder 175 donnerait un escalier de 2 625 mm, qui n'atteint pas l'étage
# ÉTAPE 3 — Chaque marche cumule les précédentes : la première monte d'une hauteur, la quinzième de quinze.
# La somme 1 + 2 + … + n vaut n(n+1)/2, soit 120 pour quinze marches — inutile de construire les quinze
# blocs pour la connaître
# ÉTAPE 4 — Volume d'une assise unitaire : giron × largeur × hauteur réelle
# ÉTAPE 5 — Volume total, converti en mètres cubes : 6,653 m³
# RÉSULTAT — tant que l'interrupteur AFFICHER LE CORRIGÉ reste sur faux, la sortie 1 du Stream Gate est
# vide : rien n'apparaît dans Rhino
hauteur_d_etage = Slider(2700, range=2000..4000)
hauteur_de_marche_visee = Slider(175, range=140..200)
giron = Slider(280, range=200..350)
largeur = Slider(1100, range=600..1600)

# ---- group: ZONE_CORRIGE / DONNÉES FOURNIES (copie)
hauteur_d_etage_2 = Slider(2700, range=2000..4000)
hauteur_de_marche_visee_2 = Slider(175, range=140..200)
giron_2 = Slider(280, range=200..350)
largeur_2 = Slider(1100, range=600..1600)

# ---- group: ZONE_CORRIGE / ÉTAPE 1
division = Division(A=hauteur_d_etage_2, B=hauteur_de_marche_visee_2)
round = Round(Number=division)  # -> Nearest, Floor, Ceiling

# ---- group: ZONE_CORRIGE / ÉTAPE 2
division_2 = Division(A=hauteur_d_etage_2, B=round.Nearest)
panel = Panel(division_2)

# ---- group: ZONE_CORRIGE / ÉTAPE 3
addition = Addition(A=round.Nearest, B=1)
multiplication = Multiplication(A=round.Nearest, B=addition)
division_3 = Division(A=multiplication, B=2)

# ---- group: ZONE_CORRIGE / ÉTAPE 4
multiplication_2 = Multiplication(A=division_2, B=giron_2)
multiplication_3 = Multiplication(A=multiplication_2, B=largeur_2)

# ---- group: ZONE_CORRIGE / ÉTAPE 5
multiplication_4 = Multiplication(A=multiplication_3, B=division_3)
division_4 = Division(A=multiplication_4, B=1000000000)
panel_2 = Panel(division_4)

# ---- group: ZONE_CORRIGE / AFFICHAGE DU CORRIGÉ
afficher_le_corrigé = BooleanToggle(False)
gate = StreamGate(Stream=division_4, Gate=afficher_le_corrigé)  # -> Target0, Target1
reponse_corrige = REPONSE_CORRIGE(gate.Target1)
