# Grasshopper definition GP-03_complet.gh (Grasshopper 1.0.8)

# ---- group: ZONE_SUJET
# La surface fournie doit devenir un maillage fermé dont l'écart à la surface d'origine ne
# dépasse nulle part 0,2 mm. Donnez le nombre de faces du maillage obtenu.
surface_a_mailler = SURFACE_A_MAILLER()
reponse = REPONSE()

# ---- group: ZONE_CORRIGE / ÉTAPE 1
nappe_de_reference = NAPPE_DE_REFERENCE(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)

# ---- group: ZONE_CORRIGE / ÉTAPE 2
# GP-03 · Un maillage qu'on peut imprimer
# Perfectionnement  —  durée cible 30 min  —  réf. REF-074, REF-075, REF-076  —  v0.5-260902
# ▼  CORRIGÉ — à consulter après validation  ▼
# ÉTAPE 1 — L'étalon : une nappe présentant une zone de forte courbure et une zone presque plane. Un
# maillage à densité uniforme y est toujours mauvais quelque part — c'est ce qui oblige à raisonner en
# écart
# ÉTAPE 2 — Mailler en fixant l'ÉCART, non la densité : régler la densité à l'œil produit soit un maillage
# grossier qui paraît lisse à l'écran, soit un maillage inutilement lourd
# ÉTAPE 3 — Compter les faces obtenues. C'est la contrepartie directe de la finesse, et du poids du fichier
# exporté
# RÉSULTAT — tant que l'interrupteur AFFICHER LE CORRIGÉ reste sur faux, la sortie 1 du Stream Gate est
# vide : rien n'apparaît dans Rhino
mesh = MeshBrep(
    Brep=nappe_de_reference,
    Settings={GridMaxCount=0, GridMinCount=16, JaggedSeams=False, MaxEdgeLength=0, MinEdgeLength=0.0001, MinTolerance=0, Refine=True, RefineAngle=0, RelativeTolerance=0.65, SimplePlanes=True, Tolerance=0})

# ---- group: ZONE_CORRIGE / ÉTAPE 3
demesh = DeconstructMesh(Mesh=mesh)  # -> Vertices, Faces, Colours, Normals
lng = ListLength(List=demesh.Faces)
panel = Panel(lng)

# ---- group: ZONE_CORRIGE / AFFICHAGE DU CORRIGÉ
afficher_le_corrigé = BooleanToggle(False)
gate = StreamGate(Stream=lng, Gate=afficher_le_corrigé)  # -> Target0, Target1
reponse_corrige = REPONSE_CORRIGE(gate.Target1)
