# Grasshopper definition GP-04_complet.gh (Grasshopper 1.0.8)

# ---- group: ZONE_SUJET
reponse = REPONSE()
# GP-04 · SubD ou NURBS ?
# Perfectionnement  —  durée cible 7 min  —  réf. REF-077, REF-078  —  v0.3-260826
# ▼  CORRIGÉ — à consulter après validation  ▼
# ÉTAPE 1 — La bonne réponse est la proposition 3. Le corrigé porte cet indice en clair : le menu du sujet,
# lui, part sur la première proposition, quelle qu'elle soit.
# ÉTAPE 2 — À retenir
# RÉSULTAT — tant que l'interrupteur AFFICHER LE CORRIGÉ reste sur faux, la sortie 1 du Stream Gate est
# vide : rien n'apparaît dans Rhino
# SubD  : recherche de forme, deformation
#         souple, peu de points de controle.
# 
# NURBS : exactitude, usinage, cotation.
# 
# La conversion SubD vers NURBS est prevue :
# les deux ne s'opposent pas.
reponse_qcm = ValueList({"0 - Directement en NURBS, puisque c'est ce qu'il faut à la…": 0, "1 - En maillage, plus simple à déformer.": 1, "2 - Peu importe, les trois sont équivalents.": 2, "3 - En SubD pour la recherche de forme, converti en NURBS…": 3}, selected=[])

# ---- group: ZONE_CORRIGE / ÉTAPE 1
bonne_reponse = BONNE_REPONSE(3)

# ---- group: ZONE_CORRIGE / AFFICHAGE DU CORRIGÉ
afficher_le_corrigé = BooleanToggle(False)
gate = StreamGate(Stream=bonne_reponse, Gate=afficher_le_corrigé)  # -> Target0, Target1
reponse_corrige = REPONSE_CORRIGE(gate.Target1)
