# Grasshopper definition GP-05_complet.gh (Grasshopper 1.0.8)

# ---- group: ZONE_SUJET
# Le bureau d'études fournit les entraxes des sept percements, mesurés chacun depuis le
# précédent, et la distance du premier au point de référence. Donnez la cote du dernier percement
# telle qu'elle doit figurer au plan de pose, en millimètres.
ecart_a_l_origine = ECART_A_L_ORIGINE(420)
entraxes = ENTRAXES([1240, 980, 1615, 1105, 1430, 875, 1290])
reponse = REPONSE()

# ---- group: ZONE_CORRIGE / DONNÉES FOURNIES (copie)
ecart_a_l_origine_2 = ECART_A_L_ORIGINE(420)
entraxes_2 = ENTRAXES([1240, 980, 1615, 1105, 1430, 875, 1290])

# ---- group: ZONE_CORRIGE / ÉTAPE 1
# GP-05 · La chaîne de cotes d'une façade
# Intermédiaire  —  durée cible 25 min  —  réf. REF-065, REF-066  —  v0.5-260902
# ▼  CORRIGÉ — à consulter après validation  ▼
# RAPPEL — copie des données fournies dans la zone sujet, afin qu'aucun câble ne relie les deux zones
# ÉTAPE 1 — Les entraxes sont des distances RELATIVES : chacun se mesure depuis le percement précédent. Les
# cumuler donne la distance parcourue depuis le premier percement — 8 535 mm — et non la cote de pose
# ÉTAPE 2 — La cote de pose se compte depuis le point de RÉFÉRENCE. Il reste donc à ajouter l'écart entre
# ce point et le premier percement : 8 955 mm. Oublier ces 420 mm décale toute la façade d'un tableau de
# baie — assez peu pour ne se voir qu'à la livraison
# ÉTAPE 3 — Ce que l'exercice vaut au-delà du chiffre : sur le plan de pose, on cote TOUJOURS depuis une
# origine unique. Coter de proche en proche fait cumuler les erreurs de report, et le dernier percement
# porte la somme de toutes les précédentes
# RÉSULTAT — tant que l'interrupteur AFFICHER LE CORRIGÉ reste sur faux, la sortie 1 du Stream Gate est
# vide : rien n'apparaît dans Rhino
# Entraxe  = distance au voisin.
# Cote     = distance a l'origine.
# 
# Le plan de pose ne porte que
# des cotes.
ma = MassAddition(Input=entraxes_2)  # -> Result, PartialResults

# ---- group: ZONE_CORRIGE / ÉTAPE 2
addition = Addition(A=ma.Result, B=ecart_a_l_origine_2)
panel = Panel(addition)

# ---- group: ZONE_CORRIGE / AFFICHAGE DU CORRIGÉ
afficher_le_corrigé = BooleanToggle(False)
gate = StreamGate(Stream=addition, Gate=afficher_le_corrigé)  # -> Target0, Target1
reponse_corrige = REPONSE_CORRIGE(gate.Target1)
