# Grasshopper definition GP-06_complet.gh (Grasshopper 1.0.8)

# ---- group: ZONE_SUJET
# La nappe est maillée en 48 divisions dans un sens et 30 dans l'autre, en quadrangles. Donnez le
# nombre de sommets.
reponse = REPONSE()
# GP-06 · Les sommets d'une nappe maillée
# Perfectionnement  —  durée cible 20 min  —  réf. REF-074  —  v0.5-260902
# ▼  CORRIGÉ — à consulter après validation  ▼
# RAPPEL — copie des données fournies dans la zone sujet, afin qu'aucun câble ne relie les deux zones
# ÉTAPE 1 — Une nappe de n divisions porte n + 1 rangées de sommets : c'est le même écart qu'entre les
# intervalles et les piquets d'une clôture
# ÉTAPE 2 — 49 × 31 = 1 519 sommets. Le nombre de FACES, lui, vaut 1 440 — 79 de moins, ce qui ne se voit
# pas sur l'image mais change la taille du système à résoudre
# RÉSULTAT — tant que l'interrupteur AFFICHER LE CORRIGÉ reste sur faux, la sortie 1 du Stream Gate est
# vide : rien n'apparaît dans Rhino
divisions_en_u = Slider(48, range=1..200)
divisions_en_v = Slider(30, range=1..200)

# ---- group: ZONE_CORRIGE / DONNÉES FOURNIES (copie)
divisions_en_u_2 = Slider(48, range=1..200)
divisions_en_v_2 = Slider(30, range=1..200)

# ---- group: ZONE_CORRIGE / ÉTAPE 1
addition = Addition(A=divisions_en_u_2, B=1)
addition_2 = Addition(A=divisions_en_v_2, B=1)

# ---- group: ZONE_CORRIGE / ÉTAPE 2
multiplication = Multiplication(A=addition, B=addition_2)
panel = Panel(multiplication)

# ---- group: ZONE_CORRIGE / AFFICHAGE DU CORRIGÉ
afficher_le_corrigé = BooleanToggle(False)
gate = StreamGate(Stream=multiplication, Gate=afficher_le_corrigé)  # -> Target0, Target1
reponse_corrige = REPONSE_CORRIGE(gate.Target1)
