# Grasshopper definition GP-07_complet.gh (Grasshopper 1.0.8)

# ---- group: ZONE_SUJET
# La nappe compte 48 divisions par 30, en quadrangles construits un à un. Donnez le nombre de
# sommets que la soudure supprimera.
reponse = REPONSE()
# GP-07 · Ce que la soudure retire
# Perfectionnement  —  durée cible 25 min  —  réf. REF-076  —  v0.5-260902
# ▼  CORRIGÉ — à consulter après validation  ▼
# RAPPEL — copie des données fournies dans la zone sujet, afin qu'aucun câble ne relie les deux zones
# ÉTAPE 1 — Non soudé, chaque quadrangle porte ses quatre sommets sans savoir que ses voisins portent les
# mêmes : 1 440 × 4 = 5 760
# ÉTAPE 2 — Soudé, il n'en reste que 1 519
# ÉTAPE 3 — 4 241 sommets supprimés : le maillage brut était 3,8 fois plus lourd que nécessaire. C'est la
# raison ordinaire d'un fichier d'export inexplicablement gros
# RÉSULTAT — tant que l'interrupteur AFFICHER LE CORRIGÉ reste sur faux, la sortie 1 du Stream Gate est
# vide : rien n'apparaît dans Rhino
divisions_en_u = Slider(48, range=1..200)
divisions_en_v = Slider(30, range=1..200)

# ---- group: ZONE_CORRIGE / DONNÉES FOURNIES (copie)
divisions_en_u_2 = Slider(48, range=1..200)
divisions_en_v_2 = Slider(30, range=1..200)

# ---- group: ZONE_CORRIGE / ÉTAPE 1
multiplication = Multiplication(A=divisions_en_u_2, B=divisions_en_v_2)
multiplication_2 = Multiplication(A=multiplication, B=4)

# ---- group: ZONE_CORRIGE / ÉTAPE 2
addition = Addition(A=divisions_en_u_2, B=1)
addition_2 = Addition(A=divisions_en_v_2, B=1)
multiplication_3 = Multiplication(A=addition, B=addition_2)

# ---- group: ZONE_CORRIGE / ÉTAPE 3
subtraction = Subtraction(A=multiplication_2, B=multiplication_3)
panel = Panel(subtraction)

# ---- group: ZONE_CORRIGE / AFFICHAGE DU CORRIGÉ
afficher_le_corrigé = BooleanToggle(False)
gate = StreamGate(Stream=subtraction, Gate=afficher_le_corrigé)  # -> Target0, Target1
reponse_corrige = REPONSE_CORRIGE(gate.Target1)
