# Grasshopper definition GP-08_complet.gh (Grasshopper 1.0.8)

# ---- group: ZONE_SUJET
# La cage compte 26 faces. Chaque passe de subdivision remplace chaque face par quatre. Donnez le
# nombre de faces après trois passes.
reponse = REPONSE()
# GP-08 · Ce que coûte une subdivision de plus
# Perfectionnement  —  durée cible 20 min  —  réf. REF-077, REF-078  —  v0.5-260902
# ▼  CORRIGÉ — à consulter après validation  ▼
# RAPPEL — copie des données fournies dans la zone sujet, afin qu'aucun câble ne relie les deux zones
# ÉTAPE 1 — Chaque passe quadruple ce que la précédente a produit : la croissance est GÉOMÉTRIQUE, quatre à
# la puissance du nombre de passes
# ÉTAPE 2 — 26 × 4³ = 1 664 faces. Multiplier par trois passes en donnerait 78, une seule passe 104 : trois
# ordres de grandeur différents, et c'est pourquoi une passe de plus, décidée sans y penser, rend un modèle
# inutilisable
# RÉSULTAT — tant que l'interrupteur AFFICHER LE CORRIGÉ reste sur faux, la sortie 1 du Stream Gate est
# vide : rien n'apparaît dans Rhino
faces_de_la_cage = Slider(26, range=1..500)
passes_de_subdivision = Slider(3, range=0..8)

# ---- group: ZONE_CORRIGE / DONNÉES FOURNIES (copie)
faces_de_la_cage_2 = Slider(26, range=1..500)
passes_de_subdivision_2 = Slider(3, range=0..8)

# ---- group: ZONE_CORRIGE / ÉTAPE 1
pow = Power(A=4, B=passes_de_subdivision_2)

# ---- group: ZONE_CORRIGE / ÉTAPE 2
multiplication = Multiplication(A=faces_de_la_cage_2, B=pow)
panel = Panel(multiplication)

# ---- group: ZONE_CORRIGE / AFFICHAGE DU CORRIGÉ
afficher_le_corrigé = BooleanToggle(False)
gate = StreamGate(Stream=multiplication, Gate=afficher_le_corrigé)  # -> Target0, Target1
reponse_corrige = REPONSE_CORRIGE(gate.Target1)
