# Grasshopper definition GP-09_complet.gh (Grasshopper 1.0.8)

# ---- group: ZONE_SUJET
# Le joue est un trapèze rectangle de 2 400 mm de base et 1 800 mm de hauteur, dont le fuyant
# fait 68° avec l'horizontale. Donnez la longueur de la petite base, en millimètres.
reponse = REPONSE()
# GP-09 · Ce que les contraintes imposent
# Intermédiaire  —  durée cible 25 min  —  réf. REF-146  —  v0.4-260901
# ▼  CORRIGÉ — à consulter après validation  ▼
# RAPPEL — copie des données fournies dans la zone sujet, afin qu'aucun câble ne relie les deux zones
# ÉTAPE 1 — L'angle est donné en degrés ; les fonctions trigonométriques attendent des radians
# ÉTAPE 2 — Ce qu'on cherche est le RECUL horizontal du fuyant, pas sa longueur : hauteur divisée par la
# tangente de l'angle, soit 727 mm. La longueur du fuyant vaut 1 941 mm — du même ordre que les cotes du
# meuble, donc tout aussi crédible
# ÉTAPE 3 — 1 672,75 mm. Retrancher le fuyant au lieu de son recul donnerait 459 mm : positif, plausible
# sur un plan, et 1,2 m trop court à l'atelier
# RÉSULTAT — tant que l'interrupteur AFFICHER LE CORRIGÉ reste sur faux, la sortie 1 du Stream Gate est
# vide : rien n'apparaît dans Rhino
base = Slider(2400, range=500..5000)
hauteur = Slider(1800, range=200..3000)
angle_du_fuyant = Slider(68, range=10..89)

# ---- group: ZONE_CORRIGE / DONNÉES FOURNIES (copie)
base_2 = Slider(2400, range=500..5000)
hauteur_2 = Slider(1800, range=200..3000)
angle_du_fuyant_2 = Slider(68, range=10..89)

# ---- group: ZONE_CORRIGE / ÉTAPE 1
rad = Radians(Degrees=angle_du_fuyant_2)

# ---- group: ZONE_CORRIGE / ÉTAPE 2
tan = Tangent(Value=rad)
division = Division(A=hauteur_2, B=tan)

# ---- group: ZONE_CORRIGE / ÉTAPE 3
subtraction = Subtraction(A=base_2, B=division)
panel = Panel(subtraction)

# ---- group: ZONE_CORRIGE / AFFICHAGE DU CORRIGÉ
afficher_le_corrigé = BooleanToggle(False)
gate = StreamGate(Stream=subtraction, Gate=afficher_le_corrigé)  # -> Target0, Target1
reponse_corrige = REPONSE_CORRIGE(gate.Target1)
