# Grasshopper definition GP-10_complet.gh (Grasshopper 1.0.8)

# ---- group: ZONE_SUJET
reponse = REPONSE()
# GP-10 · Courbe, surface, solide ou maillage
# Perfectionnement  —  durée cible 8 min  —  réf. REF-147  —  v0.4-260901
# ▼  CORRIGÉ — à consulter après validation  ▼
# ÉTAPE 1 — La bonne réponse est la proposition 2. Le corrigé porte cet indice en clair : le menu du sujet,
# lui, part sur la première proposition, quelle qu'elle soit.
# ÉTAPE 2 — À retenir
# RÉSULTAT — tant que l'interrupteur AFFICHER LE CORRIGÉ reste sur faux, la sortie 1 du Stream Gate est
# vide : rien n'apparaît dans Rhino
# Le choix se fait sur ce qu'on veut
# MESURER, pas sur ce qu'on veut voir.
# 
# Grasshopper convertit tout seul —
# et c'est justement le piege.
reponse_qcm = ValueList({"0 - Le maillage : c'est le plus rapide à obtenir.": 0, "1 - Les courbes de profil : elles suffisent, le volume s'en…": 1, "2 - Un solide fermé : seul un volume étanche a un volume.": 2, "3 - Peu importe : Grasshopper convertit tout seul.": 3}, selected=[])

# ---- group: ZONE_CORRIGE / ÉTAPE 1
bonne_reponse = BONNE_REPONSE(2)

# ---- group: ZONE_CORRIGE / AFFICHAGE DU CORRIGÉ
afficher_le_corrigé = BooleanToggle(False)
gate = StreamGate(Stream=bonne_reponse, Gate=afficher_le_corrigé)  # -> Target0, Target1
reponse_corrige = REPONSE_CORRIGE(gate.Target1)
