# Grasshopper definition GP-11_complet.gh (Grasshopper 1.0.8)

# ---- group: ZONE_SUJET
# Le contour est un rectangle de 1 800 × 900 mm. Il faut le congéer d'un rayon de 120 mm et le
# décaler de 40 mm vers l'extérieur. Donnez l'écart de périmètre entre les deux ordres possibles,
# en millimètres.
reponse = REPONSE()
# GP-11 · L'ordre des opérations
# Perfectionnement  —  durée cible 30 min  —  réf. REF-148  —  v0.5-260902
# ▼  CORRIGÉ — à consulter après validation  ▼
# RAPPEL — copie des données fournies dans la zone sujet, afin qu'aucun câble ne relie les deux zones
# ÉTAPE 1 — Congé PUIS décalage : les parties droites sont amputées du rayon aux quatre coins, et les
# congés, décalés vers l'extérieur, deviennent des arcs de rayon + décalage
# ÉTAPE 2 — Décalage PUIS congé : le contour grandit de deux décalages dans chaque dimension, et les congés
# gardent leur rayon d'origine
# ÉTAPE 3 — 68,67 mm d'écart sur 5 445 mm de périmètre, soit 1,3 % : trop peu pour se voir à l'écran, assez
# pour que deux ateliers travaillant chacun dans son ordre livrent des pièces qui ne s'assemblent pas
# RÉSULTAT — tant que l'interrupteur AFFICHER LE CORRIGÉ reste sur faux, la sortie 1 du Stream Gate est
# vide : rien n'apparaît dans Rhino
longueur = Slider(1800, range=200..4000)
hauteur = Slider(900, range=200..4000)
rayon_de_conge = Slider(120, range=0..400)
decalage = Slider(40, range=0..200)

# ---- group: ZONE_CORRIGE / DONNÉES FOURNIES (copie)
longueur_2 = Slider(1800, range=200..4000)
hauteur_2 = Slider(900, range=200..4000)
rayon_de_conge_2 = Slider(120, range=0..400)
decalage_2 = Slider(40, range=0..200)

# ---- group: ZONE_CORRIGE / ÉTAPE 1
multiplication = Multiplication(A=rayon_de_conge_2, B=2)
subtraction = Subtraction(A=longueur_2, B=multiplication)
subtraction_2 = Subtraction(A=hauteur_2, B=multiplication)
addition = Addition(A=subtraction, B=subtraction_2)
multiplication_2 = Multiplication(A=addition, B=2)
addition_2 = Addition(A=rayon_de_conge_2, B=decalage_2)
pi = Pi(Factor=2)
multiplication_3 = Multiplication(A=pi, B=addition_2)
addition_3 = Addition(A=multiplication_2, B=multiplication_3)

# ---- group: ZONE_CORRIGE / ÉTAPE 2
multiplication_4 = Multiplication(A=decalage_2, B=2)
addition_4 = Addition(A=longueur_2, B=multiplication_4)
addition_5 = Addition(A=hauteur_2, B=multiplication_4)
subtraction_3 = Subtraction(A=addition_4, B=multiplication)
subtraction_4 = Subtraction(A=addition_5, B=multiplication)
addition_6 = Addition(A=subtraction_3, B=subtraction_4)
multiplication_5 = Multiplication(A=addition_6, B=2)
pi_2 = Pi(Factor=2)
multiplication_6 = Multiplication(A=pi_2, B=rayon_de_conge_2)
addition_7 = Addition(A=multiplication_5, B=multiplication_6)

# ---- group: ZONE_CORRIGE / ÉTAPE 3
subtraction_5 = Subtraction(A=addition_3, B=addition_7)
abs = Absolute(Value=subtraction_5)
panel = Panel(abs)

# ---- group: ZONE_CORRIGE / AFFICHAGE DU CORRIGÉ
afficher_le_corrigé = BooleanToggle(False)
gate = StreamGate(Stream=abs, Gate=afficher_le_corrigé)  # -> Target0, Target1
reponse_corrige = REPONSE_CORRIGE(gate.Target1)
