# Grasshopper definition GP-12_complet.gh (Grasshopper 1.0.8)

# ---- group: ZONE_SUJET
# Le point est à 1 200 mm de l'origine sur l'axe des abscisses. On lui applique une rotation de
# 35° autour de l'origine et une translation de 800 mm en X et 300 mm en Y. Donnez la distance
# entre les deux positions finales possibles, en millimètres.
position_du_point = POSITION_DU_POINT(Vector(1200, 0, 0))
translation = TRANSLATION(Vector(800, 300, 0))
reponse = REPONSE()
# GP-12 · Tourner puis déplacer, ou l'inverse
# Intermédiaire  —  durée cible 25 min  —  réf. REF-149  —  v0.5-260902
# ▼  CORRIGÉ — à consulter après validation  ▼
# RAPPEL — copie des données fournies dans la zone sujet, afin qu'aucun câble ne relie les deux zones
# ÉTAPE 1 — L'axe de rotation est la verticale passant par l'origine, et l'angle se donne en radians
# ÉTAPE 2 — Premier ordre : tourner, puis déplacer. La rotation ne voit pas encore la translation
# ÉTAPE 3 — Second ordre : déplacer, puis tourner. La rotation autour de l'ORIGINE emporte alors la
# translation déjà faite — c'est là que les deux ordres divergent
# ÉTAPE 4 — 513,85 mm séparent les deux résultats. Sur un bras de 1,2 m, c'est un point d'ancrage qui tombe
# à côté du poteau — et aucun des deux aperçus ne paraît faux
# RÉSULTAT — tant que l'interrupteur AFFICHER LE CORRIGÉ reste sur faux, la sortie 1 du Stream Gate est
# vide : rien n'apparaît dans Rhino
angle_de_rotation = Slider(35, range=0..180)

# ---- group: ZONE_CORRIGE / DONNÉES FOURNIES (copie)
position_du_point_2 = POSITION_DU_POINT(Vector(1200, 0, 0))
translation_2 = TRANSLATION(Vector(800, 300, 0))
angle_de_rotation_2 = Slider(35, range=0..180)

# ---- group: ZONE_CORRIGE / ÉTAPE 1
Z = UnitZ(Factor=1)
rad = Radians(Degrees=angle_de_rotation_2)

# ---- group: ZONE_CORRIGE / ÉTAPE 2
vrot = Rotate(Vector=position_du_point_2, Axis=Z, Angle=rad)
addition = Addition(A=vrot, B=translation_2)

# ---- group: ZONE_CORRIGE / ÉTAPE 3
addition_2 = Addition(A=position_du_point_2, B=translation_2)
vrot_2 = Rotate(Vector=addition_2, Axis=Z, Angle=rad)

# ---- group: ZONE_CORRIGE / ÉTAPE 4
subtraction = Subtraction(A=addition, B=vrot_2)
vlen = VectorLength(Vector=subtraction)
panel = Panel(vlen)

# ---- group: ZONE_CORRIGE / AFFICHAGE DU CORRIGÉ
afficher_le_corrigé = BooleanToggle(False)
gate = StreamGate(Stream=vlen, Gate=afficher_le_corrigé)  # -> Target0, Target1
reponse_corrige = REPONSE_CORRIGE(gate.Target1)
