# Grasshopper definition GP-13_complet.gh (Grasshopper 1.0.8)

# ---- group: ZONE_SUJET
# La platine mesure 420 × 260 mm, ses quatre angles portent un congé de 35 mm de rayon, et elle
# reçoit sept perçages de 26 mm de diamètre. Elle fait 18 mm d'épaisseur. Donnez son volume, en
# décimètres cubes.
reponse = REPONSE()
# GP-13 · La pièce qui enchaîne trois opérations
# Intermédiaire  —  durée cible 22 min  —  réf. REF-073, REF-147, REF-148  —  v0.5-260902
# ▼  CORRIGÉ — à consulter après validation  ▼
# RAPPEL — copie des données fournies dans la zone sujet, afin qu'aucun câble ne relie les deux zones
# ÉTAPE 1 — Le rectangle plein
# ÉTAPE 2 — Un congé de rayon r retire à chaque angle la différence entre le carré de côté r et le quart de
# disque : (4 − π) r² pour les quatre. Les oublier ne coûte qu'un demi-pour-cent — c'est précisément
# pourquoi on ne le voit pas
# ÉTAPE 3 — Puis les sept perçages
# ÉTAPE 4 — 1,8798 dm³
# RÉSULTAT — tant que l'interrupteur AFFICHER LE CORRIGÉ reste sur faux, la sortie 1 du Stream Gate est
# vide : rien n'apparaît dans Rhino
longueur = Slider(420, range=100..900)
largeur = Slider(260, range=100..600)
rayon_de_conge = Slider(35, range=5..80)
diametre_de_percage = Slider(26, range=5..60)
percements = Slider(7, range=0..20)
epaisseur = Slider(18, range=2..60)

# ---- group: ZONE_CORRIGE / DONNÉES FOURNIES (copie)
longueur_2 = Slider(420, range=100..900)
largeur_2 = Slider(260, range=100..600)
rayon_de_conge_2 = Slider(35, range=5..80)
diametre_de_percage_2 = Slider(26, range=5..60)
percements_2 = Slider(7, range=0..20)
epaisseur_2 = Slider(18, range=2..60)

# ---- group: ZONE_CORRIGE / ÉTAPE 1
multiplication = Multiplication(A=longueur_2, B=largeur_2)

# ---- group: ZONE_CORRIGE / ÉTAPE 2
pi = Pi(Factor=1)
subtraction = Subtraction(A=4, B=pi)
multiplication_2 = Multiplication(A=rayon_de_conge_2, B=rayon_de_conge_2)
multiplication_3 = Multiplication(A=subtraction, B=multiplication_2)

# ---- group: ZONE_CORRIGE / ÉTAPE 3
division = Division(A=diametre_de_percage_2, B=2)
multiplication_4 = Multiplication(A=division, B=division)
multiplication_5 = Multiplication(A=multiplication_4, B=pi)
multiplication_6 = Multiplication(A=multiplication_5, B=percements_2)

# ---- group: ZONE_CORRIGE / ÉTAPE 4
subtraction_2 = Subtraction(A=multiplication, B=multiplication_3)
subtraction_3 = Subtraction(A=subtraction_2, B=multiplication_6)
multiplication_7 = Multiplication(A=subtraction_3, B=epaisseur_2)
division_2 = Division(A=multiplication_7, B=1000000)
panel = Panel(division_2)

# ---- group: ZONE_CORRIGE / AFFICHAGE DU CORRIGÉ
afficher_le_corrigé = BooleanToggle(False)
gate = StreamGate(Stream=division_2, Gate=afficher_le_corrigé)  # -> Target0, Target1
reponse_corrige = REPONSE_CORRIGE(gate.Target1)
