# Grasshopper definition IA-01_complet.gh (Grasshopper 1.0.8)

# ---- group: ZONE_SUJET
# Les 28 entraxes relevés vous sont fournis. Faites produire par un assistant un composant
# scripté qui renvoie le nombre de platines hors tolérance, et branchez sa sortie sur la réponse.
# Vous ne corrigerez pas le code à la main : si le résultat est faux, c'est la demande qu'il faut
# reprendre.
entraxes_releves = ENTRAXES_RELEVES([250.4, 249.2, 251.8, 250, 248.6, 250.9, 252.3, 249.7, 250.2, 247.9, 251.1, 250.6, 249.4, 252.8, 250.3, 248.1, 250.8, 251.4, 249.9, 253.1, 250.1, 246.8, 251.7, 250.5, 249.3, 252, 250.7, 248.4])
reponse = REPONSE()
# IA-01 · Spécifier un composant plutôt que le décrire
# Débutant  —  durée cible 20 min  —  réf. REF-117, REF-139  —  v0.5-260902
# ▼  CORRIGÉ — à consulter après validation  ▼
# RAPPEL — copie des données fournies dans la zone sujet, afin qu'aucun câble ne relie les deux zones
# ÉTAPE 1 — Le corrigé n'est pas la solution : c'est le contrôle indépendant. On monte ici, avec des
# composants natifs, le comptage que le composant produit par l'assistant devra retrouver.
# ÉTAPE 2 — Valeur absolue de l'écart : une platine trop courte est aussi hors tolérance qu'une platine
# trop longue
# ÉTAPE 3 — Comparer l'écart à la tolérance
# ÉTAPE 4 — Sommer les booléens : 6 platines trop grandes et 4 trop petites, soit 10
# RÉSULTAT — tant que l'interrupteur AFFICHER LE CORRIGÉ reste sur faux, la sortie 1 du Stream Gate est
# vide : rien n'apparaît dans Rhino
nominale = Slider(250, range=200..300)
tolerance = Slider(1.5, range=0..5)

# ---- group: ZONE_CORRIGE / DONNÉES FOURNIES (copie)
entraxes_releves_2 = ENTRAXES_RELEVES([250.4, 249.2, 251.8, 250, 248.6, 250.9, 252.3, 249.7, 250.2, 247.9, 251.1, 250.6, 249.4, 252.8, 250.3, 248.1, 250.8, 251.4, 249.9, 253.1, 250.1, 246.8, 251.7, 250.5, 249.3, 252, 250.7, 248.4])
nominale_2 = Slider(250, range=200..300)
tolerance_2 = Slider(1.5, range=0..5)

# ---- group: ZONE_CORRIGE / ÉTAPE 1
subtraction = Subtraction(A=entraxes_releves_2, B=nominale_2)

# ---- group: ZONE_CORRIGE / ÉTAPE 2
abs = Absolute(Value=subtraction)

# ---- group: ZONE_CORRIGE / ÉTAPE 3
larger = LargerThan(FirstNumber=abs, SecondNumber=tolerance_2)  # -> LargerThan, OrEqualTo

# ---- group: ZONE_CORRIGE / ÉTAPE 4
ma = MassAddition(Input=larger.LargerThan)  # -> Result, PartialResults
panel = Panel(ma.Result)

# ---- group: ZONE_CORRIGE / AFFICHAGE DU CORRIGÉ
afficher_le_corrigé = BooleanToggle(False)
gate = StreamGate(Stream=ma.Result, Gate=afficher_le_corrigé)  # -> Target0, Target1
reponse_corrige = REPONSE_CORRIGE(gate.Target1)
