# Grasshopper definition IA-02_complet.gh (Grasshopper 1.0.8)

# ---- group: ZONE_SUJET
reponse = REPONSE()
# IA-02 · Le contexte technique manquant
# Débutant  —  durée cible 8 min  —  réf. REF-118  —  v0.5-260902
# ▼  CORRIGÉ — à consulter après validation  ▼
# ÉTAPE 1 — La réponse est 0. Le modèle a produit du code valide — pour une autre version de l'interface de
# programmation. Nommer la version déplace le problème de « l'outil ne marche pas » à « ma demande était
# incomplète », qui est la seule formulation sur laquelle on peut agir.
# RÉSULTAT — tant que l'interrupteur AFFICHER LE CORRIGÉ reste sur faux, la sortie 1 du Stream Gate est
# vide : rien n'apparaît dans Rhino
reponse_qcm = ValueList({"0 - la version de Rhino et la bibliotheque visee": 0, "1 - le nom du composant": 1, "2 - la couleur de l'icone": 2, "3 - rien, les assistants n'ecrivent pas de composant": 3}, selected=[])

# ---- group: ZONE_CORRIGE / ÉTAPE 1
# Contexte minimal a fournir :
# - Rhino 8, Grasshopper 1.0
# - RhinoCommon, cible .NET du composant script
# - langage : C# / Python 3 / VB.NET
# - acces aux parametres : element, liste ou arbre
bonne_reponse = BONNE_REPONSE(0)

# ---- group: ZONE_CORRIGE / AFFICHAGE DU CORRIGÉ
afficher_le_corrigé = BooleanToggle(False)
gate = StreamGate(Stream=bonne_reponse, Gate=afficher_le_corrigé)  # -> Target0, Target1
reponse_corrige = REPONSE_CORRIGE(gate.Target1)
