# Grasshopper definition IA-03_complet.gh (Grasshopper 1.0.8)

# ---- group: ZONE_SUJET
# Les 28 niveaux relevés vous sont fournis, en millimètres autour du zéro. Faites produire un
# composant qui renvoie l'amplitude du relevé. Le premier code obtenu donnera un résultat faux :
# reprenez la demande sur le seul point fautif, sans la réécrire en entier.
niveaux_releves = NIVEAUX_RELEVES([12, -8, 5, -15, 22, -3, 18, -11, 7, -19, 14, -6, 25, -13, 9, -21, 16, -4, 11, -17, 20, -9, 6, -23, 13, -7, 19, -12])
reponse = REPONSE()

# ---- group: ZONE_CORRIGE / DONNÉES FOURNIES (copie)
niveaux_releves_2 = NIVEAUX_RELEVES([12, -8, 5, -15, 22, -3, 18, -11, 7, -19, 14, -6, 25, -13, 9, -21, 16, -4, 11, -17, 20, -9, 6, -23, 13, -7, 19, -12])

# ---- group: ZONE_CORRIGE / ÉTAPE 1
# IA-03 · Reprendre une demande sur le point qui échoue
# Débutant  —  durée cible 18 min  —  réf. REF-119  —  v0.5-260902
# ▼  CORRIGÉ — à consulter après validation  ▼
# RAPPEL — copie des données fournies dans la zone sujet, afin qu'aucun câble ne relie les deux zones
# ÉTAPE 1 — Encadrer le relevé : on obtient l'intervalle du plus bas au plus haut
# ÉTAPE 2 — Séparer les deux bornes de l'intervalle
# ÉTAPE 3 — L'amplitude est la différence des deux bornes : 25 − (−23) = 48. La plus grande valeur absolue
# vaudrait 25 : c'est la réponse que donne une demande mal formulée.
# RÉSULTAT — tant que l'interrupteur AFFICHER LE CORRIGÉ reste sur faux, la sortie 1 du Stream Gate est
# vide : rien n'apparaît dans Rhino
bnd = Bounds(Numbers=niveaux_releves_2)

# ---- group: ZONE_CORRIGE / ÉTAPE 2
dedomain = DeconstructDomain(Domain=bnd)  # -> Start, End

# ---- group: ZONE_CORRIGE / ÉTAPE 3
subtraction = Subtraction(A=dedomain.End, B=dedomain.Start)
panel = Panel(subtraction)

# ---- group: ZONE_CORRIGE / AFFICHAGE DU CORRIGÉ
afficher_le_corrigé = BooleanToggle(False)
gate = StreamGate(Stream=subtraction, Gate=afficher_le_corrigé)  # -> Target0, Target1
reponse_corrige = REPONSE_CORRIGE(gate.Target1)
