# Grasshopper definition IA-04_complet.gh (Grasshopper 1.0.8)

# ---- group: ZONE_SUJET
# Les longueurs et les diamètres des 16 tronçons vous sont fournis dans deux listes de même rang.
# Faites produire un composant scripté qui renvoie la surface totale à calorifuger, en mètres
# carrés.
longueurs_m = LONGUEURS_M([3.42, 5.18, 2.76, 4.95, 6.31, 3.07, 4.28, 5.63, 2.94, 4.71, 3.85, 6.02, 2.58, 5.37, 4.16, 3.69])
diametres_mm = DIAMETRES_MM([200, 315, 160, 250, 400, 160, 250, 315, 160, 250, 200, 400, 125, 315, 250, 200])
reponse = REPONSE()

# ---- group: ZONE_CORRIGE / DONNÉES FOURNIES (copie)
longueurs_m_2 = LONGUEURS_M([3.42, 5.18, 2.76, 4.95, 6.31, 3.07, 4.28, 5.63, 2.94, 4.71, 3.85, 6.02, 2.58, 5.37, 4.16, 3.69])
diametres_mm_2 = DIAMETRES_MM([200, 315, 160, 250, 400, 160, 250, 315, 160, 250, 200, 400, 125, 315, 250, 200])

# ---- group: ZONE_CORRIGE / ÉTAPE 1
# IA-04 · Un composant scripté qui somme un métré
# Intermédiaire  —  durée cible 25 min  —  réf. REF-120, REF-121  —  v0.3-260826
# ▼  CORRIGÉ — à consulter après validation  ▼
# RAPPEL — copie des données fournies dans la zone sujet, afin qu'aucun câble ne relie les deux zones
# ÉTAPE 1 — Ramener les diamètres en mètres : les deux listes doivent parler la même unité avant toute
# multiplication
# ÉTAPE 2 — Périmètre de chaque section : π × diamètre
# ÉTAPE 3 — Surface développée de chaque tronçon : périmètre × longueur
# ÉTAPE 4 — Somme des seize tronçons : 58,03 m²
# RÉSULTAT — tant que l'interrupteur AFFICHER LE CORRIGÉ reste sur faux, la sortie 1 du Stream Gate est
# vide : rien n'apparaît dans Rhino
division = Division(A=diametres_mm_2, B=1000)

# ---- group: ZONE_CORRIGE / ÉTAPE 2
pi = Pi(Factor=1)
multiplication = Multiplication(A=division, B=pi)

# ---- group: ZONE_CORRIGE / ÉTAPE 3
multiplication_2 = Multiplication(A=multiplication, B=longueurs_m_2)

# ---- group: ZONE_CORRIGE / ÉTAPE 4
ma = MassAddition(Input=multiplication_2)  # -> Result, PartialResults
panel = Panel(ma.Result)

# ---- group: ZONE_CORRIGE / AFFICHAGE DU CORRIGÉ
afficher_le_corrigé = BooleanToggle(False)
gate = StreamGate(Stream=ma.Result, Gate=afficher_le_corrigé)  # -> Target0, Target1
reponse_corrige = REPONSE_CORRIGE(gate.Target1)
