# Grasshopper definition IA-05_complet.gh (Grasshopper 1.0.8)

# ---- group: ZONE_SUJET
# Le composant fourni s'exécute sans erreur et annonce un résultat. Ce résultat est faux. Trouvez
# pourquoi et faites-le corriger, puis donnez le nombre exact de tronçons concernés.
longueurs_troncons_m = LONGUEURS_TRONCONS_M([3.42, 5.18, 2.76, 4.95, 6.31, 3.07, 4.28, 5.63, 2.94, 4.71, 3.85, 6.02, 2.58, 5.37, 4.16, 3.69])
reponse = REPONSE()
# IA-05 · Le code qui tourne et se trompe
# Intermédiaire  —  durée cible 22 min  —  réf. REF-124  —  v0.3-260826
# ▼  CORRIGÉ — à consulter après validation  ▼
# RAPPEL — copie des données fournies dans la zone sujet, afin qu'aucun câble ne relie les deux zones
# ÉTAPE 1 — Établir d'abord la réponse juste, sans regarder le code : comparer chaque longueur au seuil de
# transport
# ÉTAPE 2 — Compter les tronçons concernés : 9, et non 7. L'écart vaut 2 — c'est cet écart-là qu'il faut
# aller chercher dans le code, pas « une erreur » en général.
# ÉTAPE 3 — Le code fourni s'exécute sans rien signaler : l'absence d'erreur ne dit rien de la justesse.
# RÉSULTAT — tant que l'interrupteur AFFICHER LE CORRIGÉ reste sur faux, la sortie 1 du Stream Gate est
# vide : rien n'apparaît dans Rhino
# Un composant qui ne plante pas
# n'est pas un composant juste.
longueur_de_transport = Slider(4, range=0..10)
panel = Panel("""COMPOSANT FOURNI
annonce : 7 troncons""")

# ---- group: ZONE_CORRIGE / DONNÉES FOURNIES (copie)
longueurs_troncons_m_2 = LONGUEURS_TRONCONS_M([3.42, 5.18, 2.76, 4.95, 6.31, 3.07, 4.28, 5.63, 2.94, 4.71, 3.85, 6.02, 2.58, 5.37, 4.16, 3.69])
longueur_de_transport_2 = Slider(4, range=0..10)

# ---- group: ZONE_CORRIGE / ÉTAPE 1
larger = LargerThan(FirstNumber=longueurs_troncons_m_2, SecondNumber=longueur_de_transport_2)  # -> LargerThan, OrEqualTo

# ---- group: ZONE_CORRIGE / ÉTAPE 2
ma = MassAddition(Input=larger.LargerThan)  # -> Result, PartialResults
panel_2 = Panel(ma.Result)

# ---- group: ZONE_CORRIGE / AFFICHAGE DU CORRIGÉ
afficher_le_corrigé = BooleanToggle(False)
gate = StreamGate(Stream=ma.Result, Gate=afficher_le_corrigé)  # -> Target0, Target1
reponse_corrige = REPONSE_CORRIGE(gate.Target1)
