# Grasshopper definition IA-06_complet.gh (Grasshopper 1.0.8)

# ---- group: ZONE_SUJET
# Le composant existant produit une liste de valeurs. Faites-le porter vers un autre langage,
# puis établissez que les deux versions produisent exactement la même liste, dans le même ordre.
longueurs_m = LONGUEURS_M([3.42, 5.18, 2.76, 4.95, 6.31, 3.07, 4.28, 5.63, 2.94, 4.71, 3.85, 6.02, 2.58, 5.37, 4.16, 3.69])
reponse = REPONSE()

# ---- group: ZONE_CORRIGE / DONNÉES FOURNIES (copie)
longueurs_m_2 = LONGUEURS_M([3.42, 5.18, 2.76, 4.95, 6.31, 3.07, 4.28, 5.63, 2.94, 4.71, 3.85, 6.02, 2.58, 5.37, 4.16, 3.69])

# ---- group: ZONE_CORRIGE / ÉTAPE 1
# IA-06 · Transposer sans changer le résultat
# Intermédiaire  —  durée cible 20 min  —  réf. REF-122, REF-123  —  v0.5-260902
# ▼  CORRIGÉ — à consulter après validation  ▼
# RAPPEL — copie des données fournies dans la zone sujet, afin qu'aucun câble ne relie les deux zones
# ÉTAPE 1 — Le composant d'origine produit les sommes cumulées. L'étalon natif les fournit sans écrire une
# ligne de code : c'est contre cette liste que la version portée doit être comparée, élément par élément.
# ÉTAPE 2 — Comparer les longueurs de liste ne suffit pas : deux implémentations peuvent diverger sur un
# seul rang et coïncider partout ailleurs.
# RÉSULTAT — tant que l'interrupteur AFFICHER LE CORRIGÉ reste sur faux, la sortie 1 du Stream Gate est
# vide : rien n'apparaît dans Rhino
ma = MassAddition(Input=longueurs_m_2)  # -> Result, PartialResults
panel = Panel(ma.PartialResults)

# ---- group: ZONE_CORRIGE / ÉTAPE 2
lng = ListLength(List=ma.PartialResults)
panel_2 = Panel(lng)

# ---- group: ZONE_CORRIGE / AFFICHAGE DU CORRIGÉ
afficher_le_corrigé = BooleanToggle(False)
gate = StreamGate(Stream=ma.PartialResults, Gate=afficher_le_corrigé)  # -> Target0, Target1
reponse_corrige = REPONSE_CORRIGE(gate.Target1)
