# Grasshopper definition IA-08_complet.gh (Grasshopper 1.0.8)

# ---- group: ZONE_SUJET
reponse = REPONSE()
# IA-08 · Le GUID que l'on ne régénère pas
# Perfectionnement  —  durée cible 6 min  —  réf. REF-128  —  v0.5-260902
# ▼  CORRIGÉ — à consulter après validation  ▼
# ÉTAPE 1 — La réponse est 1. Le nom peut changer sans rien casser : c'est le GUID qui identifie le
# composant dans les fichiers enregistrés. Un GUID régénéré transforme chaque composant posé en composant
# manquant, et le symptôme n'apparaît que chez les collègues.
# RÉSULTAT — tant que l'interrupteur AFFICHER LE CORRIGÉ reste sur faux, la sortie 1 du Stream Gate est
# vide : rien n'apparaît dans Rhino
reponse_qcm = ValueList({"0 - le nom du composant a change": 0, "1 - le GUID du composant a ete regenere": 1, "2 - le plugin n'est pas signe": 2, "3 - il faut vider le cache de Grasshopper": 3}, selected=[])

# ---- group: ZONE_CORRIGE / ÉTAPE 1
# A figer des la premiere version :
# - le GUID de chaque composant
# - le nom de la categorie et de l'onglet
# - le nom des entrees et sorties
# 
# Peut changer librement :
# - le libelle affiche, l'icone, l'aide
bonne_reponse = BONNE_REPONSE(1)

# ---- group: ZONE_CORRIGE / AFFICHAGE DU CORRIGÉ
afficher_le_corrigé = BooleanToggle(False)
gate = StreamGate(Stream=bonne_reponse, Gate=afficher_le_corrigé)  # -> Target0, Target1
reponse_corrige = REPONSE_CORRIGE(gate.Target1)
