# Grasshopper definition IA-09_complet.gh (Grasshopper 1.0.8)

# ---- group: ZONE_SUJET
# Les surfaces et les déperditions mesurées des 24 baies vous sont fournies. Estimez la
# déperdition d'une baie de 2,75 m².
surfaces_m2 = SURFACES_M2([1.2, 2.4, 1.8, 3.1, 2.05, 1.45, 2.85, 3.6, 1.65, 2.2, 3.35, 1.95, 2.6, 1.35, 3.05, 2.75, 1.55, 2.95, 3.45, 1.75, 2.3, 3.2, 1.1, 2.5])
deperditions_w = DEPERDITIONS_W([168, 331, 250, 428, 284, 202, 393, 495, 229, 305, 462, 270, 359, 188, 421, 380, 215, 407, 476, 243, 318, 441, 155, 345])
reponse = REPONSE()
# IA-09 · Prédire une déperdition sur une baie nouvelle
# Perfectionnement  —  durée cible 30 min  —  réf. REF-129, REF-131, REF-132  —  v0.5-260902
# ▼  CORRIGÉ — à consulter après validation  ▼
# RAPPEL — copie des données fournies dans la zone sujet, afin qu'aucun câble ne relie les deux zones
# ÉTAPE 1 — L'étalon natif d'un ajustement affine : on n'appelle aucun plugin, on calcule les quatre sommes
# dont la droite des moindres carrés a besoin. Σx, Σy, Σxy et Σx².
# ÉTAPE 2 — Pente de la droite : a = (n·Σxy − Σx·Σy) / (n·Σx² − Σx·Σx), avec n = 24
# ÉTAPE 3 — Ordonnée à l'origine : b = (Σy − a·Σx) / n
# ÉTAPE 4 — Prédiction pour la surface visée : environ 380 W. Un apprenant qui répond par la moyenne des
# déperditions obtient un ordre de grandeur voisin — et une erreur qui explose sur les baies extrêmes.
# RÉSULTAT — tant que l'interrupteur AFFICHER LE CORRIGÉ reste sur faux, la sortie 1 du Stream Gate est
# vide : rien n'apparaît dans Rhino
surface_a_estimer = Slider(2.75, range=0..5)

# ---- group: ZONE_CORRIGE / DONNÉES FOURNIES (copie)
surfaces_m2_2 = SURFACES_M2([1.2, 2.4, 1.8, 3.1, 2.05, 1.45, 2.85, 3.6, 1.65, 2.2, 3.35, 1.95, 2.6, 1.35, 3.05, 2.75, 1.55, 2.95, 3.45, 1.75, 2.3, 3.2, 1.1, 2.5])
deperditions_w_2 = DEPERDITIONS_W([168, 331, 250, 428, 284, 202, 393, 495, 229, 305, 462, 270, 359, 188, 421, 380, 215, 407, 476, 243, 318, 441, 155, 345])
surface_a_estimer_2 = Slider(2.75, range=0..5)

# ---- group: ZONE_CORRIGE / ÉTAPE 1
ma = MassAddition(Input=surfaces_m2_2)  # -> Result, PartialResults
ma_2 = MassAddition(Input=deperditions_w_2)  # -> Result, PartialResults
multiplication = Multiplication(A=surfaces_m2_2, B=deperditions_w_2)
ma_3 = MassAddition(Input=multiplication)  # -> Result, PartialResults
multiplication_2 = Multiplication(A=surfaces_m2_2, B=surfaces_m2_2)
ma_4 = MassAddition(Input=multiplication_2)  # -> Result, PartialResults

# ---- group: ZONE_CORRIGE / ÉTAPE 2
multiplication_3 = Multiplication(A=ma_3.Result, B=24)
multiplication_4 = Multiplication(A=ma.Result, B=ma_2.Result)
subtraction = Subtraction(A=multiplication_3, B=multiplication_4)
multiplication_5 = Multiplication(A=ma_4.Result, B=24)
multiplication_6 = Multiplication(A=ma.Result, B=ma.Result)
subtraction_2 = Subtraction(A=multiplication_5, B=multiplication_6)
division = Division(A=subtraction, B=subtraction_2)

# ---- group: ZONE_CORRIGE / ÉTAPE 3
multiplication_7 = Multiplication(A=division, B=ma.Result)
subtraction_3 = Subtraction(A=ma_2.Result, B=multiplication_7)
division_2 = Division(A=subtraction_3, B=24)

# ---- group: ZONE_CORRIGE / ÉTAPE 4
multiplication_8 = Multiplication(A=division, B=surface_a_estimer_2)
addition = Addition(A=multiplication_8, B=division_2)
panel = Panel(addition)

# ---- group: ZONE_CORRIGE / AFFICHAGE DU CORRIGÉ
afficher_le_corrigé = BooleanToggle(False)
gate = StreamGate(Stream=addition, Gate=afficher_le_corrigé)  # -> Target0, Target1
reponse_corrige = REPONSE_CORRIGE(gate.Target1)
