# Grasshopper definition IA-10_complet.gh (Grasshopper 1.0.8)

# ---- group: ZONE_SUJET
# Les longueurs de débit vous sont fournies. Ramenez-les à trois longueurs de commande, chacune
# au moins égale à la plus longue pièce de son groupe, et donnez le nombre de pièces du groupe le
# plus fourni.
longueurs_debit = LONGUEURS_DEBIT([2450, 1830, 3120, 2075, 1640, 2890, 3450, 1975, 2310, 2660, 1520, 3080, 2185, 2740, 1890, 3260, 2020, 2555, 1735, 2960, 3340, 1680, 2405, 2830])
reponse = REPONSE()

# ---- group: ZONE_CORRIGE / DONNÉES FOURNIES (copie)
longueurs_debit_2 = LONGUEURS_DEBIT([2450, 1830, 3120, 2075, 1640, 2890, 3450, 1975, 2310, 2660, 1520, 3080, 2185, 2740, 1890, 3260, 2020, 2555, 1735, 2960, 3340, 1680, 2405, 2830])

# ---- group: ZONE_CORRIGE / ÉTAPE 1
# IA-10 · Regrouper un débit pour rationaliser la commande
# Perfectionnement  —  durée cible 25 min  —  réf. REF-130  —  v0.5-260902
# ▼  CORRIGÉ — à consulter après validation  ▼
# RAPPEL — copie des données fournies dans la zone sujet, afin qu'aucun câble ne relie les deux zones
# ÉTAPE 1 — Étalon natif du regroupement : à défaut d'un composant d'apprentissage, on découpe la plage en
# trois tranches de largeur égale. C'est la ligne de base contre laquelle le regroupement du plugin devra
# faire mieux.
# ÉTAPE 2 — Première borne : minimum + un tiers de l'étendue
# ÉTAPE 3 — Le groupe le plus fourni est celui des courtes : 9 pièces sur 24, commandées à 2 075 mm.
# Prendre la moyenne du groupe au lieu de son maximum rendrait une pièce sur deux trop courte.
# RÉSULTAT — tant que l'interrupteur AFFICHER LE CORRIGÉ reste sur faux, la sortie 1 du Stream Gate est
# vide : rien n'apparaît dans Rhino
bnd = Bounds(Numbers=longueurs_debit_2)
dedomain = DeconstructDomain(Domain=bnd)  # -> Start, End

# ---- group: ZONE_CORRIGE / ÉTAPE 2
subtraction = Subtraction(A=dedomain.End, B=dedomain.Start)
division = Division(A=subtraction, B=3)
addition = Addition(A=dedomain.Start, B=division)

# ---- group: ZONE_CORRIGE / ÉTAPE 3
smaller = SmallerThan(FirstNumber=longueurs_debit_2, SecondNumber=addition)  # -> SmallerThan, OrEqualTo
ma = MassAddition(Input=smaller.SmallerThan)  # -> Result, PartialResults
panel = Panel(ma.Result)

# ---- group: ZONE_CORRIGE / AFFICHAGE DU CORRIGÉ
afficher_le_corrigé = BooleanToggle(False)
gate = StreamGate(Stream=ma.Result, Gate=afficher_le_corrigé)  # -> Target0, Target1
reponse_corrige = REPONSE_CORRIGE(gate.Target1)
