# Grasshopper definition IA-11_complet.gh (Grasshopper 1.0.8)

# ---- group: ZONE_SUJET
# L'article de CCTP vous est fourni. Faites-en extraire les valeurs dimensionnelles par un modèle
# de langage, puis donnez le nombre de montants nécessaires pour la longueur prescrite.
# ARTICLE 4.2 - GARDE-CORPS
# 
# Le garde-corps du niveau R+1 sera realise en acier
# thermolaque. Il presentera une hauteur de 1 000 mm
# mesuree depuis le nu du sol fini. Les montants seront
# espaces d'un entraxe maximal de 1 100 mm. La longueur
# totale a equiper est de 14 800 mm. Le remplissage sera
# constitue de barreaudage vertical.
reponse = REPONSE()
# IA-11 · Un cahier des charges qui devient des paramètres
# Perfectionnement  —  durée cible 25 min  —  réf. REF-133, REF-134, REF-135  —  v0.5-260902
# ▼  CORRIGÉ — à consulter après validation  ▼
# RAPPEL — copie des données fournies dans la zone sujet, afin qu'aucun câble ne relie les deux zones
# ÉTAPE 1 — Deux valeurs seulement servent au calcul : la longueur et l'entraxe. Le texte contient aussi
# une hauteur de 1 000 mm, du même ordre de grandeur que l'entraxe — une extraction non contrôlée peut les
# intervertir sans que le résultat paraisse absurde.
# ÉTAPE 2 — Le nombre d'intervalles s'arrondit au SUPÉRIEUR : l'entraxe est un maximum, il faut donc au
# moins autant d'intervalles. Un arrondi au plus proche donnerait 13 et l'entraxe dépasserait la
# prescription.
# ÉTAPE 3 — Les montants sont les intervalles plus un : 14 intervalles, 15 montants.
# RÉSULTAT — tant que l'interrupteur AFFICHER LE CORRIGÉ reste sur faux, la sortie 1 du Stream Gate est
# vide : rien n'apparaît dans Rhino
longueur_totale = Slider(14800, range=0..30000)
entraxe_maximal = Slider(1100, range=0..2000)

# ---- group: ZONE_CORRIGE / DONNÉES FOURNIES (copie)
longueur_totale_2 = Slider(14800, range=0..30000)
entraxe_maximal_2 = Slider(1100, range=0..2000)

# ---- group: ZONE_CORRIGE / ÉTAPE 1
division = Division(A=longueur_totale_2, B=entraxe_maximal_2)

# ---- group: ZONE_CORRIGE / ÉTAPE 2
round = Round(Number=division)  # -> Nearest, Floor, Ceiling

# ---- group: ZONE_CORRIGE / ÉTAPE 3
addition = Addition(A=round.Ceiling, B=1)
panel = Panel(addition)

# ---- group: ZONE_CORRIGE / AFFICHAGE DU CORRIGÉ
afficher_le_corrigé = BooleanToggle(False)
gate = StreamGate(Stream=addition, Gate=afficher_le_corrigé)  # -> Target0, Target1
reponse_corrige = REPONSE_CORRIGE(gate.Target1)
