# Grasshopper definition IA-12_complet.gh (Grasshopper 1.0.8)

# ---- group: ZONE_SUJET
# Avec un agent relié à Grasshopper, faites construire une définition qui répartit des points le
# long d'une courbe et renvoie la longueur cumulée des segments obtenus. Travaillez sur une copie
# du fichier, et donnez la longueur obtenue.
courbe_de_reference = COURBE_DE_REFERENCE(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)
reponse = REPONSE()
# IA-12 · Faire construire un graphe par un agent
# Perfectionnement  —  durée cible 35 min  —  réf. REF-136, REF-137, REF-138  —  v0.5-260902
# ▼  CORRIGÉ — à consulter après validation  ▼
# RAPPEL — copie des données fournies dans la zone sujet, afin qu'aucun câble ne relie les deux zones
# ÉTAPE 1 — Étalon natif du résultat que l'agent doit retrouver. L'agent est libre de ses moyens : c'est la
# longueur cumulée qui est validée, pas la forme du graphe qu'il a produit.
# ÉTAPE 2 — Relier les points dans l'ordre donne la polyligne inscrite
# ÉTAPE 3 — Sa longueur est légèrement inférieure à celle de la courbe : c'est normal, une polyligne coupe
# les arcs.
# RÉSULTAT — tant que l'interrupteur AFFICHER LE CORRIGÉ reste sur faux, la sortie 1 du Stream Gate est
# vide : rien n'apparaît dans Rhino
divisions = Slider(24, range=2..60)

# ---- group: ZONE_CORRIGE / DONNÉES FOURNIES (copie)
courbe_de_reference_2 = COURBE_DE_REFERENCE(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)
divisions_2 = Slider(24, range=2..60)

# ---- group: ZONE_CORRIGE / ÉTAPE 1
divide = DivideCurve(Curve=courbe_de_reference_2, Count=divisions_2, Kinks=False)  # -> Points, Tangents, Parameters

# ---- group: ZONE_CORRIGE / ÉTAPE 2
pline = PolyLine(Vertices=divide.Points, Closed=False)

# ---- group: ZONE_CORRIGE / ÉTAPE 3
len = Length(Curve=pline)
panel = Panel(len)

# ---- group: ZONE_CORRIGE / AFFICHAGE DU CORRIGÉ
afficher_le_corrigé = BooleanToggle(False)
gate = StreamGate(Stream=len, Gate=afficher_le_corrigé)  # -> Target0, Target1
reponse_corrige = REPONSE_CORRIGE(gate.Target1)
