# Grasshopper definition IA-13_complet.gh (Grasshopper 1.0.8)

# ---- group: ZONE_SUJET
reponse = REPONSE()
# IA-13 · Ce qui quitte le poste
# Débutant  —  durée cible 8 min  —  réf. REF-140, REF-141  —  v0.3-260826
# ▼  CORRIGÉ — à consulter après validation  ▼
# ÉTAPE 1 — La réponse est 2. Les cotes internalisées, les noms de calques, les repères de projet et les
# commentaires voyagent avec le code, souvent sans qu'on y pense.
# RÉSULTAT — tant que l'interrupteur AFFICHER LE CORRIGÉ reste sur faux, la sortie 1 du Stream Gate est
# vide : rien n'apparaît dans Rhino
reponse_qcm = ValueList({"0 - rien, le code n'est pas une donnee de projet": 0, "1 - le code seul, sans les valeurs": 1, "2 - tout ce qui est colle, valeurs et noms compris": 2, "3 - rien tant qu'on ne coche pas une case de partage": 3}, selected=[])

# ---- group: ZONE_CORRIGE / ÉTAPE 1
# Voyagent avec un extrait colle :
# - valeurs internalisees dans les parametres
# - noms de calques et de blocs
# - commentaires et scribbles
# - chemins de fichiers
# - reperes et numeros d'affaire
bonne_reponse = BONNE_REPONSE(2)

# ---- group: ZONE_CORRIGE / AFFICHAGE DU CORRIGÉ
afficher_le_corrigé = BooleanToggle(False)
gate = StreamGate(Stream=bonne_reponse, Gate=afficher_le_corrigé)  # -> Target0, Target1
reponse_corrige = REPONSE_CORRIGE(gate.Target1)
