# Grasshopper definition IA-14_complet.gh (Grasshopper 1.0.8)

# ---- group: ZONE_SUJET
# Le composant fourni annonce un volume de matière pour l'assemblage donné. Établissez si ce
# volume est juste, et donnez le volume exact.
assemblage = ASSEMBLAGE([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])
reponse = REPONSE()
# IA-14 · Le résultat plausible et faux
# Débutant  —  durée cible 15 min  —  réf. REF-139, REF-142  —  v0.5-260902
# ▼  CORRIGÉ — à consulter après validation  ▼
# RAPPEL — copie des données fournies dans la zone sujet, afin qu'aucun câble ne relie les deux zones
# ÉTAPE 1 — Contrôle indépendant : mesurer le volume par un moyen natif, qui n'emprunte pas le chemin du
# composant fourni. Redemander à l'assistant s'il est sûr ne contrôle rien.
# ÉTAPE 2 — Somme des six blocs, en millimètres cubes. Le composant fourni annonce 40,8 m³ : il a divisé
# par un million au lieu d'un milliard. Le vrai volume est 40 800 000 mm³, soit 0,0408 m³. Un facteur mille
# — invisible pour qui ne contrôle pas l'ordre de grandeur, et parfaitement visible pour qui le fait.
# RÉSULTAT — tant que l'interrupteur AFFICHER LE CORRIGÉ reste sur faux, la sortie 1 du Stream Gate est
# vide : rien n'apparaît dans Rhino
panel = Panel("""COMPOSANT FOURNI
annonce : 0,0684 m3""")

# ---- group: ZONE_CORRIGE / DONNÉES FOURNIES (copie)
assemblage_2 = ASSEMBLAGE([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])

# ---- group: ZONE_CORRIGE / ÉTAPE 1
volume = Volume(Geometry=assemblage_2)  # -> Volume, Centroid

# ---- group: ZONE_CORRIGE / ÉTAPE 2
ma = MassAddition(Input=volume.Volume)  # -> Result, PartialResults
panel_2 = Panel(ma.Result)

# ---- group: ZONE_CORRIGE / AFFICHAGE DU CORRIGÉ
afficher_le_corrigé = BooleanToggle(False)
gate = StreamGate(Stream=ma.Result, Gate=afficher_le_corrigé)  # -> Target0, Target1
reponse_corrige = REPONSE_CORRIGE(gate.Target1)
