# Grasshopper definition IA-15_complet.gh (Grasshopper 1.0.8)

# ---- group: ZONE_SUJET
# Vous aviez spécifié neuf liaisons, chacune avec son entrée de destination. Le relevé du graphe
# produit vous est fourni en regard. Donnez le nombre de liaisons qui ne sont pas conformes à la
# spécification.
entrees_demandees = ENTREES_DEMANDEES([1, 2, 3, 0, 1, 0, 0, 0, 1])
entrees_produites = ENTREES_PRODUITES([1, 0, 3, 0, 0, 0, 0, 0, 0])
reponse = REPONSE()

# ---- group: ZONE_CORRIGE / DONNÉES FOURNIES (copie)
entrees_demandees_2 = ENTREES_DEMANDEES([1, 2, 3, 0, 1, 0, 0, 0, 1])
entrees_produites_2 = ENTREES_PRODUITES([1, 0, 3, 0, 0, 0, 0, 0, 0])

# ---- group: ZONE_CORRIGE / ÉTAPE 1
# IA-15 · Relire le graphe qu'un agent a construit
# Perfectionnement  —  durée cible 30 min  —  réf. REF-137  —  v0.5-260902
# ▼  CORRIGÉ — à consulter après validation  ▼
# RAPPEL — copie des données fournies dans la zone sujet, afin qu'aucun câble ne relie les deux zones
# ÉTAPE 1 — Comparer liaison par liaison l'entrée DEMANDÉE et l'entrée réellement atteinte. Les neuf
# liaisons existent des deux côtés : ce n'est pas leur nombre qui diffère, c'est leur point d'arrivée
# ÉTAPE 2 — Trois désaccords, et tous les trois aboutissent sur l'entrée d'indice 0. C'est la panne réelle
# des ponts agentiques : beaucoup ignorent silencieusement l'indice demandé et écrivent sur la première
# entrée. Le graphe se construit, ne signale rien, et calcule autre chose
# ÉTAPE 3 — L'aperçu, lui, était plausible. C'est tout le sujet de l'exercice : un graphe complet peut être
# entièrement faux, et il produit alors un résultat parfaitement crédible
# RÉSULTAT — tant que l'interrupteur AFFICHER LE CORRIGÉ reste sur faux, la sortie 1 du Stream Gate est
# vide : rien n'apparaît dans Rhino
# Complet n'est pas conforme.
# 
# Verifier les INDICES d'entree,
# pas seulement les composants.
equals = Equality(FirstNumber=entrees_demandees_2, SecondNumber=entrees_produites_2)  # -> Equality, Inequality

# ---- group: ZONE_CORRIGE / ÉTAPE 2
cull = CullPattern(List=entrees_demandees_2, CullPattern=equals.Inequality)
lng = ListLength(List=cull)
panel = Panel(lng)

# ---- group: ZONE_CORRIGE / AFFICHAGE DU CORRIGÉ
afficher_le_corrigé = BooleanToggle(False)
gate = StreamGate(Stream=lng, Gate=afficher_le_corrigé)  # -> Target0, Target1
reponse_corrige = REPONSE_CORRIGE(gate.Target1)
