# Grasshopper definition IA-16_complet.gh (Grasshopper 1.0.8)

# ---- group: ZONE_SUJET
reponse = REPONSE()
# IA-16 · Ce qu'un agent ne fait pas sans vous
# Perfectionnement  —  durée cible 8 min  —  réf. REF-138  —  v0.5-260902
# ▼  CORRIGÉ — à consulter après validation  ▼
# ÉTAPE 1 — La bonne réponse est la proposition 2. Le corrigé porte cet indice en clair : le menu du sujet,
# lui, part sur la première proposition, quelle qu'elle soit.
# ÉTAPE 2 — À retenir
# RÉSULTAT — tant que l'interrupteur AFFICHER LE CORRIGÉ reste sur faux, la sortie 1 du Stream Gate est
# vide : rien n'apparaît dans Rhino
# Un garde-fou ne vaut que s'il tient
# quand on cesse de regarder.
# 
# Borner ce qui est reversible,
# faire confirmer le reste.
reponse_qcm = ValueList({"0 - Relire chaque commande avant de la laisser passer.": 0, "1 - Limiter l'agent aux composants natifs.": 1, "2 - Travailler sur une copie du document, et exiger une…": 2, "3 - Journaliser les appels pour pouvoir les rejouer.": 3}, selected=[])

# ---- group: ZONE_CORRIGE / ÉTAPE 1
bonne_reponse = BONNE_REPONSE(2)

# ---- group: ZONE_CORRIGE / AFFICHAGE DU CORRIGÉ
afficher_le_corrigé = BooleanToggle(False)
gate = StreamGate(Stream=bonne_reponse, Gate=afficher_le_corrigé)  # -> Target0, Target1
reponse_corrige = REPONSE_CORRIGE(gate.Target1)
