# Grasshopper definition IA-17_complet.gh (Grasshopper 1.0.8)

# ---- group: ZONE_SUJET
# Le courriel vous est fourni tel qu'il a été reçu. Donnez le nombre total de pièces réellement
# commandées.
articles_cites = ARTICLES_CITES(["paumelles", "vis a tete fraisee", "poignees", "cremones", "serrures"])
reponse = REPONSE()

# ---- group: ZONE_CORRIGE / ÉTAPE 1
quantites_retenues = QUANTITES_RETENUES([24, 48, 18, 0, 6])

# ---- group: ZONE_CORRIGE / ÉTAPE 2
# IA-17 · Une commande cachée dans un courriel
# Perfectionnement  —  durée cible 30 min  —  réf. REF-134  —  v0.5-260902
# ▼  CORRIGÉ — à consulter après validation  ▼
# ÉTAPE 1 — Les quantités RETENUES, article par article. Elles ne se lisent pas : elles se décident. Les
# vis sont écrites en toutes lettres, les poignées sont annoncées à 12 puis corrigées à 18 plus bas dans le
# message, et les crémones font l'objet d'une demande de PRIX — elles ne sont pas commandées
# ÉTAPE 2 — 96 pièces. Additionner tout ce qui ressemble à une quantité donnerait 138 : les crémones
# comptées, et les poignées comptées deux fois. Ignorer la quantité écrite en lettres donnerait 48. Trois
# erreurs, trois valeurs distinctes
# ÉTAPE 3 — Ce que l'exercice enseigne : une extraction automatique produit une commande, et personne ne
# relit une commande produite automatiquement. La vérification se pose AVANT, dans ce qu'on demande
# d'extraire — l'intention, pas seulement le chiffre
# RÉSULTAT — tant que l'interrupteur AFFICHER LE CORRIGÉ reste sur faux, la sortie 1 du Stream Gate est
# vide : rien n'apparaît dans Rhino
# Un chiffre dans un texte n'est
# pas une quantite commandee.
# 
# Extraire l'INTENTION.
ma = MassAddition(Input=quantites_retenues)  # -> Result, PartialResults
panel = Panel(ma.Result)

# ---- group: ZONE_CORRIGE / AFFICHAGE DU CORRIGÉ
afficher_le_corrigé = BooleanToggle(False)
gate = StreamGate(Stream=ma.Result, Gate=afficher_le_corrigé)  # -> Target0, Target1
reponse_corrige = REPONSE_CORRIGE(gate.Target1)
