# Grasshopper definition IA-18_complet.gh (Grasshopper 1.0.8)

# ---- group: ZONE_SUJET
reponse = REPONSE()
# IA-18 · Ce qu'une image générée ne vous donne pas
# Perfectionnement  —  durée cible 8 min  —  réf. REF-135  —  v0.3-260826
# ▼  CORRIGÉ — à consulter après validation  ▼
# ÉTAPE 1 — La bonne réponse est la proposition 3. Le corrigé porte cet indice en clair : le menu du sujet,
# lui, part sur la première proposition, quelle qu'elle soit.
# ÉTAPE 2 — À retenir
# RÉSULTAT — tant que l'interrupteur AFFICHER LE CORRIGÉ reste sur faux, la sortie 1 du Stream Gate est
# vide : rien n'apparaît dans Rhino
# Une image generee porte une INTENTION.
# 
# Elle ne porte ni cotes, ni epaisseurs,
# ni assemblages — ni la question de
# savoir si cela tient debout.
reponse_qcm = ValueList({"0 - Une géométrie, qu'un outil de reconstruction saura…": 0, "1 - Rien d'exploitable : mieux vaut repartir d'un croquis.": 1, "2 - Une référence de style, à condition d'en avoir les droits.": 2, "3 - Une intention de forme et de matière, à traduire en cotes…": 3}, selected=[])

# ---- group: ZONE_CORRIGE / ÉTAPE 1
bonne_reponse = BONNE_REPONSE(3)

# ---- group: ZONE_CORRIGE / AFFICHAGE DU CORRIGÉ
afficher_le_corrigé = BooleanToggle(False)
gate = StreamGate(Stream=bonne_reponse, Gate=afficher_le_corrigé)  # -> Target0, Target1
reponse_corrige = REPONSE_CORRIGE(gate.Target1)
