# Grasshopper definition IA-19_complet.gh (Grasshopper 1.0.8)

# ---- group: ZONE_SUJET
# Les vingt-quatre longueurs du débit vous sont fournies. Les familles sont : petit sous 300 mm,
# moyen jusqu'à 900 mm exclus, grand au-delà. Donnez l'effectif de la famille la plus fournie.
longueurs_du_debit = LONGUEURS_DU_DEBIT([412, 88, 1240, 355, 67, 980, 1510, 210, 45, 720, 1330, 168, 890, 52, 1105, 298, 640, 1420, 75, 505, 1180, 130, 830, 385])
seuils = SEUILS([300, 900])
reponse = REPONSE()

# ---- group: ZONE_CORRIGE / ÉTAPE 1
effectifs = EFFECTIFS([9, 8, 7])

# ---- group: ZONE_CORRIGE / ÉTAPE 2
# IA-19 · Regrouper un débit en trois familles
# Perfectionnement  —  durée cible 25 min  —  réf. REF-130  —  v0.3-260826
# ▼  CORRIGÉ — à consulter après validation  ▼
# ÉTAPE 1 — Les trois effectifs, relevés famille par famille : 9 petits, 8 moyens, 7 grands. La borne haute
# est EXCLUE du moyen — « jusqu'à 900 exclus » n'est pas « jusqu'à 900 »
# ÉTAPE 2 — Le plus grand des trois : 9. C'est la famille des PETITS, ce qui est contre-intuitif — les
# grands occupent plus de place, ils ne sont pas plus nombreux. Les trois effectifs sont assez proches pour
# qu'un comptage à l'œil se trompe de famille
# RÉSULTAT — tant que l'interrupteur AFFICHER LE CORRIGÉ reste sur faux, la sortie 1 du Stream Gate est
# vide : rien n'apparaît dans Rhino
bnd = Bounds(Numbers=effectifs)
dedomain = DeconstructDomain(Domain=bnd)  # -> Start, End
panel = Panel(dedomain.End)

# ---- group: ZONE_CORRIGE / AFFICHAGE DU CORRIGÉ
afficher_le_corrigé = BooleanToggle(False)
gate = StreamGate(Stream=dedomain.End, Gate=afficher_le_corrigé)  # -> Target0, Target1
reponse_corrige = REPONSE_CORRIGE(gate.Target1)
