# Grasshopper definition IA-20_complet.gh (Grasshopper 1.0.8)

# ---- group: ZONE_SUJET
# Le budget est de 6 heures et chaque évaluation prend 42 secondes. Donnez le nombre
# d'évaluations réalisables.
reponse = REPONSE()
# IA-20 · Ce qu'un budget de calcul permet d'essayer
# Perfectionnement  —  durée cible 30 min  —  réf. REF-131, REF-132  —  v0.5-260902
# ▼  CORRIGÉ — à consulter après validation  ▼
# RAPPEL — copie des données fournies dans la zone sujet, afin qu'aucun câble ne relie les deux zones
# ÉTAPE 1 — Le budget en secondes : 6 heures font 21 600 secondes
# ÉTAPE 2 — Divisé par la durée d'une évaluation, puis arrondi à l'entier INFÉRIEUR : une évaluation
# entamée ne compte pas. 514 essais
# ÉTAPE 3 — À comparer aux 244 millions d'évaluations qu'exigerait l'exploration complète de douze
# paramètres à cinq niveaux — trois cent vingt-cinq ans de machine. Ce n'est pas une question de patience :
# c'est ce qui rend le métamodèle nécessaire
# RÉSULTAT — tant que l'interrupteur AFFICHER LE CORRIGÉ reste sur faux, la sortie 1 du Stream Gate est
# vide : rien n'apparaît dans Rhino
# 514 essais tenables.
# 244 140 625 essais pour l'exhaustif.
# 
# Le plan d'experiences se CHOISIT.
budget_en_heures = Slider(6, range=1..48)
duree_d_une_evaluation = Slider(42, range=1..300)

# ---- group: ZONE_CORRIGE / DONNÉES FOURNIES (copie)
budget_en_heures_2 = Slider(6, range=1..48)
duree_d_une_evaluation_2 = Slider(42, range=1..300)

# ---- group: ZONE_CORRIGE / ÉTAPE 1
multiplication = Multiplication(A=budget_en_heures_2, B=3600)

# ---- group: ZONE_CORRIGE / ÉTAPE 2
division = Division(A=multiplication, B=duree_d_une_evaluation_2)
round = Round(Number=division)  # -> Nearest, Floor, Ceiling
panel = Panel(round.Floor)

# ---- group: ZONE_CORRIGE / AFFICHAGE DU CORRIGÉ
afficher_le_corrigé = BooleanToggle(False)
gate = StreamGate(Stream=round.Floor, Gate=afficher_le_corrigé)  # -> Target0, Target1
reponse_corrige = REPONSE_CORRIGE(gate.Target1)
