# Grasshopper definition IA-21_complet.gh (Grasshopper 1.0.8)

# ---- group: ZONE_SUJET
# La file mesure 18 600 mm et l'entraxe ne doit pas dépasser 2 500 mm. Donnez le nombre de
# poteaux.
reponse = REPONSE()
# IA-21 · Le script qui compte les intervalles
# Intermédiaire  —  durée cible 25 min  —  réf. REF-121  —  v0.3-260826
# ▼  CORRIGÉ — à consulter après validation  ▼
# RAPPEL — copie des données fournies dans la zone sujet, afin qu'aucun câble ne relie les deux zones
# ÉTAPE 1 — 18 600 ÷ 2 500 vaut 7,44. Arrondi au SUPÉRIEUR : huit travées, d'où un entraxe réel de 2 325
# mm. Arrondir au plus proche donnerait sept travées et 2 657 mm — au-delà du maximum
# ÉTAPE 2 — Les poteaux sont un de plus que les travées : 9. Un script qui divise et arrondit sans se
# demander ce qu'il compte rend 8 — plausible, du bon ordre de grandeur, et il manque le poteau du bout,
# celui qui tient la clôture
# RÉSULTAT — tant que l'interrupteur AFFICHER LE CORRIGÉ reste sur faux, la sortie 1 du Stream Gate est
# vide : rien n'apparaît dans Rhino
longueur_de_la_file = Slider(18600, range=1000..50000)
entraxe_maximal = Slider(2500, range=500..5000)

# ---- group: ZONE_CORRIGE / DONNÉES FOURNIES (copie)
longueur_de_la_file_2 = Slider(18600, range=1000..50000)
entraxe_maximal_2 = Slider(2500, range=500..5000)

# ---- group: ZONE_CORRIGE / ÉTAPE 1
division = Division(A=longueur_de_la_file_2, B=entraxe_maximal_2)
round = Round(Number=division)  # -> Nearest, Floor, Ceiling

# ---- group: ZONE_CORRIGE / ÉTAPE 2
addition = Addition(A=round.Ceiling, B=1)
panel = Panel(addition)

# ---- group: ZONE_CORRIGE / AFFICHAGE DU CORRIGÉ
afficher_le_corrigé = BooleanToggle(False)
gate = StreamGate(Stream=addition, Gate=afficher_le_corrigé)  # -> Target0, Target1
reponse_corrige = REPONSE_CORRIGE(gate.Target1)
