# Grasshopper definition IA-22_complet.gh (Grasshopper 1.0.8)

# ---- group: ZONE_SUJET
# Les douze quantités à arrondir vous sont fournies ; toutes tombent sur une demi-unité. Le
# métier arrondit la demie vers le haut. Donnez la somme des quantités arrondies selon la règle
# du métier.
quantites = QUANTITES([12.5, 7.5, 3.5, 18.5, 24.5, 9.5, 15.5, 2.5, 21.5, 6.5, 11.5, 30.5])
reponse = REPONSE()

# ---- group: ZONE_CORRIGE / DONNÉES FOURNIES (copie)
quantites_2 = QUANTITES([12.5, 7.5, 3.5, 18.5, 24.5, 9.5, 15.5, 2.5, 21.5, 6.5, 11.5, 30.5])

# ---- group: ZONE_CORRIGE / ÉTAPE 1
# IA-22 · L'arrondi qui change avec le langage
# Intermédiaire  —  durée cible 25 min  —  réf. REF-123  —  v0.3-260826
# ▼  CORRIGÉ — à consulter après validation  ▼
# RAPPEL — copie des données fournies dans la zone sujet, afin qu'aucun câble ne relie les deux zones
# ÉTAPE 1 — La règle du métier — la demie monte — s'écrit explicitement : ajouter un demi, puis prendre le
# plancher. Elle ne dépend alors plus du langage
# ÉTAPE 2 — 170. L'arrondi par défaut de la plupart des langages envoie la demie vers le nombre PAIR — 2,5
# donne 2, 3,5 donne 4 — pour ne pas biaiser les sommes. C'est statistiquement vertueux et commercialement
# faux : six unités s'évaporent sur douze lignes
# RÉSULTAT — tant que l'interrupteur AFFICHER LE CORRIGÉ reste sur faux, la sortie 1 du Stream Gate est
# vide : rien n'apparaît dans Rhino
addition = Addition(A=quantites_2, B=0.5)
round = Round(Number=addition)  # -> Nearest, Floor, Ceiling

# ---- group: ZONE_CORRIGE / ÉTAPE 2
ma = MassAddition(Input=round.Floor)  # -> Result, PartialResults
panel = Panel(ma.Result)

# ---- group: ZONE_CORRIGE / AFFICHAGE DU CORRIGÉ
afficher_le_corrigé = BooleanToggle(False)
gate = StreamGate(Stream=ma.Result, Gate=afficher_le_corrigé)  # -> Target0, Target1
reponse_corrige = REPONSE_CORRIGE(gate.Target1)
