# Grasshopper definition IA-23_complet.gh (Grasshopper 1.0.8)

# ---- group: ZONE_SUJET
# Dix-huit cas d'essai doivent passer. Le relevé des cinq tours d'itération vous est fourni.
# Donnez le numéro du premier tour où tous les cas passent.
numero_de_tour = NUMERO_DE_TOUR([1, 2, 3, 4, 5])
cas_qui_passent = CAS_QUI_PASSENT([7, 12, 16, 18, 18])
cas_a_satisfaire = CAS_A_SATISFAIRE(18)
reponse = REPONSE()

# ---- group: ZONE_CORRIGE / DONNÉES FOURNIES (copie)
numero_de_tour_2 = NUMERO_DE_TOUR([1, 2, 3, 4, 5])
cas_qui_passent_2 = CAS_QUI_PASSENT([7, 12, 16, 18, 18])
cas_a_satisfaire_2 = CAS_A_SATISFAIRE(18)

# ---- group: ZONE_CORRIGE / ÉTAPE 1
# IA-23 · Combien de tours avant que tout passe
# Perfectionnement  —  durée cible 25 min  —  réf. REF-126  —  v0.5-260902
# ▼  CORRIGÉ — à consulter après validation  ▼
# RAPPEL — copie des données fournies dans la zone sujet, afin qu'aucun câble ne relie les deux zones
# ÉTAPE 1 — Comparer, tour par tour, les cas qui passent à la cible. La sortie retenue est « ou égal » :
# atteindre la cible suffit
# ÉTAPE 2 — Ne garder que les tours qui l'atteignent, et prendre le PREMIER. Le cinquième n'a rien amélioré
# : il a coûté un aller-retour pour confirmer que le quatrième suffisait
# ÉTAPE 3 — Ce que l'exercice ne dit pas, et qui suit : dix-huit cas qui passent ne font pas un composant
# juste. Ils font un composant juste SUR CES CAS
# RÉSULTAT — tant que l'interrupteur AFFICHER LE CORRIGÉ reste sur faux, la sortie 1 du Stream Gate est
# vide : rien n'apparaît dans Rhino
# Une iteration sans critere d'arret
# ne s'arrete pas : elle s'epuise.
# 
# La suite est d'ecrire les cas
# qui manquent.
larger = LargerThan(FirstNumber=cas_qui_passent_2, SecondNumber=cas_a_satisfaire_2)  # -> LargerThan, OrEqualTo

# ---- group: ZONE_CORRIGE / ÉTAPE 2
cull = CullPattern(List=numero_de_tour_2, CullPattern=larger.OrEqualTo)
item = ListItem(List=cull, Index=0, Wrap=True)
panel = Panel(item)

# ---- group: ZONE_CORRIGE / AFFICHAGE DU CORRIGÉ
afficher_le_corrigé = BooleanToggle(False)
gate = StreamGate(Stream=item, Gate=afficher_le_corrigé)  # -> Target0, Target1
reponse_corrige = REPONSE_CORRIGE(gate.Target1)
