# Grasshopper definition IA-24_complet.gh (Grasshopper 1.0.8)

# ---- group: ZONE_SUJET
reponse = REPONSE()
# IA-24 · Le composant qui n'apparaît pas
# Perfectionnement  —  durée cible 8 min  —  réf. REF-127  —  v0.5-260902
# ▼  CORRIGÉ — à consulter après validation  ▼
# ÉTAPE 1 — La bonne réponse est la proposition 1. Le corrigé porte cet indice en clair : le menu du sujet,
# lui, part sur la première proposition, quelle qu'elle soit.
# ÉTAPE 2 — À retenir
# RÉSULTAT — tant que l'interrupteur AFFICHER LE CORRIGÉ reste sur faux, la sortie 1 du Stream Gate est
# vide : rien n'apparaît dans Rhino
# L'absence de message EST l'information.
# 
# Un composant mal ecrit leve une erreur.
# Un composant jamais charge ne dit rien.
reponse_qcm = ValueList({"0 - Le code du composant : il manque sans doute une méthode.": 0, "1 - Où le fichier compilé a été déposé, et si Rhino regarde…": 1, "2 - La version du SDK utilisée pour compiler.": 2, "3 - Le journal de Grasshopper, qui doit contenir l'erreur.": 3}, selected=[])

# ---- group: ZONE_CORRIGE / ÉTAPE 1
bonne_reponse = BONNE_REPONSE(1)

# ---- group: ZONE_CORRIGE / AFFICHAGE DU CORRIGÉ
afficher_le_corrigé = BooleanToggle(False)
gate = StreamGate(Stream=bonne_reponse, Gate=afficher_le_corrigé)  # -> Target0, Target1
reponse_corrige = REPONSE_CORRIGE(gate.Target1)
