# Grasshopper definition IA-25_complet.gh (Grasshopper 1.0.8)

# ---- group: ZONE_SUJET
# Le service traite 4 200 requêtes par mois. Chacune envoie 1 850 jetons et en reçoit 320.
# L'entrée est facturée 3 € le million de jetons, la sortie 15 €. Donnez le coût mensuel, en
# euros.
reponse = REPONSE()
# IA-25 · Ce que le service coûte par mois
# Perfectionnement  —  durée cible 25 min  —  réf. REF-142  —  v0.3-260826
# ▼  CORRIGÉ — à consulter après validation  ▼
# RAPPEL — copie des données fournies dans la zone sujet, afin qu'aucun câble ne relie les deux zones
# ÉTAPE 1 — Les jetons du mois, séparément : l'entrée et la sortie ne coûtent pas le même prix
# ÉTAPE 2 — Chacun à SON tarif : 3 € le million en entrée, 15 € en sortie. La sortie coûte cinq fois
# l'entrée, et c'est structurel — elle se produit jeton par jeton
# ÉTAPE 3 — 43,47 € par mois. Un tarif unique aurait annoncé 27,34 €. Malgré un rapport de six contre un en
# VOLUME, la sortie pèse 36 % de la facture : c'est ce renversement que le calcul fait apparaître
# RÉSULTAT — tant que l'interrupteur AFFICHER LE CORRIGÉ reste sur faux, la sortie 1 du Stream Gate est
# vide : rien n'apparaît dans Rhino
requetes_par_mois = Slider(4200, range=100..50000)
jetons_en_entree = Slider(1850, range=100..10000)
jetons_en_sortie = Slider(320, range=10..5000)

# ---- group: ZONE_CORRIGE / DONNÉES FOURNIES (copie)
requetes_par_mois_2 = Slider(4200, range=100..50000)
jetons_en_entree_2 = Slider(1850, range=100..10000)
jetons_en_sortie_2 = Slider(320, range=10..5000)

# ---- group: ZONE_CORRIGE / ÉTAPE 1
multiplication = Multiplication(A=requetes_par_mois_2, B=jetons_en_entree_2)
multiplication_2 = Multiplication(A=requetes_par_mois_2, B=jetons_en_sortie_2)

# ---- group: ZONE_CORRIGE / ÉTAPE 2
multiplication_3 = Multiplication(A=multiplication, B=3)
multiplication_4 = Multiplication(A=multiplication_2, B=15)

# ---- group: ZONE_CORRIGE / ÉTAPE 3
addition = Addition(A=multiplication_3, B=multiplication_4)
division = Division(A=addition, B=1000000)
panel = Panel(division)

# ---- group: ZONE_CORRIGE / AFFICHAGE DU CORRIGÉ
afficher_le_corrigé = BooleanToggle(False)
gate = StreamGate(Stream=division, Gate=afficher_le_corrigé)  # -> Target0, Target1
reponse_corrige = REPONSE_CORRIGE(gate.Target1)
