# Grasshopper definition IA-26_complet.gh (Grasshopper 1.0.8)

# ---- group: ZONE_SUJET
# Le composant existant produit les sommes cumulées d'une liste. Faites-le porter vers un autre
# langage, puis appliquez les deux versions au jeu de preuve fourni et donnez les quatorze
# valeurs obtenues.
jeu_de_preuve = JEU_DE_PREUVE([213, 17, 426, 355, 295, 254, 151, 90, 349, 84, 156, 134, 465, 152])
reponse = REPONSE()

# ---- group: ZONE_CORRIGE / DONNÉES FOURNIES (copie)
jeu_de_preuve_2 = JEU_DE_PREUVE([213, 17, 426, 355, 295, 254, 151, 90, 349, 84, 156, 134, 465, 152])

# ---- group: ZONE_CORRIGE / ÉTAPE 1
# IA-26 · Transposer, et le prouver sur un second jeu
# Intermédiaire  —  durée cible 18 min  —  réf. REF-122, REF-123  —  v0.5-260902
# ▼  CORRIGÉ — à consulter après validation  ▼
# RAPPEL — copie des données fournies dans la zone sujet, afin qu'aucun câble ne relie les deux zones
# ÉTAPE 1 — `Mass Addition` rend aussi ses résultats PARTIELS : ce sont les sommes cumulées. Le cumul est
# strictement croissant — un décalage d'un rang se voit, une somme oubliée décale tout ce qui suit, et
# c'est ce qui rend la comparaison sévère
# RÉSULTAT — tant que l'interrupteur AFFICHER LE CORRIGÉ reste sur faux, la sortie 1 du Stream Gate est
# vide : rien n'apparaît dans Rhino
ma = MassAddition(Input=jeu_de_preuve_2)  # -> Result, PartialResults
panel = Panel(ma.PartialResults)

# ---- group: ZONE_CORRIGE / AFFICHAGE DU CORRIGÉ
afficher_le_corrigé = BooleanToggle(False)
gate = StreamGate(Stream=ma.PartialResults, Gate=afficher_le_corrigé)  # -> Target0, Target1
reponse_corrige = REPONSE_CORRIGE(gate.Target1)
