# Grasshopper definition IA-27_complet.gh (Grasshopper 1.0.8)

# ---- group: ZONE_SUJET
# Le composant fourni doit compter les longueurs qui dépassent 1 500 mm parmi les trente
# relevées. Il rend un résultat faux. Corrigez-le et donnez le compte exact.
longueurs_relevees = LONGUEURS_RELEVEES([682, 1597, 1346, 2674, 1986, 1053, 344, 240, 1279, 2636, 1789, 448, 2181, 1293, 1628, 722, 1448, 1265, 1997, 1753, 2389, 2715, 339, 1014, 2814, 1947, 609, 2810, 1279, 2592])
reponse = REPONSE()
# IA-27 · Le script qui tourne et compte mal
# Intermédiaire  —  durée cible 16 min  —  réf. REF-124  —  v0.5-260902
# ▼  CORRIGÉ — à consulter après validation  ▼
# RAPPEL — copie des données fournies dans la zone sujet, afin qu'aucun câble ne relie les deux zones
# ÉTAPE 1 — Le comptage natif teste TOUTES les valeurs. La boucle fautive s'arrête un cran trop tôt et ne
# voit jamais la dernière — qui vaut 2 592 mm et dépasse largement
# ÉTAPE 2 — 15 longueurs dépassent le seuil, et non quatorze
# RÉSULTAT — tant que l'interrupteur AFFICHER LE CORRIGÉ reste sur faux, la sortie 1 du Stream Gate est
# vide : rien n'apparaît dans Rhino
seuil = Slider(1500, range=100..4000)

# ---- group: ZONE_CORRIGE / DONNÉES FOURNIES (copie)
longueurs_relevees_2 = LONGUEURS_RELEVEES([682, 1597, 1346, 2674, 1986, 1053, 344, 240, 1279, 2636, 1789, 448, 2181, 1293, 1628, 722, 1448, 1265, 1997, 1753, 2389, 2715, 339, 1014, 2814, 1947, 609, 2810, 1279, 2592])
seuil_2 = Slider(1500, range=100..4000)

# ---- group: ZONE_CORRIGE / ÉTAPE 1
larger = LargerThan(FirstNumber=longueurs_relevees_2, SecondNumber=seuil_2)  # -> LargerThan, OrEqualTo
cull = CullPattern(List=longueurs_relevees_2, CullPattern=larger.LargerThan)

# ---- group: ZONE_CORRIGE / ÉTAPE 2
lng = ListLength(List=cull)
panel = Panel(lng)

# ---- group: ZONE_CORRIGE / AFFICHAGE DU CORRIGÉ
afficher_le_corrigé = BooleanToggle(False)
gate = StreamGate(Stream=lng, Gate=afficher_le_corrigé)  # -> Target0, Target1
reponse_corrige = REPONSE_CORRIGE(gate.Target1)
