# Grasshopper definition IA-28_complet.gh (Grasshopper 1.0.8)

# ---- group: ZONE_SUJET
# Les vingt pièces vous sont données par leur longueur et leur épaisseur. Regroupez-les selon
# qu'elles dépassent ou non 900 mm de long et 34 mm d'épaisseur. Donnez l'effectif du groupe le
# plus fourni.
longueurs = LONGUEURS([900, 680, 1110, 210, 1490, 1290, 1400, 1570, 380, 1610, 650, 670, 480, 350, 440, 200, 1080, 1660, 540, 730])
epaisseurs = EPAISSEURS([38, 60, 40, 44, 34, 12, 48, 18, 36, 56, 44, 46, 12, 42, 34, 46, 54, 20, 50, 44])
reponse = REPONSE()
# IA-28 · Regrouper des pièces par similarité
# Perfectionnement  —  durée cible 20 min  —  réf. REF-130  —  v0.5-260902
# ▼  CORRIGÉ — à consulter après validation  ▼
# RAPPEL — copie des données fournies dans la zone sujet, afin qu'aucun câble ne relie les deux zones
# ÉTAPE 1 — Chaque pièce est jugée sur les DEUX critères. La longueur seule donnerait deux groupes de dix ;
# c'est le croisement qui produit quatre familles
# ÉTAPE 2 — Les quatre familles : longue et épaisse, longue et mince, courte et épaisse, courte et mince
# ÉTAPE 3 — 10 pièces dans la plus fournie — la moitié du lot
# RÉSULTAT — tant que l'interrupteur AFFICHER LE CORRIGÉ reste sur faux, la sortie 1 du Stream Gate est
# vide : rien n'apparaît dans Rhino
seuil_de_longueur = Slider(900, range=100..2000)
seuil_d_epaisseur = Slider(34, range=5..80)

# ---- group: ZONE_CORRIGE / DONNÉES FOURNIES (copie)
longueurs_2 = LONGUEURS([900, 680, 1110, 210, 1490, 1290, 1400, 1570, 380, 1610, 650, 670, 480, 350, 440, 200, 1080, 1660, 540, 730])
epaisseurs_2 = EPAISSEURS([38, 60, 40, 44, 34, 12, 48, 18, 36, 56, 44, 46, 12, 42, 34, 46, 54, 20, 50, 44])
seuil_de_longueur_2 = Slider(900, range=100..2000)
seuil_d_epaisseur_2 = Slider(34, range=5..80)

# ---- group: ZONE_CORRIGE / ÉTAPE 1
larger = LargerThan(FirstNumber=longueurs_2, SecondNumber=seuil_de_longueur_2)  # -> LargerThan, OrEqualTo
larger_2 = LargerThan(FirstNumber=epaisseurs_2, SecondNumber=seuil_d_epaisseur_2)  # -> LargerThan, OrEqualTo
not = GateNot(A=larger.LargerThan)
not_2 = GateNot(A=larger_2.LargerThan)

# ---- group: ZONE_CORRIGE / ÉTAPE 2
and = GateAnd(A=larger.LargerThan, B=larger_2.LargerThan)
and_2 = GateAnd(A=larger.LargerThan, B=not_2)
and_3 = GateAnd(A=not, B=larger_2.LargerThan)
and_4 = GateAnd(A=not, B=not_2)
cull = CullPattern(List=longueurs_2, CullPattern=and)
cull_2 = CullPattern(List=longueurs_2, CullPattern=and_2)
cull_3 = CullPattern(List=longueurs_2, CullPattern=and_3)
cull_4 = CullPattern(List=longueurs_2, CullPattern=and_4)
lng = ListLength(List=cull)
lng_2 = ListLength(List=cull_2)
lng_3 = ListLength(List=cull_3)
lng_4 = ListLength(List=cull_4)

# ---- group: ZONE_CORRIGE / ÉTAPE 3
merge = Merge(Data1=lng, Data2=lng_2)
merge_2 = Merge(Data1=lng_3, Data2=lng_4)
merge_3 = Merge(Data1=merge, Data2=merge_2)
bnd = Bounds(Numbers=merge_3)
dedomain = DeconstructDomain(Domain=bnd)  # -> Start, End
panel = Panel(dedomain.End)

# ---- group: ZONE_CORRIGE / AFFICHAGE DU CORRIGÉ
afficher_le_corrigé = BooleanToggle(False)
gate = StreamGate(Stream=dedomain.End, Gate=afficher_le_corrigé)  # -> Target0, Target1
reponse_corrige = REPONSE_CORRIGE(gate.Target1)
