# Grasshopper definition IA-29_complet.gh (Grasshopper 1.0.8)

# ---- group: ZONE_SUJET
# Le tableau donne, pour huit composants du plugin, si leur GUID a été conservé d'une version à
# l'autre et combien de définitions les emploient. Donnez le nombre de définitions cassées par la
# mise à jour.
guid_conserve = GUID_CONSERVE([1, 0, 1, 0, 1, 0, 1, 0])
definitions_qui_l_emploient = DEFINITIONS_QUI_L_EMPLOIENT([4, 7, 2, 3, 9, 5, 6, 1])
reponse = REPONSE()

# ---- group: ZONE_CORRIGE / DONNÉES FOURNIES (copie)
guid_conserve_2 = GUID_CONSERVE([1, 0, 1, 0, 1, 0, 1, 0])
definitions_qui_l_emploient_2 = DEFINITIONS_QUI_L_EMPLOIENT([4, 7, 2, 3, 9, 5, 6, 1])

# ---- group: ZONE_CORRIGE / ÉTAPE 1
# IA-29 · Les GUID qui cassent les définitions
# Perfectionnement  —  durée cible 18 min  —  réf. REF-128  —  v0.5-260902
# ▼  CORRIGÉ — à consulter après validation  ▼
# RAPPEL — copie des données fournies dans la zone sujet, afin qu'aucun câble ne relie les deux zones
# ÉTAPE 1 — Compter les COMPOSANTS régénérés en donnerait quatre. Un composant casse autant de définitions
# qu'il en sert : le préjudice se mesure chez les utilisateurs, pas dans le code
# ÉTAPE 2 — 16 définitions cassées
# RÉSULTAT — tant que l'interrupteur AFFICHER LE CORRIGÉ reste sur faux, la sortie 1 du Stream Gate est
# vide : rien n'apparaît dans Rhino
equals = Equality(FirstNumber=guid_conserve_2, SecondNumber=0)  # -> Equality, Inequality
cull = CullPattern(List=definitions_qui_l_emploient_2, CullPattern=equals.Equality)

# ---- group: ZONE_CORRIGE / ÉTAPE 2
ma = MassAddition(Input=cull)  # -> Result, PartialResults
panel = Panel(ma.Result)

# ---- group: ZONE_CORRIGE / AFFICHAGE DU CORRIGÉ
afficher_le_corrigé = BooleanToggle(False)
gate = StreamGate(Stream=ma.Result, Gate=afficher_le_corrigé)  # -> Target0, Target1
reponse_corrige = REPONSE_CORRIGE(gate.Target1)
