# Grasshopper definition IA-30_complet.gh (Grasshopper 1.0.8)

# ---- group: ZONE_SUJET
# La définition émet trois appels par recalcul, et la séance en a compté 240. Chaque appel coûte
# 0,004 € et prend 1,8 s. Donnez le coût de la séance, en euros.
reponse = REPONSE()
# IA-30 · Ce qu'un appel coûte dans une définition qui recalcule
# Perfectionnement  —  durée cible 15 min  —  réf. REF-142  —  v0.5-260902
# ▼  CORRIGÉ — à consulter après validation  ▼
# RAPPEL — copie des données fournies dans la zone sujet, afin qu'aucun câble ne relie les deux zones
# ÉTAPE 1 — Trois appels par recalcul, pas un. Compter un seul appel donnerait 0,96 € — trois fois moins,
# et c'est le genre de multiplication qu'on ne découvre qu'à la facture
# RÉSULTAT — tant que l'interrupteur AFFICHER LE CORRIGÉ reste sur faux, la sortie 1 du Stream Gate est
# vide : rien n'apparaît dans Rhino
appels_par_recalcul = Slider(3, range=1..10)
recalculs = Slider(240, range=10..1000)
prix_par_appel = Slider(0.004, range=0.001..0.05)

# ---- group: ZONE_CORRIGE / DONNÉES FOURNIES (copie)
appels_par_recalcul_2 = Slider(3, range=1..10)
recalculs_2 = Slider(240, range=10..1000)
prix_par_appel_2 = Slider(0.004, range=0.001..0.05)

# ---- group: ZONE_CORRIGE / ÉTAPE 1
multiplication = Multiplication(A=appels_par_recalcul_2, B=recalculs_2)
multiplication_2 = Multiplication(A=multiplication, B=prix_par_appel_2)
panel = Panel(multiplication_2)

# ---- group: ZONE_CORRIGE / AFFICHAGE DU CORRIGÉ
afficher_le_corrigé = BooleanToggle(False)
gate = StreamGate(Stream=multiplication_2, Gate=afficher_le_corrigé)  # -> Target0, Target1
reponse_corrige = REPONSE_CORRIGE(gate.Target1)
