# Grasshopper definition IA-31_complet.gh (Grasshopper 1.0.8)

# ---- group: ZONE_SUJET
# Le journal donne les vingt-deux opérations menées par l'agent. Donnez le nombre d'opérations
# qui ont MODIFIÉ le document.
journal_1lire_2ajouter_3supprimer_4cable = JOURNAL_1LIRE_2AJOUTER_3SUPPRIMER_4CABLER_5DEPLACER_6RENOMMER([1, 1, 2, 1, 4, 1, 1, 3, 1, 2, 5, 1, 4, 1, 6, 1, 1, 2, 1, 3, 1, 4])
reponse = REPONSE()

# ---- group: ZONE_CORRIGE / DONNÉES FOURNIES (copie)
journal_1lire_2ajouter_3supprimer_4cable_2 = JOURNAL_1LIRE_2AJOUTER_3SUPPRIMER_4CABLER_5DEPLACER_6RENOMMER([1, 1, 2, 1, 4, 1, 1, 3, 1, 2, 5, 1, 4, 1, 6, 1, 1, 2, 1, 3, 1, 4])

# ---- group: ZONE_CORRIGE / ÉTAPE 1
# IA-31 · Ce que l'agent a modifié
# Perfectionnement  —  durée cible 16 min  —  réf. REF-136, REF-137, REF-138  —  v0.5-260902
# ▼  CORRIGÉ — à consulter après validation  ▼
# RAPPEL — copie des données fournies dans la zone sujet, afin qu'aucun câble ne relie les deux zones
# ÉTAPE 1 — Seule la lecture porte le code 1 : tout le reste écrit. Ne compter que les ajouts et les
# suppressions en trouverait cinq — câbler, déplacer et renommer modifient le document tout autant, et un
# fil rebranché change le résultat sans que rien n'apparaisse ni ne disparaisse
# ÉTAPE 2 — 10 opérations ont modifié le document
# RÉSULTAT — tant que l'interrupteur AFFICHER LE CORRIGÉ reste sur faux, la sortie 1 du Stream Gate est
# vide : rien n'apparaît dans Rhino
larger = LargerThan(FirstNumber=journal_1lire_2ajouter_3supprimer_4cable_2, SecondNumber=1)  # -> LargerThan, OrEqualTo
cull = CullPattern(List=journal_1lire_2ajouter_3supprimer_4cable_2, CullPattern=larger.LargerThan)

# ---- group: ZONE_CORRIGE / ÉTAPE 2
lng = ListLength(List=cull)
panel = Panel(lng)

# ---- group: ZONE_CORRIGE / AFFICHAGE DU CORRIGÉ
afficher_le_corrigé = BooleanToggle(False)
gate = StreamGate(Stream=lng, Gate=afficher_le_corrigé)  # -> Target0, Target1
reponse_corrige = REPONSE_CORRIGE(gate.Target1)
