# Grasshopper definition IA-32_complet.gh (Grasshopper 1.0.8)

# ---- group: ZONE_SUJET
# La consigne dit « compte les grandes valeurs » sur les seize relevés fournis. Appliquez-lui
# quatre lectures : strictement au-dessus de 500, au moins 500, au-dessus de la moyenne,
# au-dessus de la médiane. Donnez les quatre comptes, dans cet ordre.
releves = RELEVES([362, 264, 137, 888, 241, 500, 571, 734, 483, 733, 774, 230, 592, 606, 175, 275])
reponse = REPONSE()
# IA-32 · Ce qu'une demande floue laisse passer
# Débutant  —  durée cible 15 min  —  réf. REF-117, REF-119  —  v0.5-260902
# ▼  CORRIGÉ — à consulter après validation  ▼
# RAPPEL — copie des données fournies dans la zone sujet, afin qu'aucun câble ne relie les deux zones
# ÉTAPE 1 — Un relevé vaut EXACTEMENT 500 : c'est lui qui sépare la comparaison stricte de la comparaison
# large, et c'est le cas limite qu'une spécification doit nommer
# ÉTAPE 2 — La moyenne, 472,81, et la médiane, 491,50, encadrent le seuil sans coïncider avec lui : aucune
# des quatre lectures n'est plus légitime que les autres
# ÉTAPE 3 — Les quatre comptes : 7, 8, 9, 8
# RÉSULTAT — tant que l'interrupteur AFFICHER LE CORRIGÉ reste sur faux, la sortie 1 du Stream Gate est
# vide : rien n'apparaît dans Rhino
seuil = Slider(500, range=100..900)

# ---- group: ZONE_CORRIGE / DONNÉES FOURNIES (copie)
releves_2 = RELEVES([362, 264, 137, 888, 241, 500, 571, 734, 483, 733, 774, 230, 592, 606, 175, 275])
seuil_2 = Slider(500, range=100..900)

# ---- group: ZONE_CORRIGE / ÉTAPE 1
larger = LargerThan(FirstNumber=releves_2, SecondNumber=seuil_2)  # -> LargerThan, OrEqualTo
cull = CullPattern(List=releves_2, CullPattern=larger.LargerThan)
lng = ListLength(List=cull)
cull_2 = CullPattern(List=releves_2, CullPattern=larger.OrEqualTo)
lng_2 = ListLength(List=cull_2)

# ---- group: ZONE_CORRIGE / ÉTAPE 2
avr = Average(Input=releves_2)
larger_2 = LargerThan(FirstNumber=releves_2, SecondNumber=avr)  # -> LargerThan, OrEqualTo
cull_3 = CullPattern(List=releves_2, CullPattern=larger_2.LargerThan)
lng_3 = ListLength(List=cull_3)
sort = SortList(Keys=releves_2)  # -> Keys, ValuesA
item = ListItem(List=sort.Keys, Index=8, Wrap=True)
item_2 = ListItem(List=sort.Keys, Index=7, Wrap=True)
addition = Addition(A=item, B=item_2)
division = Division(A=addition, B=2)
larger_3 = LargerThan(FirstNumber=releves_2, SecondNumber=division)  # -> LargerThan, OrEqualTo
cull_4 = CullPattern(List=releves_2, CullPattern=larger_3.LargerThan)
lng_4 = ListLength(List=cull_4)

# ---- group: ZONE_CORRIGE / ÉTAPE 3
merge = Merge(Data1=lng, Data2=lng_2)
merge_2 = Merge(Data1=merge, Data2=lng_3)
merge_3 = Merge(Data1=merge_2, Data2=lng_4)
panel = Panel(merge_3)

# ---- group: ZONE_CORRIGE / AFFICHAGE DU CORRIGÉ
afficher_le_corrigé = BooleanToggle(False)
gate = StreamGate(Stream=merge_3, Gate=afficher_le_corrigé)  # -> Target0, Target1
reponse_corrige = REPONSE_CORRIGE(gate.Target1)
