# Grasshopper definition IA-33_complet.gh (Grasshopper 1.0.8)

# ---- group: ZONE_SUJET
# L'extrait décrit une verrière de 3 200 mm de large et 2 450 mm de haut, à 6 travées égales
# séparées par des montants de 60 mm, avec une imposte de 380 mm en partie haute. Donnez la
# largeur d'une travée puis la hauteur vitrée, en millimètres.
reponse = REPONSE()
# IA-33 · Du texte aux paramètres
# Perfectionnement  —  durée cible 18 min  —  réf. REF-134  —  v0.5-260902
# ▼  CORRIGÉ — à consulter après validation  ▼
# RAPPEL — copie des données fournies dans la zone sujet, afin qu'aucun câble ne relie les deux zones
# ÉTAPE 1 — Six travées, CINQ montants — un de moins, comme les barreaux de garde-corps en B-02. Diviser la
# largeur par six sans les déduire donnerait 533,33 mm, et la verrière déborderait de 300 mm au montage
# ÉTAPE 2 — 483,3333 mm de travée, puis 2 070 mm de hauteur vitrée
# RÉSULTAT — tant que l'interrupteur AFFICHER LE CORRIGÉ reste sur faux, la sortie 1 du Stream Gate est
# vide : rien n'apparaît dans Rhino
largeur_de_verriere = Slider(3200, range=500..8000)
hauteur_de_verriere = Slider(2450, range=500..6000)
travees = Slider(6, range=1..20)
largeur_de_montant = Slider(60, range=10..200)
imposte = Slider(380, range=0..1000)

# ---- group: ZONE_CORRIGE / DONNÉES FOURNIES (copie)
largeur_de_verriere_2 = Slider(3200, range=500..8000)
hauteur_de_verriere_2 = Slider(2450, range=500..6000)
travees_2 = Slider(6, range=1..20)
largeur_de_montant_2 = Slider(60, range=10..200)
imposte_2 = Slider(380, range=0..1000)

# ---- group: ZONE_CORRIGE / ÉTAPE 1
subtraction = Subtraction(A=travees_2, B=1)
multiplication = Multiplication(A=subtraction, B=largeur_de_montant_2)
subtraction_2 = Subtraction(A=largeur_de_verriere_2, B=multiplication)
division = Division(A=subtraction_2, B=travees_2)

# ---- group: ZONE_CORRIGE / ÉTAPE 2
subtraction_3 = Subtraction(A=hauteur_de_verriere_2, B=imposte_2)
merge = Merge(Data1=division, Data2=subtraction_3)
panel = Panel(merge)

# ---- group: ZONE_CORRIGE / AFFICHAGE DU CORRIGÉ
afficher_le_corrigé = BooleanToggle(False)
gate = StreamGate(Stream=merge, Gate=afficher_le_corrigé)  # -> Target0, Target1
reponse_corrige = REPONSE_CORRIGE(gate.Target1)
