# Grasshopper definition MP-02_complet.gh (Grasshopper 1.0.8)

# ---- group: ZONE_SUJET
# Les temps de recalcul des 20 composants d'une définition vous sont fournis, en millisecondes.
# Donnez la part du temps total que représentent les trois composants les plus coûteux, en
# pourcentage arrondi à l'entier.
temps_ms = TEMPS_MS([1840, 12, 8, 26, 15, 9, 2260, 11, 7, 19, 14, 6, 22, 13, 10, 2150, 9, 8, 17, 12])
reponse = REPONSE()

# ---- group: ZONE_CORRIGE / DONNÉES FOURNIES (copie)
temps_ms_2 = TEMPS_MS([1840, 12, 8, 26, 15, 9, 2260, 11, 7, 19, 14, 6, 22, 13, 10, 2150, 9, 8, 17, 12])

# ---- group: ZONE_CORRIGE / ÉTAPE 1
# MP-02 · Trouver ce qui coûte le temps de calcul
# Perfectionnement  —  durée cible 25 min  —  réf. REF-089  —  v0.5-260902
# ▼  CORRIGÉ — à consulter après validation  ▼
# RAPPEL — copie des données fournies dans la zone sujet, afin qu'aucun câble ne relie les deux zones
# ÉTAPE 1 — Temps total de recalcul
# ÉTAPE 2 — Trier, puis INVERSER : sans l'inversion on prélève les trois plus rapides, et la conclusion
# s'inverse avec
# ÉTAPE 3 — Prélever les trois premiers et les sommer
# ÉTAPE 4 — Part du total : 97 %. Dix-sept composants coûtent moins de 30 ms chacun — les régler tous ne
# ferait rien gagner
# RÉSULTAT — tant que l'interrupteur AFFICHER LE CORRIGÉ reste sur faux, la sortie 1 du Stream Gate est
# vide : rien n'apparaît dans Rhino
ma = MassAddition(Input=temps_ms_2)  # -> Result, PartialResults

# ---- group: ZONE_CORRIGE / ÉTAPE 2
sort = SortList(Keys=temps_ms_2)  # -> Keys, ValuesA
rev = ReverseList(List=sort.Keys)

# ---- group: ZONE_CORRIGE / ÉTAPE 3
dom = ConstructDomain(DomainStart=0, DomainEnd=2)
subset = SubList(List=rev, Domain=dom, Wrap=True)  # -> List, Index
ma_2 = MassAddition(Input=subset.List)  # -> Result, PartialResults

# ---- group: ZONE_CORRIGE / ÉTAPE 4
division = Division(A=ma_2.Result, B=ma.Result)
multiplication = Multiplication(A=division, B=100)
round = Round(Number=multiplication)  # -> Nearest, Floor, Ceiling
panel = Panel(round.Nearest)

# ---- group: ZONE_CORRIGE / AFFICHAGE DU CORRIGÉ
afficher_le_corrigé = BooleanToggle(False)
gate = StreamGate(Stream=round.Nearest, Gate=afficher_le_corrigé)  # -> Target0, Target1
reponse_corrige = REPONSE_CORRIGE(gate.Target1)
