# Grasshopper definition MP-03_complet.gh (Grasshopper 1.0.8)

# ---- group: ZONE_SUJET
reponse = REPONSE()
# MP-03 · Une définition qui réagit
# Perfectionnement  —  durée cible 8 min  —  réf. REF-091, REF-092  —  v0.5-260902
# ▼  CORRIGÉ — à consulter après validation  ▼
# ÉTAPE 1 — La bonne réponse est la proposition 2. Le corrigé porte cet indice en clair : le menu du sujet,
# lui, part sur la première proposition, quelle qu'elle soit.
# ÉTAPE 2 — À retenir
# RÉSULTAT — tant que l'interrupteur AFFICHER LE CORRIGÉ reste sur faux, la sortie 1 du Stream Gate est
# vide : rien n'apparaît dans Rhino
# Le modele ne change pas : une donnee
# change, l'aval se recalcule.
# 
# Un evenement clavier ou souris est une
# donnee de plus, exposee par un composant.
# Ce n'est pas une exception au modele.
reponse_qcm = ValueList({"0 - C'est impossible, Grasshopper n'écoute rien.": 0, "1 - En relançant la définition à la main.": 1, "2 - Par un composant qui expose l'évènement comme une donnée,…": 2, "3 - En écrivant un plugin, il n'y a pas d'autre voie.": 3}, selected=[])

# ---- group: ZONE_CORRIGE / ÉTAPE 1
bonne_reponse = BONNE_REPONSE(2)

# ---- group: ZONE_CORRIGE / AFFICHAGE DU CORRIGÉ
afficher_le_corrigé = BooleanToggle(False)
gate = StreamGate(Stream=bonne_reponse, Gate=afficher_le_corrigé)  # -> Target0, Target1
reponse_corrige = REPONSE_CORRIGE(gate.Target1)
