# Grasshopper definition MP-04_complet.gh (Grasshopper 1.0.8)

# ---- group: ZONE_SUJET
# Les liaisons du graphe vous sont fournies. Donnez le nombre de composants qui se recalculent
# lorsque le curseur Largeur est déplacé.
reponse = REPONSE()

# ---- group: ZONE_CORRIGE / ÉTAPE 1
recalcules_en_aval = RECALCULES_EN_AVAL(["Aire", "Cout", "Enveloppe", "Extrusion", "Isolant", "Masse", "Ratio", "Rectangle", "Surface", "Volume"])

# ---- group: ZONE_CORRIGE / ÉTAPE 2
# MP-04 · Ce qu'un curseur fait recalculer
# Perfectionnement  —  durée cible 25 min  —  réf. REF-090  —  v0.5-260902
# ▼  CORRIGÉ — à consulter après validation  ▼
# ÉTAPE 1 — L'étalon porte ce que le parcours des liaisons désigne : les composants situés EN AVAL de
# Largeur, atteints directement ou par une chaîne. Hauteur, Essence et Prix unitaire n'en font pas partie —
# ils alimentent le graphe sans dépendre de Largeur
# ÉTAPE 2 — Dix composants sur quatorze. Croire que tout repasse en ferait treize, et conduirait à
# optimiser au mauvais endroit
# RÉSULTAT — tant que l'interrupteur AFFICHER LE CORRIGÉ reste sur faux, la sortie 1 du Stream Gate est
# vide : rien n'apparaît dans Rhino
lng = ListLength(List=recalcules_en_aval)
panel = Panel(lng)

# ---- group: ZONE_CORRIGE / AFFICHAGE DU CORRIGÉ
afficher_le_corrigé = BooleanToggle(False)
gate = StreamGate(Stream=lng, Gate=afficher_le_corrigé)  # -> Target0, Target1
reponse_corrige = REPONSE_CORRIGE(gate.Target1)
