# Grasshopper definition MP-05_complet.gh (Grasshopper 1.0.8)

# ---- group: ZONE_SUJET
# Le relevé de temps des douze composants vous est fourni, en millisecondes. Donnez la part du
# composant le plus lourd dans le temps total, en pour cent, arrondie à l'entier.
temps_par_composant = TEMPS_PAR_COMPOSANT([210, 95, 4820, 140, 60, 1310, 180, 75, 640, 120, 210, 40])
reponse = REPONSE()

# ---- group: ZONE_CORRIGE / DONNÉES FOURNIES (copie)
temps_par_composant_2 = TEMPS_PAR_COMPOSANT([210, 95, 4820, 140, 60, 1310, 180, 75, 640, 120, 210, 40])

# ---- group: ZONE_CORRIGE / ÉTAPE 1
# MP-05 · Mesurer avant d'optimiser
# Perfectionnement  —  durée cible 25 min  —  réf. REF-150  —  v0.5-260902
# ▼  CORRIGÉ — à consulter après validation  ▼
# RAPPEL — copie des données fournies dans la zone sujet, afin qu'aucun câble ne relie les deux zones
# ÉTAPE 1 — Le temps total : 7 900 ms
# ÉTAPE 2 — Le plus lourd : 4 820 ms pour le maillage adaptatif. Les neuf plus légers cumulés pèsent moins
# d'un quart de lui seul
# ÉTAPE 3 — 61 % du temps tient dans un seul composant. Le diviser par dix ferait gagner 55 % ; annuler
# complètement les onze autres n'en ferait gagner que 39. C'est ce que le relevé dit et que l'intuition ne
# dit pas
# RÉSULTAT — tant que l'interrupteur AFFICHER LE CORRIGÉ reste sur faux, la sortie 1 du Stream Gate est
# vide : rien n'apparaît dans Rhino
ma = MassAddition(Input=temps_par_composant_2)  # -> Result, PartialResults

# ---- group: ZONE_CORRIGE / ÉTAPE 2
bnd = Bounds(Numbers=temps_par_composant_2)
dedomain = DeconstructDomain(Domain=bnd)  # -> Start, End

# ---- group: ZONE_CORRIGE / ÉTAPE 3
division = Division(A=dedomain.End, B=ma.Result)
multiplication = Multiplication(A=division, B=100)
round = Round(Number=multiplication)  # -> Nearest, Floor, Ceiling
panel = Panel(round.Nearest)

# ---- group: ZONE_CORRIGE / AFFICHAGE DU CORRIGÉ
afficher_le_corrigé = BooleanToggle(False)
gate = StreamGate(Stream=round.Nearest, Gate=afficher_le_corrigé)  # -> Target0, Target1
reponse_corrige = REPONSE_CORRIGE(gate.Target1)
