# Grasshopper definition PL-01_complet.gh (Grasshopper 1.0.8)

# ---- group: ZONE_SUJET
reponse = REPONSE()
# PL-01 · Ce qui change quand on passe au paramétrique
# Débutant  —  durée cible 8 min  —  réf. REF-025  —  v0.3-260826
# ▼  CORRIGÉ — à consulter après validation  ▼
# ÉTAPE 1 — La bonne réponse est la proposition 1. Le corrigé porte cet indice en clair : le menu du sujet,
# lui, part sur la première proposition, quelle qu'elle soit.
# ÉTAPE 2 — À retenir
# RÉSULTAT — tant que l'interrupteur AFFICHER LE CORRIGÉ reste sur faux, la sortie 1 du Stream Gate est
# vide : rien n'apparaît dans Rhino
# Une definition coute presque toujours
# plus cher que le dessin equivalent,
# la PREMIERE fois.
# 
# Elle s'amortit sur les variantes.
# Pour un cas unique, elle ne se
# rentabilise jamais.
reponse_qcm = ValueList({"0 - Elle va plus vite à produire la première fois.": 0, "1 - Elle rend la modification bon marché : on change une…": 1, "2 - Elle donne un modèle plus précis.": 2, "3 - Elle évite d'avoir à connaître Rhino.": 3}, selected=[])

# ---- group: ZONE_CORRIGE / ÉTAPE 1
bonne_reponse = BONNE_REPONSE(1)

# ---- group: ZONE_CORRIGE / AFFICHAGE DU CORRIGÉ
afficher_le_corrigé = BooleanToggle(False)
gate = StreamGate(Stream=bonne_reponse, Gate=afficher_le_corrigé)  # -> Target0, Target1
reponse_corrige = REPONSE_CORRIGE(gate.Target1)
