# Grasshopper definition PL-02_complet.gh (Grasshopper 1.0.8)

# ---- group: ZONE_SUJET
reponse = REPONSE()
# PL-02 · Où trouver un plugin, et lequel
# Intermédiaire  —  durée cible 8 min  —  réf. REF-029, REF-030  —  v0.5-260902
# ▼  CORRIGÉ — à consulter après validation  ▼
# ÉTAPE 1 — La bonne réponse est la proposition 0. Le corrigé porte cet indice en clair : le menu du sujet,
# lui, part sur la première proposition, quelle qu'elle soit.
# ÉTAPE 2 — À retenir
# RÉSULTAT — tant que l'interrupteur AFFICHER LE CORRIGÉ reste sur faux, la sortie 1 du Stream Gate est
# vide : rien n'apparaît dans Rhino
# Grasshopper NOMME toujours ce qui manque :
# le composant rouge porte le nom du plugin.
# 
# Preferer le gestionnaire de paquets au
# telechargement manuel : il gere versions
# et mises a jour.
reponse_qcm = ValueList({"0 - Lire le nom du composant manquant, qui porte celui du…": 0, "1 - Reconstruire les parties manquantes à la main.": 1, "2 - Demander à l'auteur de refaire la définition sans plugin.": 2, "3 - Réinstaller Rhino.": 3}, selected=[])

# ---- group: ZONE_CORRIGE / ÉTAPE 1
bonne_reponse = BONNE_REPONSE(0)

# ---- group: ZONE_CORRIGE / AFFICHAGE DU CORRIGÉ
afficher_le_corrigé = BooleanToggle(False)
gate = StreamGate(Stream=bonne_reponse, Gate=afficher_le_corrigé)  # -> Target0, Target1
reponse_corrige = REPONSE_CORRIGE(gate.Target1)
