# Grasshopper definition PL-04_complet.gh (Grasshopper 1.0.8)

# ---- group: ZONE_SUJET
reponse = REPONSE()
# PL-04 · Choisir un plugin fonctionnel
# Intermédiaire  —  durée cible 8 min  —  réf. REF-038, REF-039  —  v0.3-260826
# ▼  CORRIGÉ — à consulter après validation  ▼
# ÉTAPE 1 — La bonne réponse est la proposition 3. Le corrigé porte cet indice en clair : le menu du sujet,
# lui, part sur la première proposition, quelle qu'elle soit.
# ÉTAPE 2 — À retenir
# RÉSULTAT — tant que l'interrupteur AFFICHER LE CORRIGÉ reste sur faux, la sortie 1 du Stream Gate est
# vide : rien n'apparaît dans Rhino
# Avant d'adopter un plugin dans une
# definition LIVREE :
# - licence, et droit d'usage commercial
# - entretien : derniere mise a jour ?
# - que devient le client s'il disparait ?
# 
# Gratuit ne dit rien de tout cela.
reponse_qcm = ValueList({"0 - Le nombre de composants qu'il apporte.": 0, "1 - Sa popularité sur les forums.": 1, "2 - Qu'il soit gratuit.": 2, "3 - Sa licence, son entretien et ce qui se passe pour le…": 3}, selected=[])

# ---- group: ZONE_CORRIGE / ÉTAPE 1
bonne_reponse = BONNE_REPONSE(3)

# ---- group: ZONE_CORRIGE / AFFICHAGE DU CORRIGÉ
afficher_le_corrigé = BooleanToggle(False)
gate = StreamGate(Stream=bonne_reponse, Gate=afficher_le_corrigé)  # -> Target0, Target1
reponse_corrige = REPONSE_CORRIGE(gate.Target1)
