# Grasshopper definition PL-05_complet.gh (Grasshopper 1.0.8)

# ---- group: ZONE_SUJET
# Le tableau des dépendances déclarées vous est fourni. Donnez le nombre total de paquets à
# emporter pour installer Nid, celui-ci compris.
reponse = REPONSE()

# ---- group: ZONE_CORRIGE / ÉTAPE 1
paquets_a_emporter = PAQUETS_A_EMPORTER(["Nid", "Aiguille", "Fontaine", "Noyau", "Sillage", "Trame"])

# ---- group: ZONE_CORRIGE / ÉTAPE 2
# PL-05 · Ce qu'un plugin traîne derrière lui
# Intermédiaire  —  durée cible 20 min  —  réf. REF-029, REF-030  —  v0.5-260902
# ▼  CORRIGÉ — à consulter après validation  ▼
# ÉTAPE 1 — L'étalon porte la fermeture du graphe : le paquet visé, et tout ce dont il dépend de proche en
# proche. Noyau y figure UNE FOIS bien que deux paquets l'exigent
# ÉTAPE 2 — Six paquets. S'arrêter aux dépendances directes en emporterait trois, et l'installation
# s'arrêterait au premier maillon manquant
# RÉSULTAT — tant que l'interrupteur AFFICHER LE CORRIGÉ reste sur faux, la sortie 1 du Stream Gate est
# vide : rien n'apparaît dans Rhino
lng = ListLength(List=paquets_a_emporter)
panel = Panel(lng)

# ---- group: ZONE_CORRIGE / AFFICHAGE DU CORRIGÉ
afficher_le_corrigé = BooleanToggle(False)
gate = StreamGate(Stream=lng, Gate=afficher_le_corrigé)  # -> Target0, Target1
reponse_corrige = REPONSE_CORRIGE(gate.Target1)
