# Grasshopper definition PL-06_complet.gh (Grasshopper 1.0.8)

# ---- group: ZONE_SUJET
# Votre définition exige trois plugins. L'inventaire des sept postes destinataires vous est
# fourni. Donnez le nombre de postes qui pourront l'exécuter.
reponse = REPONSE()

# ---- group: ZONE_CORRIGE / ÉTAPE 1
postes_capables = POSTES_CAPABLES(["Bureau A", "Atelier", "Sous-traitant"])

# ---- group: ZONE_CORRIGE / ÉTAPE 2
# PL-06 · Qui pourra ouvrir votre définition
# Intermédiaire  —  durée cible 20 min  —  réf. REF-038, REF-039  —  v0.5-260902
# ▼  CORRIGÉ — à consulter après validation  ▼
# ÉTAPE 1 — L'étalon nomme les postes qui possèdent les TROIS plugins requis. Il en faut trois sur trois :
# un composant manquant suffit à rompre la chaîne, et la définition ne rend alors rien
# ÉTAPE 2 — Trois postes sur sept. Compter ceux qui ont au moins un des trois en donnerait six — et la
# livraison paraîtrait sans risque
# RÉSULTAT — tant que l'interrupteur AFFICHER LE CORRIGÉ reste sur faux, la sortie 1 du Stream Gate est
# vide : rien n'apparaît dans Rhino
lng = ListLength(List=postes_capables)
panel = Panel(lng)

# ---- group: ZONE_CORRIGE / AFFICHAGE DU CORRIGÉ
afficher_le_corrigé = BooleanToggle(False)
gate = StreamGate(Stream=lng, Gate=afficher_le_corrigé)  # -> Target0, Target1
reponse_corrige = REPONSE_CORRIGE(gate.Target1)
