# Grasshopper definition PL-07_complet.gh (Grasshopper 1.0.8)

# ---- group: ZONE_SUJET
# Cinq tâches vous sont données, avec le nombre de composants qu'elles demandent en natif et avec
# le plugin adapté. Donnez le nombre de composants économisés au total.
composants_en_natif = COMPOSANTS_EN_NATIF([34, 41, 12, 27, 9])
composants_avec_plugin = COMPOSANTS_AVEC_PLUGIN([1, 2, 1, 3, 1])
reponse = REPONSE()

# ---- group: ZONE_CORRIGE / DONNÉES FOURNIES (copie)
composants_en_natif_2 = COMPOSANTS_EN_NATIF([34, 41, 12, 27, 9])
composants_avec_plugin_2 = COMPOSANTS_AVEC_PLUGIN([1, 2, 1, 3, 1])

# ---- group: ZONE_CORRIGE / ÉTAPE 1
# PL-07 · Ce qu'un plugin vous épargne d'écrire
# Intermédiaire  —  durée cible 20 min  —  réf. REF-038, REF-039  —  v0.5-260902
# ▼  CORRIGÉ — à consulter après validation  ▼
# RAPPEL — copie des données fournies dans la zone sujet, afin qu'aucun câble ne relie les deux zones
# ÉTAPE 1 — Sommer les deux colonnes : 123 composants en natif, 8 avec les plugins
# ÉTAPE 2 — C'est l'ÉCART qui se met en balance avec le coût de la dépendance : 115 composants épargnés,
# contre quatre postes sur sept qui ne pourront plus ouvrir le fichier — c'est ce que PL-06 mesure
# RÉSULTAT — tant que l'interrupteur AFFICHER LE CORRIGÉ reste sur faux, la sortie 1 du Stream Gate est
# vide : rien n'apparaît dans Rhino
ma = MassAddition(Input=composants_en_natif_2)  # -> Result, PartialResults
ma_2 = MassAddition(Input=composants_avec_plugin_2)  # -> Result, PartialResults

# ---- group: ZONE_CORRIGE / ÉTAPE 2
subtraction = Subtraction(A=ma.Result, B=ma_2.Result)
panel = Panel(subtraction)

# ---- group: ZONE_CORRIGE / AFFICHAGE DU CORRIGÉ
afficher_le_corrigé = BooleanToggle(False)
gate = StreamGate(Stream=subtraction, Gate=afficher_le_corrigé)  # -> Target0, Target1
reponse_corrige = REPONSE_CORRIGE(gate.Target1)
