# Grasshopper definition PL-08_complet.gh (Grasshopper 1.0.8)

# ---- group: ZONE_SUJET
# Les vingt-quatre surnoms relevés sur la définition vous sont fournis. Donnez le nombre de
# composants dont le surnom ne dit pas ce qu'ils font.
reponse = REPONSE()

# ---- group: ZONE_CORRIGE / ÉTAPE 1
surnoms_muets = SURNOMS_MUETS(["A", "Srf", "D", "Mult", "X", "Div", "N", "Rot", "Pt", "Vec"])

# ---- group: ZONE_CORRIGE / ÉTAPE 2
# PL-08 · Les composants qui ne disent pas leur nom
# Intermédiaire  —  durée cible 20 min  —  réf. REF-031, REF-032, REF-033  —  v0.5-260902
# ▼  CORRIGÉ — à consulter après validation  ▼
# ÉTAPE 1 — L'étalon nomme les surnoms qui n'apprennent rien : six abréviations de composants et quatre
# lettres seules. Le critère n'est pas la longueur — « Jeu de pose » est court et parlant
# ÉTAPE 2 — Dix sur vingt-quatre, soit plus de quatre sur dix. La proportion ordinaire d'une définition
# écrite sans intention de la faire relire
# RÉSULTAT — tant que l'interrupteur AFFICHER LE CORRIGÉ reste sur faux, la sortie 1 du Stream Gate est
# vide : rien n'apparaît dans Rhino
lng = ListLength(List=surnoms_muets)
panel = Panel(lng)

# ---- group: ZONE_CORRIGE / AFFICHAGE DU CORRIGÉ
afficher_le_corrigé = BooleanToggle(False)
gate = StreamGate(Stream=lng, Gate=afficher_le_corrigé)  # -> Target0, Target1
reponse_corrige = REPONSE_CORRIGE(gate.Target1)
