# Grasshopper definition PL-09_complet.gh (Grasshopper 1.0.8)

# ---- group: ZONE_SUJET
# Les neuf plugins vous sont fournis avec la version de Rhino qu'ils exigent au minimum. Le poste
# tourne sous Rhino 8. Donnez le nombre de plugins installables.
version_exigee = VERSION_EXIGEE([7, 8, 6, 8, 5, 7, 8, 9, 9])
seuil = SEUIL(8)
reponse = REPONSE()

# ---- group: ZONE_CORRIGE / DONNÉES FOURNIES (copie)
version_exigee_2 = VERSION_EXIGEE([7, 8, 6, 8, 5, 7, 8, 9, 9])
seuil_2 = SEUIL(8)

# ---- group: ZONE_CORRIGE / ÉTAPE 1
# PL-09 · Ce qui s'installera vraiment sur ce poste
# Intermédiaire  —  durée cible 15 min  —  réf. REF-030  —  v0.5-260902
# ▼  CORRIGÉ — à consulter après validation  ▼
# RAPPEL — copie des données fournies dans la zone sujet, afin qu'aucun câble ne relie les deux zones
# ÉTAPE 1 — La version déclarée est un PLANCHER : un plugin écrit pour Rhino 6 s'installe sur Rhino 8. La
# comparaison retenue est donc « au plus la version du poste », sortie « ou égal à » comprise
# ÉTAPE 2 — Sept plugins sur neuf. Chercher l'égalité exacte n'en trouverait que trois ; ce sont les deux
# qui exigent Rhino 9 qui ne passeront pas
# RÉSULTAT — tant que l'interrupteur AFFICHER LE CORRIGÉ reste sur faux, la sortie 1 du Stream Gate est
# vide : rien n'apparaît dans Rhino
smaller = SmallerThan(FirstNumber=version_exigee_2, SecondNumber=seuil_2)  # -> SmallerThan, OrEqualTo

# ---- group: ZONE_CORRIGE / ÉTAPE 2
cull = CullPattern(List=version_exigee_2, CullPattern=smaller.OrEqualTo)
lng = ListLength(List=cull)
panel = Panel(lng)

# ---- group: ZONE_CORRIGE / AFFICHAGE DU CORRIGÉ
afficher_le_corrigé = BooleanToggle(False)
gate = StreamGate(Stream=lng, Gate=afficher_le_corrigé)  # -> Target0, Target1
reponse_corrige = REPONSE_CORRIGE(gate.Target1)
