# Grasshopper definition PL-10_complet.gh (Grasshopper 1.0.8)

# ---- group: ZONE_SUJET
reponse = REPONSE()
# PL-10 · Où chercher un plugin
# Intermédiaire  —  durée cible 8 min  —  réf. REF-029, REF-030  —  v0.5-260902
# ▼  CORRIGÉ — à consulter après validation  ▼
# ÉTAPE 1 — La bonne réponse est la proposition 0. Le corrigé porte cet indice en clair : le menu du sujet,
# lui, part sur la première proposition, quelle qu'elle soit.
# ÉTAPE 2 — À retenir
# RÉSULTAT — tant que l'interrupteur AFFICHER LE CORRIGÉ reste sur faux, la sortie 1 du Stream Gate est
# vide : rien n'apparaît dans Rhino
# Le binaire est le meme.
# Ce qui l'entoure ne l'est pas :
# dependances, mise a jour,
# desinstallation.
reponse_qcm = ValueList({"0 - Le gestionnaire de paquets : il gère les dépendances, les…": 0, "1 - Le site communautaire : on y trouve la version la plus…": 1, "2 - Peu importe, le fichier installé est le même.": 2, "3 - Le site communautaire, pour lire les avis avant…": 3}, selected=[])

# ---- group: ZONE_CORRIGE / ÉTAPE 1
bonne_reponse = BONNE_REPONSE(0)

# ---- group: ZONE_CORRIGE / AFFICHAGE DU CORRIGÉ
afficher_le_corrigé = BooleanToggle(False)
gate = StreamGate(Stream=bonne_reponse, Gate=afficher_le_corrigé)  # -> Target0, Target1
reponse_corrige = REPONSE_CORRIGE(gate.Target1)
