# Grasshopper definition PL-11_complet.gh (Grasshopper 1.0.8)

# ---- group: ZONE_SUJET
reponse = REPONSE()
# PL-11 · Deux familles de plugins
# Intermédiaire  —  durée cible 8 min  —  réf. REF-031, REF-034, REF-035, REF-036, REF-037  —  v0.5-260902
# ▼  CORRIGÉ — à consulter après validation  ▼
# ÉTAPE 1 — La bonne réponse est la proposition 3. Le corrigé porte cet indice en clair : le menu du sujet,
# lui, part sur la première proposition, quelle qu'elle soit.
# ÉTAPE 2 — À retenir
# RÉSULTAT — tant que l'interrupteur AFFICHER LE CORRIGÉ reste sur faux, la sortie 1 du Stream Gate est
# vide : rien n'apparaît dans Rhino
# Ergonomie   : rien dans le fichier livre.
# Fonctionnel : une dependance qui suit
#               le fichier partout.
# 
# C'est ce que PL-06 mesure.
reponse_qcm = ValueList({"0 - L'ergonomie est gratuite, le fonctionnel est payant.": 0, "1 - L'ergonomie est réservée aux débutants.": 1, "2 - Le fonctionnel est plus lourd à installer.": 2, "3 - L'ergonomie ne laisse aucune trace dans le fichier livré…": 3}, selected=[])

# ---- group: ZONE_CORRIGE / ÉTAPE 1
bonne_reponse = BONNE_REPONSE(3)

# ---- group: ZONE_CORRIGE / AFFICHAGE DU CORRIGÉ
afficher_le_corrigé = BooleanToggle(False)
gate = StreamGate(Stream=bonne_reponse, Gate=afficher_le_corrigé)  # -> Target0, Target1
reponse_corrige = REPONSE_CORRIGE(gate.Target1)
