# Grasshopper definition PL-12_complet.gh (Grasshopper 1.0.8)

# ---- group: ZONE_SUJET
reponse = REPONSE()
# PL-12 · Le plugin qui n'est plus maintenu
# Intermédiaire  —  durée cible 8 min  —  réf. REF-039  —  v0.5-260902
# ▼  CORRIGÉ — à consulter après validation  ▼
# ÉTAPE 1 — La bonne réponse est la proposition 1. Le corrigé porte cet indice en clair : le menu du sujet,
# lui, part sur la première proposition, quelle qu'elle soit.
# ÉTAPE 2 — À retenir
# RÉSULTAT — tant que l'interrupteur AFFICHER LE CORRIGÉ reste sur faux, la sortie 1 du Stream Gate est
# vide : rien n'apparaît dans Rhino
# Figer Rhino gele aussi tout le reste,
# et le probleme revient dans un an.
# 
# Savoir CE QUE le plugin fait encore
# precede le choix d'un remplacant.
reponse_qcm = ValueList({"0 - Chercher un plugin de remplacement équivalent.": 0, "1 - Repérer ce que ce plugin fait réellement dans la…": 1, "2 - Figer la version de Rhino pour que rien ne bouge.": 2, "3 - Réécrire la partie concernée en natif, sans attendre.": 3}, selected=[])

# ---- group: ZONE_CORRIGE / ÉTAPE 1
bonne_reponse = BONNE_REPONSE(1)

# ---- group: ZONE_CORRIGE / AFFICHAGE DU CORRIGÉ
afficher_le_corrigé = BooleanToggle(False)
gate = StreamGate(Stream=bonne_reponse, Gate=afficher_le_corrigé)  # -> Target0, Target1
reponse_corrige = REPONSE_CORRIGE(gate.Target1)
