# Grasshopper definition PL-13_complet.gh (Grasshopper 1.0.8)

# ---- group: ZONE_SUJET
# Le tableau vous donne, pour quatorze plugins, leur présence sur le gestionnaire de paquets et
# sur Food4Rhino. Donnez le nombre de plugins qui ne sont disponibles QUE sur Food4Rhino.
sur_le_gestionnaire = SUR_LE_GESTIONNAIRE([1, 0, 1, 0, 1, 1, 1, 0, 0, 0, 1, 0, 1, 1])
sur_food4rhino = SUR_FOOD4RHINO([1, 1, 1, 1, 1, 1, 0, 1, 1, 1, 1, 1, 1, 1])
reponse = REPONSE()

# ---- group: ZONE_CORRIGE / DONNÉES FOURNIES (copie)
sur_le_gestionnaire_2 = SUR_LE_GESTIONNAIRE([1, 0, 1, 0, 1, 1, 1, 0, 0, 0, 1, 0, 1, 1])
sur_food4rhino_2 = SUR_FOOD4RHINO([1, 1, 1, 1, 1, 1, 0, 1, 1, 1, 1, 1, 1, 1])

# ---- group: ZONE_CORRIGE / ÉTAPE 1
# PL-13 · Où trouver chaque plugin
# Intermédiaire  —  durée cible 12 min  —  réf. REF-029, REF-030  —  v0.5-260902
# ▼  CORRIGÉ — à consulter après validation  ▼
# RAPPEL — copie des données fournies dans la zone sujet, afin qu'aucun câble ne relie les deux zones
# ÉTAPE 1 — « Seulement sur Food4Rhino » est une EXCLUSIVITÉ : présent d'un côté, absent de l'autre.
# Compter la seule colonne Food4Rhino donnerait treize
# ÉTAPE 2 — 6 plugins imposeront un téléchargement, un déblocage du fichier et un redémarrage sur chaque
# poste
# RÉSULTAT — tant que l'interrupteur AFFICHER LE CORRIGÉ reste sur faux, la sortie 1 du Stream Gate est
# vide : rien n'apparaît dans Rhino
equals = Equality(FirstNumber=sur_le_gestionnaire_2, SecondNumber=0)  # -> Equality, Inequality
equals_2 = Equality(FirstNumber=sur_food4rhino_2, SecondNumber=1)  # -> Equality, Inequality
and = GateAnd(A=equals.Equality, B=equals_2.Equality)

# ---- group: ZONE_CORRIGE / ÉTAPE 2
cull = CullPattern(List=sur_food4rhino_2, CullPattern=and)
lng = ListLength(List=cull)
panel = Panel(lng)

# ---- group: ZONE_CORRIGE / AFFICHAGE DU CORRIGÉ
afficher_le_corrigé = BooleanToggle(False)
gate = StreamGate(Stream=lng, Gate=afficher_le_corrigé)  # -> Target0, Target1
reponse_corrige = REPONSE_CORRIGE(gate.Target1)
