# Grasshopper definition PL-14_complet.gh (Grasshopper 1.0.8)

# ---- group: ZONE_SUJET
# Le relevé donne le temps de chargement de sept plugins, et signale ceux qu'un autre plugin déjà
# installé exige de toute façon. Donnez le temps AJOUTÉ par la panoplie d'ergonomie, en
# millisecondes.
temps_de_chargement_ms = TEMPS_DE_CHARGEMENT_MS([210, 145, 95, 130, 380, 260, 175])
deja_exige_par_un_autre = DEJA_EXIGE_PAR_UN_AUTRE([0, 0, 0, 0, 0, 0, 1])
reponse = REPONSE()

# ---- group: ZONE_CORRIGE / DONNÉES FOURNIES (copie)
temps_de_chargement_ms_2 = TEMPS_DE_CHARGEMENT_MS([210, 145, 95, 130, 380, 260, 175])
deja_exige_par_un_autre_2 = DEJA_EXIGE_PAR_UN_AUTRE([0, 0, 0, 0, 0, 0, 1])

# ---- group: ZONE_CORRIGE / ÉTAPE 1
# PL-14 · Ce que l'ergonomie coûte au démarrage
# Intermédiaire  —  durée cible 14 min  —  réf. REF-031, REF-032, REF-033, REF-034, REF-035, REF-036, REF-037  —  v0.5-260902
# ▼  CORRIGÉ — à consulter après validation  ▼
# RAPPEL — copie des données fournies dans la zone sujet, afin qu'aucun câble ne relie les deux zones
# ÉTAPE 1 — Ce qui est déjà exigé par un plugin installé n'est pas imputable à l'ergonomie : le compter
# reviendrait à facturer deux fois la même seconde
# ÉTAPE 2 — 1 220 ms ajoutés. Tout additionner en donnerait 1 395 — 14 % de plus, assez pour fausser une
# décision d'équipement
# RÉSULTAT — tant que l'interrupteur AFFICHER LE CORRIGÉ reste sur faux, la sortie 1 du Stream Gate est
# vide : rien n'apparaît dans Rhino
equals = Equality(FirstNumber=deja_exige_par_un_autre_2, SecondNumber=0)  # -> Equality, Inequality
cull = CullPattern(List=temps_de_chargement_ms_2, CullPattern=equals.Equality)

# ---- group: ZONE_CORRIGE / ÉTAPE 2
ma = MassAddition(Input=cull)  # -> Result, PartialResults
panel = Panel(ma.Result)

# ---- group: ZONE_CORRIGE / AFFICHAGE DU CORRIGÉ
afficher_le_corrigé = BooleanToggle(False)
gate = StreamGate(Stream=ma.Result, Gate=afficher_le_corrigé)  # -> Target0, Target1
reponse_corrige = REPONSE_CORRIGE(gate.Target1)
