# Grasshopper definition PL-15_complet.gh (Grasshopper 1.0.8)

# ---- group: ZONE_SUJET
# La définition à reprendre emploie douze composants non natifs. Le tableau donne ce qu'apporte
# chacun des six plugins candidats. Donnez le nombre MINIMAL de plugins à installer pour couvrir
# les douze.
reponse = REPONSE()
# PL-15 · Combien de plugins pour douze composants
# Perfectionnement  —  durée cible 22 min  —  réf. REF-038, REF-039  —  v0.5-260902
# ▼  CORRIGÉ — à consulter après validation  ▼
# ÉTAPE 1 — Couvrir douze composants par le plus petit nombre de plugins est un problème de COUVERTURE : il
# se résout en énumérant les sous-ensembles, ce qu'aucun composant natif ne fait. L'étalon porte le
# minimum, et deux quartets différents l'atteignent — c'est pourquoi la question porte sur le nombre
# RÉSULTAT — tant que l'interrupteur AFFICHER LE CORRIGÉ reste sur faux, la sortie 1 du Stream Gate est
# vide : rien n'apparaît dans Rhino
composants_requis = Slider(12, range=1..20)
plugins_candidats = Slider(6, range=1..12)

# ---- group: ZONE_CORRIGE / ÉTAPE 1
plugins_au_minimum = PLUGINS_AU_MINIMUM(4)
panel = Panel(plugins_au_minimum)

# ---- group: ZONE_CORRIGE / AFFICHAGE DU CORRIGÉ
afficher_le_corrigé = BooleanToggle(False)
gate = StreamGate(Stream=plugins_au_minimum, Gate=afficher_le_corrigé)  # -> Target0, Target1
reponse_corrige = REPONSE_CORRIGE(gate.Target1)
