# Grasshopper definition PL-16_complet.gh (Grasshopper 1.0.8)

# ---- group: ZONE_SUJET
# Le tableau donne, pour quatorze plugins, la version de Rhino minimale et la version maximale
# supportée. Donnez le nombre de plugins compatibles avec Rhino 8.
version_minimale = VERSION_MINIMALE([6, 5, 6, 5, 6, 6, 6, 5, 6, 5, 7, 6, 7, 6])
version_maximale = VERSION_MAXIMALE([8, 7, 8, 8, 8, 8, 8, 6, 7, 8, 8, 7, 8, 8])
reponse = REPONSE()
# PL-16 · Ce qui tourne encore sous Rhino 8
# Intermédiaire  —  durée cible 12 min  —  réf. REF-029, REF-038, REF-039  —  v0.5-260902
# ▼  CORRIGÉ — à consulter après validation  ▼
# RAPPEL — copie des données fournies dans la zone sujet, afin qu'aucun câble ne relie les deux zones
# ÉTAPE 1 — Un intervalle a DEUX bornes. La borne minimale ne rejette personne ici — le test naïf donne
# quatorze sur quatorze, le score parfait, et c'est ce qui le rend crédible
# ÉTAPE 2 — 10 plugins sur 14. Les quatre autres, abandonnés en version 6 ou 7, feront échouer la migration
# RÉSULTAT — tant que l'interrupteur AFFICHER LE CORRIGÉ reste sur faux, la sortie 1 du Stream Gate est
# vide : rien n'apparaît dans Rhino
version_cible = Slider(8, range=5..9)

# ---- group: ZONE_CORRIGE / DONNÉES FOURNIES (copie)
version_minimale_2 = VERSION_MINIMALE([6, 5, 6, 5, 6, 6, 6, 5, 6, 5, 7, 6, 7, 6])
version_maximale_2 = VERSION_MAXIMALE([8, 7, 8, 8, 8, 8, 8, 6, 7, 8, 8, 7, 8, 8])
version_cible_2 = Slider(8, range=5..9)

# ---- group: ZONE_CORRIGE / ÉTAPE 1
smaller = SmallerThan(FirstNumber=version_minimale_2, SecondNumber=version_cible_2)  # -> SmallerThan, OrEqualTo
larger = LargerThan(FirstNumber=version_maximale_2, SecondNumber=version_cible_2)  # -> LargerThan, OrEqualTo

# ---- group: ZONE_CORRIGE / ÉTAPE 2
and = GateAnd(A=smaller.OrEqualTo, B=larger.OrEqualTo)
cull = CullPattern(List=version_minimale_2, CullPattern=and)
lng = ListLength(List=cull)
panel = Panel(lng)

# ---- group: ZONE_CORRIGE / AFFICHAGE DU CORRIGÉ
afficher_le_corrigé = BooleanToggle(False)
gate = StreamGate(Stream=lng, Gate=afficher_le_corrigé)  # -> Target0, Target1
reponse_corrige = REPONSE_CORRIGE(gate.Target1)
