# Grasshopper definition QT-01_complet.gh (Grasshopper 1.0.8)

# ---- group: ZONE_SUJET
# Les 20 solives du plancher vous sont fournies avec leur section et leur longueur. Donnez le
# volume total de bois, en mètres cubes.
section_largeur_mm = SECTION_LARGEUR_MM([63, 63, 75, 63, 75, 63, 63, 75, 63, 63, 75, 63, 63, 75, 63, 63, 75, 63, 63, 75])
section_hauteur_mm = SECTION_HAUTEUR_MM([175, 200, 225, 175, 225, 200, 175, 200, 225, 175, 225, 200, 175, 200, 225, 200, 225, 175, 200, 200])
longueurs_mm = LONGUEURS_MM([4180, 4620, 5240, 4180, 5240, 4620, 4180, 4870, 5510, 4180, 5240, 4620, 4180, 4870, 5510, 4620, 5240, 4180, 4620, 4870])
reponse = REPONSE()

# ---- group: ZONE_CORRIGE / DONNÉES FOURNIES (copie)
section_largeur_mm_2 = SECTION_LARGEUR_MM([63, 63, 75, 63, 75, 63, 63, 75, 63, 63, 75, 63, 63, 75, 63, 63, 75, 63, 63, 75])
section_hauteur_mm_2 = SECTION_HAUTEUR_MM([175, 200, 225, 175, 225, 200, 175, 200, 225, 175, 225, 200, 175, 200, 225, 200, 225, 175, 200, 200])
longueurs_mm_2 = LONGUEURS_MM([4180, 4620, 5240, 4180, 5240, 4620, 4180, 4870, 5510, 4180, 5240, 4620, 4180, 4870, 5510, 4620, 5240, 4180, 4620, 4870])

# ---- group: ZONE_CORRIGE / ÉTAPE 1
# QT-01 · Le métré d'un plancher bois
# Intermédiaire  —  durée cible 25 min  —  réf. REF-082, REF-084  —  v0.5-260902
# ▼  CORRIGÉ — à consulter après validation  ▼
# RAPPEL — copie des données fournies dans la zone sujet, afin qu'aucun câble ne relie les deux zones
# ÉTAPE 1 — Aire de chaque section, en millimètres carrés
# ÉTAPE 2 — Volume de chaque solive : son aire par SA longueur, terme à terme. Prendre la section moyenne
# pour la longueur totale donnerait une valeur voisine et fausse — les sections ne sont pas indépendantes
# des longueurs
# ÉTAPE 3 — Somme des vingt volumes, puis conversion : un mètre cube vaut un MILLIARD de millimètres cubes,
# non un million
# RÉSULTAT — tant que l'interrupteur AFFICHER LE CORRIGÉ reste sur faux, la sortie 1 du Stream Gate est
# vide : rien n'apparaît dans Rhino
multiplication = Multiplication(A=section_largeur_mm_2, B=section_hauteur_mm_2)

# ---- group: ZONE_CORRIGE / ÉTAPE 2
multiplication_2 = Multiplication(A=multiplication, B=longueurs_mm_2)

# ---- group: ZONE_CORRIGE / ÉTAPE 3
ma = MassAddition(Input=multiplication_2)  # -> Result, PartialResults
division = Division(A=ma.Result, B=1000000000)
panel = Panel(division)

# ---- group: ZONE_CORRIGE / AFFICHAGE DU CORRIGÉ
afficher_le_corrigé = BooleanToggle(False)
gate = StreamGate(Stream=division, Gate=afficher_le_corrigé)  # -> Target0, Target1
reponse_corrige = REPONSE_CORRIGE(gate.Target1)
