# Grasshopper definition QT-02_complet.gh (Grasshopper 1.0.8)

# ---- group: ZONE_SUJET
# Le bordereau fournit un prix au mètre linéaire pour chacune des cinq sections. Donnez le
# montant total du plancher, en euros.
longueurs_mm = LONGUEURS_MM([4180, 4620, 5240, 4180, 5240, 4620, 4180, 4870, 5510, 4180, 5240, 4620, 4180, 4870, 5510, 4620, 5240, 4180, 4620, 4870])
prix_au_metre = PRIX_AU_METRE([6.8, 7.9, 10.7, 6.8, 10.7, 7.9, 6.8, 9.4, 9.1, 6.8, 10.7, 7.9, 6.8, 9.4, 9.1, 7.9, 10.7, 6.8, 7.9, 9.4])
reponse = REPONSE()

# ---- group: ZONE_CORRIGE / DONNÉES FOURNIES (copie)
longueurs_mm_2 = LONGUEURS_MM([4180, 4620, 5240, 4180, 5240, 4620, 4180, 4870, 5510, 4180, 5240, 4620, 4180, 4870, 5510, 4620, 5240, 4180, 4620, 4870])
prix_au_metre_2 = PRIX_AU_METRE([6.8, 7.9, 10.7, 6.8, 10.7, 7.9, 6.8, 9.4, 9.1, 6.8, 10.7, 7.9, 6.8, 9.4, 9.1, 7.9, 10.7, 6.8, 7.9, 9.4])

# ---- group: ZONE_CORRIGE / ÉTAPE 1
# QT-02 · Du métré au prix
# Intermédiaire  —  durée cible 25 min  —  réf. REF-083  —  v0.3-260826
# ▼  CORRIGÉ — à consulter après validation  ▼
# RAPPEL — copie des données fournies dans la zone sujet, afin qu'aucun câble ne relie les deux zones
# ÉTAPE 1 — Le prix est au mètre linéaire : convertir les longueurs avant toute multiplication
# ÉTAPE 2 — Prix par solive. L'appariement doit se faire par SECTION, non par rang : vingt solives pour
# cinq prix, un appariement par rang produirait silencieusement un résultat calculé sur le mauvais prix
# ÉTAPE 3 — Montant total : 814,92 €
# RÉSULTAT — tant que l'interrupteur AFFICHER LE CORRIGÉ reste sur faux, la sortie 1 du Stream Gate est
# vide : rien n'apparaît dans Rhino
division = Division(A=longueurs_mm_2, B=1000)

# ---- group: ZONE_CORRIGE / ÉTAPE 2
multiplication = Multiplication(A=division, B=prix_au_metre_2)

# ---- group: ZONE_CORRIGE / ÉTAPE 3
ma = MassAddition(Input=multiplication)  # -> Result, PartialResults
panel = Panel(ma.Result)

# ---- group: ZONE_CORRIGE / AFFICHAGE DU CORRIGÉ
afficher_le_corrigé = BooleanToggle(False)
gate = StreamGate(Stream=ma.Result, Gate=afficher_le_corrigé)  # -> Target0, Target1
reponse_corrige = REPONSE_CORRIGE(gate.Target1)
