# Grasshopper definition QT-03_complet.gh (Grasshopper 1.0.8)

# ---- group: ZONE_SUJET
# Les 18 menuiseries vous sont fournies avec leur repère, leur largeur et leur hauteur. Produisez
# le tableau à quatre colonnes — repère, largeur, hauteur, surface — et exportez-le en CSV.
# Donnez la surface totale, en mètres carrés.
reperes = REPERES(["MEN-01", "MEN-02", "MEN-03", "MEN-04", "MEN-05", "MEN-06", "MEN-07", "MEN-08", "MEN-09", "MEN-10", "MEN-11", "MEN-12", "MEN-13", "MEN-14", "MEN-15", "MEN-16", "MEN-17", "MEN-18"])
largeurs_mm = LARGEURS_MM([1200, 900, 1800, 1200, 600, 2400, 900, 1500, 1200, 1800, 600, 2100, 1500, 900, 1200, 2400, 1800, 1500])
hauteurs_mm = HAUTEURS_MM([2150, 2150, 2400, 1450, 1450, 2400, 2150, 2400, 1450, 2150, 1450, 2400, 2150, 1450, 2400, 2150, 1450, 2400])
reponse = REPONSE()

# ---- group: ZONE_CORRIGE / DONNÉES FOURNIES (copie)
largeurs_mm_2 = LARGEURS_MM([1200, 900, 1800, 1200, 600, 2400, 900, 1500, 1200, 1800, 600, 2100, 1500, 900, 1200, 2400, 1800, 1500])
hauteurs_mm_2 = HAUTEURS_MM([2150, 2150, 2400, 1450, 1450, 2400, 2150, 2400, 1450, 2150, 1450, 2400, 2150, 1450, 2400, 2150, 1450, 2400])

# ---- group: ZONE_CORRIGE / ÉTAPE 1
# QT-03 · Une nomenclature exportable
# Intermédiaire  —  durée cible 30 min  —  réf. REF-085, REF-086, REF-087  —  v0.5-260902
# ▼  CORRIGÉ — à consulter après validation  ▼
# RAPPEL — copie des données fournies dans la zone sujet, afin qu'aucun câble ne relie les deux zones
# ÉTAPE 1 — Surface de chaque menuiserie, en mètres carrés
# ÉTAPE 2 — Le tableau se construit COLONNE par colonne, jointes par un séparateur. En contexte
# francophone, le point-virgule s'impose : la virgule sert déjà de séparateur décimal, et chaque nombre
# casserait une ligne en deux colonnes
# ÉTAPE 3 — Surface totale : 53,04 m²
# RÉSULTAT — tant que l'interrupteur AFFICHER LE CORRIGÉ reste sur faux, la sortie 1 du Stream Gate est
# vide : rien n'apparaît dans Rhino
multiplication = Multiplication(A=largeurs_mm_2, B=hauteurs_mm_2)
division = Division(A=multiplication, B=1000000)

# ---- group: ZONE_CORRIGE / ÉTAPE 2
panel = Panel("Repere;Largeur;Hauteur;Surface")

# ---- group: ZONE_CORRIGE / ÉTAPE 3
ma = MassAddition(Input=division)  # -> Result, PartialResults
panel_2 = Panel(ma.Result)

# ---- group: ZONE_CORRIGE / AFFICHAGE DU CORRIGÉ
afficher_le_corrigé = BooleanToggle(False)
gate = StreamGate(Stream=ma.Result, Gate=afficher_le_corrigé)  # -> Target0, Target1
reponse_corrige = REPONSE_CORRIGE(gate.Target1)
