# Grasshopper definition QT-04_complet.gh (Grasshopper 1.0.8)

# ---- group: ZONE_SUJET
# Le débit vous est fourni tel qu'il sort de l'atelier : vingt-quatre lignes, dans le désordre,
# où la même référence revient plusieurs fois. Donnez la quantité totale de la référence la plus
# commandée.
references = REFERENCES(["MEL-19-CHENE", "MEL-19-BLANC", "CP-18-BOUL", "MEL-19-CHENE", "MAS-27-HETRE", "CP-18-BOUL", "MEL-19-BLANC", "MDF-22-BRUT", "MEL-19-CHENE", "MAS-27-HETRE", "CP-12-PEUPL", "MDF-22-BRUT", "MEL-19-BLANC", "CP-18-BOUL", "MAS-40-CHENE", "MEL-19-CHENE", "CP-12-PEUPL", "MDF-16-BRUT", "MAS-27-HETRE", "MEL-19-BLANC", "CP-18-BOUL", "MDF-22-BRUT", "MAS-40-CHENE", "MDF-16-BRUT"])
quantites = QUANTITES([4, 6, 2, 3, 5, 7, 2, 8, 6, 1, 4, 3, 5, 1, 2, 2, 6, 4, 3, 4, 5, 2, 6, 3])
reponse = REPONSE()

# ---- group: ZONE_CORRIGE / DONNÉES FOURNIES (copie)
references_2 = REFERENCES(["MEL-19-CHENE", "MEL-19-BLANC", "CP-18-BOUL", "MEL-19-CHENE", "MAS-27-HETRE", "CP-18-BOUL", "MEL-19-BLANC", "MDF-22-BRUT", "MEL-19-CHENE", "MAS-27-HETRE", "CP-12-PEUPL", "MDF-22-BRUT", "MEL-19-BLANC", "CP-18-BOUL", "MAS-40-CHENE", "MEL-19-CHENE", "CP-12-PEUPL", "MDF-16-BRUT", "MAS-27-HETRE", "MEL-19-BLANC", "CP-18-BOUL", "MDF-22-BRUT", "MAS-40-CHENE", "MDF-16-BRUT"])
quantites_2 = QUANTITES([4, 6, 2, 3, 5, 7, 2, 8, 6, 1, 4, 3, 5, 1, 2, 2, 6, 4, 3, 4, 5, 2, 6, 3])

# ---- group: ZONE_CORRIGE / ÉTAPE 1
# QT-04 · Un débit qui devient une commande
# Intermédiaire  —  durée cible 30 min  —  réf. REF-085  —  v0.5-260902
# ▼  CORRIGÉ — à consulter après validation  ▼
# RAPPEL — copie des données fournies dans la zone sujet, afin qu'aucun câble ne relie les deux zones
# ÉTAPE 1 — Établir la liste des références DISTINCTES : vingt-quatre lignes pour huit références
# ÉTAPE 2 — Pour chaque référence, relever à quelles lignes du débit elle apparaît. C'est ce relevé qui
# fait le regroupement — sans lui, on ne peut que trier
# ÉTAPE 3 — Aller chercher les quantités à ces lignes, puis les cumuler référence par référence
# ÉTAPE 4 — Les huit cumuls arrivent en huit BRANCHES distinctes — une par référence — et non en une liste.
# Les aplatir avant de chercher le plus grand : trier huit branches d'un élément chacune ne trie rien du
# tout, et rend les huit cumuls dans leur ordre d'origine
# ÉTAPE 5 — Le plus grand cumul vaut 17. La plus grosse LIGNE unitaire vaut 8, et la référence la plus
# FRÉQUENTE n'est pas celle qui porte le plus gros cumul : trois lectures possibles, trois réponses
# différentes
# RÉSULTAT — tant que l'interrupteur AFFICHER LE CORRIGÉ reste sur faux, la sortie 1 du Stream Gate est
# vide : rien n'apparaît dans Rhino
cset = CreateSet(List=references_2)  # -> Set, Map

# ---- group: ZONE_CORRIGE / ÉTAPE 2
mindex = MemberIndex(Set=references_2, Member=cset.Set)  # -> Index, Count

# ---- group: ZONE_CORRIGE / ÉTAPE 3
item = ListItem(List=quantites_2, Index=mindex.Index, Wrap=True)
ma = MassAddition(Input=item)  # -> Result, PartialResults

# ---- group: ZONE_CORRIGE / ÉTAPE 4
flatten = FlattenTree(Tree=ma.Result, Path="{0}")

# ---- group: ZONE_CORRIGE / ÉTAPE 5
bnd = Bounds(Numbers=flatten)
dedomain = DeconstructDomain(Domain=bnd)  # -> Start, End
panel = Panel(dedomain.End)

# ---- group: ZONE_CORRIGE / AFFICHAGE DU CORRIGÉ
afficher_le_corrigé = BooleanToggle(False)
gate = StreamGate(Stream=dedomain.End, Gate=afficher_le_corrigé)  # -> Target0, Target1
reponse_corrige = REPONSE_CORRIGE(gate.Target1)
