# Grasshopper definition QT-05_complet.gh (Grasshopper 1.0.8)

# ---- group: ZONE_SUJET
# Vous exportez la commande regroupée de l'exercice précédent au format CSV, avec une ligne
# d'en-tête nommant les colonnes. Donnez le nombre de lignes que le fichier doit contenir.
references = REFERENCES(["MEL-19-CHENE", "MEL-19-BLANC", "CP-18-BOUL", "MEL-19-CHENE", "MAS-27-HETRE", "CP-18-BOUL", "MEL-19-BLANC", "MDF-22-BRUT", "MEL-19-CHENE", "MAS-27-HETRE", "CP-12-PEUPL", "MDF-22-BRUT", "MEL-19-BLANC", "CP-18-BOUL", "MAS-40-CHENE", "MEL-19-CHENE", "CP-12-PEUPL", "MDF-16-BRUT", "MAS-27-HETRE", "MEL-19-BLANC", "CP-18-BOUL", "MDF-22-BRUT", "MAS-40-CHENE", "MDF-16-BRUT"])
reponse = REPONSE()

# ---- group: ZONE_CORRIGE / DONNÉES FOURNIES (copie)
references_2 = REFERENCES(["MEL-19-CHENE", "MEL-19-BLANC", "CP-18-BOUL", "MEL-19-CHENE", "MAS-27-HETRE", "CP-18-BOUL", "MEL-19-BLANC", "MDF-22-BRUT", "MEL-19-CHENE", "MAS-27-HETRE", "CP-12-PEUPL", "MDF-22-BRUT", "MEL-19-BLANC", "CP-18-BOUL", "MAS-40-CHENE", "MEL-19-CHENE", "CP-12-PEUPL", "MDF-16-BRUT", "MAS-27-HETRE", "MEL-19-BLANC", "CP-18-BOUL", "MDF-22-BRUT", "MAS-40-CHENE", "MDF-16-BRUT"])

# ---- group: ZONE_CORRIGE / ÉTAPE 1
# QT-05 · Le fichier que le fournisseur va lire
# Intermédiaire  —  durée cible 25 min  —  réf. REF-086, REF-087  —  v0.3-260826
# ▼  CORRIGÉ — à consulter après validation  ▼
# RAPPEL — copie des données fournies dans la zone sujet, afin qu'aucun câble ne relie les deux zones
# ÉTAPE 1 — Le fichier ne porte pas les lignes du débit, mais les références distinctes : une ligne par
# référence
# ÉTAPE 2 — Plus la ligne d'en-tête, qui nomme les colonnes. Neuf lignes en tout. L'oublier fait lire la
# première référence comme un nom de colonne : elle disparaît de la commande, sans erreur ni message
# RÉSULTAT — tant que l'interrupteur AFFICHER LE CORRIGÉ reste sur faux, la sortie 1 du Stream Gate est
# vide : rien n'apparaît dans Rhino
cset = CreateSet(List=references_2)  # -> Set, Map
lng = ListLength(List=cset.Set)

# ---- group: ZONE_CORRIGE / ÉTAPE 2
addition = Addition(A=lng, B=1)
panel = Panel(addition)

# ---- group: ZONE_CORRIGE / AFFICHAGE DU CORRIGÉ
afficher_le_corrigé = BooleanToggle(False)
gate = StreamGate(Stream=addition, Gate=afficher_le_corrigé)  # -> Target0, Target1
reponse_corrige = REPONSE_CORRIGE(gate.Target1)
