# Grasshopper definition QT-06_complet.gh (Grasshopper 1.0.8)

# ---- group: ZONE_SUJET
# Les matériaux reviennent à 4 820,50 €. La pose demande 22,5 heures à 48 € l'heure. La marge est
# de 12 %, la taxe de 10 %. Donnez le montant toutes taxes comprises, en euros.
reponse = REPONSE()
# QT-06 · Du métré au devis
# Intermédiaire  —  durée cible 30 min  —  réf. REF-083  —  v0.3-260826
# ▼  CORRIGÉ — à consulter après validation  ▼
# RAPPEL — copie des données fournies dans la zone sujet, afin qu'aucun câble ne relie les deux zones
# ÉTAPE 1 — La main d'œuvre, puis le déboursé sec : matériaux et pose
# ÉTAPE 2 — La marge s'applique au déboursé sec. L'oublier facturerait 6 490,55 € — un devis parfaitement
# plausible, et à prix coûtant : 778,87 € qui ne rentreront pas
# ÉTAPE 3 — La taxe s'applique ensuite. Marge et taxe étant toutes deux multiplicatives, leur ordre ne
# change rien — c'est l'oubli de l'une qui se voit. 7 269,42 €
# RÉSULTAT — tant que l'interrupteur AFFICHER LE CORRIGÉ reste sur faux, la sortie 1 du Stream Gate est
# vide : rien n'apparaît dans Rhino
materiaux = Slider(4820.5, range=0..20000)
heures = Slider(22.5, range=0..200)
taux_horaire = Slider(48, range=20..120)
marge = Slider(0.12, range=0..0.5)
taxe = Slider(0.1, range=0..0.3)

# ---- group: ZONE_CORRIGE / DONNÉES FOURNIES (copie)
materiaux_2 = Slider(4820.5, range=0..20000)
heures_2 = Slider(22.5, range=0..200)
taux_horaire_2 = Slider(48, range=20..120)
marge_2 = Slider(0.12, range=0..0.5)
taxe_2 = Slider(0.1, range=0..0.3)

# ---- group: ZONE_CORRIGE / ÉTAPE 1
multiplication = Multiplication(A=heures_2, B=taux_horaire_2)
addition = Addition(A=materiaux_2, B=multiplication)

# ---- group: ZONE_CORRIGE / ÉTAPE 2
addition_2 = Addition(A=marge_2, B=1)
multiplication_2 = Multiplication(A=addition, B=addition_2)

# ---- group: ZONE_CORRIGE / ÉTAPE 3
addition_3 = Addition(A=taxe_2, B=1)
multiplication_3 = Multiplication(A=multiplication_2, B=addition_3)
panel = Panel(multiplication_3)

# ---- group: ZONE_CORRIGE / AFFICHAGE DU CORRIGÉ
afficher_le_corrigé = BooleanToggle(False)
gate = StreamGate(Stream=multiplication_3, Gate=afficher_le_corrigé)  # -> Target0, Target1
reponse_corrige = REPONSE_CORRIGE(gate.Target1)
