# Grasshopper definition RH-01_complet.gh (Grasshopper 1.0.8)

# ---- group: ZONE_SUJET
reponse = REPONSE()
# RH-01 · Retrouver un objet perdu de vue
# Débutant  —  durée cible 6 min  —  réf. REF-001, REF-002, REF-003  —  v0.3-260826
# ▼  CORRIGÉ — à consulter après validation  ▼
# ÉTAPE 1 — La bonne réponse est la proposition 0. Le corrigé porte cet indice en clair : le menu du sujet,
# lui, part sur la première proposition, quelle qu'elle soit.
# ÉTAPE 2 — À retenir
# RÉSULTAT — tant que l'interrupteur AFFICHER LE CORRIGÉ reste sur faux, la sortie 1 du Stream Gate est
# vide : rien n'apparaît dans Rhino
# Si le zoom etendue ne montre rien :
# - un calque est masque
# - les objets sont hors du plan de coupe
# - un objet egare tres loin ecrase l'echelle
reponse_qcm = ValueList({"0 - Zoom Étendue — la vue se cadre sur tout ce qui est…": 0, "1 - Zoomer arrière longuement jusqu'à voir quelque chose.": 1, "2 - Recréer une vue depuis le menu.": 2, "3 - Fermer et rouvrir le fichier.": 3}, selected=[])

# ---- group: ZONE_CORRIGE / ÉTAPE 1
bonne_reponse = BONNE_REPONSE(0)

# ---- group: ZONE_CORRIGE / AFFICHAGE DU CORRIGÉ
afficher_le_corrigé = BooleanToggle(False)
gate = StreamGate(Stream=bonne_reponse, Gate=afficher_le_corrigé)  # -> Target0, Target1
reponse_corrige = REPONSE_CORRIGE(gate.Target1)
