# Grasshopper definition RH-02_complet.gh (Grasshopper 1.0.8)

# ---- group: ZONE_SUJET
# Le fichier fourni contient 18 points d'implantation sur un calque unique. Séparez les 12
# porteurs des 6 cloisons sur deux calques distincts, puis faites compter les porteurs par la
# définition — sans les désigner un par un.
points_du_calque_porteurs = POINTS_DU_CALQUE_PORTEURS()
reponse = REPONSE()

# ---- group: ZONE_CORRIGE / ÉTAPE 1
porteurs_de_reference = PORTEURS_DE_REFERENCE([Point(0, 0, 0), Point(5400, 0, 0), Point(10800, 0, 0), Point(16200, 0, 0), Point(0, 6200, 0), Point(5400, 6200, 0), Point(10800, 6200, 0), Point(16200, 6200, 0), Point(0, 12400, 0), Point(5400, 12400, 0), Point(10800, 12400, 0), Point(16200, 12400, 0)])

# ---- group: ZONE_CORRIGE / ÉTAPE 2
# RH-02 · Reprendre une implantation par son calque
# Débutant  —  durée cible 15 min  —  réf. REF-004, REF-006, REF-014  —  v0.3-260826
# ▼  CORRIGÉ — à consulter après validation  ▼
# ÉTAPE 1 — L'étalon : les douze porteurs, tels qu'ils doivent rester une fois les six cloisons écartées
# sur leur propre calque
# ÉTAPE 2 — Compter ne demande qu'un composant. Toute la difficulté est en amont, dans Rhino : ce qui est
# compté doit venir d'un CALQUE et non d'une sélection, sans quoi le compte cesse de suivre dès la
# prochaine livraison du géomètre
# RÉSULTAT — tant que l'interrupteur AFFICHER LE CORRIGÉ reste sur faux, la sortie 1 du Stream Gate est
# vide : rien n'apparaît dans Rhino
lng = ListLength(List=porteurs_de_reference)
panel = Panel(lng)

# ---- group: ZONE_CORRIGE / AFFICHAGE DU CORRIGÉ
afficher_le_corrigé = BooleanToggle(False)
gate = StreamGate(Stream=lng, Gate=afficher_le_corrigé)  # -> Target0, Target1
reponse_corrige = REPONSE_CORRIGE(gate.Target1)
