# Grasshopper definition RH-03_complet.gh (Grasshopper 1.0.8)

# ---- group: ZONE_SUJET
# L'emprise de la terrasse mesure 4 200 mm sur 3 000 mm. Posez un plot cylindrique de 100 mm de
# diamètre à chaque nœud d'une trame de 600 mm, le premier au coin d'origine. Donnez le nombre de
# plots.
centres_des_plots = CENTRES_DES_PLOTS()
reponse = REPONSE()

# ---- group: ZONE_CORRIGE / ÉTAPE 1
plots_de_reference = PLOTS_DE_REFERENCE([Point(0, 0, 0), Point(600, 0, 0), Point(1200, 0, 0), Point(1800, 0, 0), Point(2400, 0, 0), Point(3000, 0, 0)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])

# ---- group: ZONE_CORRIGE / ÉTAPE 2
# RH-03 · Une trame de plots posée dans Rhino
# Débutant  —  durée cible 20 min  —  réf. REF-007, REF-008, REF-013  —  v0.5-260902
# ▼  CORRIGÉ — à consulter après validation  ▼
# ÉTAPE 1 — L'étalon : huit positions en longueur, six en largeur. 4 200 ÷ 600 vaut 7 intervalles, donc 8
# nœuds. C'est là que se joue l'exercice — et un angle de terrasse sans appui avec
# ÉTAPE 2 — 48 plots : six rangées de huit
# RÉSULTAT — tant que l'interrupteur AFFICHER LE CORRIGÉ reste sur faux, la sortie 1 du Stream Gate est
# vide : rien n'apparaît dans Rhino
lng = ListLength(List=plots_de_reference)
panel = Panel(lng)

# ---- group: ZONE_CORRIGE / AFFICHAGE DU CORRIGÉ
afficher_le_corrigé = BooleanToggle(False)
gate = StreamGate(Stream=lng, Gate=afficher_le_corrigé)  # -> Target0, Target1
reponse_corrige = REPONSE_CORRIGE(gate.Target1)
