# Grasshopper definition RH-04_complet.gh (Grasshopper 1.0.8)

# ---- group: ZONE_SUJET
# Le relevé fournit la ligne au sol du bardage. Produisez la surface du bardage en la montant de
# 2 800 mm à la verticale, puis donnez sa surface en mètres carrés.
ligne_au_sol = LIGNE_AU_SOL()
reponse = REPONSE()

# ---- group: ZONE_CORRIGE / ÉTAPE 1
ligne_de_reference = LIGNE_DE_REFERENCE(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)

# ---- group: ZONE_CORRIGE / ÉTAPE 2
hauteur_de_bardage = HAUTEUR_DE_BARDAGE(2800)
# RH-04 · Du profil à la surface
# Débutant  —  durée cible 20 min  —  réf. REF-009, REF-010, REF-011  —  v0.5-260902
# ▼  CORRIGÉ — à consulter après validation  ▼
# ÉTAPE 1 — L'étalon : la ligne au sol du relevé, telle que le géomètre la livre — une courbe dont le rayon
# change tout au long du tracé
# ÉTAPE 2 — La direction de montée est VERTICALE, et vaut 2 800 mm. C'est un vecteur explicite, non la
# normale de la courbe : sur un tracé dont la courbure varie, suivre la normale donnerait une nappe gauche,
# voisine à l'œil et fausse au métré
# ÉTAPE 3 — L'aire vient en millimètres carrés : la ramener au mètre carré est le dernier geste, et le plus
# souvent oublié. 31,24 m²
# RÉSULTAT — tant que l'interrupteur AFFICHER LE CORRIGÉ reste sur faux, la sortie 1 du Stream Gate est
# vide : rien n'apparaît dans Rhino
Z = UnitZ(Factor=hauteur_de_bardage)
extr = Extrude(Base=ligne_de_reference, Direction=Z)

# ---- group: ZONE_CORRIGE / ÉTAPE 3
area = Area(Geometry=extr)  # -> Area, Centroid
division = Division(A=area.Area, B=1000000)
panel = Panel(division)

# ---- group: ZONE_CORRIGE / AFFICHAGE DU CORRIGÉ
afficher_le_corrigé = BooleanToggle(False)
gate = StreamGate(Stream=division, Gate=afficher_le_corrigé)  # -> Target0, Target1
reponse_corrige = REPONSE_CORRIGE(gate.Target1)
