# Grasshopper definition RH-05_complet.gh (Grasshopper 1.0.8)

# ---- group: ZONE_SUJET
# La platine mesure 300 × 200 × 15 mm. Percez-la de quatre trous traversants de 18 mm de
# diamètre, centrés à 40 mm de chaque bord. Donnez le volume de matière retirée, en millimètres
# cubes.
platine_percee = PLATINE_PERCEE()
reponse = REPONSE()

# ---- group: ZONE_CORRIGE / ÉTAPE 1
platine_pleine = PLATINE_PLEINE(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)

# ---- group: ZONE_CORRIGE / ÉTAPE 2
percages = PERCAGES([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])

# ---- group: ZONE_CORRIGE / ÉTAPE 3
# RH-05 · Percer une platine dans Rhino
# Débutant  —  durée cible 15 min  —  réf. REF-012  —  v0.3-260826
# ▼  CORRIGÉ — à consulter après validation  ▼
# ÉTAPE 1 — L'étalon : la platine pleine, 300 × 200 × 15 mm
# ÉTAPE 2 — Les quatre perçages, Ø 18 mm. Ils DÉPASSENT de la platine, de part et d'autre : deux faces
# coplanaires ne se coupent pas proprement, et la booléenne échouerait sur des cylindres posés à fleur
# ÉTAPE 3 — Percer, puis mesurer les deux volumes
# ÉTAPE 4 — La matière retirée est la DIFFÉRENCE des deux volumes, non le volume des cylindres : ceux-ci
# dépassent, et les compter entiers donnerait 25 447 mm³ au lieu de 15 268
# RÉSULTAT — tant que l'interrupteur AFFICHER LE CORRIGÉ reste sur faux, la sortie 1 du Stream Gate est
# vide : rien n'apparaît dans Rhino
sdiff = SolidDifference(BrepsA=platine_pleine, BrepsB=percages)
volume = Volume(Geometry=platine_pleine)  # -> Volume, Centroid
volume_2 = Volume(Geometry=sdiff)  # -> Volume, Centroid

# ---- group: ZONE_CORRIGE / ÉTAPE 4
subtraction = Subtraction(A=volume.Volume, B=volume_2.Volume)
panel = Panel(subtraction)

# ---- group: ZONE_CORRIGE / AFFICHAGE DU CORRIGÉ
afficher_le_corrigé = BooleanToggle(False)
gate = StreamGate(Stream=subtraction, Gate=afficher_le_corrigé)  # -> Target0, Target1
reponse_corrige = REPONSE_CORRIGE(gate.Target1)
