# Grasshopper definition RH-06_complet.gh (Grasshopper 1.0.8)

# ---- group: ZONE_SUJET
reponse = REPONSE()
# RH-06 · Groupe ou bloc ?
# Débutant  —  durée cible 6 min  —  réf. REF-005  —  v0.3-260826
# ▼  CORRIGÉ — à consulter après validation  ▼
# ÉTAPE 1 — La bonne réponse est la proposition 3. Le corrigé porte cet indice en clair : le menu du sujet,
# lui, part sur la première proposition, quelle qu'elle soit.
# ÉTAPE 2 — À retenir
# RÉSULTAT — tant que l'interrupteur AFFICHER LE CORRIGÉ reste sur faux, la sortie 1 du Stream Gate est
# vide : rien n'apparaît dans Rhino
# Groupe   : rassemble une selection.
#            Modifier = reprendre chaque copie.
# 
# Bloc     : une definition, N instances.
#            Modifier la definition met tout a jour.
reponse_qcm = ValueList({"0 - Un groupe : il rassemble les objets, c'est fait pour ça.": 0, "1 - Les deux se valent, c'est une affaire d'habitude.": 1, "2 - Ni l'un ni l'autre, il faut un calque par module.": 2, "3 - Un bloc : modifier sa définition met à jour les quarante…": 3}, selected=[])

# ---- group: ZONE_CORRIGE / ÉTAPE 1
bonne_reponse = BONNE_REPONSE(3)

# ---- group: ZONE_CORRIGE / AFFICHAGE DU CORRIGÉ
afficher_le_corrigé = BooleanToggle(False)
gate = StreamGate(Stream=bonne_reponse, Gate=afficher_le_corrigé)  # -> Target0, Target1
reponse_corrige = REPONSE_CORRIGE(gate.Target1)
