# Grasshopper definition RH-07_complet.gh (Grasshopper 1.0.8)

# ---- group: ZONE_SUJET
reponse = REPONSE()
# RH-07 · Le fichier au mauvais millimètre
# Débutant  —  durée cible 7 min  —  réf. REF-015, REF-017  —  v0.5-260902
# ▼  CORRIGÉ — à consulter après validation  ▼
# ÉTAPE 1 — La bonne réponse est la proposition 1. Le corrigé porte cet indice en clair : le menu du sujet,
# lui, part sur la première proposition, quelle qu'elle soit.
# ÉTAPE 2 — À retenir
# RÉSULTAT — tant que l'interrupteur AFFICHER LE CORRIGÉ reste sur faux, la sortie 1 du Stream Gate est
# vide : rien n'apparaît dans Rhino
# Changer l'unite du document ne met PAS
# le modele a l'echelle : c'est un choix
# explicite, propose separement.
# 
# La tolerance absolue suit l'unite : la
# revoir apres toute mise a l'echelle.
reponse_qcm = ValueList({"0 - Mettre le modèle à l'échelle 1000.": 0, "1 - Vérifier d'abord l'unité du document : il a sans doute…": 1, "2 - Changer l'unité du document, ce qui remet tout d'aplomb…": 2, "3 - Redemander le fichier.": 3}, selected=[])

# ---- group: ZONE_CORRIGE / ÉTAPE 1
bonne_reponse = BONNE_REPONSE(1)

# ---- group: ZONE_CORRIGE / AFFICHAGE DU CORRIGÉ
afficher_le_corrigé = BooleanToggle(False)
gate = StreamGate(Stream=bonne_reponse, Gate=afficher_le_corrigé)  # -> Target0, Target1
reponse_corrige = REPONSE_CORRIGE(gate.Target1)
