# Grasshopper definition RH-08_complet.gh (Grasshopper 1.0.8)

# ---- group: ZONE_SUJET
# Le caisson fourni paraît fermé mais ne l'est pas. Trouvez ce qui l'empêche, réparez-le, et
# donnez son volume une fois étanche, en millimètres cubes.
caisson_a_refermer = CAISSON_A_REFERMER()
reponse = REPONSE()

# ---- group: ZONE_CORRIGE / ÉTAPE 1
caisson_ouvert = CAISSON_OUVERT(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)

# ---- group: ZONE_CORRIGE / ÉTAPE 2
# RH-08 · Un caisson vraiment fermé
# Débutant  —  durée cible 25 min  —  réf. REF-019, REF-020, REF-021, REF-022, REF-023  —  v0.5-260902
# ▼  CORRIGÉ — à consulter après validation  ▼
# ÉTAPE 1 — L'étalon : le caisson tel qu'il est livré, deux faces manquantes. À l'écran, rien ne le
# distingue d'un solide
# ÉTAPE 2 — Refermer les ouvertures planes
# ÉTAPE 3 — Le volume EST la preuve : une enveloppe ouverte n'en a pas. 19 656 000 mm³ une fois fermée.
# Mesurer avant de refermer rend bien une valeur — et elle ne veut rien dire
# RÉSULTAT — tant que l'interrupteur AFFICHER LE CORRIGÉ reste sur faux, la sortie 1 du Stream Gate est
# vide : rien n'apparaît dans Rhino
cap = CapHoles(Brep=caisson_ouvert)

# ---- group: ZONE_CORRIGE / ÉTAPE 3
volume = Volume(Geometry=cap)  # -> Volume, Centroid
panel = Panel(volume.Volume)

# ---- group: ZONE_CORRIGE / AFFICHAGE DU CORRIGÉ
afficher_le_corrigé = BooleanToggle(False)
gate = StreamGate(Stream=volume.Volume, Gate=afficher_le_corrigé)  # -> Target0, Target1
reponse_corrige = REPONSE_CORRIGE(gate.Target1)
