# Grasshopper definition RH-09_complet.gh (Grasshopper 1.0.8)

# ---- group: ZONE_SUJET
# La pièce fournie doit passer sur cette machine. Établissez le facteur d'échelle maximal qui la
# fait tenir dans le volume d'impression, arrondi au centième inférieur, et donnez-le.
piece_a_imprimer = PIECE_A_IMPRIMER()
reponse = REPONSE()
# RH-09 · Une pièce imprimable
# Débutant  —  durée cible 20 min  —  réf. REF-016, REF-018  —  v0.3-260826
# ▼  CORRIGÉ — à consulter après validation  ▼
# RAPPEL — copie des données fournies dans la zone sujet, afin qu'aucun câble ne relie les deux zones
# ÉTAPE 1 — L'étalon : la pièce, 380 × 260 × 195 mm hors tout
# ÉTAPE 2 — Encadrer la pièce, puis en extraire la LONGUEUR selon X. L'encadrement rend des intervalles,
# non des nombres : il faut les décomposer, sinon on divise une cote par un domaine et le résultat n'a pas
# de sens
# ÉTAPE 3 — Un rapport par axe : 220÷380 = 0,579, 220÷260 = 0,846, 250÷195 = 1,282. Le troisième passerait
# sans réduction ; prendre la moyenne donnerait 0,90 et la pièce ne rentrerait pas. C'est le plus PETIT qui
# commande
# ÉTAPE 4 — Arrondi VERS LE BAS au centième : 0,57. Au plus proche on obtiendrait 0,58, et la pièce
# dépasserait — ce que la machine découvre après trois heures d'impression, pas avant
# RÉSULTAT — tant que l'interrupteur AFFICHER LE CORRIGÉ reste sur faux, la sortie 1 du Stream Gate est
# vide : rien n'apparaît dans Rhino
# 0.579  /  0.846  /  1.282
# le plus PETIT commande
plateau_x = Slider(220, range=100..400)

# ---- group: ZONE_CORRIGE / ÉTAPE 1
piece_de_reference = PIECE_DE_REFERENCE(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)

# ---- group: ZONE_CORRIGE / DONNÉES FOURNIES (copie)
plateau_x_2 = Slider(220, range=100..400)

# ---- group: ZONE_CORRIGE / ÉTAPE 2
bbox = BoundingBox(Content=piece_de_reference, Plane=PlaneXY(0, 0, 0))  # -> Box, Box_2
debox = DeconstructBox(Box=bbox.Box)  # -> Plane, X, Y, Z
dedomain = DeconstructDomain(Domain=debox.X)  # -> Start, End
subtraction = Subtraction(A=dedomain.End, B=dedomain.Start)

# ---- group: ZONE_CORRIGE / ÉTAPE 4
division = Division(A=plateau_x_2, B=subtraction)
multiplication = Multiplication(A=division, B=100)
round = Round(Number=multiplication)  # -> Nearest, Floor, Ceiling
division_2 = Division(A=round.Floor, B=100)
panel = Panel(division_2)

# ---- group: ZONE_CORRIGE / AFFICHAGE DU CORRIGÉ
afficher_le_corrigé = BooleanToggle(False)
gate = StreamGate(Stream=division_2, Gate=afficher_le_corrigé)  # -> Target0, Target1
reponse_corrige = REPONSE_CORRIGE(gate.Target1)
