# Grasshopper definition RH-10_complet.gh (Grasshopper 1.0.8)

# ---- group: ZONE_SUJET
reponse = REPONSE()
# RH-10 · Ce que l'export STL perd
# Débutant  —  durée cible 7 min  —  réf. REF-024  —  v0.5-260902
# ▼  CORRIGÉ — à consulter après validation  ▼
# ÉTAPE 1 — La bonne réponse est la proposition 0. Le corrigé porte cet indice en clair : le menu du sujet,
# lui, part sur la première proposition, quelle qu'elle soit.
# ÉTAPE 2 — À retenir
# RÉSULTAT — tant que l'interrupteur AFFICHER LE CORRIGÉ reste sur faux, la sortie 1 du Stream Gate est
# vide : rien n'apparaît dans Rhino
# STL et OBJ ne connaissent que des
# triangles. La finesse du maillage est un
# reglage de l'export, pas une propriete
# de la machine.
reponse_qcm = ValueList({"0 - Le format STL ne connaît que des triangles : la…": 0, "1 - L'imprimante n'est pas assez précise.": 1, "2 - Le fichier a été enregistré en basse résolution.": 2, "3 - Il fallait exporter en OBJ.": 3}, selected=[])

# ---- group: ZONE_CORRIGE / ÉTAPE 1
bonne_reponse = BONNE_REPONSE(0)

# ---- group: ZONE_CORRIGE / AFFICHAGE DU CORRIGÉ
afficher_le_corrigé = BooleanToggle(False)
gate = StreamGate(Stream=bonne_reponse, Gate=afficher_le_corrigé)  # -> Target0, Target1
reponse_corrige = REPONSE_CORRIGE(gate.Target1)
