# Grasshopper definition RH-11_complet.gh (Grasshopper 1.0.8)

# ---- group: ZONE_SUJET
# Le fichier contient cinquante objets, dont les coordonnées vous sont fournies. Donnez l'étendue
# du fichier selon X, en mètres.
objets_du_fichier = OBJETS_DU_FICHIER([Point(0, 0, 0), Point(1200, 0, 0), Point(2400, 0, 0), Point(3600, 0, 0), Point(4800, 0, 0), Point(6000, 0, 0)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])
reponse = REPONSE()

# ---- group: ZONE_CORRIGE / DONNÉES FOURNIES (copie)
objets_du_fichier_2 = OBJETS_DU_FICHIER([Point(0, 0, 0), Point(1200, 0, 0), Point(2400, 0, 0), Point(3600, 0, 0), Point(4800, 0, 0), Point(6000, 0, 0)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])

# ---- group: ZONE_CORRIGE / ÉTAPE 1
# RH-11 · Ce que le zoom étendue vous apprend
# Débutant  —  durée cible 15 min  —  réf. REF-001, REF-002, REF-003  —  v0.3-260826
# ▼  CORRIGÉ — à consulter après validation  ▼
# RAPPEL — copie des données fournies dans la zone sujet, afin qu'aucun câble ne relie les deux zones
# ÉTAPE 1 — Ne garder que l'abscisse de chaque objet : c'est selon X que l'étendue est demandée
# ÉTAPE 2 — Les bornes de la liste — et non celles de ce que l'écran montre. Deux objets suffisent à les
# fixer
# ÉTAPE 3 — L'étendue est la différence des bornes : 6 050 000 mm, soit 6 050 m. Le bâtiment, lui, tient
# dans 8,4 m — un sept-centième de ce que le zoom étendue doit cadrer
# RÉSULTAT — tant que l'interrupteur AFFICHER LE CORRIGÉ reste sur faux, la sortie 1 du Stream Gate est
# vide : rien n'apparaît dans Rhino
pdecon = Deconstruct(Point=objets_du_fichier_2)  # -> XComponent, YComponent, ZComponent

# ---- group: ZONE_CORRIGE / ÉTAPE 2
bnd = Bounds(Numbers=pdecon.XComponent)
dedomain = DeconstructDomain(Domain=bnd)  # -> Start, End

# ---- group: ZONE_CORRIGE / ÉTAPE 3
subtraction = Subtraction(A=dedomain.End, B=dedomain.Start)
division = Division(A=subtraction, B=1000)
panel = Panel(division)

# ---- group: ZONE_CORRIGE / AFFICHAGE DU CORRIGÉ
afficher_le_corrigé = BooleanToggle(False)
gate = StreamGate(Stream=division, Gate=afficher_le_corrigé)  # -> Target0, Target1
reponse_corrige = REPONSE_CORRIGE(gate.Target1)
