# Grasshopper definition RH-12_complet.gh (Grasshopper 1.0.8)

# ---- group: ZONE_SUJET
# Les altitudes des trente objets vous sont fournies. Donnez le nombre d'objets qui dépassent
# strictement le niveau de 2 800 mm.
altitudes = ALTITUDES([180, 2650, 2810, 940, 3120, 2795, 4400, 2800, 1220, 3980, 2799, 5100, 2801, 760, 3450, 2790, 6200, 2820, 1580, 2808, 4720, 2788, 3300, 2812, 990, 5600, 2802, 3900, 2796, 2830])
seuil = SEUIL(2800)
reponse = REPONSE()

# ---- group: ZONE_CORRIGE / DONNÉES FOURNIES (copie)
altitudes_2 = ALTITUDES([180, 2650, 2810, 940, 3120, 2795, 4400, 2800, 1220, 3980, 2799, 5100, 2801, 760, 3450, 2790, 6200, 2820, 1580, 2808, 4720, 2788, 3300, 2812, 990, 5600, 2802, 3900, 2796, 2830])
seuil_2 = SEUIL(2800)

# ---- group: ZONE_CORRIGE / ÉTAPE 1
# RH-12 · Ce qui dépasse le niveau
# Débutant  —  durée cible 15 min  —  réf. REF-002  —  v0.5-260902
# ▼  CORRIGÉ — à consulter après validation  ▼
# RAPPEL — copie des données fournies dans la zone sujet, afin qu'aucun câble ne relie les deux zones
# ÉTAPE 1 — Comparer chaque altitude au niveau. La sortie retenue est la comparaison STRICTE : c'est ce que
# la consigne demande, et l'objet posé exactement à 2 800 en dépend
# ÉTAPE 2 — Retenir les objets qui dépassent, puis les compter : 17. En comptant « supérieur ou égal », on
# en trouverait 18
# RÉSULTAT — tant que l'interrupteur AFFICHER LE CORRIGÉ reste sur faux, la sortie 1 du Stream Gate est
# vide : rien n'apparaît dans Rhino
larger = LargerThan(FirstNumber=altitudes_2, SecondNumber=seuil_2)  # -> LargerThan, OrEqualTo

# ---- group: ZONE_CORRIGE / ÉTAPE 2
cull = CullPattern(List=altitudes_2, CullPattern=larger.LargerThan)
lng = ListLength(List=cull)
panel = Panel(lng)

# ---- group: ZONE_CORRIGE / AFFICHAGE DU CORRIGÉ
afficher_le_corrigé = BooleanToggle(False)
gate = StreamGate(Stream=lng, Gate=afficher_le_corrigé)  # -> Target0, Target1
reponse_corrige = REPONSE_CORRIGE(gate.Target1)
