# Grasshopper definition RH-13_complet.gh (Grasshopper 1.0.8)

# ---- group: ZONE_SUJET
# Les huit calques vous sont fournis avec leur état et le nombre d'objets de chacun. Donnez le
# nombre d'objets actuellement VISIBLES.
calque_allume = CALQUE_ALLUME([False, True, True, True, False, True, False, False])
objets_par_calque = OBJETS_PAR_CALQUE([12, 34, 58, 21, 47, 63, 9, 26])
reponse = REPONSE()

# ---- group: ZONE_CORRIGE / DONNÉES FOURNIES (copie)
calque_allume_2 = CALQUE_ALLUME([False, True, True, True, False, True, False, False])
objets_par_calque_2 = OBJETS_PAR_CALQUE([12, 34, 58, 21, 47, 63, 9, 26])

# ---- group: ZONE_CORRIGE / ÉTAPE 1
# RH-13 · Ce que le fichier contient vraiment
# Débutant  —  durée cible 15 min  —  réf. REF-006, REF-004  —  v0.5-260902
# ▼  CORRIGÉ — à consulter après validation  ▼
# RAPPEL — copie des données fournies dans la zone sujet, afin qu'aucun câble ne relie les deux zones
# ÉTAPE 1 — Ne retenir que les calques allumés
# ÉTAPE 2 — Sommer leurs objets : 176 visibles. Le fichier en contient 270 — les 94 autres partiront chez
# le destinataire sans que personne les ait vus, dont d'anciens relevés
# RÉSULTAT — tant que l'interrupteur AFFICHER LE CORRIGÉ reste sur faux, la sortie 1 du Stream Gate est
# vide : rien n'apparaît dans Rhino
cull = CullPattern(List=objets_par_calque_2, CullPattern=calque_allume_2)

# ---- group: ZONE_CORRIGE / ÉTAPE 2
ma = MassAddition(Input=cull)  # -> Result, PartialResults
panel = Panel(ma.Result)

# ---- group: ZONE_CORRIGE / AFFICHAGE DU CORRIGÉ
afficher_le_corrigé = BooleanToggle(False)
gate = StreamGate(Stream=ma.Result, Gate=afficher_le_corrigé)  # -> Target0, Target1
reponse_corrige = REPONSE_CORRIGE(gate.Target1)
