# Grasshopper definition RH-14_complet.gh (Grasshopper 1.0.8)

# ---- group: ZONE_SUJET
# La trame compte huit plots en longueur et six en largeur, au pas de 1 200 mm. La trémie en
# supprime trois en longueur et deux en largeur. Donnez le nombre de plots.
reponse = REPONSE()
# RH-14 · La trame percée d'une trémie
# Débutant  —  durée cible 20 min  —  réf. REF-013, REF-008  —  v0.5-260902
# ▼  CORRIGÉ — à consulter après validation  ▼
# RAPPEL — copie des données fournies dans la zone sujet, afin qu'aucun câble ne relie les deux zones
# ÉTAPE 1 — La trame complète : 8 × 6 = 48 plots
# ÉTAPE 2 — La trémie retire un RECTANGLE de plots : 3 × 2 = 6, et non 3 + 2 = 5. Le plot qu'on aurait
# oublié de retirer se retrouve au milieu de l'escalier
# ÉTAPE 3 — 42 plots
# RÉSULTAT — tant que l'interrupteur AFFICHER LE CORRIGÉ reste sur faux, la sortie 1 du Stream Gate est
# vide : rien n'apparaît dans Rhino
plots_en_longueur = Slider(8, range=2..20)
plots_en_largeur = Slider(6, range=2..20)
tremie_en_longueur = Slider(3, range=0..10)
tremie_en_largeur = Slider(2, range=0..10)

# ---- group: ZONE_CORRIGE / DONNÉES FOURNIES (copie)
plots_en_longueur_2 = Slider(8, range=2..20)
plots_en_largeur_2 = Slider(6, range=2..20)
tremie_en_longueur_2 = Slider(3, range=0..10)
tremie_en_largeur_2 = Slider(2, range=0..10)

# ---- group: ZONE_CORRIGE / ÉTAPE 1
multiplication = Multiplication(A=plots_en_longueur_2, B=plots_en_largeur_2)

# ---- group: ZONE_CORRIGE / ÉTAPE 2
multiplication_2 = Multiplication(A=tremie_en_longueur_2, B=tremie_en_largeur_2)

# ---- group: ZONE_CORRIGE / ÉTAPE 3
subtraction = Subtraction(A=multiplication, B=multiplication_2)
panel = Panel(subtraction)

# ---- group: ZONE_CORRIGE / AFFICHAGE DU CORRIGÉ
afficher_le_corrigé = BooleanToggle(False)
gate = StreamGate(Stream=subtraction, Gate=afficher_le_corrigé)  # -> Target0, Target1
reponse_corrige = REPONSE_CORRIGE(gate.Target1)
