# Grasshopper definition RH-15_complet.gh (Grasshopper 1.0.8)

# ---- group: ZONE_SUJET
# Les six sommets du cheminement vous sont fournis. Donnez sa longueur développée, en
# millimètres.
sommets_du_cheminement = SOMMETS_DU_CHEMINEMENT([Point(0, 0, 0), Point(2400, 0, 0), Point(2400, 1800, 0), Point(5600, 1800, 0), Point(5600, 4300, 0), Point(9100, 4300, 0)])
reponse = REPONSE()

# ---- group: ZONE_CORRIGE / DONNÉES FOURNIES (copie)
sommets_du_cheminement_2 = SOMMETS_DU_CHEMINEMENT([Point(0, 0, 0), Point(2400, 0, 0), Point(2400, 1800, 0), Point(5600, 1800, 0), Point(5600, 4300, 0), Point(9100, 4300, 0)])

# ---- group: ZONE_CORRIGE / ÉTAPE 1
# RH-15 · Le développé d'un cheminement
# Débutant  —  durée cible 20 min  —  réf. REF-009  —  v0.5-260902
# ▼  CORRIGÉ — à consulter après validation  ▼
# RAPPEL — copie des données fournies dans la zone sujet, afin qu'aucun câble ne relie les deux zones
# ÉTAPE 1 — Relier les sommets dans l'ordre, sans refermer : la consigne ne le demande pas, et refermer
# ajouterait la corde de retour
# ÉTAPE 2 — Mesurer la COURBE, et non la distance entre ses extrémités. 13 400 mm développés contre 10 065
# mm de corde : 3,3 m de garde-corps qui manqueraient à la livraison
# RÉSULTAT — tant que l'interrupteur AFFICHER LE CORRIGÉ reste sur faux, la sortie 1 du Stream Gate est
# vide : rien n'apparaît dans Rhino
pline = PolyLine(Vertices=sommets_du_cheminement_2, Closed=False)

# ---- group: ZONE_CORRIGE / ÉTAPE 2
len = Length(Curve=pline)
panel = Panel(len)

# ---- group: ZONE_CORRIGE / AFFICHAGE DU CORRIGÉ
afficher_le_corrigé = BooleanToggle(False)
gate = StreamGate(Stream=len, Gate=afficher_le_corrigé)  # -> Target0, Target1
reponse_corrige = REPONSE_CORRIGE(gate.Target1)
