# Grasshopper definition RH-16_complet.gh (Grasshopper 1.0.8)

# ---- group: ZONE_SUJET
# L'appentis mesure 8 400 mm de long, 3 200 mm de profondeur en projection, pour un dénivelé de 1
# 500 mm. Donnez la surface de couverture à commander, en mètres carrés.
reponse = REPONSE()
# RH-16 · La surface d'un rampant
# Débutant  —  durée cible 20 min  —  réf. REF-010, REF-011  —  v0.5-260902
# ▼  CORRIGÉ — à consulter après validation  ▼
# RAPPEL — copie des données fournies dans la zone sujet, afin qu'aucun câble ne relie les deux zones
# ÉTAPE 1 — Le rampant est l'hypoténuse : la projection et le dénivelé en sont les côtés. 3 534 mm pour 3
# 200 de projection
# ÉTAPE 2 — L'aire se mesure DANS le plan du rampant : 29,69 m². Prendre la projection donnerait 26,88 m²,
# soit 10 % de moins — de quoi arrêter le chantier à trois rangs de la faîtière
# RÉSULTAT — tant que l'interrupteur AFFICHER LE CORRIGÉ reste sur faux, la sortie 1 du Stream Gate est
# vide : rien n'apparaît dans Rhino
longueur = Slider(8400, range=1000..20000)
profondeur_en_projection = Slider(3200, range=500..10000)
denivele = Slider(1500, range=0..5000)

# ---- group: ZONE_CORRIGE / DONNÉES FOURNIES (copie)
longueur_2 = Slider(8400, range=1000..20000)
profondeur_en_projection_2 = Slider(3200, range=500..10000)
denivele_2 = Slider(1500, range=0..5000)

# ---- group: ZONE_CORRIGE / ÉTAPE 1
multiplication = Multiplication(A=profondeur_en_projection_2, B=profondeur_en_projection_2)
multiplication_2 = Multiplication(A=denivele_2, B=denivele_2)
addition = Addition(A=multiplication, B=multiplication_2)
sqrt = SquareRoot(Value=addition)

# ---- group: ZONE_CORRIGE / ÉTAPE 2
multiplication_3 = Multiplication(A=longueur_2, B=sqrt)
division = Division(A=multiplication_3, B=1000000)
panel = Panel(division)

# ---- group: ZONE_CORRIGE / AFFICHAGE DU CORRIGÉ
afficher_le_corrigé = BooleanToggle(False)
gate = StreamGate(Stream=division, Gate=afficher_le_corrigé)  # -> Target0, Target1
reponse_corrige = REPONSE_CORRIGE(gate.Target1)
