# Grasshopper definition RH-17_complet.gh (Grasshopper 1.0.8)

# ---- group: ZONE_SUJET
# Le premier massif mesure 400 × 300 × 200 mm, le second 250 × 350 × 180 mm, et leur recouvrement
# 150 × 200 × 180 mm. Donnez le volume de béton, en décimètres cubes.
massif_a = MASSIF_A([400, 300, 200])
massif_b = MASSIF_B([250, 350, 180])
recouvrement = RECOUVREMENT([150, 200, 180])
reponse = REPONSE()

# ---- group: ZONE_CORRIGE / DONNÉES FOURNIES (copie)
massif_a_2 = MASSIF_A([400, 300, 200])
massif_b_2 = MASSIF_B([250, 350, 180])
recouvrement_2 = RECOUVREMENT([150, 200, 180])

# ---- group: ZONE_CORRIGE / ÉTAPE 1
# RH-17 · Le volume de deux blocs qui se recouvrent
# Débutant  —  durée cible 20 min  —  réf. REF-012  —  v0.5-260902
# ▼  CORRIGÉ — à consulter après validation  ▼
# RAPPEL — copie des données fournies dans la zone sujet, afin qu'aucun câble ne relie les deux zones
# ÉTAPE 1 — Le volume de chaque parallélépipède est le produit de ses trois dimensions — un produit cumulé
# sur la liste
# ÉTAPE 2 — La réunion additionne les deux massifs puis retranche UNE FOIS leur partie commune.
# L'additionner sans retrancher la compterait deux fois : 5,4 dm³ de béton commandés pour rien
# ÉTAPE 3 — 34,35 dm³, contre 39,75 si l'on additionne
# RÉSULTAT — tant que l'interrupteur AFFICHER LE CORRIGÉ reste sur faux, la sortie 1 du Stream Gate est
# vide : rien n'apparaît dans Rhino
mm = MassMultiplication(Input=massif_a_2)  # -> Result, PartialResults
mm_2 = MassMultiplication(Input=massif_b_2)  # -> Result, PartialResults
mm_3 = MassMultiplication(Input=recouvrement_2)  # -> Result, PartialResults

# ---- group: ZONE_CORRIGE / ÉTAPE 2
addition = Addition(A=mm.Result, B=mm_2.Result)
subtraction = Subtraction(A=addition, B=mm_3.Result)

# ---- group: ZONE_CORRIGE / ÉTAPE 3
division = Division(A=subtraction, B=1000000)
panel = Panel(division)

# ---- group: ZONE_CORRIGE / AFFICHAGE DU CORRIGÉ
afficher_le_corrigé = BooleanToggle(False)
gate = StreamGate(Stream=division, Gate=afficher_le_corrigé)  # -> Target0, Target1
reponse_corrige = REPONSE_CORRIGE(gate.Target1)
