# Grasshopper definition RH-18_complet.gh (Grasshopper 1.0.8)

# ---- group: ZONE_SUJET
# Les quatorze épaisseurs de paroi relevées sur la pièce vous sont fournies. Donnez le nombre de
# parois strictement inférieures au minimum imprimable de 1,2 mm.
epaisseurs_de_paroi = EPAISSEURS_DE_PAROI([2.4, 1.8, 0.9, 3.2, 1.1, 2, 0.75, 1.6, 2.8, 1.2, 0.95, 4.1, 1.15, 2.2])
seuil = SEUIL(1.2)
reponse = REPONSE()

# ---- group: ZONE_CORRIGE / DONNÉES FOURNIES (copie)
epaisseurs_de_paroi_2 = EPAISSEURS_DE_PAROI([2.4, 1.8, 0.9, 3.2, 1.1, 2, 0.75, 1.6, 2.8, 1.2, 0.95, 4.1, 1.15, 2.2])
seuil_2 = SEUIL(1.2)

# ---- group: ZONE_CORRIGE / ÉTAPE 1
# RH-18 · Les parois que la machine ne saura pas faire
# Débutant  —  durée cible 20 min  —  réf. REF-016  —  v0.5-260902
# ▼  CORRIGÉ — à consulter après validation  ▼
# RAPPEL — copie des données fournies dans la zone sujet, afin qu'aucun câble ne relie les deux zones
# ÉTAPE 1 — Comparer chaque épaisseur au minimum imprimable. La comparaison est STRICTE : le minimum est
# atteignable, c'est un minimum et non une borne exclue
# ÉTAPE 2 — Compter les parois qui passent dessous : 5. En incluant celle qui vaut exactement 1,2 mm, on en
# reprendrait une pour rien
# RÉSULTAT — tant que l'interrupteur AFFICHER LE CORRIGÉ reste sur faux, la sortie 1 du Stream Gate est
# vide : rien n'apparaît dans Rhino
smaller = SmallerThan(FirstNumber=epaisseurs_de_paroi_2, SecondNumber=seuil_2)  # -> SmallerThan, OrEqualTo

# ---- group: ZONE_CORRIGE / ÉTAPE 2
cull = CullPattern(List=epaisseurs_de_paroi_2, CullPattern=smaller.SmallerThan)
lng = ListLength(List=cull)
panel = Panel(lng)

# ---- group: ZONE_CORRIGE / AFFICHAGE DU CORRIGÉ
afficher_le_corrigé = BooleanToggle(False)
gate = StreamGate(Stream=lng, Gate=afficher_le_corrigé)  # -> Target0, Target1
reponse_corrige = REPONSE_CORRIGE(gate.Target1)
