# Grasshopper definition RH-19_complet.gh (Grasshopper 1.0.8)

# ---- group: ZONE_SUJET
# Les douze détails les plus fins du modèle vous sont fournis, mesurés sur la maquette. Le modèle
# sera agrandi 25 fois. Donnez le nombre de détails qui resteront sous la résolution de 0,4 mm
# APRÈS agrandissement.
details_sur_la_maquette = DETAILS_SUR_LA_MAQUETTE([0.031, 0.006, 0.018, 0.009, 0.024, 0.011, 0.038, 0.004, 0.015, 0.021, 0.007, 0.028])
reponse = REPONSE()
# RH-19 · Ce que la mise à l'échelle fait aux détails
# Débutant  —  durée cible 25 min  —  réf. REF-017, REF-018  —  v0.5-260902
# ▼  CORRIGÉ — à consulter après validation  ▼
# RAPPEL — copie des données fournies dans la zone sujet, afin qu'aucun câble ne relie les deux zones
# ÉTAPE 1 — Agrandir D'ABORD. C'est tout l'exercice : juger la finesse à l'échelle où la pièce sera
# imprimée, et non à celle où elle a été dessinée
# ÉTAPE 2 — Comparer ensuite à la résolution de la machine, et compter : 6 détails restent trop fins. Avant
# agrandissement, les douze l'étaient — et l'on aurait refait toute la maquette
# RÉSULTAT — tant que l'interrupteur AFFICHER LE CORRIGÉ reste sur faux, la sortie 1 du Stream Gate est
# vide : rien n'apparaît dans Rhino
facteur_d_echelle = Slider(25, range=1..100)
resolution_machine = Slider(0.4, range=0.1..2)

# ---- group: ZONE_CORRIGE / DONNÉES FOURNIES (copie)
details_sur_la_maquette_2 = DETAILS_SUR_LA_MAQUETTE([0.031, 0.006, 0.018, 0.009, 0.024, 0.011, 0.038, 0.004, 0.015, 0.021, 0.007, 0.028])
facteur_d_echelle_2 = Slider(25, range=1..100)
resolution_machine_2 = Slider(0.4, range=0.1..2)

# ---- group: ZONE_CORRIGE / ÉTAPE 1
multiplication = Multiplication(A=details_sur_la_maquette_2, B=facteur_d_echelle_2)

# ---- group: ZONE_CORRIGE / ÉTAPE 2
smaller = SmallerThan(FirstNumber=multiplication, SecondNumber=resolution_machine_2)  # -> SmallerThan, OrEqualTo
cull = CullPattern(List=multiplication, CullPattern=smaller.SmallerThan)
lng = ListLength(List=cull)
panel = Panel(lng)

# ---- group: ZONE_CORRIGE / AFFICHAGE DU CORRIGÉ
afficher_le_corrigé = BooleanToggle(False)
gate = StreamGate(Stream=lng, Gate=afficher_le_corrigé)  # -> Target0, Target1
reponse_corrige = REPONSE_CORRIGE(gate.Target1)
