# Grasshopper definition RH-20_complet.gh (Grasshopper 1.0.8)

# ---- group: ZONE_SUJET
# Le maillage compte 2 960 faces triangulaires et 4 434 arêtes. Donnez le nombre d'arêtes nues.
reponse = REPONSE()
# RH-20 · Un maillage est-il fermé
# Débutant  —  durée cible 25 min  —  réf. REF-019, REF-020, REF-021  —  v0.5-260902
# ▼  CORRIGÉ — à consulter après validation  ▼
# RAPPEL — copie des données fournies dans la zone sujet, afin qu'aucun câble ne relie les deux zones
# ÉTAPE 1 — Chaque triangle réclame trois arêtes : 8 880 usages d'arête au total
# ÉTAPE 2 — Chaque arête INTÉRIEURE en sert deux : 8 868 usages offerts. Un maillage fermé de 2 960
# triangles aurait exactement 4 440 arêtes
# ÉTAPE 3 — La différence est le nombre d'arêtes qui ne bordent qu'une seule face : 12 arêtes nues, soit
# 0,3 % du maillage. Invisible à l'œil, rédhibitoire à la machine
# RÉSULTAT — tant que l'interrupteur AFFICHER LE CORRIGÉ reste sur faux, la sortie 1 du Stream Gate est
# vide : rien n'apparaît dans Rhino
faces_triangulaires = Slider(2960, range=100..10000)
aretes = Slider(4434, range=100..15000)

# ---- group: ZONE_CORRIGE / DONNÉES FOURNIES (copie)
faces_triangulaires_2 = Slider(2960, range=100..10000)
aretes_2 = Slider(4434, range=100..15000)

# ---- group: ZONE_CORRIGE / ÉTAPE 1
multiplication = Multiplication(A=faces_triangulaires_2, B=3)

# ---- group: ZONE_CORRIGE / ÉTAPE 2
multiplication_2 = Multiplication(A=aretes_2, B=2)

# ---- group: ZONE_CORRIGE / ÉTAPE 3
subtraction = Subtraction(A=multiplication, B=multiplication_2)
panel = Panel(subtraction)

# ---- group: ZONE_CORRIGE / AFFICHAGE DU CORRIGÉ
afficher_le_corrigé = BooleanToggle(False)
gate = StreamGate(Stream=subtraction, Gate=afficher_le_corrigé)  # -> Target0, Target1
reponse_corrige = REPONSE_CORRIGE(gate.Target1)
