# Grasshopper definition RH-21_complet.gh (Grasshopper 1.0.8)

# ---- group: ZONE_SUJET
# Les aires des quinze faces suspectes vous sont fournies, en millimètres carrés. La tolérance du
# document vaut 0,001 mm². Donnez le nombre de faces dégénérées.
aires_des_faces = AIRES_DES_FACES([12.4, 0.0008, 8.7, 22.1, 0.0003, 5.6, 14.9, 0.0009, 31.2, 7.3, 0.0012, 19.8, 4.5, 26.7, 0.0006])
seuil = SEUIL(0.001)
reponse = REPONSE()

# ---- group: ZONE_CORRIGE / DONNÉES FOURNIES (copie)
aires_des_faces_2 = AIRES_DES_FACES([12.4, 0.0008, 8.7, 22.1, 0.0003, 5.6, 14.9, 0.0009, 31.2, 7.3, 0.0012, 19.8, 4.5, 26.7, 0.0006])
seuil_2 = SEUIL(0.001)

# ---- group: ZONE_CORRIGE / ÉTAPE 1
# RH-21 · Les faces qui ne mesurent rien
# Débutant  —  durée cible 20 min  —  réf. REF-022, REF-023  —  v0.5-260902
# ▼  CORRIGÉ — à consulter après validation  ▼
# RAPPEL — copie des données fournies dans la zone sujet, afin qu'aucun câble ne relie les deux zones
# ÉTAPE 1 — Comparer chaque aire à la TOLÉRANCE du document, et non à zéro. Aucune face n'a une aire nulle
# : elles valent quelques dix-millièmes, ce qui n'est pas zéro et n'est rien
# ÉTAPE 2 — Compter les faces dégénérées : 4. Celle qui vaut 0,0012 passe juste au-dessus de la tolérance
# et n'en est pas une
# RÉSULTAT — tant que l'interrupteur AFFICHER LE CORRIGÉ reste sur faux, la sortie 1 du Stream Gate est
# vide : rien n'apparaît dans Rhino
smaller = SmallerThan(FirstNumber=aires_des_faces_2, SecondNumber=seuil_2)  # -> SmallerThan, OrEqualTo

# ---- group: ZONE_CORRIGE / ÉTAPE 2
cull = CullPattern(List=aires_des_faces_2, CullPattern=smaller.SmallerThan)
lng = ListLength(List=cull)
panel = Panel(lng)

# ---- group: ZONE_CORRIGE / AFFICHAGE DU CORRIGÉ
afficher_le_corrigé = BooleanToggle(False)
gate = StreamGate(Stream=lng, Gate=afficher_le_corrigé)  # -> Target0, Target1
reponse_corrige = REPONSE_CORRIGE(gate.Target1)
