# Grasshopper definition RH-22_complet.gh (Grasshopper 1.0.8)

# ---- group: ZONE_SUJET
# Le cylindre a 30 mm de rayon. L'écart entre le maillage et la surface réelle ne doit pas
# dépasser 0,05 mm. Donnez le nombre minimal de facettes sur un demi-tour.
reponse = REPONSE()
# RH-22 · La finesse du maillage à l'export
# Débutant  —  durée cible 25 min  —  réf. REF-024  —  v0.3-260826
# ▼  CORRIGÉ — à consulter après validation  ▼
# RAPPEL — copie des données fournies dans la zone sujet, afin qu'aucun câble ne relie les deux zones
# ÉTAPE 1 — L'écart entre la corde et l'arc vaut r × (1 − cos(π/n)). On inverse : cos de l'angle au sommet
# vaut 1 − flèche ÷ rayon
# ÉTAPE 2 — Le demi-tour vaut π : le nombre de facettes est π divisé par cet angle, soit 54,41
# ÉTAPE 3 — Arrondi au SUPÉRIEUR : 55 facettes. À 54, la flèche vaut déjà 0,0508 mm — au-delà du toléré, et
# rien à l'écran ne le signale
# RÉSULTAT — tant que l'interrupteur AFFICHER LE CORRIGÉ reste sur faux, la sortie 1 du Stream Gate est
# vide : rien n'apparaît dans Rhino
rayon = Slider(30, range=1..200)
fleche_admise = Slider(0.05, range=0.01..1)

# ---- group: ZONE_CORRIGE / DONNÉES FOURNIES (copie)
rayon_2 = Slider(30, range=1..200)
fleche_admise_2 = Slider(0.05, range=0.01..1)

# ---- group: ZONE_CORRIGE / ÉTAPE 1
division = Division(A=fleche_admise_2, B=rayon_2)
subtraction = Subtraction(A=1, B=division)
acos = ArcCosine(Value=subtraction)

# ---- group: ZONE_CORRIGE / ÉTAPE 2
division_2 = Division(A=3.141592654, B=acos)

# ---- group: ZONE_CORRIGE / ÉTAPE 3
round = Round(Number=division_2)  # -> Nearest, Floor, Ceiling
panel = Panel(round.Ceiling)

# ---- group: ZONE_CORRIGE / AFFICHAGE DU CORRIGÉ
afficher_le_corrigé = BooleanToggle(False)
gate = StreamGate(Stream=round.Ceiling, Gate=afficher_le_corrigé)  # -> Target0, Target1
reponse_corrige = REPONSE_CORRIGE(gate.Target1)
