# Grasshopper definition RH-23_complet.gh (Grasshopper 1.0.8)

# ---- group: ZONE_SUJET
# Le relevé des vingt-quatre objets vous est fourni, avec pour chacun son calque et son type.
# Donnez le nombre d'objets qui sont À LA FOIS sur le calque des porteurs et de type courbe.
reponse = REPONSE()

# ---- group: ZONE_CORRIGE / ÉTAPE 1
objets_retenus = OBJETS_RETENUS(["10-Porteurs / Courbe", "10-Porteurs / Courbe", "10-Porteurs / Courbe", "10-Porteurs / Courbe", "10-Porteurs / Courbe", "10-Porteurs / Courbe"])

# ---- group: ZONE_CORRIGE / ÉTAPE 2
# RH-23 · Sélectionner sur ce que les objets sont
# Débutant  —  durée cible 20 min  —  réf. REF-143  —  v0.5-260902
# ▼  CORRIGÉ — à consulter après validation  ▼
# ÉTAPE 1 — L'étalon porte les objets qui satisfont les DEUX conditions : le calque des porteurs ET le type
# courbe. Onze objets sont sur ce calque, onze sont des courbes — les deux comptes partiels sont égaux, à
# dessein
# ÉTAPE 2 — Six objets seulement vérifient les deux ensemble. Un apprenant qui n'en vérifie qu'une obtient
# onze des deux côtés et n'a aucune raison de se méfier
# RÉSULTAT — tant que l'interrupteur AFFICHER LE CORRIGÉ reste sur faux, la sortie 1 du Stream Gate est
# vide : rien n'apparaît dans Rhino
lng = ListLength(List=objets_retenus)
panel = Panel(lng)

# ---- group: ZONE_CORRIGE / AFFICHAGE DU CORRIGÉ
afficher_le_corrigé = BooleanToggle(False)
gate = StreamGate(Stream=lng, Gate=afficher_le_corrigé)  # -> Target0, Target1
reponse_corrige = REPONSE_CORRIGE(gate.Target1)
