# Grasshopper definition RH-24_complet.gh (Grasshopper 1.0.8)

# ---- group: ZONE_SUJET
# Le relevé donne dix-huit épaisseurs de paroi, en centièmes de millimètre. La pièce sera
# imprimée à 62 % de sa taille, et la machine ne tient pas sous 1,20 mm. Donnez le nombre de
# parois qui ne passeront pas.
epaisseurs_en_centiemes = EPAISSEURS_EN_CENTIEMES([260, 280, 240, 330, 90, 140, 60, 190, 170, 160, 240, 40, 90, 180, 170, 140, 300, 80])
reponse = REPONSE()
# RH-24 · Les parois trop minces après mise à l'échelle
# Débutant  —  durée cible 15 min  —  réf. REF-016, REF-017, REF-018  —  v0.5-260902
# ▼  CORRIGÉ — à consulter après validation  ▼
# RAPPEL — copie des données fournies dans la zone sujet, afin qu'aucun câble ne relie les deux zones
# ÉTAPE 1 — Les centièmes deviennent des millimètres, puis la réduction s'applique. Juger AVANT la mise à
# l'échelle en trouverait cinq
# ÉTAPE 2 — 12 parois passent sous le minimum. Sept franchissent le seuil pendant la réduction — rien dans
# le modèle au 1/1 ne le laissait voir
# RÉSULTAT — tant que l'interrupteur AFFICHER LE CORRIGÉ reste sur faux, la sortie 1 du Stream Gate est
# vide : rien n'apparaît dans Rhino
facteur_d_echelle = Slider(0.62, range=0.1..1)
minimum_machine = Slider(1.2, range=0.2..3)

# ---- group: ZONE_CORRIGE / DONNÉES FOURNIES (copie)
epaisseurs_en_centiemes_2 = EPAISSEURS_EN_CENTIEMES([260, 280, 240, 330, 90, 140, 60, 190, 170, 160, 240, 40, 90, 180, 170, 140, 300, 80])
facteur_d_echelle_2 = Slider(0.62, range=0.1..1)
minimum_machine_2 = Slider(1.2, range=0.2..3)

# ---- group: ZONE_CORRIGE / ÉTAPE 1
division = Division(A=epaisseurs_en_centiemes_2, B=100)
multiplication = Multiplication(A=division, B=facteur_d_echelle_2)

# ---- group: ZONE_CORRIGE / ÉTAPE 2
smaller = SmallerThan(FirstNumber=multiplication, SecondNumber=minimum_machine_2)  # -> SmallerThan, OrEqualTo
cull = CullPattern(List=epaisseurs_en_centiemes_2, CullPattern=smaller.SmallerThan)
lng = ListLength(List=cull)
panel = Panel(lng)

# ---- group: ZONE_CORRIGE / AFFICHAGE DU CORRIGÉ
afficher_le_corrigé = BooleanToggle(False)
gate = StreamGate(Stream=lng, Gate=afficher_le_corrigé)  # -> Target0, Target1
reponse_corrige = REPONSE_CORRIGE(gate.Target1)
