# Grasshopper definition RH-25_complet.gh (Grasshopper 1.0.8)

# ---- group: ZONE_SUJET
# Le rapport d'analyse donne, pour douze polysurfaces, le nombre d'arêtes nues et le nombre
# d'arêtes non-manifold. Donnez le nombre de polysurfaces réellement étanches.
aretes_nues = ARETES_NUES([0, 4, 0, 0, 12, 0, 2, 0, 0, 6, 0, 0])
aretes_non_manifold = ARETES_NON_MANIFOLD([0, 0, 2, 0, 0, 0, 1, 0, 3, 0, 0, 0])
reponse = REPONSE()

# ---- group: ZONE_CORRIGE / DONNÉES FOURNIES (copie)
aretes_nues_2 = ARETES_NUES([0, 4, 0, 0, 12, 0, 2, 0, 0, 6, 0, 0])
aretes_non_manifold_2 = ARETES_NON_MANIFOLD([0, 0, 2, 0, 0, 0, 1, 0, 3, 0, 0, 0])

# ---- group: ZONE_CORRIGE / ÉTAPE 1
# RH-25 · Les volumes réellement étanches
# Débutant  —  durée cible 14 min  —  réf. REF-019, REF-020, REF-021  —  v0.5-260902
# ▼  CORRIGÉ — à consulter après validation  ▼
# RAPPEL — copie des données fournies dans la zone sujet, afin qu'aucun câble ne relie les deux zones
# ÉTAPE 1 — Les DEUX compteurs doivent être à zéro. Ne regarder que les arêtes nues en déclarerait huit
# bonnes : deux polysurfaces fermées portent des arêtes non-manifold, où trois faces partagent la même
# arête
# ÉTAPE 2 — 6 polysurfaces sur 12 sont réellement étanches
# RÉSULTAT — tant que l'interrupteur AFFICHER LE CORRIGÉ reste sur faux, la sortie 1 du Stream Gate est
# vide : rien n'apparaît dans Rhino
equals = Equality(FirstNumber=aretes_nues_2, SecondNumber=0)  # -> Equality, Inequality
equals_2 = Equality(FirstNumber=aretes_non_manifold_2, SecondNumber=0)  # -> Equality, Inequality
and = GateAnd(A=equals.Equality, B=equals_2.Equality)

# ---- group: ZONE_CORRIGE / ÉTAPE 2
cull = CullPattern(List=aretes_nues_2, CullPattern=and)
lng = ListLength(List=cull)
panel = Panel(lng)

# ---- group: ZONE_CORRIGE / AFFICHAGE DU CORRIGÉ
afficher_le_corrigé = BooleanToggle(False)
gate = StreamGate(Stream=lng, Gate=afficher_le_corrigé)  # -> Target0, Target1
reponse_corrige = REPONSE_CORRIGE(gate.Target1)
