# Grasshopper definition RH-26_complet.gh (Grasshopper 1.0.8)

# ---- group: ZONE_SUJET
# Le maillage compte 148 520 triangles. Un STL binaire pèse 84 octets d'en-tête plus 50 octets
# par triangle. Donnez le poids du fichier, en octets.
reponse = REPONSE()
# RH-26 · Le poids du fichier à envoyer
# Débutant  —  durée cible 12 min  —  réf. REF-022, REF-023, REF-024  —  v0.5-260902
# ▼  CORRIGÉ — à consulter après validation  ▼
# RAPPEL — copie des données fournies dans la zone sujet, afin qu'aucun câble ne relie les deux zones
# ÉTAPE 1 — Le STL binaire réserve cinquante octets par triangle, plus quatre-vingt-quatre d'en-tête. Le
# même maillage en ASCII pèserait environ cinq fois plus, et le format par défaut de la boîte de dialogue
# n'est pas toujours le binaire
# RÉSULTAT — tant que l'interrupteur AFFICHER LE CORRIGÉ reste sur faux, la sortie 1 du Stream Gate est
# vide : rien n'apparaît dans Rhino
triangles = Slider(148520, range=1000..500000)

# ---- group: ZONE_CORRIGE / DONNÉES FOURNIES (copie)
triangles_2 = Slider(148520, range=1000..500000)

# ---- group: ZONE_CORRIGE / ÉTAPE 1
multiplication = Multiplication(A=triangles_2, B=50)
addition = Addition(A=multiplication, B=84)
panel = Panel(addition)

# ---- group: ZONE_CORRIGE / AFFICHAGE DU CORRIGÉ
afficher_le_corrigé = BooleanToggle(False)
gate = StreamGate(Stream=addition, Gate=afficher_le_corrigé)  # -> Target0, Target1
reponse_corrige = REPONSE_CORRIGE(gate.Target1)
