# Grasshopper definition RH-27_complet.gh (Grasshopper 1.0.8)

# ---- group: ZONE_SUJET
# Le socle mesure 240 × 160 × 40 mm. Le fût cylindrique fait 45 mm de rayon et 120 mm de haut, et
# s'encastre de 15 mm dans le socle. Donnez le volume de matière, en décimètres cubes.
reponse = REPONSE()
# RH-27 · Le volume d'un assemblage de primitives
# Débutant  —  durée cible 16 min  —  réf. REF-007, REF-008  —  v0.5-260902
# ▼  CORRIGÉ — à consulter après validation  ▼
# RAPPEL — copie des données fournies dans la zone sujet, afin qu'aucun câble ne relie les deux zones
# ÉTAPE 1 — Le socle, puis le fût entier
# ÉTAPE 2 — La partie encastrée appartient aux DEUX : elle est comptée deux fois. Additionner sans la
# déduire donnerait 2,2994 dm³, 4 % de trop — assez pour fausser un devis de fonderie
# RÉSULTAT — tant que l'interrupteur AFFICHER LE CORRIGÉ reste sur faux, la sortie 1 du Stream Gate est
# vide : rien n'apparaît dans Rhino
longueur_du_socle = Slider(240, range=50..600)
largeur_du_socle = Slider(160, range=50..400)
hauteur_du_socle = Slider(40, range=10..120)
rayon_du_fut = Slider(45, range=10..120)
hauteur_du_fut = Slider(120, range=20..300)
enfoncement = Slider(15, range=0..40)

# ---- group: ZONE_CORRIGE / DONNÉES FOURNIES (copie)
longueur_du_socle_2 = Slider(240, range=50..600)
largeur_du_socle_2 = Slider(160, range=50..400)
hauteur_du_socle_2 = Slider(40, range=10..120)
rayon_du_fut_2 = Slider(45, range=10..120)
hauteur_du_fut_2 = Slider(120, range=20..300)
enfoncement_2 = Slider(15, range=0..40)

# ---- group: ZONE_CORRIGE / ÉTAPE 1
multiplication = Multiplication(A=longueur_du_socle_2, B=largeur_du_socle_2)
multiplication_2 = Multiplication(A=multiplication, B=hauteur_du_socle_2)
multiplication_3 = Multiplication(A=rayon_du_fut_2, B=rayon_du_fut_2)
pi = Pi(Factor=1)
multiplication_4 = Multiplication(A=multiplication_3, B=pi)
multiplication_5 = Multiplication(A=multiplication_4, B=hauteur_du_fut_2)

# ---- group: ZONE_CORRIGE / ÉTAPE 2
multiplication_6 = Multiplication(A=multiplication_4, B=enfoncement_2)
addition = Addition(A=multiplication_2, B=multiplication_5)
subtraction = Subtraction(A=addition, B=multiplication_6)
division = Division(A=subtraction, B=1000000)
panel = Panel(division)

# ---- group: ZONE_CORRIGE / AFFICHAGE DU CORRIGÉ
afficher_le_corrigé = BooleanToggle(False)
gate = StreamGate(Stream=division, Gate=afficher_le_corrigé)  # -> Target0, Target1
reponse_corrige = REPONSE_CORRIGE(gate.Target1)
