# Grasshopper definition RH-28_complet.gh (Grasshopper 1.0.8)

# ---- group: ZONE_SUJET
# Le contour au sol vous est donné par ses cinq sommets, en millimètres. Le bardage monte à 2 600
# mm. Donnez sa surface, en mètres carrés.
sommets_x = SOMMETS_X([0, 1800, 1800, 1100, 0])
sommets_y = SOMMETS_Y([0, 0, 900, 1400, 1400])
reponse = REPONSE()
# RH-28 · La surface d'une extrusion
# Débutant  —  durée cible 14 min  —  réf. REF-009, REF-010, REF-011  —  v0.5-260902
# ▼  CORRIGÉ — à consulter après validation  ▼
# RAPPEL — copie des données fournies dans la zone sujet, afin qu'aucun câble ne relie les deux zones
# ÉTAPE 1 — Les cinq sommets, puis la polyligne REFERMÉE. La laisser ouverte donnerait 12,1166 m² : le
# segment de fermeture mesure 1 400 mm, soit un mur entier, et l'aperçu ne les distingue pas
# ÉTAPE 2 — 15,7566 m² de bardage
# RÉSULTAT — tant que l'interrupteur AFFICHER LE CORRIGÉ reste sur faux, la sortie 1 du Stream Gate est
# vide : rien n'apparaît dans Rhino
hauteur_de_bardage = Slider(2600, range=500..6000)

# ---- group: ZONE_CORRIGE / DONNÉES FOURNIES (copie)
sommets_x_2 = SOMMETS_X([0, 1800, 1800, 1100, 0])
sommets_y_2 = SOMMETS_Y([0, 0, 900, 1400, 1400])
hauteur_de_bardage_2 = Slider(2600, range=500..6000)

# ---- group: ZONE_CORRIGE / ÉTAPE 1
pt = ConstructPoint(XCoordinate=sommets_x_2, YCoordinate=sommets_y_2, ZCoordinate=0)
pline = PolyLine(Vertices=pt, Closed=True)
len = Length(Curve=pline)

# ---- group: ZONE_CORRIGE / ÉTAPE 2
multiplication = Multiplication(A=len, B=hauteur_de_bardage_2)
division = Division(A=multiplication, B=1000000)
panel = Panel(division)

# ---- group: ZONE_CORRIGE / AFFICHAGE DU CORRIGÉ
afficher_le_corrigé = BooleanToggle(False)
gate = StreamGate(Stream=division, Gate=afficher_le_corrigé)  # -> Target0, Target1
reponse_corrige = REPONSE_CORRIGE(gate.Target1)
