# Grasshopper definition RH-29_complet.gh (Grasshopper 1.0.8)

# ---- group: ZONE_SUJET
# La platine mesure 900 × 600 × 12 mm. Elle reçoit un réseau de 6 par 4 trous traversants de 22
# mm de diamètre. Donnez le volume de matière restante, en décimètres cubes.
reponse = REPONSE()
# RH-29 · La platine percée en réseau
# Débutant  —  durée cible 14 min  —  réf. REF-012, REF-013  —  v0.5-260902
# ▼  CORRIGÉ — à consulter après validation  ▼
# RAPPEL — copie des données fournies dans la zone sujet, afin qu'aucun câble ne relie les deux zones
# ÉTAPE 1 — La platine pleine
# ÉTAPE 2 — Le RAYON, pas le diamètre : l'aire va comme son carré. La confusion quadruple le volume percé
# et allège la platine de 5 %
# ÉTAPE 3 — 6,3705 dm³ de matière restante
# RÉSULTAT — tant que l'interrupteur AFFICHER LE CORRIGÉ reste sur faux, la sortie 1 du Stream Gate est
# vide : rien n'apparaît dans Rhino
longueur = Slider(900, range=200..2000)
largeur = Slider(600, range=200..2000)
epaisseur = Slider(12, range=2..40)
trous_en_x = Slider(6, range=1..20)
trous_en_y = Slider(4, range=1..20)
diametre_des_trous = Slider(22, range=4..80)

# ---- group: ZONE_CORRIGE / DONNÉES FOURNIES (copie)
longueur_2 = Slider(900, range=200..2000)
largeur_2 = Slider(600, range=200..2000)
epaisseur_2 = Slider(12, range=2..40)
trous_en_x_2 = Slider(6, range=1..20)
trous_en_y_2 = Slider(4, range=1..20)
diametre_des_trous_2 = Slider(22, range=4..80)

# ---- group: ZONE_CORRIGE / ÉTAPE 1
multiplication = Multiplication(A=longueur_2, B=largeur_2)
multiplication_2 = Multiplication(A=multiplication, B=epaisseur_2)

# ---- group: ZONE_CORRIGE / ÉTAPE 2
division = Division(A=diametre_des_trous_2, B=2)
multiplication_3 = Multiplication(A=division, B=division)
pi = Pi(Factor=1)
multiplication_4 = Multiplication(A=multiplication_3, B=pi)
multiplication_5 = Multiplication(A=multiplication_4, B=epaisseur_2)
multiplication_6 = Multiplication(A=trous_en_x_2, B=trous_en_y_2)
multiplication_7 = Multiplication(A=multiplication_5, B=multiplication_6)

# ---- group: ZONE_CORRIGE / ÉTAPE 3
subtraction = Subtraction(A=multiplication_2, B=multiplication_7)
division_2 = Division(A=subtraction, B=1000000)
panel = Panel(division_2)

# ---- group: ZONE_CORRIGE / AFFICHAGE DU CORRIGÉ
afficher_le_corrigé = BooleanToggle(False)
gate = StreamGate(Stream=division_2, Gate=afficher_le_corrigé)  # -> Target0, Target1
reponse_corrige = REPONSE_CORRIGE(gate.Target1)
