# Grasshopper definition RH-30_complet.gh (Grasshopper 1.0.8)

# ---- group: ZONE_SUJET
# L'inventaire donne, pour seize objets, leur type, leur calque et leur état de verrouillage.
# Donnez le nombre d'objets que retient une sélection des courbes du calque 10-Porteurs.
type_1courbe_2surface_3bloc_4maillage = TYPE_1COURBE_2SURFACE_3BLOC_4MAILLAGE([1, 2, 1, 3, 1, 2, 1, 1, 4, 1, 2, 1, 3, 1, 1, 2])
calque_1porteurs_2cloisons_3menuiseries = CALQUE_1PORTEURS_2CLOISONS_3MENUISERIES([1, 1, 2, 1, 1, 2, 3, 1, 1, 2, 3, 1, 2, 1, 3, 1])
verrouille = VERROUILLE([0, 0, 1, 0, 1, 0, 0, 0, 0, 0, 1, 0, 0, 1, 0, 0])
reponse = REPONSE()

# ---- group: ZONE_CORRIGE / DONNÉES FOURNIES (copie)
type_1courbe_2surface_3bloc_4maillage_2 = TYPE_1COURBE_2SURFACE_3BLOC_4MAILLAGE([1, 2, 1, 3, 1, 2, 1, 1, 4, 1, 2, 1, 3, 1, 1, 2])
calque_1porteurs_2cloisons_3menuiseries_2 = CALQUE_1PORTEURS_2CLOISONS_3MENUISERIES([1, 1, 2, 1, 1, 2, 3, 1, 1, 2, 3, 1, 2, 1, 3, 1])
verrouille_2 = VERROUILLE([0, 0, 1, 0, 1, 0, 0, 0, 0, 0, 1, 0, 0, 1, 0, 0])

# ---- group: ZONE_CORRIGE / ÉTAPE 1
# RH-30 · Ce que le filtre de sélection retient
# Débutant  —  durée cible 12 min  —  réf. REF-003, REF-004  —  v0.5-260902
# ▼  CORRIGÉ — à consulter après validation  ▼
# RAPPEL — copie des données fournies dans la zone sujet, afin qu'aucun câble ne relie les deux zones
# ÉTAPE 1 — Trois conditions : le bon type, le bon calque, et NON verrouillé. Oublier la troisième en
# trouverait cinq — deux courbes du bon calque sont verrouillées et n'entreront jamais dans la sélection
# ÉTAPE 2 — 3 objets sont retenus
# RÉSULTAT — tant que l'interrupteur AFFICHER LE CORRIGÉ reste sur faux, la sortie 1 du Stream Gate est
# vide : rien n'apparaît dans Rhino
equals = Equality(FirstNumber=type_1courbe_2surface_3bloc_4maillage_2, SecondNumber=1)  # -> Equality, Inequality
equals_2 = Equality(FirstNumber=calque_1porteurs_2cloisons_3menuiseries_2, SecondNumber=1)  # -> Equality, Inequality
equals_3 = Equality(FirstNumber=verrouille_2, SecondNumber=0)  # -> Equality, Inequality
and = GateAnd(A=equals.Equality, B=equals_2.Equality)
and_2 = GateAnd(A=and, B=equals_3.Equality)

# ---- group: ZONE_CORRIGE / ÉTAPE 2
cull = CullPattern(List=type_1courbe_2surface_3bloc_4maillage_2, CullPattern=and_2)
lng = ListLength(List=cull)
panel = Panel(lng)

# ---- group: ZONE_CORRIGE / AFFICHAGE DU CORRIGÉ
afficher_le_corrigé = BooleanToggle(False)
gate = StreamGate(Stream=lng, Gate=afficher_le_corrigé)  # -> Target0, Target1
reponse_corrige = REPONSE_CORRIGE(gate.Target1)
