# Grasshopper definition RH-31_complet.gh (Grasshopper 1.0.8)

# ---- group: ZONE_SUJET
# L'inventaire donne, pour dix-huit objets, leur groupe, la visibilité de leur calque et leur
# propre état de masquage. Donnez le nombre d'objets réellement visibles à l'écran.
calque_visible = CALQUE_VISIBLE([1, 1, 0, 1, 1, 0, 1, 1, 1, 0, 1, 1, 1, 0, 1, 1, 1, 1])
objet_masque = OBJET_MASQUE([0, 1, 0, 0, 0, 1, 1, 0, 0, 0, 0, 1, 0, 0, 0, 0, 1, 0])
reponse = REPONSE()

# ---- group: ZONE_CORRIGE / DONNÉES FOURNIES (copie)
calque_visible_2 = CALQUE_VISIBLE([1, 1, 0, 1, 1, 0, 1, 1, 1, 0, 1, 1, 1, 0, 1, 1, 1, 1])
objet_masque_2 = OBJET_MASQUE([0, 1, 0, 0, 0, 1, 1, 0, 0, 0, 0, 1, 0, 0, 0, 0, 1, 0])

# ---- group: ZONE_CORRIGE / ÉTAPE 1
# RH-31 · Ce qui reste visible
# Débutant  —  durée cible 12 min  —  réf. REF-005, REF-006  —  v0.5-260902
# ▼  CORRIGÉ — à consulter après validation  ▼
# RAPPEL — copie des données fournies dans la zone sujet, afin qu'aucun câble ne relie les deux zones
# ÉTAPE 1 — Deux mécanismes produisent le même symptôme. Ne regarder que le masquage d'objet en compterait
# treize : trois objets non masqués reposent sur un calque éteint, et « Montrer tout » ne les fera pas
# revenir
# ÉTAPE 2 — 10 objets sont réellement visibles
# RÉSULTAT — tant que l'interrupteur AFFICHER LE CORRIGÉ reste sur faux, la sortie 1 du Stream Gate est
# vide : rien n'apparaît dans Rhino
equals = Equality(FirstNumber=calque_visible_2, SecondNumber=1)  # -> Equality, Inequality
equals_2 = Equality(FirstNumber=objet_masque_2, SecondNumber=0)  # -> Equality, Inequality
and = GateAnd(A=equals.Equality, B=equals_2.Equality)

# ---- group: ZONE_CORRIGE / ÉTAPE 2
cull = CullPattern(List=calque_visible_2, CullPattern=and)
lng = ListLength(List=cull)
panel = Panel(lng)

# ---- group: ZONE_CORRIGE / AFFICHAGE DU CORRIGÉ
afficher_le_corrigé = BooleanToggle(False)
gate = StreamGate(Stream=lng, Gate=afficher_le_corrigé)  # -> Target0, Target1
reponse_corrige = REPONSE_CORRIGE(gate.Target1)
