# Grasshopper definition RH-32_complet.gh (Grasshopper 1.0.8)

# ---- group: ZONE_SUJET
# L'inventaire donne la couleur de vingt objets : « ParCalque » ou une couleur propre. Le calque
# va changer de couleur. Donnez le nombre d'objets qui suivront.
couleur_0parcalque_sinon_propre = COULEUR_0PARCALQUE_SINON_PROPRE([0, 1, 0, 0, 2, 0, 0, 3, 0, 1, 0, 0, 2, 0, 0, 4, 0, 0, 0, 1])
reponse = REPONSE()

# ---- group: ZONE_CORRIGE / DONNÉES FOURNIES (copie)
couleur_0parcalque_sinon_propre_2 = COULEUR_0PARCALQUE_SINON_PROPRE([0, 1, 0, 0, 2, 0, 0, 3, 0, 1, 0, 0, 2, 0, 0, 4, 0, 0, 0, 1])

# ---- group: ZONE_CORRIGE / ÉTAPE 1
# RH-32 · Ce qui suivra le calque
# Débutant  —  durée cible 12 min  —  réf. REF-014, REF-015, REF-143  —  v0.5-260902
# ▼  CORRIGÉ — à consulter après validation  ▼
# RAPPEL — copie des données fournies dans la zone sujet, afin qu'aucun câble ne relie les deux zones
# ÉTAPE 1 — Suivront le calque : ceux dont la couleur est HÉRITÉE. Compter les couleurs propres — sept —
# répond à la question inverse, et les deux comptes se complètent à vingt
# RÉSULTAT — tant que l'interrupteur AFFICHER LE CORRIGÉ reste sur faux, la sortie 1 du Stream Gate est
# vide : rien n'apparaît dans Rhino
equals = Equality(FirstNumber=couleur_0parcalque_sinon_propre_2, SecondNumber=0)  # -> Equality, Inequality
cull = CullPattern(List=couleur_0parcalque_sinon_propre_2, CullPattern=equals.Equality)
lng = ListLength(List=cull)
panel = Panel(lng)

# ---- group: ZONE_CORRIGE / AFFICHAGE DU CORRIGÉ
afficher_le_corrigé = BooleanToggle(False)
gate = StreamGate(Stream=lng, Gate=afficher_le_corrigé)  # -> Target0, Target1
reponse_corrige = REPONSE_CORRIGE(gate.Target1)
