# Grasshopper definition WB-03_complet.gh (Grasshopper 1.0.8)

# ---- group: ZONE_SUJET
reponse = REPONSE()
# WB-03 · Rhino sans Rhino
# Expert  —  durée cible 8 min  —  réf. REF-111, REF-112  —  v0.5-260902
# ▼  CORRIGÉ — à consulter après validation  ▼
# ÉTAPE 1 — La bonne réponse est la proposition 0. Le corrigé porte cet indice en clair : le menu du sujet,
# lui, part sur la première proposition, quelle qu'elle soit.
# ÉTAPE 2 — À retenir
# RÉSULTAT — tant que l'interrupteur AFFICHER LE CORRIGÉ reste sur faux, la sortie 1 du Stream Gate est
# vide : rien n'apparaît dans Rhino
# Rhino.Inside  : Rhino cohabite avec un
#                 logiciel hote, sur le poste.
# 
# Rhino.Compute : le moteur de calcul au
#                 bout d'un appel reseau.
# 
# Deux reponses a deux besoins differents.
reponse_qcm = ValueList({"0 - Rhino.Compute, qui expose le moteur de calcul comme un…": 0, "1 - Rhino.Inside, qui charge Rhino dans un autre logiciel…": 1, "2 - Un export en maillage, qui suffit toujours.": 2, "3 - Les deux font la même chose.": 3}, selected=[])

# ---- group: ZONE_CORRIGE / ÉTAPE 1
bonne_reponse = BONNE_REPONSE(0)

# ---- group: ZONE_CORRIGE / AFFICHAGE DU CORRIGÉ
afficher_le_corrigé = BooleanToggle(False)
gate = StreamGate(Stream=bonne_reponse, Gate=afficher_le_corrigé)  # -> Target0, Target1
reponse_corrige = REPONSE_CORRIGE(gate.Target1)
