# Grasshopper definition WB-04_complet.gh (Grasshopper 1.0.8)

# ---- group: ZONE_SUJET
# La définition du meuble compte quatorze entrées, décrites une à une avec ce qu'elles commandent
# et ce dont elles dépendent. Donnez le nombre d'entrées à exposer dans l'interface.
nature_de_chaque_entree = NATURE_DE_CHAQUE_ENTREE(["choix", "choix", "choix", "choix", "choix", "choix", "derive", "derive", "derive", "interne", "interne", "interne", "interne", "interne"])
reponse = REPONSE()

# ---- group: ZONE_CORRIGE / DONNÉES FOURNIES (copie)
nature_de_chaque_entree_2 = NATURE_DE_CHAQUE_ENTREE(["choix", "choix", "choix", "choix", "choix", "choix", "derive", "derive", "derive", "interne", "interne", "interne", "interne", "interne"])

# ---- group: ZONE_CORRIGE / ÉTAPE 1
ce_qui_s_expose = CE_QUI_S_EXPOSE("choix")

# ---- group: ZONE_CORRIGE / ÉTAPE 2
# WB-04 · Ce qu'on expose, et ce qu'on cache
# Perfectionnement  —  durée cible 25 min  —  réf. REF-107  —  v0.5-260902
# ▼  CORRIGÉ — à consulter après validation  ▼
# RAPPEL — copie des données fournies dans la zone sujet, afin qu'aucun câble ne relie les deux zones
# ÉTAPE 1 — Trois familles, et une seule s'expose. Les réglages internes appartiennent à l'auteur de la
# définition ; les grandeurs dérivées se déduisent d'autres entrées, et les exposer autoriserait deux
# vérités contradictoires — une hauteur de tiroir incompatible avec la hauteur du meuble
# ÉTAPE 2 — Compter les entrées de cette seule famille : six sur quatorze. Tout exposer en donnerait
# quatorze, s'arrêter aux non-internes en donnerait neuf
# RÉSULTAT — tant que l'interrupteur AFFICHER LE CORRIGÉ reste sur faux, la sortie 1 du Stream Gate est
# vide : rien n'apparaît dans Rhino
mindex = MemberIndex(Set=nature_de_chaque_entree_2, Member=ce_qui_s_expose)  # -> Index, Count
panel = Panel(mindex.Count)

# ---- group: ZONE_CORRIGE / AFFICHAGE DU CORRIGÉ
afficher_le_corrigé = BooleanToggle(False)
gate = StreamGate(Stream=mindex.Count, Gate=afficher_le_corrigé)  # -> Target0, Target1
reponse_corrige = REPONSE_CORRIGE(gate.Target1)
