# Grasshopper definition WB-05_complet.gh (Grasshopper 1.0.8)

# ---- group: ZONE_SUJET
# Le configurateur reçoit 12 000 visites par jour, dont 18 % se concentrent sur l'heure de
# pointe. Chaque visite déclenche 6 recalculs, et un recalcul occupe une instance pendant 1,2
# seconde. Donnez le nombre d'instances nécessaires pour tenir la pointe sans faire attendre.
reponse = REPONSE()
# WB-05 · Dimensionner le calcul d'un configurateur
# Expert  —  durée cible 30 min  —  réf. REF-112  —  v0.3-260826
# ▼  CORRIGÉ — à consulter après validation  ▼
# RAPPEL — copie des données fournies dans la zone sujet, afin qu'aucun câble ne relie les deux zones
# ÉTAPE 1 — Ramener la fréquentation à l'heure de pointe : 2 160 visites, et non les 500 d'une moyenne
# horaire. C'est la seule heure qui décide du dimensionnement
# ÉTAPE 2 — Chaque visite déclenche six recalculs, chacun d'1,2 seconde : 15 552 secondes de calcul à
# absorber
# ÉTAPE 3 — Une instance rend 3 600 secondes en une heure. Il en faut 4,32, donc 5 : on ne loue pas un
# quart d'instance. Lisser la charge sur les vingt-quatre heures aurait donné 1 — le service aurait tenu la
# nuit et cédé le soir
# RÉSULTAT — tant que l'interrupteur AFFICHER LE CORRIGÉ reste sur faux, la sortie 1 du Stream Gate est
# vide : rien n'apparaît dans Rhino
visites_par_jour = Slider(12000, range=1000..40000)
part_de_la_pointe = Slider(0.18, range=0.05..0.5)
recalculs_par_visite = Slider(6, range=1..20)
duree_d_un_recalcul = Slider(1.2, range=0.1..10)

# ---- group: ZONE_CORRIGE / DONNÉES FOURNIES (copie)
visites_par_jour_2 = Slider(12000, range=1000..40000)
part_de_la_pointe_2 = Slider(0.18, range=0.05..0.5)
recalculs_par_visite_2 = Slider(6, range=1..20)
duree_d_un_recalcul_2 = Slider(1.2, range=0.1..10)

# ---- group: ZONE_CORRIGE / ÉTAPE 1
multiplication = Multiplication(A=visites_par_jour_2, B=part_de_la_pointe_2)

# ---- group: ZONE_CORRIGE / ÉTAPE 2
multiplication_2 = Multiplication(A=multiplication, B=recalculs_par_visite_2)
multiplication_3 = Multiplication(A=multiplication_2, B=duree_d_un_recalcul_2)

# ---- group: ZONE_CORRIGE / ÉTAPE 3
division = Division(A=multiplication_3, B=3600)
round = Round(Number=division)  # -> Nearest, Floor, Ceiling
panel = Panel(round.Ceiling)

# ---- group: ZONE_CORRIGE / AFFICHAGE DU CORRIGÉ
afficher_le_corrigé = BooleanToggle(False)
gate = StreamGate(Stream=round.Ceiling, Gate=afficher_le_corrigé)  # -> Target0, Target1
reponse_corrige = REPONSE_CORRIGE(gate.Target1)
