# Grasshopper definition WB-06_complet.gh (Grasshopper 1.0.8)

# ---- group: ZONE_SUJET
# Le maillage d'aperçu compte 24 310 faces quadrangulaires. Vous l'exportez dans un format
# binaire qui ne stocke que des triangles, avec un en-tête de 84 octets et 50 octets par facette.
# Donnez le poids du fichier, en octets.
reponse = REPONSE()
# WB-06 · Le poids du modèle que l'on télécharge
# Perfectionnement  —  durée cible 25 min  —  réf. REF-109  —  v0.5-260902
# ▼  CORRIGÉ — à consulter après validation  ▼
# RAPPEL — copie des données fournies dans la zone sujet, afin qu'aucun câble ne relie les deux zones
# ÉTAPE 1 — Le format ne connaît que le TRIANGLE. Chaque quadrangle en donne deux : 48 620 facettes, et non
# 24 310. C'est là que se joue l'exercice — le reste n'est qu'une multiplication
# ÉTAPE 2 — Cinquante octets par facette, plus les 84 octets d'en-tête : 2 431 084 octets, soit 2,32 Mio.
# Compter une facette par face aurait annoncé 1,16 Mio — la moitié, et l'utilisateur reçoit le double de ce
# qu'on lui a promis
# RÉSULTAT — tant que l'interrupteur AFFICHER LE CORRIGÉ reste sur faux, la sortie 1 du Stream Gate est
# vide : rien n'apparaît dans Rhino
faces_quadrangulaires = Slider(24310, range=1000..60000)

# ---- group: ZONE_CORRIGE / DONNÉES FOURNIES (copie)
faces_quadrangulaires_2 = Slider(24310, range=1000..60000)

# ---- group: ZONE_CORRIGE / ÉTAPE 1
multiplication = Multiplication(A=faces_quadrangulaires_2, B=2)

# ---- group: ZONE_CORRIGE / ÉTAPE 2
multiplication_2 = Multiplication(A=multiplication, B=50)
addition = Addition(A=multiplication_2, B=84)
panel = Panel(addition)

# ---- group: ZONE_CORRIGE / AFFICHAGE DU CORRIGÉ
afficher_le_corrigé = BooleanToggle(False)
gate = StreamGate(Stream=addition, Gate=afficher_le_corrigé)  # -> Target0, Target1
reponse_corrige = REPONSE_CORRIGE(gate.Target1)
