# Grasshopper definition WB-07_complet.gh (Grasshopper 1.0.8)

# ---- group: ZONE_SUJET
# La pièce mesure 2 380 mm de long et 1 640 mm de haut. Le plan sort sur une feuille de 420 × 297
# mm, avec 15 mm de marge sur chaque bord. Les échelles disponibles sont 1:1, 1:2, 1:5, 1:10,
# 1:20, 1:50 et 1:100. Donnez le dénominateur de la plus grande échelle qui convient.
echelles_normalisees = ECHELLES_NORMALISEES([1, 2, 5, 10, 20, 50, 100])
reponse = REPONSE()
# WB-07 · Le plan qui tient sur la feuille
# Perfectionnement  —  durée cible 25 min  —  réf. REF-110  —  v0.3-260826
# ▼  CORRIGÉ — à consulter après validation  ▼
# RAPPEL — copie des données fournies dans la zone sujet, afin qu'aucun câble ne relie les deux zones
# ÉTAPE 1 — La zone utile est la feuille moins deux marges sur chaque dimension : 390 × 267 mm
# ÉTAPE 2 — La pièce réduite doit tenir dans les DEUX dimensions. Ici 6,10 en longueur et 6,14 en hauteur :
# ni l'une ni l'autre ne tranche seule, il faut vérifier les deux
# ÉTAPE 3 — Retenir les échelles qui satisfont les deux conditions, et prendre la première : 1:10. Le
# rapport exact vaut 6,10, mais 1:6,1 n'existe pas, et 1:5 déborde de 86 mm — une échelle se choisit DANS
# la liste, et toujours vers la plus petite
# RÉSULTAT — tant que l'interrupteur AFFICHER LE CORRIGÉ reste sur faux, la sortie 1 du Stream Gate est
# vide : rien n'apparaît dans Rhino
longueur_de_la_piece = Slider(2380, range=200..6000)
hauteur_de_la_piece = Slider(1640, range=200..6000)

# ---- group: ZONE_CORRIGE / DONNÉES FOURNIES (copie)
echelles_normalisees_2 = ECHELLES_NORMALISEES([1, 2, 5, 10, 20, 50, 100])
longueur_de_la_piece_2 = Slider(2380, range=200..6000)
hauteur_de_la_piece_2 = Slider(1640, range=200..6000)

# ---- group: ZONE_CORRIGE / ÉTAPE 1
subtraction = Subtraction(A=420, B=30)
subtraction_2 = Subtraction(A=297, B=30)

# ---- group: ZONE_CORRIGE / ÉTAPE 2
division = Division(A=longueur_de_la_piece_2, B=echelles_normalisees_2)
division_2 = Division(A=hauteur_de_la_piece_2, B=echelles_normalisees_2)
smaller = SmallerThan(FirstNumber=division, SecondNumber=subtraction)  # -> SmallerThan, OrEqualTo
smaller_2 = SmallerThan(FirstNumber=division_2, SecondNumber=subtraction_2)  # -> SmallerThan, OrEqualTo

# ---- group: ZONE_CORRIGE / ÉTAPE 3
and = GateAnd(A=smaller.OrEqualTo, B=smaller_2.OrEqualTo)
cull = CullPattern(List=echelles_normalisees_2, CullPattern=and)
item = ListItem(List=cull, Index=0, Wrap=True)
panel = Panel(item)

# ---- group: ZONE_CORRIGE / AFFICHAGE DU CORRIGÉ
afficher_le_corrigé = BooleanToggle(False)
gate = StreamGate(Stream=item, Gate=afficher_le_corrigé)  # -> Target0, Target1
reponse_corrige = REPONSE_CORRIGE(gate.Target1)
