# Grasshopper definition WB-08_complet.gh (Grasshopper 1.0.8)

# ---- group: ZONE_SUJET
# Une tablette exige 180 mm de hauteur libre, plus son épaisseur. Les douze réglages soumis vous
# sont fournis : hauteur du meuble, nombre de tablettes, épaisseur. Donnez le nombre de réglages
# infabricables.
hauteur_du_meuble = HAUTEUR_DU_MEUBLE([2200, 1200, 900, 1800, 600, 2000, 450, 1500, 1000, 1600, 2100, 750])
nombre_de_tablettes = NOMBRE_DE_TABLETTES([6, 6, 4, 6, 3, 5, 2, 4, 5, 8, 4, 4])
epaisseur = EPAISSEUR([30, 30, 22, 18, 16, 25, 30, 30, 22, 18, 16, 25])
reponse = REPONSE()

# ---- group: ZONE_CORRIGE / DONNÉES FOURNIES (copie)
hauteur_du_meuble_2 = HAUTEUR_DU_MEUBLE([2200, 1200, 900, 1800, 600, 2000, 450, 1500, 1000, 1600, 2100, 750])
nombre_de_tablettes_2 = NOMBRE_DE_TABLETTES([6, 6, 4, 6, 3, 5, 2, 4, 5, 8, 4, 4])
epaisseur_2 = EPAISSEUR([30, 30, 22, 18, 16, 25, 30, 30, 22, 18, 16, 25])

# ---- group: ZONE_CORRIGE / ÉTAPE 1
# WB-08 · Les bornes qui empêchent l'infabricable
# Perfectionnement  —  durée cible 25 min  —  réf. REF-157  —  v0.5-260902
# ▼  CORRIGÉ — à consulter après validation  ▼
# RAPPEL — copie des données fournies dans la zone sujet, afin qu'aucun câble ne relie les deux zones
# ÉTAPE 1 — Ce qu'une tablette occupe : la hauteur libre exigée, PLUS son épaisseur. L'oublier fait passer
# trois réglages de plus
# ÉTAPE 2 — Ce qu'exige le meuble entier : autant de fois que de tablettes
# ÉTAPE 3 — Comparer à la hauteur disponible. Trois réglages sur douze n'y tiennent pas — alors que chaque
# paramètre, pris SÉPARÉMENT, est dans sa plage. C'est leur croisement qui échoue, et une interface qui
# borne les paramètres un à un ne le voit pas
# RÉSULTAT — tant que l'interrupteur AFFICHER LE CORRIGÉ reste sur faux, la sortie 1 du Stream Gate est
# vide : rien n'apparaît dans Rhino
addition = Addition(A=180, B=epaisseur_2)

# ---- group: ZONE_CORRIGE / ÉTAPE 2
multiplication = Multiplication(A=nombre_de_tablettes_2, B=addition)

# ---- group: ZONE_CORRIGE / ÉTAPE 3
smaller = SmallerThan(FirstNumber=hauteur_du_meuble_2, SecondNumber=multiplication)  # -> SmallerThan, OrEqualTo
cull = CullPattern(List=hauteur_du_meuble_2, CullPattern=smaller.SmallerThan)
lng = ListLength(List=cull)
panel = Panel(lng)

# ---- group: ZONE_CORRIGE / AFFICHAGE DU CORRIGÉ
afficher_le_corrigé = BooleanToggle(False)
gate = StreamGate(Stream=lng, Gate=afficher_le_corrigé)  # -> Target0, Target1
reponse_corrige = REPONSE_CORRIGE(gate.Target1)
