# Grasshopper definition WB-09_complet.gh (Grasshopper 1.0.8)

# ---- group: ZONE_SUJET
# Le tableau des six formats vous est fourni, avec ce que chacun transporte. L'échange exige la
# géométrie, les unités, les calques et les courbes. Donnez le nombre de formats qui conviennent.
porte_la_geometrie = PORTE_LA_GEOMETRIE([True, True, True, True, True, True])
porte_les_unites = PORTE_LES_UNITES([False, False, True, True, True, True])
porte_les_calques = PORTE_LES_CALQUES([False, True, True, True, True, False])
porte_les_courbes = PORTE_LES_COURBES([False, False, True, True, True, False])
reponse = REPONSE()

# ---- group: ZONE_CORRIGE / DONNÉES FOURNIES (copie)
porte_la_geometrie_2 = PORTE_LA_GEOMETRIE([True, True, True, True, True, True])
porte_les_unites_2 = PORTE_LES_UNITES([False, False, True, True, True, True])
porte_les_calques_2 = PORTE_LES_CALQUES([False, True, True, True, True, False])
porte_les_courbes_2 = PORTE_LES_COURBES([False, False, True, True, True, False])

# ---- group: ZONE_CORRIGE / ÉTAPE 1
# WB-09 · Ce que le format transporte, et ce qu'il perd
# Perfectionnement  —  durée cible 25 min  —  réf. REF-158  —  v0.4-260901
# ▼  CORRIGÉ — à consulter après validation  ▼
# RAPPEL — copie des données fournies dans la zone sujet, afin qu'aucun câble ne relie les deux zones
# ÉTAPE 1 — L'échange exige QUATRE choses. Un format qui n'en porte que trois produit un fichier qui
# s'ouvre — et un bureau d'études qui redemande le reste
# ÉTAPE 2 — Trois formats sur six répondent aux quatre exigences. Retenir tout ce qui porte la géométrie en
# retiendrait six, et la moitié du travail de mise en ordre serait à refaire à l'arrivée
# RÉSULTAT — tant que l'interrupteur AFFICHER LE CORRIGÉ reste sur faux, la sortie 1 du Stream Gate est
# vide : rien n'apparaît dans Rhino
and = GateAnd(A=porte_la_geometrie_2, B=porte_les_unites_2)
and_2 = GateAnd(A=and, B=porte_les_calques_2)
and_3 = GateAnd(A=and_2, B=porte_les_courbes_2)

# ---- group: ZONE_CORRIGE / ÉTAPE 2
cull = CullPattern(List=porte_la_geometrie_2, CullPattern=and_3)
lng = ListLength(List=cull)
panel = Panel(lng)

# ---- group: ZONE_CORRIGE / AFFICHAGE DU CORRIGÉ
afficher_le_corrigé = BooleanToggle(False)
gate = StreamGate(Stream=lng, Gate=afficher_le_corrigé)  # -> Target0, Target1
reponse_corrige = REPONSE_CORRIGE(gate.Target1)
