# Grasshopper definition WB-10_complet.gh (Grasshopper 1.0.8)

# ---- group: ZONE_SUJET
# Le tableau donne, pour huit propriétés du modèle, les formats qui les transportent. Donnez le
# nombre de propriétés perdues par un export au format STEP.
porte_par_3dm = PORTE_PAR_3DM([1, 1, 1, 1, 1, 1, 1, 1])
porte_par_step = PORTE_PAR_STEP([1, 1, 1, 0, 0, 0, 0, 0])
porte_par_dwg = PORTE_PAR_DWG([0, 0, 1, 1, 0, 1, 0, 1])
porte_par_obj = PORTE_PAR_OBJ([0, 0, 0, 0, 0, 0, 0, 1])
porte_par_stl = PORTE_PAR_STL([0, 0, 0, 0, 0, 0, 0, 1])
reponse = REPONSE()

# ---- group: ZONE_CORRIGE / DONNÉES FOURNIES (copie)
porte_par_step_2 = PORTE_PAR_STEP([1, 1, 1, 0, 0, 0, 0, 0])

# ---- group: ZONE_CORRIGE / ÉTAPE 1
# WB-10 · Ce qu'un format d'échange laisse en route
# Perfectionnement  —  durée cible 15 min  —  réf. REF-111, REF-112, REF-158  —  v0.5-260902
# ▼  CORRIGÉ — à consulter après validation  ▼
# RAPPEL — copie des données fournies dans la zone sujet, afin qu'aucun câble ne relie les deux zones
# ÉTAPE 1 — La colonne STEP, et ce qu'elle NE porte pas. Compter ce qu'elle conserve — trois — répond à la
# question inverse : c'est la perte qui décide, et un modèle exporté en STEP arrive sans matériaux, sans
# blocs, sans historique, sans couleurs d'objet et sans maillages
# RÉSULTAT — tant que l'interrupteur AFFICHER LE CORRIGÉ reste sur faux, la sortie 1 du Stream Gate est
# vide : rien n'apparaît dans Rhino
equals = Equality(FirstNumber=porte_par_step_2, SecondNumber=0)  # -> Equality, Inequality
cull = CullPattern(List=porte_par_step_2, CullPattern=equals.Equality)
lng = ListLength(List=cull)
panel = Panel(lng)

# ---- group: ZONE_CORRIGE / AFFICHAGE DU CORRIGÉ
afficher_le_corrigé = BooleanToggle(False)
gate = StreamGate(Stream=lng, Gate=afficher_le_corrigé)  # -> Target0, Target1
reponse_corrige = REPONSE_CORRIGE(gate.Target1)
