# Grasshopper definition WB-11_complet.gh (Grasshopper 1.0.8)

# ---- group: ZONE_SUJET
# Le profilage donne le temps de recalcul des vingt-quatre composants sur votre poste, en
# millisecondes. Le serveur est 2,4 fois plus lent. Donnez le temps de réponse en ligne, en
# secondes.
temps_local_ms = TEMPS_LOCAL_MS([392, 169, 759, 419, 415, 140, 270, 120, 157, 55, 398, 86, 130, 900, 175, 483, 679, 428, 898, 875, 836, 873, 378, 454])
reponse = REPONSE()
# WB-11 · Le temps de calcul, une fois en ligne
# Perfectionnement  —  durée cible 16 min  —  réf. REF-108, REF-109, REF-110  —  v0.5-260902
# ▼  CORRIGÉ — à consulter après validation  ▼
# RAPPEL — copie des données fournies dans la zone sujet, afin qu'aucun câble ne relie les deux zones
# ÉTAPE 1 — Le total local passe sous la limite de vingt secondes : 10,489 s. C'est le facteur serveur qui
# décide, et le profilage local donne toujours le résultat rassurant
# RÉSULTAT — tant que l'interrupteur AFFICHER LE CORRIGÉ reste sur faux, la sortie 1 du Stream Gate est
# vide : rien n'apparaît dans Rhino
facteur_serveur = Slider(2.4, range=1..5)

# ---- group: ZONE_CORRIGE / DONNÉES FOURNIES (copie)
temps_local_ms_2 = TEMPS_LOCAL_MS([392, 169, 759, 419, 415, 140, 270, 120, 157, 55, 398, 86, 130, 900, 175, 483, 679, 428, 898, 875, 836, 873, 378, 454])
facteur_serveur_2 = Slider(2.4, range=1..5)

# ---- group: ZONE_CORRIGE / ÉTAPE 1
ma = MassAddition(Input=temps_local_ms_2)  # -> Result, PartialResults
multiplication = Multiplication(A=ma.Result, B=facteur_serveur_2)
division = Division(A=multiplication, B=1000)
panel = Panel(division)

# ---- group: ZONE_CORRIGE / AFFICHAGE DU CORRIGÉ
afficher_le_corrigé = BooleanToggle(False)
gate = StreamGate(Stream=division, Gate=afficher_le_corrigé)  # -> Target0, Target1
reponse_corrige = REPONSE_CORRIGE(gate.Target1)
